# Grasshopper definition Mac_Studio.gh (Grasshopper 1.0.8)
# plug-ins: ScriptParasite

number_slider = Slider(10, range=0..100)
number_slider_2 = Slider(2, range=0..10)
number_slider_3 = Slider(1000, range=0..10000)
number_slider_4 = Slider(1, range=0..1)
number_slider_5 = Slider(8, range=0..10)
number_slider_6 = Slider(10, range=0..100)
number_slider_7 = Slider(15, range=0..100)
rectangle = Rectangle(x=number_slider, y=number_slider, radii=Slider(2, range=0..10))  # -> rect, joined, points, notes; inputs x: Double, y: Double, radii: list of Double, bend: Double
# ---------- rectangle: C# usings ----------
using System.Linq;
using Rhino.Display;
using System.Drawing;
# ---------- rectangle: C# ----------
    // Update 2025-05-24

    if (no_input("x")) x = 20;
    if (no_input("y")) y = 20;
    if (no_input("radii")) radii.AddRange(new[] { 0.0, 0.0, 0.0, 0.0 });
    if (no_input("bend")) bend = 0.72;

    int degree = 6;
    int ptnum = 4;
    double tol = 0.01;
    pt_list.Clear();
    radii_text.Clear();

    //  ------- I put the radii organising in here so that
    if (bend < 0) for (int i = 0; i < radii.Count; i++) { radii[i] *= 1.5; bend = 0.72; }

    double[] rads = new[] { radii[0], radii[0], radii[0], radii[0] };
    if (radii.Count == 2) { rads[1] = radii[0]; rads[2] = radii[1]; rads[3] = radii[1]; }
    else if (radii.Count == 3) { rads[1] = radii[1]; rads[2] = radii[2]; rads[3] = radii[2]; }
    else if (radii.Count == 4) { rads[1] = radii[1]; rads[2] = radii[2]; rads[3] = radii[3]; }

    for (int i = 0; i < 4; i++) Print($"{rads[i]}");

    corner_type ctype = corner_type.Blend;
    if (bend == 0) ctype = corner_type.Chamfer;
    else if (bend >= 1) ctype = corner_type.Arc;

    Curve[] r = super_rectangle(x, y, rads, ctype, bend, ptnum, degree);
    rect = r.Select(c => new GH_Curve(c));
    joined = new GH_Curve(Curve.JoinCurves(r, tol, false)[0]);

    Point3d[] pts = { new Point3d(-x * 0.5, -y * 0.5, 0), new Point3d(-x * 0.5, y * 0.5, 0), new Point3d(x * 0.5, y * 0.5, 0), new Point3d(x * 0.5, -y * 0.5, 0) };
    points = pts.Select(p => new GH_Point(p));
    pt_list = pts.ToList();

    if (bend < 0) rads = rads.Select(n => n / 1.5).ToArray();
    List<string> rad_vals = new List<string> { "", "", "", "" };
    if (rads.Where(i => i == 0).Count() != 4) rad_vals = new List<string> { Math.Round(rads[0], 3).ToString(), Math.Round(rads[1], 3).ToString(), Math.Round(rads[2], 3).ToString(), Math.Round(rads[3], 3).ToString() };
    for (int i = 0; i < 4; i++) if (rad_vals[i] == "-0") rad_vals[i] = "0";

    radii_text = rad_vals.ToList();

    notes = @"-ve radii will give true arc values if bend = 0.72
No radii input, gives a Simple Rectangle
1 radii input, gives a Rectangle with C2 corners (all the same)
Multi radii input, gives rectangle with multi corner sizes
Bend at 0 plus radii input, gives a chamfered rectangle
Bend at 1 plus radii input, gives a rectangle with arc corners";
# ---------- rectangle: C# additional code ----------
  public enum corner_type { Arc, Blend, Chamfer }

  public static Curve corner(double radius, Transform transform, out Point3d[] pt_list, corner_type c_type = corner_type.Blend, double blend = 0.72, int ptnum = 4, int degree = 6, double x_limit = 0, double y_limit = 0)
  {
    if (c_type == corner_type.Arc)
    {
      Point3d[] pts = {new Point3d(radius - x_limit, 0, 0), new Point3d(0, radius - y_limit, 0)};
      Curve crv = new ArcCurve( new Arc(pts[0], -Vector3d.XAxis, pts[1]));
      TransformGeos(pts, transform);
      crv.Transform(transform);
      pt_list = pts;
      return crv;
    }
    else if (c_type == corner_type.Chamfer) {
      Point3d[] pts = {new Point3d(radius - x_limit, 0, 0), new Point3d(0, radius - y_limit, 0)};
      Curve crv = new LineCurve(new Point3d(radius - x_limit, 0, 0), new Point3d(0, radius - y_limit, 0));
      TransformGeos(pts, transform);
      crv.Transform(transform);
      pt_list = pts;
      return crv;
    }
    else
    {
      double offset = radius * blend / (ptnum - 1);

      Point3d[] corner_points = new Point3d[ptnum * 2];
      double[] ratios = new double[ptnum];
      for (int i = 0; i < ptnum; i++) ratios[i] = radius - (i * offset);
      for (int i = 0; i < ptnum; i++)
      {
        corner_points[i] = new Point3d(ratios[i], 0, 0);
        corner_points[i + ptnum] = new Point3d(0, ratios[ptnum - i - 1], 0);
      }
      corner_points[0].X -= x_limit;
      corner_points[(ptnum * 2) -1].Y -= y_limit;
      TransformGeos(corner_points,transform);
      pt_list = corner_points;
      return Curve.CreateControlPointCurve(corner_points, degree);
    }
  }


 public Curve[] super_rectangle(double x, double y, double[] rads, corner_type c_type, double blend = 0.72, int half_ptnum = 4, int degree = 6)
  {
    double radA = rads[0];
    double radB = rads[1];
    double radC = rads[2];
    double radD = rads[3];

    double[] x_limits = {0,0,0,0};
    double[] y_limits = {0,0,0,0};
    bool[] side_lines = {true, true, true, true};

    if (radA + radB >= y){
      double limit = (radA + radB - y) * 0.5;
      y_limits[0] = limit;
      x_limits[1] = limit;
      side_lines[0] = false;
    }
    if (radB + radC >= x){
      double limit = (radB + radC - x) * 0.5;
      y_limits[1] = limit;
      x_limits[2] = limit;
      side_lines[1] = false;
    }
    if (radC + radD >= y){
      double limit = (radC + radD - y) * 0.5;
      y_limits[2] = limit;
      x_limits[3] = limit;
      side_lines[2] = false;
    }
    if (radD + radA >= x){
      double limit = (radD + radA - x) * 0.5;
      y_limits[3] = limit;
      x_limits[0] = limit;
      side_lines[3] = false;
    }

    x *= 0.5;
    y *= 0.5;

    Curve[] curves = new Curve[8];
    Transform[] transforms = new[]
    {
      Transform.Translation(-x, -y, 0),
      Transform.Translation(-x, y, 0) * Transform.Rotation(Math.PI * 1.5, Point3d.Origin),
      Transform.Translation(x, y, 0) * Transform.Rotation(Math.PI, Point3d.Origin),
      Transform.Translation(x, -y, 0) * Transform.Rotation(Math.PI * 0.5, Point3d.Origin)
    };

    Curve[] corners = new Curve[4];
    Curve[] sides = new Curve[4];

    int ptnum = half_ptnum << 1;

    Point3d[] pt_listA = new Point3d[ptnum];
    Point3d[] pt_listB = new Point3d[ptnum];
    Point3d[] pt_listC = new Point3d[ptnum];
    Point3d[] pt_listD = new Point3d[ptnum];


    corners[0] = (radA == 0)? null : corner(radA, transforms[0], out pt_listA, c_type, blend, half_ptnum, degree, x_limits[0], y_limits[0]);
    sides[0] = !side_lines[0] ? null : new LineCurve(new Point3d(-x, radA - y - y_limits[0], 0), new Point3d(-x, y - radB + x_limits[1], 0));
    corners[1] = (radB == 0)? null : corner(radB, transforms[1], out pt_listB, c_type, blend, half_ptnum, degree, x_limits[1], y_limits[1]);
    sides[1] = !side_lines[1] ? null : new LineCurve(new Point3d(radB - x - y_limits[1], y, 0), new Point3d(x - radC + x_limits[2], y, 0));
    corners[2] = (radC == 0)? null : corner(radC, transforms[2], out pt_listC, c_type, blend, half_ptnum, degree, x_limits[2], y_limits[2]);
    sides[2] = !side_lines[2] ? null : new LineCurve(new Point3d(x, y - radC + y_limits[2], 0), new Point3d(x, radD - y - x_limits[3], 0));
    corners[3] = (radD == 0)? null : corner(radD, transforms[3], out pt_listD, c_type, blend, half_ptnum, degree, x_limits[3], y_limits[3]);
    sides[3] = !side_lines[3] ? null : new LineCurve(new Point3d(x - radD+ y_limits[3], -y, 0), new Point3d(radA - x - x_limits[0], -y, 0));

  int zero_pt = ptnum;
  int last_pt = ptnum -1;
  int pen_pt = ptnum -2;

  bool[] combine_crvs = new bool[4]; // AB, BC, CD, DA
  combine_crvs[0] = radA != 0 && radB != 0 && (pt_listA[last_pt].Y < pt_listA[pen_pt].Y || pt_listA[last_pt].Y > pt_listB[1].Y);
  combine_crvs[1] = radB != 0 && radC != 0 && (pt_listB[last_pt].X < pt_listB[pen_pt].X || pt_listB[last_pt].X > pt_listC[1].X);
  combine_crvs[2] = radC != 0 && radD != 0 && (pt_listC[last_pt].Y > pt_listC[pen_pt].Y || pt_listC[last_pt].Y < pt_listD[1].Y);
  combine_crvs[3] = radD != 0 && radA != 0 && (pt_listD[last_pt].X > pt_listD[pen_pt].X || pt_listD[last_pt].X < pt_listA[1].X);

  //pen_pt = last_pt;
  last_pt = zero_pt;

  if (combine_crvs[0] && !combine_crvs[1] && !combine_crvs[3]){ corners[0] = Curve.CreateControlPointCurve(pt_listA[0..pen_pt].Concat(pt_listB[1..zero_pt]), degree); corners[1] = null;} // Print("AB");}
  if (combine_crvs[1] && !combine_crvs[2] && !combine_crvs[0]){ corners[1] = Curve.CreateControlPointCurve(pt_listB[0..pen_pt].Concat(pt_listC[1..zero_pt]), degree); corners[2] = null;} // Print("BC");}
  if (combine_crvs[2] && !combine_crvs[3] && !combine_crvs[1]){ corners[2] = Curve.CreateControlPointCurve(pt_listC[0..pen_pt].Concat(pt_listD[1..zero_pt]), degree); corners[3] = null;} // Print("CD");}
  if (combine_crvs[3] && !combine_crvs[0] && !combine_crvs[2]){ corners[3] = Curve.CreateControlPointCurve(pt_listD[0..pen_pt].Concat(pt_listA[1..zero_pt]), degree); corners[0] = null;} // Print("DA");}

  if (combine_crvs[0] && combine_crvs[1] && !combine_crvs[2] && !combine_crvs[3]){ corners[0] = Curve.CreateControlPointCurve(pt_listA[0..pen_pt].Concat(pt_listB[1..pen_pt]).Concat(pt_listC[1..last_pt]), degree); corners[1] = null; corners[2] = null;} // Print("ABC");}
  if (combine_crvs[1] && combine_crvs[2] && !combine_crvs[3] && !combine_crvs[0]){ corners[1] = Curve.CreateControlPointCurve(pt_listB[0..pen_pt].Concat(pt_listC[1..pen_pt]).Concat(pt_listD[1..last_pt]), degree); corners[2] = null; corners[3] = null;} // Print("BCD");}
  if (combine_crvs[2] && combine_crvs[3] && !combine_crvs[0] && !combine_crvs[1]){ corners[2] = Curve.CreateControlPointCurve(pt_listC[0..pen_pt].Concat(pt_listD[1..pen_pt]).Concat(pt_listA[1..last_pt]), degree); corners[3] = null; corners[0] = null;} // Print("CDA");}
  if (combine_crvs[3] && combine_crvs[0] && !combine_crvs[1] && !combine_crvs[2]){ corners[3] = Curve.CreateControlPointCurve(pt_listD[0..pen_pt].Concat(pt_listA[1..pen_pt]).Concat(pt_listB[1..last_pt]), degree); corners[0] = null; corners[1] = null;} // Print("DAB");}

  if (combine_crvs[0] && combine_crvs[1] && combine_crvs[2] && !combine_crvs[3]){ corners[0] = Curve.CreateControlPointCurve(pt_listA[0..pen_pt].Concat(pt_listB[1..pen_pt]).Concat(pt_listC[1..pen_pt]).Concat(pt_listD[1..last_pt]), degree); corners[1] = null; corners[2] = null;  corners[3] = null;} // Print("ABCD");}
  if (combine_crvs[1] && combine_crvs[2] && combine_crvs[3] && !combine_crvs[0]){ corners[1] = Curve.CreateControlPointCurve(pt_listB[0..pen_pt].Concat(pt_listC[1..pen_pt]).Concat(pt_listD[1..pen_pt]).Concat(pt_listA[1..last_pt]), degree); corners[2] = null; corners[3] = null;  corners[0] = null;} // Print("BCDA");}
  if (combine_crvs[2] && combine_crvs[3] && combine_crvs[0] && !combine_crvs[1]){ corners[2] = Curve.CreateControlPointCurve(pt_listC[0..pen_pt].Concat(pt_listD[1..pen_pt]).Concat(pt_listA[1..pen_pt]).Concat(pt_listB[1..last_pt]), degree); corners[3] = null; corners[0] = null;  corners[1] = null;} // Print("CDAB");}
  if (combine_crvs[3] && combine_crvs[0] && combine_crvs[1] && !combine_crvs[2]){ corners[3] = Curve.CreateControlPointCurve(pt_listD[0..pen_pt].Concat(pt_listA[1..pen_pt]).Concat(pt_listB[1..pen_pt]).Concat(pt_listC[1..last_pt]), degree); corners[0] = null; corners[1] = null;  corners[2] = null;} // Print("DABC");}

  if (combine_crvs[0] && combine_crvs[1] && combine_crvs[2] && combine_crvs[3]){ corners[0] = Curve.CreateControlPointCurve(pt_listA[1..pen_pt].Concat(pt_listB[1..pen_pt]).Concat(pt_listC[1..pen_pt]).Concat(pt_listD[1..pen_pt]), degree); corners[1] = null; corners[2] = null; corners[3] = null;} // Print("ALL");}

  int counter = 0;
  if (corners[0] != null) curves[counter++] = corners[0];
  if (sides[0] != null) curves[counter++] = sides[0];
  if (corners[1] != null) curves[counter++] = corners[1];
  if (sides[1] != null) curves[counter++] = sides[1];
  if (corners[2] != null) curves[counter++] = corners[2];
  if (sides[2] != null) curves[counter++] = sides[2];
  if (corners[3] != null) curves[counter++] = corners[3];
  if (sides[3] != null) curves[counter++] = sides[3];

  Array.Resize(ref curves, counter);

  return curves;
  }



  public static void TransformGeos(Point3d[] geos, Transform transform)
  {
    for (int i = 0; i < geos.Length; i++) geos[i].Transform(transform);
  }
  public static void TransformGeos(GeometryBase[] geos, Transform transform)
  {
    for (int i = 0; i < geos.Length; i++) geos[i].Transform(transform);
  }

  private bool no_input(string name) => Component.Params.Input[Component.Params.IndexOfInputParam(name)].SourceCount == 0;


  //Return a BoundingBox that contains all the geometry you are about to draw.
  public override BoundingBox ClippingBox => BoundingBox.Empty;

  double text_size = 0.75;
  //Draw all wires and points in this method.
  public override void DrawViewportWires(IGH_PreviewArgs args)
  {
    RhinoDoc doc = RhinoDoc.ActiveDoc;
    RhinoView view = doc.Views.ActiveView;
    RhinoViewport vp = view.ActiveViewport;
    vp.GetCameraFrame(out Plane pl);
    for (int i = 0; i < pt_list.Count; i++)
    {
      pl.Origin = pt_list[i];
      if (i == 0 || i == 3) pl.Transform(Transform.Translation(-pl.YAxis * text_size));
      Text3d text = new Text3d(radii_text[i].ToString(), pl, text_size);
      if (i == 0 || i == 1) text.HorizontalAlignment = Rhino.DocObjects.TextHorizontalAlignment.Right;

      args.Display.Draw3dText(text, Color.White);
      args.Display.DrawPoint(pt_list[i], Color.White);

    }
  }
  List<Point3d> pt_list = new List<Point3d>();
  List<string> radii_text = new List<string>();
# ---------- end rectangle ----------
rectangle_2 = Rectangle(radii=Slider(2, range=0..10))  # -> rect, joined, points, notes; inputs x: Double, y: Double, radii: list of Double, bend: Double; same code as rectangle
series = Series(Start=number_slider_2, Step=number_slider_2, Count=number_slider_6)
multiplication = Multiplication(A=series, B=Slider(6, range=0..10))
number_slider_8 = Slider(90, range=0..100)
number_slider_9 = Slider(77.5, range=0..100)
number_slider_10 = Slider(76.5, range=0..100)
number_slider_11 = Slider(69.5, range=0..100)
X = UnitX(Factor=multiplication)
rectangle_3 = Rectangle()  # -> rect, joined, points, notes; inputs x: Double, y: Double, radii: list of Double, bend: Double; same code as rectangle
dup = DuplicateData(Data=graft(rectangle_2.rect), Number=number_slider_3, Order=True)
plus_1 = Plus1(expr("x+1", number_slider_5))
dup_2 = DuplicateData(Data=graft(rectangle.rect), Number=number_slider_3, Order=True)
number_slider_12 = Slider(197, range=0..1000)
cir = Circle(Plane=X, Radius=series)
random = Random(Range=Domain(0, 1), Number=number_slider_6, Seed=2)
x = X(expr("-x", Slider(1, range=0..1)))
dup_3 = DuplicateData(Data=graft(rectangle_3.rect), Number=Slider(3000, range=0..10000), Order=True)
flip = FlipMatrix(Data=dup_3)
number_slider_13 = Slider(100, range=0..100)
division = Division(A=Slider(1, range=0..1), B=plus_1)
cir_2 = Circle(Plane=PlaneXY(0, 0, 0), Radius=number_slider_8)
cir_3 = Circle(Plane=PlaneXY(0, 0, 0), Radius=number_slider_9)
cir_4 = Circle(Plane=PlaneXY(0, 0, 0), Radius=number_slider_10)
cir_5 = Circle(Plane=PlaneXY(0, 0, 0), Radius=number_slider_11)
flip_2 = FlipMatrix(Data=dup_2)
flip_3 = FlipMatrix(Data=dup)
number_slider_14 = Slider(10, range=0..10)
Z = UnitZ(Factor=x)
panel = Panel("VARIO-SUMMICRON")
number_slider_15 = Slider(9, range=0..100)
sort = SortList(Keys=random, ValuesA=cir)  # -> Keys, ValuesA
crv = Curve(sort.ValuesA)
number_slider_16 = Slider(1, range=0..1)
xy = XYPlane(Origin=Point(0, 0, 0))
text = CSharpScript(text=" words", height=number_slider_14)  # -> flatten(curves); inputs text: String, height: Double, font: String
# ---------- text: C# usings ----------
using System.Globalization;
using System.Linq;
# ---------- text: C# ----------
    if (Component.Params.Input[0].SourceCount == 0) text = "feed me some text";
    if (Component.Params.Input[1].SourceCount == 0) height = 5.0;
    if (Component.Params.Input[2].SourceCount == 0) font = "Arial";


    int textStyle = 0;
    bool cl = true; // closeLoops
    double tol = 0.0001;
    double scs = 100; //smallCapsScale


    Plane plane = Plane.WorldXY;

    curves = Curve.CreateTextOutlines(text, font, height, textStyle, cl, plane, scs, tol).Select(c => new GH_Curve(c)).ToArray();
# ---------- end text ----------
edges = Align(curves=flip)  # -> srf; inputs curves: list of Curve; disabled
# ---------- edges: C# ----------
  srf = Brep.CreateEdgeSurface(curves);
# ---------- end edges ----------
edges_2 = Align(curves=flip)  # -> srf; inputs curves: list of Curve; disabled
# ---------- edges_2: C# ----------
  srf = Brep.CreatePlanarBreps(curves, 0.1);
# ---------- end edges_2 ----------
vario_summicron = Curve([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])
_1_8_2_6_15_45_asph = Curve([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])
rectangle_4 = Rectangle(x=number_slider_12, y=number_slider_12, radii=Slider(46.4, range=0..100))  # -> rect, joined, points, notes; inputs x: Double, y: Double, radii: list of Double, bend: Double; same code as rectangle
edges_3 = Align(curves=flip_3)  # -> srf; inputs curves: list of Curve
# ---------- edges_3: C# ----------
  srf = Brep.CreateTrimmedPlane(Plane.WorldXY, curves);
# ---------- end edges_3 ----------
offset = OffsetCurve(
    Curve=rectangle_4.rect,
    Distance=graft([Slider(2, range=0..10), Slider(2.1, range=0..10), Slider(5, range=0..10)]),
    Plane=xy,
    Corners=1)
number_slider_17 = Slider(1, range=0..1)
series_2 = Series(Start=division, Step=division, Count=number_slider_5)
number_slider_18 = Slider(2, range=0..10)
number_slider_19 = Slider(0.6, range=0..1)
number_slider_20 = Slider(5, range=0..100)
join = TextJoin(Text="1.8-2.6/15-45 ASPH")
subtraction = Subtraction(A=Slider(95, range=0..100), B=number_slider_15)
Z_2 = UnitZ(Factor=number_slider_15)
move = Move(Geometry=cir_2, Motion=Z_2)  # -> Geometry, Transform
loft = Loft(
    Curves=[move.Geometry, cir_3],
    Options={Adjust=False, Closed=False, LoftEnds=0, LoftSimp=0, LoftType=0, Rebuild=10, Refit=0.01})
text_2 = CSharpScript(text=" words", height=number_slider_14)  # -> flatten(curves); inputs text: String, height: Double, font: String; same code as text
geo = Geometry(text_2)
explode = Explode(Curve=geo, Recursive=True)  # -> Segments, Vertices
geo_2 = Geometry(text_2)
number_slider_21 = Slider(0, range=0..1)
number_slider_22 = Slider(0, range=0..50)
geo_3 = Geometry(text_2)
explode_2 = Explode(Curve=geo_3, Recursive=True)  # -> Segments, Vertices
cut = SeparateItems(L=flatten(explode_2.Segments))  # -> remains, items; inputs L: list, i: list of Int32
# ---------- cut: C# ----------
    List<System.Object> itms = new List<System.Object>();
    if(Component.Params.Input[1].SourceCount == 0) i.Add(0);

    int count = L.Count;
    i.Sort();
    i.Reverse();

    for (int j = 0; j < i.Count; j++){
      i[j] = count- Math.Abs(i[j]);
      i[j] %= count;

      itms.Add(L[i[j]]);
      L.RemoveAt(i[j]);
    }

    itms.Reverse();

    remains = L;
    items = itms;
# ---------- end cut ----------
move_2 = Move(Geometry=geo_3, Motion=Z)  # -> Geometry, Transform
geo_4 = Geometry(cut.remains)
move_3 = Move(Geometry=rectangle_4.rect, Motion=Z_2)  # -> Geometry, Transform
trim = TrimTree(Tree=offset, Depth=1)
subtraction_2 = Subtraction(A=number_slider_8, B=number_slider_9)
tweencrv = TweenCurve(CurveA=move.Geometry, CurveB=cir_3, Factor=series_2, BlendType=0)
bra = Branch_select(tree=dup_3)  # -> remains, branch; inputs tree: tree, i: Int32
# ---------- bra: C# ----------
tree.SimplifyPaths();

if (i < 0) i = tree.BranchCount - Math.Abs(i);

i = i % tree.BranchCount;

GH_Path path = new GH_Path(i);
branch = tree.Branch(path);
tree.RemovePath(path);
remains = tree;
# ---------- end bra ----------
bra_2 = Branch_select(tree=dup_3, i=Slider(2, range=0..10))  # -> remains, branch; inputs tree: tree, i: Int32; same code as bra
number_slider_23 = Slider(1, range=0..1)
scripts = ScriptsFolderPath("D:\Core_Files\Scripts\")
pill = Pill()  # -> curves, joined; inputs rect: Double, radii: Double
# ---------- pill: C# ----------
    // Update 2025-08-29

    if (no_input("radii")) radii = 1.25;
    if (no_input("rect")) rect = 7.5;
    rect -= radii * 2;

    Curve[] pill_crvs = rect > 0 ? pill(rect, radii) : circle(radii);

    curves = Array.ConvertAll(pill_crvs, c => new GH_Curve(c));
    joined =  new GH_Curve(Curve.JoinCurves(pill_crvs, 0.01, false)[0]);
# ---------- pill: C# additional code ----------
  Curve[] pill(double rect, double radius)
  {
    Point3d[] pts = {
      new Point3d(-rect * 0.5, -radius, 0),
      new Point3d(-rect * 0.5, radius, 0),
      new Point3d(rect * 0.5, radius, 0),
      new Point3d(rect * 0.5, -radius, 0)
      };

    Curve [] crvs = {
      new ArcCurve(new Arc(pts[0], -Vector3d.XAxis, pts[1])),
      new LineCurve(pts[1], pts[2]),
      new ArcCurve(new Arc(pts[2], Vector3d.XAxis, pts[3])),
      new LineCurve(pts[3], pts[0])
    };

    return crvs;
  }


  Curve[] circle(double radius)
  {
    Point3d[] pts = {
      new Point3d(0, -radius, 0),
      new Point3d(0, radius, 0),
      };

    Curve[] crvs = {
      new ArcCurve(new Arc(pts[0], -Vector3d.XAxis, pts[1])),
      new ArcCurve(new Arc(pts[1], Vector3d.XAxis, pts[0]))
    };

    return crvs;
  }



  private bool no_input(string name) => Component.Params.Input[Component.Params.IndexOfInputParam(name)].SourceCount == 0;
# ---------- end pill ----------
number_slider_24 = Slider(200, range=0..1000)
number_slider_25 = Slider(2, range=0..10)
number_slider_26 = Slider(0, range=0..10)
flip_4 = FlipCurve(Curve=bra_2.branch)  # -> Curve, Flag
extrude_punch = ExtrudeAndPunch(curves=geo_3, extrude=number_slider_18)  # -> surfaces, pl, crv, notes; inputs curves: list, brep: Brep, radii: list of Double, bulges: list of Double, extrude: Double, inset: Double, flip: Boolean
# ---------- extrude_punch: C# usings ----------
using Rhino.Geometry.Intersect;
using System.Linq;
# ---------- extrude_punch: C# ----------
    // Updated 2025-07-09

    if (no_input("curves")) { if (!no_input("brep")) surfaces = new GH_Brep(brep); Component.Message = ""; return; }
    if (no_input("radii")) radii.Add(0);
    if (no_input("bulges")) bulges.Add(0.68);
    if (no_input("flip")) flip = false;

    double tol = 0.0001;
    int sectors = 12;
    Interval interval = new Interval(0, 1);
    Plane pln = Plane.WorldXY;

    Curve[] curve_list = object_curve_convert(curves);

    Curve[] curveloops = Curve.JoinCurves(curve_list, tol, true, false, out int[] keys);
    int idx = keys.Max() + 1;
    Plane[] planes = new Plane[idx];

    BoundingBox brep_bb = new BoundingBox();
    if (!no_input("brep")) brep_bb = brep.GetBoundingBox(true);

    List<Curve> temp_crvs = new List<Curve>();
    List<int> temp_ints = new List<int>();
    for (int i = 0; i < idx; i++)
    {
      if (!curveloops[i].IsClosed) continue;
      Curve[] crvs = curve_list.Where((c, j) => keys[j] == i).ToArray();
      if (!no_input("inset") && inset != 0) crvs = offset(crvs, -inset, out planes[i], tol);
      else planes[i] = curves_plane(crvs);

      if (!no_input("brep"))
      {
        planes[i] = plane_on_box(planes[i], brep_bb, 1);
      }

      TransformGeos(crvs, Transform.Scale(planes[i], 1, 1, 0));

      int count = crvs.Length;
      if (count > 1)
      {
        sort_crv(crvs);
        clean_lines(ref crvs);
        match_crv_ends(crvs);
      }
      temp_crvs.AddRange(crvs);
      temp_ints.AddRange(Enumerable.Repeat(i, crvs.Length));
    }
    keys = temp_ints.ToArray();
    curve_list = temp_crvs.ToArray();

    if ((no_input("extrude") || extrude == 0) && (no_input("curves") || no_input("brep")))
    {
      crv = curve_list.Select(c => new GH_Curve(c));
      Component.Message = "Surface";
      if (!no_input("brep")) surfaces = new GH_Brep(brep);
      else surfaces = Brep.CreatePlanarBreps(curve_list, 0.001).Select(b => new GH_Brep(b));
      return;
    }

    if (no_input("extrude") && no_input("brep")) { Component.Message = ""; return; }


    // ------- Set Basic Conditions ------- //

    bool simple = no_input("radii");
    if (radii.Count == 1) radii.Add(radii[0]);
    if (radii[0] == 0 && radii[1] == 0) simple = true;
    bulges.Add(bulges[0]);

    bool has_extrude = (!no_input("extrude") && Math.Abs(extrude) > tol);
    bool has_brep = !no_input("brep");

    bool hole = has_brep && has_extrude;
    bool through_hole = has_brep && !has_extrude;
    bool extrusion = !hole && !through_hole;

    bool quick = false;
    bool mirror = false;
    bool centre = extrusion && flip;

    bool simple_extrude = extrusion && simple;
    bool normal_extrude = false;
    if (extrusion)
    {
      if (!simple) quick = radii[0] == radii[1];
      mirror = extrude != Math.Abs(extrude) && !centre;  // REVERSE direction of extrude (no point if the extrude is centred)
      normal_extrude = !mirror && !quick;
    }

    bool inner_hole = false;
    bool inner_though = false;
    if (flip)
    {
      inner_hole = hole;
      inner_though = through_hole;
      hole = false;
      through_hole = false;
    }
    if (hole && !inner_hole && flip) { hole = false; inner_hole = true; }

    // ------- Sort incoming curves ------- //

    List<Curve> all_crvs = new List<Curve>();
    List<Brep> all_breps = new List<Brep>();
    List<Plane> plane_list = new List<Plane>();


    // ------- Sort incoming curves ------- //


    for (int i = 0; i < idx; i++)
    {
      Curve[] crvs = curve_list.Where((c, j) => keys[j] == i).ToArray();
      int count = crvs.Length;

      Plane plane = planes[i];
      Transform orient = Transform.PlaneToPlane(plane, pln);
      Transform reorient = Transform.PlaneToPlane(pln, plane);


      if (has_brep) brep.Transform(orient);
      TransformGeos(crvs, orient);

      // Check that the curve is inside the Brep's bounds
      double edge_inset_caution = (through_hole || hole) && !simple ? 0.2 + Math.Max(radii[0], radii[1]) : 0.2;

      if (has_brep && !boxboxinside2D(brep.GetBoundingBox(true), bb_union(crvs, edge_inset_caution)))
      {
        brep.Transform(reorient);
        continue;
      }

      // ------- Construct Breps and Parts ------- //

      //Brep test_piece = new Brep();
      Plane base_plane = Plane.Unset;
      Curve[] hole_crvs = new Curve[count];
      Brep part = new Brep();
      if (simple_extrude) part = capped_extrude(crvs, out hole_crvs, extrude, centre, tol);
      else if (quick) part = quick_extrude(crvs, extrude, radii[0], bulges[0], sectors, centre, tol, out hole_crvs);
      else if (extrusion) part = full_extrude(crvs, extrude, radii, bulges, sectors, centre, tol, out hole_crvs);
      else if (hole) part = hole_extrude(crvs, brep, extrude, radii, bulges, sectors, tol, out base_plane, out hole_crvs);
      else if (inner_hole) part = hole_inner(crvs, brep, extrude, radii, bulges, sectors, tol, out base_plane, out hole_crvs);
      else if (through_hole) part = hole_through(crvs, brep, radii, bulges, sectors, tol, out hole_crvs);
      else if (inner_though) part = through_inner(crvs, brep, radii, bulges, sectors, tol, out hole_crvs);
      else continue;

      Curve[] hole_curves = hole_crvs.Where(c => c != null).ToArray();

      part.Transform(reorient);

      if (through_hole || hole) brep = part;
      else
      {
        all_breps.Add(part);
        if (has_brep) brep.Transform(reorient);
      }
      if (base_plane.IsValid) { base_plane.Transform(reorient); plane_list.Add(base_plane); }
      if (hole_curves.Length > 0) { TransformGeos(hole_curves, reorient); all_crvs.AddRange(hole_curves); }
    }

    if (all_breps.Count == 0) all_breps.Add(brep);
    crv = all_crvs.Select(c => new GH_Curve(c));
    pl = plane_list;
    surfaces = all_breps.Select(b => new GH_Brep(b));

    string identifier = "";
    if (simple_extrude) identifier = "Simple Extrude";
    else if (quick) identifier = "Quick Extrude";
    else if (extrusion) identifier = "Full Extrusion";
    else if (hole) identifier = "Indent Hole";
    else if (inner_hole) identifier = "Indent Hole Inner";
    else if (through_hole) identifier = "Through Hole";
    else if (inner_though) identifier = "Through Hole Inner";
    else identifier = "";

    Component.Message = identifier;


    string[] note_strings = {
      identifier
    };

    notes = note_strings;
# ---------- extrude_punch: C# additional code ----------
  private Brep hole_inner(Curve[] curves, Brep brep, double extrude, List<double> radii, List<double> bulges, int sectors, double tol, out Plane pl, out Curve[] crvs)
  {
    Point3d pu = Point3d.Unset;
    double gap = 1 / (sectors - 1.0);
    Plane pln = Plane.WorldXY;
    int count = curves.Length;
    int cross_numA = (bulges[0] == 0) ? 2 : 4; // (radii[0] < 0.25) ? 4 : 5;
    int cross_numB = (bulges[1] == 0) ? 2 : 4; // (radii[1] < 0.25) ? 4 : 5;

    bool remirror = brep.GetBoundingBox(true).Center.Z < 0;  // Put Brep above Plane.XY
    Transform mirror = Transform.Mirror(pln);
    if (remirror) brep.Transform(mirror);

    if (extrude == 0) { pl = pln; crvs = curves; return brep; } //brep
    bool flip = extrude < 0;

    // Transform move_curves = Transform.Translation(0,0,brep.GetBoundingBox(true).Min.Z - 1);
    // TransformGeos(curves, move_curves);

    // ------- Separate BrepFaces ------- //

    Brep[] final_breps = new Brep[count * 3 + 1];
    separate_brepfaces(brep, curves, Vector3d.ZAxis, out Brep brep_half, out Brep brep_out);


    // ------- Initial Geometry to be copied and transformed ------- //

    double radA = -radii[0]; //inset removed
    double radB = -radii[1]; //inset removed

    double len = 0.1;
    Surface cutter = planar_srf(len, len);
    cutter.Transform(Transform.Translation(0, len * 0.5, 0));

    double[] ts = new double[sectors];
    for (int i = 0; i < sectors; i++) ts[i] = i * gap;


    Plane base_plane = pln;
    Plane inside_plane = pln;
    Point3d central_pt = project_point(Point3d.Origin, brep, Vector3d.ZAxis);
    base_plane.Origin = new Point3d(central_pt.X, central_pt.Y, central_pt.Z + extrude);


    // ------- Create test to see if surface is flat.  If so, a more simple construction can be used ------- //

    Curve[] test_flat_crvs = new Curve[count * 2];
    Array.Copy(offset(curves, radA - 0.1, out _, tol), test_flat_crvs, count);
    Array.Copy(curves, 0, test_flat_crvs, count, count);

    bool flat_srf = test_flat(test_flat_crvs, brep_half, Vector3d.ZAxis, tol, out _);

    if (test_flat(test_flat_crvs, brep_half, Vector3d.ZAxis, tol, out _))
    {
      double extrude_val = remirror ? -extrude : extrude;
      Curve[] quick_crvs = new Curve[count];
      for (int i = 0; i < count; i++) quick_crvs[i] = project_closest(curves[i], brep_half, Vector3d.ZAxis, tol);

      Brep quick_brep = full_extrude(quick_crvs, extrude_val, radii, bulges, sectors, false, tol, out Curve[] out_crvs);

      pl = new Plane(new Point3d(0, 0, extrude), Vector3d.XAxis, Vector3d.YAxis); // base_plane; //
      crvs = out_crvs;

      return quick_brep;
    }

    // ------- Setup Curves ------- //

    Curve[] crvA = offset(curves, radA, out _, tol);
    Curve[] crvD = offset(curves, radB, out _, tol);

    //Curve[] final_crvs = crvA.Select(c => c.DuplicateCurve()).ToArray();

    crvA = crvA.Select(c => project_closest(c, brep_half, Vector3d.ZAxis, tol)).ToArray();
    Curve[] crvB = curves.Select(c => project_closest(c, brep_half, Vector3d.ZAxis, tol)).ToArray();

    sort_crvs(pln, crvA, crvB);
    sort_crvs(pln, crvA, crvD);

    match_crv_ends(crvA);
    match_crv_ends(crvB);
    match_crv_ends(crvD);

    Curve[] crvC = crvB.Select(c => c.DuplicateCurve()).ToArray();
    Curve[] final_crvs = crvA.Select(c => c.DuplicateCurve()).ToArray();

    double inside_z = base_plane.OriginZ - radii[1];  //double z_move = base_plane.OriginZ;

    inside_plane.OriginZ = inside_z;
    TransformGeos(crvB, Transform.Translation(0, 0, radii[0]));
    TransformGeos(crvC, Transform.Scale(inside_plane, 1, 1, 0));
    TransformGeos(crvD, Transform.Scale(base_plane, 1, 1, 0));

    List<Curve> test_crvs = new List<Curve>();

    // ------- main loop ------- //

    for (int i = 0; i < count; i++)
    {
      if (radii[0] == 0 && radii[1] == 0) { final_breps[count + i] = Brep.CreateFromLoft(new[] { crvB[i], crvC[i] }, pu, pu, LoftType.Straight, false)[0]; continue; } //circle_check(ref crvA[i]); //circle_check(ref crvB[i]); // can remove if simple circle hole built later //circle_check(ref crvC[i]); //circle_check(ref crvD[i]);

      bool straight = crvA[i].IsLinear(0.01) && crvB[i].IsLinear(0.01);

      Curve[] edges_A = new Curve[sectors];
      Curve[] edges_B = new Curve[sectors];

      for (int j = 0; j < sectors; j++)
      {
        Point3d pB = crvB[i].PointAtNormalizedLength(ts[j]);
        Point3d pC = new Point3d(pB.X, pB.Y, inside_z);
        Curve lnA = new LineCurve(pB, pC);
        bool straight_check = !straight || (straight && (j == 0 || j == sectors - 1));

        if (radii[0] != 0 && straight_check)
        {
          Point3d pA = crvA[i].PointAtNormalizedLength(ts[j]);
          //Vector3d vec = new Vector3d(pA - pB) { Z = 0 };
          Plane frame = new Plane(pA, Vector3d.ZAxis, new Vector3d(pA.X - pB.X, pA.Y - pB.Y, 0));

          cutter.Transform(Transform.PlaneToPlane(pln, frame));
          Intersection.BrepSurface(brep_half, cutter, tol, out Curve[] int_crvs, out _);
          cutter.Transform(Transform.PlaneToPlane(frame, pln));
          Curve cx_crv;
          if (pA.DistanceToSquared(int_crvs[0].PointAtEnd) < 0.0001) cx_crv = int_crvs[0];
          else
          {
            cx_crv = (int_crvs.Length > 1) ? Curve.JoinCurves(int_crvs, tol, false)[0] : int_crvs[0];
            if (pA.DistanceToSquared(cx_crv.PointAtStart) < 0.0001) cx_crv.Reverse();
          }
          edges_A[j] = Curve.CreateBlendCurve(cx_crv, lnA, BlendContinuity.Curvature, bulges[0], bulges[0]);
        }

        if (radii[1] != 0 && straight_check)
        {
          Point3d pD = crvD[i].PointAtNormalizedLength(ts[j]);  // PointAt(ts[j]);  NORMALIZED is more SOLID
          //Vector3d vec = new Vector3d(pD - pB) { Z = 0 };
          Curve lnB = new LineCurve(pD, new Point3d(pD.X + (pD.X - pB.X), pD.Y + (pD.Y - pB.Y), pD.Z)); //Curve lnB = new LineCurve(pD, pD + vec);
          edges_B[j] = Curve.CreateBlendCurve(lnA, lnB, BlendContinuity.Curvature, bulges[1], bulges[1]);
          // test_crvs.Add(lnA);
          // test_crvs.Add(lnB);
        }
      }
      test_crvs.Add(crvA[i]);
      test_crvs.Add(crvB[i]);
      // test_crvs.AddRange(crvC);
      // test_crvs.AddRange(crvD);
      test_crvs.AddRange(edges_A);
      //test_crvs.AddRange(edges_B);


      if (radii[0] != 0)
      {
        if (straight) final_breps[i] = (bulges[0] == 0)
            ? Brep.CreateFromLoft(new[] { crvA[i], crvB[i] }, pu, pu, LoftType.Straight, false)[0]
            : Brep.CreateFromLoft(new[] { edges_A[0], edges_A[sectors - 1] }, pu, pu, LoftType.Straight, false)[0];
        else final_breps[i] = (bulges[0] == 0)
          ? Brep.CreateFromLoft(new[] { crvA[i], crvB[i] }, pu, pu, LoftType.Straight, false)[0]
          : edge_srf(crvA[i], crvB[i], edges_A, cross_numA);
        // final_breps[i] = edge_srf(crvA[i], crvB[i], edges_A, cross_numA, out Curve[] cvx);
        // test_crvs.AddRange(cvx);
      }
      Print(cross_numB.ToString());
      if (radii[1] != 0)
      {
        if (straight) final_breps[(count * 2) + i] = (bulges[1] == 0)
            ? Brep.CreateFromLoft(new[] { crvC[i], crvD[i] }, pu, pu, LoftType.Straight, false)[0]
            : Brep.CreateFromLoft(new[] { edges_B[0], edges_B[sectors - 1] }, pu, pu, LoftType.Straight, false)[0];
        else final_breps[(count * 2) + i] = (bulges[1] == 0)
          ? Brep.CreateFromLoft(new[] { crvC[i], crvD[i] }, pu, pu, LoftType.Straight, false)[0]
          : edge_srf(crvC[i], crvD[i], edges_B, cross_numB);
        // final_breps[(count * 2) + i] = edge_srf(crvC[i], crvD[i], edges_B, cross_numB, out Curve[] cvx);
        // test_crvs.AddRange(cvx);
      }
      final_breps[count + i] = Brep.CreateFromLoft(new[] { crvB[i], crvC[i] }, pu, pu, LoftType.Straight, false)[0]; // edge_srf( crvB[i], crvC[i], null, cross_numB);//
    }


    // ------- Re-Assemble parts ------- //

    //Brep final_brep = new Brep();
    BoundingBox target_bb = bb_union(crvA, 0.1);
    Brep[] split_breps = brep_half.Split(crvA, tol);
    Brep[] pieces = new Brep[split_breps.Length + final_breps.Length + 1];
    int counter = 0;
    for (int i = 0; i < split_breps.Length; i++) if (boxboxinside2D(target_bb, split_breps[i].GetBoundingBox(true))) pieces[counter++] = split_breps[i];
    for (int i = 0; i < final_breps.Length; i++) if (final_breps[i] != null) pieces[counter++] = final_breps[i];
    pieces[counter++] = Brep.CreatePlanarBreps(crvD, 0.001)[0];
    Array.Resize(ref pieces, counter);

    //final_crvs = test_crvs.ToArray();
    Brep final_brep = Brep.JoinBreps(pieces, 0.001, 0.1)[0]; new Brep(); //
    // for (int i = 0; i < pieces.Length; i++) final_brep.Append(pieces[i]);

    base_plane = new Plane(base_plane.Origin, -base_plane.XAxis, -base_plane.YAxis);

    if (remirror)
    {
      final_brep.Transform(mirror);
      brep.Transform(mirror);
      base_plane.Transform(mirror);
      TransformGeos(final_crvs, mirror);
    }

    if (final_brep.SolidOrientation == BrepSolidOrientation.Inward) final_brep.Flip();

    pl = base_plane; //Plane.WorldXY; //
    crvs = final_crvs; // test_crvs.ToArray(); //new[] { new LineCurve(Point3d.Origin, new Point3d(0, 0, 1)) }; //   crvD; //

    return final_brep; // brep_half;  // brep_out;  // new Brep(); //
  }
  private Brep hole_extrude(Curve[] curves, Brep brep, double extrude, List<double> radii, List<double> bulges, int sectors, double tol, out Plane pl, out Curve[] crvs)
  {
    Point3d pu = Point3d.Unset;
    double gap = 1 / (sectors - 1.0);
    Plane pln = Plane.WorldXY;
    Vector3d Z_up = Vector3d.ZAxis;
    int count = curves.Length;

    bool top_sharp = radii[0] == 0;
    bool bot_sharp = radii[1] == 0;

    bool top_chamfer = bulges[0] == 0;
    bool bot_chamfer = bulges[1] == 0;

    int cross_numA = top_chamfer ? 2 : 4;
    int cross_numB = bot_chamfer ? 2 : 4;

    bool remirror = brep.GetBoundingBox(true).Center.Z < 0;  // Put Brep above Plane.XY
    Transform mirror = Transform.Mirror(pln);
    if (remirror) brep.Transform(mirror);

    if (extrude == 0) { pl = pln; crvs = curves; return brep; }
    double flip = (extrude < 0) ? -1 : 1;


    // ------- Setup Curves ------- //

    double radA = radii[0];
    double radB = -radii[1];

    Curve[] crvA = (top_sharp)
    ? curves.Select(c => c.DuplicateCurve()).ToArray()
    : offset(curves, radA, out _, tol);


    // ------- Separate BrepFaces ------- //

    Brep[] final_breps = new Brep[count * 3 + 3];
    separate_brepfaces(brep, crvA, Z_up, out Brep brep_half, out Brep brep_out);
    final_breps[count * 3 + 1] = brep_out;

    double len = 0.2;
    Surface cutter = planar_srf(len, len);
    cutter.Transform(Transform.Translation(0, len * 0.5, 0));

    double[] ts = Enumerable.Range(0, sectors).Select(x => x * gap).ToArray();


    // ------- Setup Curves ------- //

    Curve[] crvB = curves.Select(c => c.DuplicateCurve()).ToArray();

    Curve[] crvD = (bot_sharp)
      ? curves.Select(c => c.DuplicateCurve()).ToArray()
      : offset(curves, radB, out _, tol);

    crvA = crvA.Select(c => project_closest(c, brep_half, Z_up, tol)).ToArray();
    crvB = (top_sharp)
      ? crvA.Select(c => c.DuplicateCurve()).ToArray()
      : crvB.Select(c => project_closest(c, brep_half, Z_up, tol)).ToArray();

    sort_crvs(pln, crvA, crvB);
    sort_crvs(pln, crvA, crvD);
    Curve[] crvC = crvB.Select(c => c.DuplicateCurve()).ToArray();
    Curve[] final_crvs = crvB.Select(c => c.DuplicateCurve()).ToArray();

    Plane base_plane = pln;
    Plane inside_plane = pln;
    Point3d central_pt = project_point(Point3d.Origin, brep, Z_up);
    base_plane.Origin = central_pt;
    base_plane.Transform(Transform.Translation(0, 0, extrude));
    double z_move = base_plane.OriginZ;

    double inside_z = base_plane.OriginZ - (radii[1] * flip);
    inside_plane.OriginZ = inside_z;
    TransformGeos(crvB, Transform.Translation(0, 0, radii[0] * flip));
    TransformGeos(crvC, Transform.Scale(inside_plane, 1, 1, 0));
    TransformGeos(crvD, Transform.Scale(base_plane, 1, 1, 0));


    // ------- Create test to see if surface is flat.  If so, a more simple construction can be used ------- //

    Curve[] test_flat_crvs = new Curve[count * 2];
    Array.Copy(offset(curves, radA - 0.1, out _, tol), test_flat_crvs, count);
    Array.Copy(crvA, 0, test_flat_crvs, count, count);

    bool flat_srf = test_flat(test_flat_crvs, brep_half, Z_up, tol, out _);


    // ------- main loop ------- //

    //List<Curve> test_crvs = new List<Curve>();

    BlendContinuity curvature = BlendContinuity.Curvature;
    LoftType straight_loft = LoftType.Straight;

    for (int i = 0; i < count; i++)
    {
      bool straight = crvA[i].IsLinear(0.01);

      Curve[] edges_A = new Curve[sectors];
      Curve[] edges_B = new Curve[sectors];

      for (int j = 0; j < sectors; j++)
      {
        Point3d pB = crvB[i].PointAtNormalizedLength(ts[j]);
        Point3d pC = new Point3d(pB.X, pB.Y, inside_z);
        Curve lnA = new LineCurve(pB, pC);
        bool straight_check = !straight || (straight && (j == 0 || j == sectors - 1));

        if (!top_sharp && straight_check && !top_chamfer)
        {
          Point3d pA = crvA[i].PointAtNormalizedLength(ts[j]);
          Vector3d vec = new Vector3d(pA - pB) { Z = 0 };

          if (flat_srf)
          {
            Curve top_ln = new LineCurve(pA + vec, pA);
            edges_A[j] = Curve.CreateBlendCurve(top_ln, lnA, curvature, bulges[0], bulges[0]);
          }
          else
          {
            Plane frame = new Plane(pA, Z_up, vec);
            Transform frame_trans = Transform.PlaneToPlane(pln, frame);

            cutter.Transform(Transform.PlaneToPlane(pln, frame));
            Intersection.BrepSurface(brep_half, cutter, tol, out Curve[] int_crvs, out _);
            cutter.Transform(Transform.PlaneToPlane(frame, pln));

            Curve cx_crv = (int_crvs.Length > 1) ? Curve.JoinCurves(int_crvs, tol, false)[0] : int_crvs[0];
            if (pA.DistanceToSquared(cx_crv.PointAtStart) < 0.001) cx_crv.Reverse();
            edges_A[j] = Curve.CreateBlendCurve(cx_crv, lnA, curvature, bulges[0], bulges[0]);
          }
        }

        if (!bot_sharp && straight_check && !bot_chamfer)
        {
          Point3d pD = crvD[i].PointAtNormalizedLength(ts[j]);
          Vector3d vec = new Vector3d(pD - pB) { Z = 0 };
          Curve lnB = new LineCurve(new Line(pD, vec, 1));
          edges_B[j] = Curve.CreateBlendCurve(lnA, lnB, curvature, bulges[1], bulges[1]);
        }
      }

      if (!top_sharp)
      {
        if (straight) final_breps[i] = (top_chamfer)
            ? Brep.CreateFromLoft(new[] { crvA[i], crvB[i] }, pu, pu, straight_loft, false)[0]
            : Brep.CreateFromLoft(new[] { edges_A[0], edges_A[sectors - 1] }, pu, pu, straight_loft, false)[0];
        else final_breps[i] = (top_chamfer)
          ? Brep.CreateFromLoft(new[] { crvA[i], crvB[i] }, pu, pu, straight_loft, false)[0]
          : edge_srf(crvA[i], crvB[i], edges_A, cross_numA);
      }

      if (!bot_sharp)
      {
        if (straight) final_breps[(count * 2) + i] = (bot_chamfer)
            ? Brep.CreateFromLoft(new[] { crvC[i], crvD[i] }, pu, pu, straight_loft, false)[0]
            : Brep.CreateFromLoft(new[] { edges_B[0], edges_B[sectors - 1] }, pu, pu, straight_loft, false)[0];
        else final_breps[(count * 2) + i] = (bot_chamfer)
          ? Brep.CreateFromLoft(new[] { crvC[i], crvD[i] }, pu, pu, straight_loft, false)[0]
          : edge_srf(crvC[i], crvD[i], edges_B, cross_numB);
      }

      final_breps[count + i] = Brep.CreateFromLoft(new[] { crvB[i], crvC[i] }, pu, pu, straight_loft, false)[0];
    }

    // ------- Re-Assemble parts ------- //

    final_breps[count * 3] = Brep.CreatePlanarBreps(crvD, 0.001)[0];

    BoundingBox target_bb = bb_union(crvA);
    target_bb.Inflate(0.1);

    List<Brep> pieces = brep_half.Split(crvA, tol).Where(b => !boxboxinside2D(target_bb, b.GetBoundingBox(true))).ToList();

    pieces.AddRange(final_breps);

    Brep final_brep = Brep.JoinBreps(pieces, 0.001, 0.1)[0]; // new Brep(); //  brep; //

    base_plane = new Plane(base_plane.Origin, -base_plane.XAxis, -base_plane.YAxis);

    if (remirror)
    {
      final_brep.Transform(mirror);
      brep.Transform(mirror);
      base_plane.Transform(mirror);
      TransformGeos(final_crvs, mirror);
    }

    if (final_brep.SolidOrientation == BrepSolidOrientation.Inward) final_brep.Flip();

    pl = base_plane; // Plane.WorldXY; //
    crvs = final_crvs; // new[] { new LineCurve(Point3d.Origin, new Point3d(0, 0, 1)) }; // crvA.Concat(crvB).Concat(crvC).Concat(crvD).ToArray(); //  crvD; //

    return final_brep; // new Brep(); //
  }
  private Brep hole_through(Curve[] curves, Brep brep, List<double> radii, List<double> bulges, int sectors, double tol, out Curve[] crvs)
  {
    Point3d pu = Point3d.Unset;
    double gap = 1 / (sectors - 1.0);
    Plane pln = Plane.WorldXY;
    int count = curves.Length;
    Interval interval = new Interval(0, 1);

    //List<Curve> test_crvs = new List<Curve>();

    int cross_numA = (bulges[0] == 0) ? 2 : 4;
    int cross_numB = (bulges[1] == 0) ? 2 : 4;

    Transform mirror = Transform.Mirror(Plane.WorldXY);
    bool remirror = brep.GetBoundingBox(true).Center.Z < 0;
    if (remirror) brep.Transform(mirror);


    // ------- Setup Curves ------- //

    double radA = radii[0];
    double radB = radii[1];


    Curve[] crvB = curves.Select(c => c.DuplicateCurve()).ToArray();
    Curve[] crvC = crvB.Select(c => c.DuplicateCurve()).ToArray();

    Curve[] crvA = (radii[0] == 0)
      ? curves.Select(c => c.DuplicateCurve()).ToArray()
      : offset(curves, radA, out _, tol);

    Curve[] crvD = (radii[1] == 0)
      ? curves.Select(c => c.DuplicateCurve()).ToArray()
      : offset(curves, radB, out _, tol);

    Point3d pt_on_other_side = new Point3d(0, 0, brep.GetBoundingBox(true).Max.Z + 1);
    Transform move_to_other_sides = Transform.Translation(new Vector3d(pt_on_other_side));
    TransformGeos(crvC, move_to_other_sides);
    TransformGeos(crvD, move_to_other_sides);


    Curve[] test_flat_crvsA = new Curve[count * 2];
    Array.Copy(offset(crvA, 0.1, out _, tol), test_flat_crvsA, count);
    Array.Copy(crvA, 0, test_flat_crvsA, count, count);

    Curve[] test_flat_crvsD = new Curve[count * 2];
    Array.Copy(offset(crvD, 0.1, out _, tol), test_flat_crvsD, count);
    Array.Copy(crvD, 0, test_flat_crvsD, count, count);

    // ------- Separate BrepFaces ------- //

    Brep[] final_breps = new Brep[count * 3];
    separate_brepfaces(brep, crvA, Vector3d.ZAxis, out Brep brep_halfA, out Brep brep_out);
    separate_brepfaces(brep_out, crvD, -Vector3d.ZAxis, out Brep brep_halfB, out brep_out);

    double len = 0.2;
    Surface cutter = planar_srf(len, len);
    cutter.Transform(Transform.Translation(0, len * 0.5, 0));

    double[] ts = Enumerable.Range(0, sectors).Select(x => x * gap).ToArray();


    // ------- Project Curves ------- //

    crvA = crvA.Select(c => project_closest(c, brep_halfA, Vector3d.ZAxis, tol)).ToArray();
    crvB = (radii[0] == 0)
      ? crvA.Select(c => c.DuplicateCurve()).ToArray()
      : crvB.Select(c => project_closest(c, brep_halfA, Vector3d.ZAxis, tol)).ToArray();


    crvD = crvD.Select(c => project_closest(c, brep_halfB, -Vector3d.ZAxis, tol)).ToArray();
    crvC = (radii[1] == 0)
      ? crvD.Select(c => c.DuplicateCurve()).ToArray()
      : crvC.Select(c => project_closest(c, brep_halfB, -Vector3d.ZAxis, tol)).ToArray();

    sort_crvs(pln, curves, crvA);
    sort_crvs(pln, curves, crvB);
    sort_crvs(pln, curves, crvC);
    sort_crvs(pln, curves, crvD);

    Point3d central_ptA = project_point(Point3d.Origin, brep_halfA, Vector3d.ZAxis);
    Point3d central_ptB = project_point(pt_on_other_side, brep_halfB, -Vector3d.ZAxis);

    Curve[] final_crvs = crvB.Select(c => c.DuplicateCurve()).ToArray();

    TransformGeos(crvB, Transform.Translation(0, 0, radii[0]));
    TransformGeos(crvC, Transform.Translation(0, 0, -radii[1]));


    // ------- Create test to see if surface is flat.  If so, a more simple construction can be used ------- //

    bool flat_srfA = test_flat(test_flat_crvsA, brep_halfA, Vector3d.ZAxis, tol, out _);
    bool flat_srfB = test_flat(test_flat_crvsD, brep_halfB, -Vector3d.ZAxis, tol, out _);


    // ------- main loop ------- //

    for (int i = 0; i < count; i++)
    {
      crvA[i].Domain = interval;
      crvB[i].Domain = interval;
      crvC[i].Domain = interval;
      crvD[i].Domain = interval;

      bool straightA = crvA[i].IsLinear(0.01);  //crvA[i].IsLinear(0.01) && crvB[i].IsLinear(0.01);
      bool straightB = crvD[i].IsLinear(0.01);

      Curve[] edges_A = new Curve[sectors];
      Curve[] edges_B = new Curve[sectors];

      for (int j = 0; j < sectors; j++)
      {
        Point3d pB = crvB[i].PointAtNormalizedLength(ts[j]);
        Point3d pC = crvC[i].PointAtNormalizedLength(ts[j]);
        Curve ln = new LineCurve(pC, pB);

        bool straight_checkA = (!straightA || (straightA && (j == 0 || j == sectors - 1)));
        bool straight_checkB = (!straightB || (straightB && (j == 0 || j == sectors - 1)));

        if (radii[0] != 0 && straight_checkA && bulges[0] != 0)
        {
          Point3d pA = crvA[i].PointAtNormalizedLength(ts[j]);
          Vector3d vec = new Vector3d(pA - pB) { Z = 0 };

          if (flat_srfA)
          {
            Curve top_ln = new LineCurve(pA, pA + vec);
            edges_A[j] = Curve.CreateBlendCurve(ln, top_ln, BlendContinuity.Curvature, bulges[0], bulges[0]);
          }
          else
          {
            Plane frame = new Plane(pA, Vector3d.ZAxis, vec);
            Transform frame_trans = Transform.PlaneToPlane(Plane.WorldZX, frame);

            cutter.Transform(Transform.PlaneToPlane(pln, frame));
            Intersection.BrepSurface(brep_halfA, cutter, tol, out Curve[] int_crvs, out _);
            cutter.Transform(Transform.PlaneToPlane(frame, pln));

            Curve cx_crv = (int_crvs.Length > 1) ? Curve.JoinCurves(int_crvs, tol, false)[0] : int_crvs[0];
            if (central_ptA.DistanceToSquared(cx_crv.PointAtEnd) < central_ptA.DistanceToSquared(cx_crv.PointAtStart)) cx_crv.Reverse();
            edges_A[j] = Curve.CreateBlendCurve(ln, cx_crv, BlendContinuity.Curvature, bulges[0], bulges[0]);
            //int_crvs[0].Reverse();
            //edges_A[j] = Curve.CreateBlendCurve(ln, int_crvs[0], BlendContinuity.Curvature, bulges[0], bulges[0]);
          }
        }

        if (radii[1] != 0 && straight_checkB && bulges[1] != 0)
        {
          Point3d pD = crvD[i].PointAtNormalizedLength(ts[j]);
          Vector3d vec = new Vector3d(pD - pC) { Z = 0 };

          if (flat_srfB)
          {
            Curve top_ln = new LineCurve(pD + vec, pD);
            edges_B[j] = Curve.CreateBlendCurve(top_ln, ln, BlendContinuity.Curvature, bulges[1], bulges[1]);
          }
          else
          {
            Plane frame = new Plane(pD, -Vector3d.ZAxis, vec);
            Transform frame_trans = Transform.PlaneToPlane(Plane.WorldZX, frame);

            cutter.Transform(Transform.PlaneToPlane(pln, frame));
            Intersection.BrepSurface(brep_halfB, cutter, tol, out Curve[] int_crvs, out _);
            cutter.Transform(Transform.PlaneToPlane(frame, pln));

            Curve cx_crv = (int_crvs.Length > 1) ? Curve.JoinCurves(int_crvs, tol, false)[0] : int_crvs[0];
            if (central_ptB.DistanceToSquared(cx_crv.PointAtEnd) < central_ptB.DistanceToSquared(cx_crv.PointAtStart)) cx_crv.Reverse();
            edges_A[j] = Curve.CreateBlendCurve(cx_crv, ln, BlendContinuity.Curvature, bulges[1], bulges[1]);

            //edges_B[j] = Curve.CreateBlendCurve(int_crvs[0], ln, BlendContinuity.Curvature, bulges[1], bulges[1]);
          }
        }
      }

      if (radii[0] != 0)
      {
        if (straightA) final_breps[i] = (bulges[0] == 0)
            ? Brep.CreateFromLoft(new[] { crvA[i], crvB[i] }, pu, pu, LoftType.Straight, false)[0]
            : Brep.CreateFromLoft(new[] { edges_A[0], edges_A[sectors - 1] }, pu, pu, LoftType.Straight, false)[0];
        else final_breps[i] = (bulges[0] == 0)
          ? Brep.CreateFromLoft(new[] { crvB[i], crvA[i] }, pu, pu, LoftType.Straight, false)[0]
          : edge_srf(crvB[i], crvA[i], edges_A, cross_numA);
      }
      if (radii[1] != 0)
      {
        if (straightB) final_breps[(count * 2) + i] = (bulges[1] == 0)
            ? Brep.CreateFromLoft(new[] { crvC[i], crvD[i] }, pu, pu, LoftType.Straight, false)[0]
            : Brep.CreateFromLoft(new[] { edges_B[0], edges_B[sectors - 1] }, pu, pu, LoftType.Straight, false)[0];
        else final_breps[(count * 2) + i] = (bulges[1] == 0)
          ? Brep.CreateFromLoft(new[] { crvD[i], crvC[i] }, pu, pu, LoftType.Straight, false)[0]
          : edge_srf(crvD[i], crvC[i], edges_B, cross_numB);
      }
      final_breps[count + i] = Brep.CreateFromLoft(new[] { crvB[i], crvC[i] }, pu, pu, LoftType.Straight, false)[0];
    }


    if (remirror) brep.Transform(mirror);

    BoundingBox test_boxA = bb_union(crvA, 0.2);
    BoundingBox test_boxB = bb_union(crvD, 0.2);

    List<Brep> pieces = brep_halfA.Split(crvA, tol).Where(b => !boxboxinside2D(test_boxA, b.GetBoundingBox(true))).ToList();
    pieces.AddRange(brep_halfB.Split(crvD, tol).Where(b => !boxboxinside2D(test_boxB, b.GetBoundingBox(true))));
    pieces.AddRange(final_breps);
    pieces.Add(brep_out);

    Brep[] parts = Brep.JoinBreps(pieces.Where(p => p != null), 0.001, 0.1);
    Brep final_brep = new Brep();
    for (int i = 0; i < parts.Length; i++) if (parts[i] != null) final_brep.Append(parts[i]);

    if (remirror)
    {
      final_brep.Transform(mirror);
      brep.Transform(mirror);
      TransformGeos(final_crvs, mirror);
    }

    if (final_brep.SolidOrientation == BrepSolidOrientation.Inward) final_brep.Flip();

    crvs = final_crvs;

    return final_brep;
  }
  private Brep through_inner(Curve[] curves, Brep brep, List<double> radii, List<double> bulges, int sectors, double tol, out Curve[] crvs)
  {
    Point3d pu = Point3d.Unset;
    double gap = 1 / (sectors - 1.0);
    Plane pln = Plane.WorldXY;
    int count = curves.Length;
    Interval interval = new Interval(0, 1);

    int cross_numA = (bulges[0] == 0) ? 2 : 4;
    int cross_numB = (bulges[1] == 0) ? 2 : 4;

    Transform mirror = Transform.Mirror(Plane.WorldXY);
    bool remirror = brep.GetBoundingBox(true).Center.Z < 0;
    if (remirror) brep.Transform(mirror);


    // ------- Setup Curves & Adjust for Inset ------- //

    double radA = -(radii[0]); //inset removed
    double radB = -(radii[1]); //inset removed


    Curve[] crvB = curves.Select(c => c.DuplicateCurve()).ToArray(); // offset(curves, -inset, tol);
    Curve[] crvC = crvB.Select(c => c.DuplicateCurve()).ToArray();

    Curve[] crvA = (radii[0] == 0)
      ? curves.Select(c => c.DuplicateCurve()).ToArray() //offset(curves, -inset, tol)
      : offset(curves, radA, out _, tol);

    Curve[] crvD = (radii[1] == 0)
      ? curves.Select(c => c.DuplicateCurve()).ToArray() //offset(curves, -inset, tol)
      : offset(curves, radB, out _, tol);

    Point3d pt_on_other_side = new Point3d(0, 0, brep.GetBoundingBox(true).Max.Z + 1);
    Transform move_to_other_sides = Transform.Translation(new Vector3d(pt_on_other_side));
    TransformGeos(crvC, move_to_other_sides);
    TransformGeos(crvD, move_to_other_sides);


    Curve[] test_flat_crvsA = new Curve[count * 2];
    Array.Copy(offset(crvA, 0.1, out _, tol), test_flat_crvsA, count);
    Array.Copy(crvA, 0, test_flat_crvsA, count, count);

    Curve[] test_flat_crvsD = new Curve[count * 2];
    Array.Copy(offset(crvD, 0.1, out _, tol), test_flat_crvsD, count);
    Array.Copy(crvD, 0, test_flat_crvsD, count, count);


    // ------- Separate BrepFaces ------- //

    Brep[] final_breps = new Brep[count * 3];
    separate_brepfaces(brep, crvA, Vector3d.ZAxis, out Brep brep_halfA, out Brep brep_out);
    separate_brepfaces(brep_out, crvD, -Vector3d.ZAxis, out Brep brep_halfB, out brep_out);

    double len = 0.1;
    Surface cutter = planar_srf(len, len);
    cutter.Transform(Transform.Translation(0, len * 0.5, 0));

    double[] ts = Enumerable.Range(0, sectors).Select(x => x * gap).ToArray();


    // ------- Project Curves ------- //

    crvA = crvA.Select(c => project_closest(c, brep_halfA, Vector3d.ZAxis, tol)).ToArray();
    crvB = (radii[0] == 0)
      ? crvA.Select(c => c.DuplicateCurve()).ToArray()
      : crvB.Select(c => project_closest(c, brep_halfA, Vector3d.ZAxis, tol)).ToArray();


    crvD = crvD.Select(c => project_closest(c, brep_halfB, -Vector3d.ZAxis, tol)).ToArray();
    crvC = (radii[1] == 0)
      ? crvD.Select(c => c.DuplicateCurve()).ToArray()
      : crvC.Select(c => project_closest(c, brep_halfB, -Vector3d.ZAxis, tol)).ToArray();

    sort_crvs(pln, curves, crvA);
    sort_crvs(pln, curves, crvB);
    sort_crvs(pln, curves, crvC);
    sort_crvs(pln, curves, crvD);

    Point3d central_ptA = project_point(Point3d.Origin, brep_halfA, Vector3d.ZAxis);
    Point3d central_ptB = project_point(pt_on_other_side, brep_halfB, -Vector3d.ZAxis);

    Curve[] final_crvs = crvB.Select(c => c.DuplicateCurve()).ToArray();

    TransformGeos(crvB, Transform.Translation(0, 0, radii[0]));
    TransformGeos(crvC, Transform.Translation(0, 0, -radii[1]));


    // ------- Create test to see if surface is flat.  If so, a more simple construction can be used ------- //

    bool flat_srfA = test_flat(test_flat_crvsA, brep_halfA, Vector3d.ZAxis, tol, out _);
    bool flat_srfB = test_flat(test_flat_crvsD, brep_halfB, -Vector3d.ZAxis, tol, out _);
    //List<Curve> test_crvs = new List<Curve>();


    // ------- main loop ------- //

    for (int i = 0; i < count; i++)
    {
      crvA[i].Domain = interval;
      crvB[i].Domain = interval;
      crvC[i].Domain = interval;
      crvD[i].Domain = interval;

      bool straightA = crvA[i].IsLinear(0.01);  //crvA[i].IsLinear(0.01) && crvB[i].IsLinear(0.01);
      bool straightB = crvD[i].IsLinear(0.01);

      if (!straightA)
      {
        circle_check(ref crvA[i]);
        circle_check(ref crvD[i]);
      }

      Curve[] edges_A = new Curve[sectors];
      Curve[] edges_B = new Curve[sectors];

      for (int j = 0; j < sectors; j++)
      {
        Point3d pB = crvB[i].PointAtNormalizedLength(ts[j]);
        Point3d pC = crvC[i].PointAtNormalizedLength(ts[j]);
        Curve ln = new LineCurve(pC, pB);

        bool straight_checkA = (!straightA || (straightA && (j == 0 || j == sectors - 1)));
        bool straight_checkB = (!straightB || (straightB && (j == 0 || j == sectors - 1)));

        if (radii[0] != 0 && straight_checkA && bulges[0] != 0)
        {
          Point3d pA = crvA[i].PointAtNormalizedLength(ts[j]);
          Vector3d vec = new Vector3d(pA - pB) { Z = 0 };
          vec.Unitize();
          if (flat_srfA)
          {
            Curve top_ln = new LineCurve(pA, pA + vec);
            edges_A[j] = Curve.CreateBlendCurve(ln, top_ln, BlendContinuity.Curvature, bulges[0], bulges[0]);
          }
          else
          {
            Plane frame = new Plane(pA, Vector3d.ZAxis, vec);
            Transform frame_trans = Transform.PlaneToPlane(Plane.WorldZX, frame);


            cutter.Transform(Transform.PlaneToPlane(pln, frame));
            Intersection.BrepSurface(brep_halfA, cutter, tol, out Curve[] int_crvs, out _);
            cutter.Transform(Transform.PlaneToPlane(frame, pln));
            int_crvs[0].Reverse();

            //Curve cx_crv = (int_crvs.Length > 1) ? Curve.JoinCurves(int_crvs, tol, false)[0] : int_crvs[0];
            //if (central_ptA.DistanceToSquared(cx_crv.PointAtEnd) < central_ptA.DistanceToSquared(cx_crv.PointAtStart)) cx_crv.Reverse();
            //edges_A[j] = Curve.CreateBlendCurve(ln, cx_crv, BlendContinuity.Curvature, bulges[0], bulges[0]);

            edges_A[j] = Curve.CreateBlendCurve(ln, int_crvs[0], BlendContinuity.Curvature, bulges[0], bulges[0]);
          }
        }

        if (radii[1] != 0 && straight_checkB && bulges[1] != 0)
        {
          Point3d pD = crvD[i].PointAtNormalizedLength(ts[j]);
          Vector3d vec = new Vector3d(pD - pC) { Z = 0 };

          if (flat_srfB)
          {
            Curve top_ln = new LineCurve(pD + vec, pD);
            edges_B[j] = Curve.CreateBlendCurve(top_ln, ln, BlendContinuity.Curvature, bulges[1], bulges[1]);
          }
          else
          {
            Plane frame = new Plane(pD, -Vector3d.ZAxis, vec);
            Transform frame_trans = Transform.PlaneToPlane(Plane.WorldZX, frame);


            cutter.Transform(Transform.PlaneToPlane(pln, frame));
            Intersection.BrepSurface(brep_halfB, cutter, tol, out Curve[] int_crvs, out _);
            cutter.Transform(Transform.PlaneToPlane(frame, pln));

            //Curve cx_crv = (int_crvs.Length > 1) ? Curve.JoinCurves(int_crvs, tol, false)[0] : int_crvs[0];
            //if (central_ptB.DistanceToSquared(cx_crv.PointAtEnd) < central_ptB.DistanceToSquared(cx_crv.PointAtStart)) cx_crv.Reverse();
            //edges_A[j] = Curve.CreateBlendCurve(cx_crv, ln, BlendContinuity.Curvature, bulges[1], bulges[1]);

            edges_B[j] = Curve.CreateBlendCurve(int_crvs[0], ln, BlendContinuity.Curvature, bulges[1], bulges[1]);
          }
        }
      }


      if (radii[0] != 0)
      {
        if (straightA) final_breps[i] = (bulges[0] == 0)
            ? Brep.CreateFromLoft(new[] { crvA[i], crvB[i] }, pu, pu, LoftType.Straight, false)[0]
            : Brep.CreateFromLoft(new[] { edges_A[0], edges_A[sectors - 1] }, pu, pu, LoftType.Straight, false)[0];
        else final_breps[i] = (bulges[0] == 0)
          ? Brep.CreateFromLoft(new[] { crvB[i], crvA[i] }, pu, pu, LoftType.Straight, false)[0]
          : edge_srf(crvB[i], crvA[i], edges_A, cross_numA);
      }
      if (radii[1] != 0)
      {
        if (straightB) final_breps[(count * 2) + i] = (bulges[1] == 0)
            ? Brep.CreateFromLoft(new[] { crvC[i], crvD[i] }, pu, pu, LoftType.Straight, false)[0]
            : Brep.CreateFromLoft(new[] { edges_B[0], edges_B[sectors - 1] }, pu, pu, LoftType.Straight, false)[0];
        else final_breps[(count * 2) + i] = (bulges[1] == 0)
          ? Brep.CreateFromLoft(new[] { crvD[i], crvC[i] }, pu, pu, LoftType.Straight, false)[0]
          : edge_srf(crvD[i], crvC[i], edges_B, cross_numB);
      }
      final_breps[count + i] = Brep.CreateFromLoft(new[] { crvB[i], crvC[i] }, pu, pu, LoftType.Straight, false)[0];
    }

    //test_crvs.AddRange(crvC);
    //test_crvs.AddRange(crvD);

    //Brep test_brep = new Brep();
    //for (int i = 0; i < final_breps.Length; i++) if (final_breps[i] != null) test_brep.Append(final_breps[i]);

    //crvs = test_crvs.ToArray();
    //return test_brep;

    BoundingBox test_boxA = bb_union(crvA, 0.1);
    BoundingBox test_boxB = bb_union(crvD, 0.1);

    List<Brep> pieces = brep_halfA.Split(crvA, tol).Where(b => boxboxinside2D(test_boxA, b.GetBoundingBox(true))).ToList();
    pieces.AddRange(brep_halfB.Split(crvD, tol).Where(b => boxboxinside2D(test_boxB, b.GetBoundingBox(true))));
    pieces.AddRange(final_breps);


    Brep[] parts = Brep.JoinBreps(pieces.Where(p => p != null), 0.001, 0.1);
    Brep final_brep = new Brep();
    for (int i = 0; i < parts.Length; i++) if (parts[i] != null) final_brep.Append(parts[i]);

    if (remirror)
    {
      final_brep.Transform(mirror);
      brep.Transform(mirror);
      TransformGeos(final_crvs, mirror);
    }

    if (final_brep.SolidOrientation == BrepSolidOrientation.Inward) final_brep.Flip();

    crvs = final_crvs;

    return final_brep;
  }
  private Brep full_extrude(Curve[] crvs, double extrude, List<double> radii, List<double> bulges, int sectors, bool centre, double tol, out Curve[] out_crvs)
  {
    Plane plane = curves_plane(crvs);
    Transform orient = Transform.PlaneToPlane(plane, Plane.WorldXY);
    Transform reorient = Transform.PlaneToPlane(Plane.WorldXY, plane);

    TransformGeos(crvs, orient);

    bool loop = crvs.Length == 1 && crvs[0].IsClosed;
    Point3d pu = Point3d.Unset;

    bool mirror = extrude != Math.Abs(extrude) && !centre;
    extrude = Math.Abs(extrude);

    // -------  Set Up Radii and Decide if should add Sides  ------- //

    radii = radii.Select(n => Math.Max(n, 0)).ToList();

    bool has_sides = radii[0] < extrude;
    if (!has_sides) { radii[0] = extrude; radii[1] = 0; }
    if (radii[1] > extrude - radii[0])
    {
      radii[1] = extrude - radii[0];
      has_sides = false;
    }

    bool C2arcA = bulges[0] <= -1 && (radii[0] * 1.5) <= extrude - radii[1];
    bool C2arcB = bulges[1] <= -1 && (radii[1] * 1.5) <= extrude - radii[0];
    if (C2arcA) { radii[0] *= 1.5; bulges[0] = 0.72; }
    if (C2arcB) { radii[1] *= 1.5; bulges[1] = 0.72; }

    bool has_radA = radii[0] != 0;
    bool has_radB = radii[1] != 0;


    // -------  Set Up Standard Variables  ------- //

    int count = crvs.Length;
    int v_num = (count == 1) ? v_num = sectors - 1 : sectors;

    crvs = square_crvs(crvs);
    match_crv_ends(crvs);
    Curve[] crvA = offset(crvs, -radii[0], out _, tol);
    Curve[] crvB = crvs.Select(c => c.DuplicateCurve()).ToArray();
    Curve[] crvC = crvs.Select(c => c.DuplicateCurve()).ToArray();
    Curve[] crvD = offset(crvs, -radii[1], out _, tol);


    if (Math.Abs(crvA[0].PointAtStart.DistanceTo(crvB[0].PointAtStart) - radii[0]) > tol) sort_crvs(crvA, crvB);
    if (Math.Abs(crvD[0].PointAtStart.DistanceTo(crvB[0].PointAtStart) - radii[1]) > tol) sort_crvs(crvD, crvB);

    Transform moveA = Transform.Translation(0, 0, radii[0]);
    Transform moveB = Transform.Translation(0, 0, radii[1]);
    Transform moveC = Transform.Translation(0, 0, extrude - (radii[1] * 2));
    Transform moveD = Transform.Translation(0, 0, extrude);
    Transform moveC2 = Transform.Translation(0, 0, radii[1]);

    Transform mirror_trans = Transform.Mirror(Plane.WorldXY);
    Transform centre_trans = Transform.Translation(0, 0, -(extrude * 0.5));

    // -------  Main Loop - Build Surfaces  ------- //

    Brep[] srfs = new Brep[(count * 3) + 2];

    for (int i = 0; i < count; i++)
    {
      crvB[i].Transform(moveA);  // ---- Arrange Curves---- //
      crvC[i].Transform(moveB);
      int edge_num = crvB[i].IsLinear(0.01) ? 2 : sectors;

      if (has_radA)
      {
        int cross_num = (bulges[0] == 0) ? 2 : 4;
        Curve[] edge_curves = simple_edges(crvA[i], crvB[i], bulges[0], edge_num);
        srfs[count + i] = edge_srf(crvA[i], crvB[i], edge_curves, cross_num);
      }

      if (has_radB)
      {
        int cross_num = (bulges[1] == 0) ? 2 : 4;
        Curve[] edge_curves = simple_edges(crvD[i], crvC[i], bulges[1], edge_num);
        srfs[(count * 2) + i] = edge_srf(crvD[i], crvC[i], edge_curves, cross_num);
        srfs[(count * 2) + i].Transform(mirror_trans);
        srfs[(count * 2) + i].Transform(moveD);
      }

      crvC[i].Transform(moveC);
      if (has_sides) srfs[i] = Brep.CreateFromLoft(new[] { crvB[i], crvC[i] }, pu, pu, LoftType.Straight, false)[0];
      crvC[i].Transform(moveC2);
    }

    srfs[count * 3] = Brep.CreatePlanarBreps(crvA, 0.001)[0];
    srfs[(count * 3) + 1] = Brep.CreatePlanarBreps(crvD, 0.001)[0];
    srfs[(count * 3) + 1].Transform(moveD);

    Brep brep = Brep.JoinBreps(srfs, 0.001, 0.1)[0];


    if (mirror) { brep.Transform(mirror_trans); TransformGeos(crvC, mirror_trans); }
    if (centre) { brep.Transform(centre_trans); TransformGeos(crvC, centre_trans); }

    brep.Transform(reorient);
    TransformGeos(crvs, reorient);

    out_crvs = crvs;

    return brep;
  }
  private Brep quick_extrude(Curve[] crvs, double extrude, double radius, double bulge, int sectors, bool centre, double tol, out Curve[] out_crvs)
  {
    // -------  Set Up Conditions  ------- //

    bool loop = crvs.Length == 1 && crvs[0].IsClosed;
    bool mirror = extrude != Math.Abs(extrude) && !centre;
    extrude = Math.Abs(extrude);
    int cross_num = (bulge == 0) ? 2 : 4;

    bool has_sides = radius < extrude * 0.5;
    if (!has_sides) radius = extrude * 0.5;

    bool C2arc = bulge <= -1 && (radius * 3) + tol < extrude; // bulge is less than one and does not make the radius bigger than half the extrude
    if (C2arc)
    {
      radius *= 1.5;
      bulge = 0.72;
    }

    // -------  Set Up Standard Variables  ------- //

    int count = crvs.Length;
    Point3d pu = Point3d.Unset;

    Curve[] crvA = offset(crvs, -radius, out _, tol);
    Curve[] crvC = crvs.Select(c => c.DuplicateCurve()).ToArray();

    if (Math.Abs(crvA[0].PointAtStart.DistanceTo(crvs[0].PointAtStart) - radius) > tol) sort_crvs(crvA, crvs);

    Transform moveB = Transform.Translation(0, 0, radius);
    Transform moveC = Transform.Translation(0, 0, extrude - radius);
    Transform moveD = Transform.Translation(0, 0, extrude);
    Transform moveC2 = Transform.Translation(0, 0, radius);
    Transform mirror_trans = Transform.Mirror(Plane.WorldXY);
    Transform centre_trans = Transform.Translation(0, 0, -(extrude * 0.5));

    // -------  Main Loop - Build Surfaces  ------- //

    Brep[] srfs = new Brep[(count * 3) + 2];

    for (int i = 0; i < count; i++)
    {
      bool straight = crvs[i].IsLinear(0.01);
      crvs[i].Transform(moveB);  // ---- Arrange Curves---- //
      crvC[i].Transform(moveC);

      if (has_sides) srfs[i] = Brep.CreateFromLoft(new[] { crvs[i], crvC[i] }, pu, pu, LoftType.Straight, false)[0];
      srfs[i].Flip();
      int edge_num = straight ? 2 : sectors;

      Curve[] edges = simple_edges(crvA[i], crvs[i], bulge, edge_num);
      srfs[count + i] = edge_srf(crvs[i], crvA[i], edges, cross_num); //

      srfs[(count * 2) + i] = srfs[count + i].DuplicateBrep();
      srfs[(count * 2) + i].Transform(mirror_trans);
      srfs[(count * 2) + i].Transform(moveD);
      crvC[i].Transform(moveC2);
    }

    srfs[count * 3] = Brep.CreatePlanarBreps(crvA, 0.001)[0];
    srfs[(count * 3) + 1] = srfs[count * 3].DuplicateBrep();
    srfs[(count * 3) + 1].Transform(moveD);

    Brep brep = Brep.JoinBreps(srfs.Where(s => s != null), 0.001, 0.1)[0];

    if (mirror) { brep.Transform(mirror_trans); TransformGeos(crvC, mirror_trans); }
    if (centre) { brep.Transform(centre_trans); TransformGeos(crvC, centre_trans); }

    out_crvs = crvC;

    return brep;
  }
  public Brep edge_srf(Curve top, Curve bottom, Curve[] edge_curves, int num, bool loop = false, double tol = 0.001)
  {
    if (num < 3 || edge_curves == null)
    {
      return Brep.CreateFromLoft(new[] { top, bottom }, Point3d.Unset, Point3d.Unset, LoftType.Straight, false)[0];
    }
    double ang_tol = 0.1;
    double cos_tol = Math.Cos(ang_tol);

    Vector3d[] axes = new Vector3d[] { Vector3d.XAxis, -Vector3d.XAxis, Vector3d.YAxis, -Vector3d.YAxis, Vector3d.ZAxis, -Vector3d.ZAxis };

    Vector3d start = top.TangentAtStart; // Already Unitized Vector
    Vector3d end = top.TangentAtEnd;
    for (int i = 0; i < 6; i++)
    {
      if (start * axes[i] > cos_tol) { start = axes[i]; break; }
    }
    for (int i = 0; i < 6; i++)
    {
      if (end * axes[i] > cos_tol) { end = axes[i]; break; }
    }

    int count = edge_curves.Length;
    double gap = 1 / (num - 1.0);

    Curve[] curves = new Curve[num];

    if (edge_curves[0].PointAtStart.EpsilonEquals(top.PointAtStart, 0.01) ||
      edge_curves[0].PointAtStart.EpsilonEquals(top.PointAtEnd, 0.01))
    {
      curves[0] = top;
      curves[num - 1] = bottom;
    }
    else { curves[0] = bottom; curves[num - 1] = top; }

    int pt_num = loop ? count + 1 : count;
    Point3d[] edge_mid_pts = new Point3d[pt_num];

    for (int i = 1; i < num - 1; i++)
    {
      double gap_size = gap * i;
      for (int j = 0; j < count; j++) edge_mid_pts[j] = edge_curves[j].PointAtNormalizedLength(gap_size);
      if (loop) edge_mid_pts[count] = edge_mid_pts[0];

      Curve edge_mid = Curve.CreateInterpolatedCurve(edge_mid_pts, 3, CurveKnotStyle.Uniform, start, end);
      if (edge_mid.IsCircle(0.01)) edge_mid = new ArcCurve(new Circle(edge_mid_pts[0], edge_mid_pts[1], edge_mid_pts[2])); //circle_check(edge_mid, edge_mid_pts);
      else edge_mid = square_crv(edge_mid);
      curves[i] = edge_mid;
    }

    if (top.IsClosed) Array.Resize(ref edge_curves, edge_curves.Length - 1);

    NurbsSurface surface = NurbsSurface.CreateNetworkSurface(curves, 3, 3, edge_curves, 3, 3, tol, tol, tol, out _);
    if (surface == null) surface = NurbsSurface.CreateNetworkSurface(new[] { top, bottom }, 3, 3, edge_curves, 3, 3, tol, tol, tol, out _);

    return surface.ToBrep(); // new Brep(); //

  }  // optimized


  public Brep edge_srfx(Curve top, Curve bottom, Curve[] edge_curves, int num, out Curve[] crv_list, bool loop = false, double tol = 0.001)
  {
    if (num < 3 || edge_curves == null)
    {
      crv_list = null;
      return Brep.CreateFromLoft(new[] { top, bottom }, Point3d.Unset, Point3d.Unset, LoftType.Straight, false)[0];
    }
    double ang_tol = 0.01;

    Vector3d start = top.TangentAtStart;
    if (start.EpsilonEquals(Vector3d.XAxis, ang_tol)) start = Vector3d.XAxis;
    else if (start.EpsilonEquals(-Vector3d.XAxis, ang_tol)) start = -Vector3d.XAxis;
    else if (start.EpsilonEquals(Vector3d.YAxis, ang_tol)) start = Vector3d.YAxis;
    else if (start.EpsilonEquals(-Vector3d.YAxis, ang_tol)) start = -Vector3d.YAxis;
    else if (start.EpsilonEquals(Vector3d.ZAxis, ang_tol)) start = Vector3d.ZAxis;
    else if (start.EpsilonEquals(-Vector3d.ZAxis, ang_tol)) start = -Vector3d.ZAxis;

    Vector3d end = top.TangentAtEnd;
    if (end.EpsilonEquals(Vector3d.XAxis, ang_tol)) end = Vector3d.XAxis;
    else if (end.EpsilonEquals(-Vector3d.XAxis, ang_tol)) end = -Vector3d.XAxis;
    else if (end.EpsilonEquals(Vector3d.YAxis, ang_tol)) end = Vector3d.YAxis;
    else if (end.EpsilonEquals(-Vector3d.YAxis, ang_tol)) end = -Vector3d.YAxis;
    else if (end.EpsilonEquals(Vector3d.ZAxis, ang_tol)) end = Vector3d.ZAxis;
    else if (end.EpsilonEquals(-Vector3d.ZAxis, ang_tol)) end = -Vector3d.ZAxis;

    int count = edge_curves.Length;
    double gap = 1 / (num - 1.0);
    Curve[] curves = new Curve[num];
    Interval interval = new Interval(0, 1);
    for (int j = 0; j < count; j++) edge_curves[j].Domain = interval;

    if (edge_curves[0].PointAtStart.EpsilonEquals(top.PointAtStart, 0.01) ||
      edge_curves[0].PointAtStart.EpsilonEquals(top.PointAtEnd, 0.01))
    {
      curves[0] = top;
      curves[num - 1] = bottom;
    }
    else { curves[0] = bottom; curves[num - 1] = top; }

    int pt_num = loop ? count + 1 : count;
    Point3d[] edge_mid_pts = new Point3d[pt_num];

    for (int i = 1; i < num - 1; i++)
    {
      double gap_size = gap * i;
      for (int j = 0; j < count; j++) edge_mid_pts[j] = edge_curves[j].PointAtNormalizedLength(gap_size);
      if (loop) edge_mid_pts[count] = edge_mid_pts[0];

      Curve edge_mid = Curve.CreateInterpolatedCurve(edge_mid_pts, 3, CurveKnotStyle.Uniform, start, end);
      if (edge_mid.IsCircle(0.01)) edge_mid = new ArcCurve(new Circle(edge_mid_pts[0], edge_mid_pts[1], edge_mid_pts[2])); //circle_check(edge_mid, edge_mid_pts);
      else edge_mid = square_crv(edge_mid);
      curves[i] = edge_mid;
    }

    if (top.IsClosed) Array.Resize(ref edge_curves, edge_curves.Length - 1);
    crv_list = curves;

    NurbsSurface surface = NurbsSurface.CreateNetworkSurface(curves, 3, 3, edge_curves, 3, 3, tol, tol, tol, out _);
    if (surface == null) surface = NurbsSurface.CreateNetworkSurface(new[] { top, bottom }, 3, 3, edge_curves, 3, 3, tol, tol, tol, out _);

    return surface.ToBrep(); // new Brep(); //
  }  // optimized


  public static Curve[] simple_edges(Curve crvA, Curve crvB, double bulge, int sectors)
  {
    double gap = 1 / (sectors - 1.0);
    Interval interval = new Interval(0, 1);
    crvA.Domain = interval;
    crvB.Domain = interval;
    Point3d[] ptsA = new Point3d[sectors];
    Point3d[] ptsB = new Point3d[sectors];
    for (int i = 0; i < sectors; i++)
    {
      ptsA[i] = crvA.PointAtNormalizedLength(gap * i);
      ptsB[i] = crvB.PointAtNormalizedLength(gap * i);
    }
    // Output Chamfers
    if (bulge == 0) return ptsA.Select((p, i) => new LineCurve(p, ptsB[i])).ToArray();
    // Output Arcs
    if (bulge < 0) return ptsA.Select((p, i) => new ArcCurve(new Arc(ptsB[i], -Vector3d.ZAxis, p))).ToArray();

    // Output Blends
    Curve[] edge_curves = new Curve[sectors];
    Curve side_ln = new LineCurve(new Point3d(0, 0, 1), Point3d.Origin);
    for (int i = 0; i < sectors; i++)
    {
      Vector3d move = new Vector3d(ptsB[i]);
      Vector3d vec = new Vector3d(ptsA[i] - ptsB[i]) { Z = 0 };
      Curve crv0 = new LineCurve(ptsA[i], ptsA[i] + vec);
      side_ln.Transform(Transform.Translation(move));
      edge_curves[i] = Curve.CreateBlendCurve(side_ln, crv0, BlendContinuity.Curvature, bulge, bulge);
      side_ln.Transform(Transform.Translation(-move));
    }
    return edge_curves;
  }
  public static Brep capped_extrude(Curve[] crvs, out Curve[] out_crvs, double length = 5.0, bool centre = false, double tol = 0.01)
  {
    Point3d pu = Point3d.Unset;
    int count = crvs.Length;
    Vector3d dir = curves_plane(crvs).Normal * length;
    Transform moveC2 = Transform.Translation(dir);
    if (centre)
    {
      Transform transform = Transform.Translation(-dir * 0.5);
      for (int i = 0; i < count; i++) crvs[i].Transform(transform);
    }
    Curve[] crvC = new Curve[count];
    Brep[] sides = new Brep[count + 2];
    for (int i = 0; i < count; i++)
    {
      crvC[i] = crvs[i].DuplicateCurve();
      crvC[i].Transform(moveC2);
      sides[i + 1] = Brep.CreateFromLoft(new[] { crvs[i], crvC[i] }, pu, pu, LoftType.Straight, false)[0]; // Surface.CreateExtrusion(crvs[i], dir).ToBrep();
    }
    sides[0] = Brep.CreatePlanarBreps(crvs, 0.001)[0];
    sides[count + 1] = sides[0].DuplicateBrep();
    sides[count + 1].Transform(moveC2);

    Brep body = Brep.JoinBreps(sides, 0.001, 0.1)[0];
    if (body.SolidOrientation == BrepSolidOrientation.Inward) body.Flip();

    out_crvs = crvC;
    return body;
  }
  public static bool test_flat(Curve[] crvs, Brep brep, Vector3d direction, double tol, out Point3d[] test_pts)
  {
    int count = crvs.Length;
    Interval interval = new Interval(0, 1);

    Point3d[] pts = new Point3d[count * 3];
    for (int i = 0; i < count; i++)
    {
      crvs[i].Domain = interval;
      pts[i] = project_point(crvs[i].PointAt(0.15), brep, direction);
      pts[count + i] = project_point(crvs[i].PointAt(0.5), brep, direction);
      pts[(count * 2) + i] = project_point(crvs[i].PointAt(0.85), brep, direction);
    }

    test_pts = pts;
    Plane.FitPlaneToPoints(pts, out _, out double amount);
    return amount < tol;
  }
  public static bool circle_check(ref Curve curve, double tol = 0.01)  // ******** Needs Love
  {
    bool iscircle = curve.TryGetCircle(out Circle circle, tol);
    Point3d test_pt = curve.PointAtStart;
    if (iscircle) curve = new ArcCurve(circle);
    curve.ClosestPoint(test_pt, out double t);
    curve.ChangeClosedCurveSeam(t);
    //bool iscircle = curve.IsCircle(tol);
    //if (iscircle) curve = new ArcCurve(new Arc(curve.PointAtStart, curve.TangentAtStart, curve.PointAtEnd));
    return iscircle;
  }
  public static Curve[] object_curve_convert(List<object> objects)
  {
    int count = objects.Count;
    Curve[] curves = new Curve[count];
    for (int i = 0; i < count; i++)
    {
      if (objects[i] is Curve) curves[i] = objects[i] as Curve;
      else if (objects[i] is Line) curves[i] = new LineCurve((Line)objects[i]);
      else if (objects[i] is Circle) curves[i] = new ArcCurve((Circle)objects[i]);
      else curves[i] = new ArcCurve((Arc)objects[i]);
    }
    return curves;
  }
  public void separate_brepfaces(Brep brep, Curve[] crvs, Vector3d direction, out Brep brep_in, out Brep brep_out) // !!! FIX !!!
  {
    double tol = 0.001;
    int count = crvs.Length;
    int face_count = brep.Faces.Count;

    bool should_orient = direction.EpsilonEquals(Vector3d.ZAxis, tol);
    Transform reorient = Transform.Unset;
    if (should_orient)
    {
      Plane pl = curves_plane(crvs);
      Transform orient = Transform.PlaneToPlane(pl, Plane.WorldXY);
      reorient = Transform.PlaneToPlane(Plane.WorldXY, pl);
      TransformGeos(crvs, orient);
      brep.Transform(orient);
    }

    int ptnum = 14;
    double pt_gap = 1.0 / ptnum;
    Point3d[] pts = new Point3d[count * ptnum];
    int counter = 0;
    for (int i = 0; i < count; i++)
    {
      crvs[i].Reparameterize();
      for (int j = 0; j < ptnum; j++)
      {
        // pts[counter++] = Intersection.RayShoot(new Ray3d(crvs[i].PointAt(pt_gap * (j + 0.5)), direction), new[] { brep }, 1)[0];
        pts[counter++] = project_point(crvs[i].PointAt(pt_gap * (j + 0.5)), brep, direction);
      }
    }

    HashSet<int> index_in = new HashSet<int>();
    for (int i = 0; i < pts.Length; i++)
    {
      brep.ClosestPoint(pts[i], out _, out ComponentIndex ci, out _, out _, tol, out _);
      if (ci.Index != -1) index_in.Add(ci.Index);
    }

    List<int> index_out = new List<int>();
    for (int i = 0; i < face_count; i++)
    {
      if (!index_in.Contains(i)) index_out.Add(i);  //index_outx[counter++] = i;
    }

    BoundingBox test_box = new BoundingBox(pts);
    test_box.Union(new Point3d(0, 0, -brep.GetBoundingBox(false).Min.Z - 10));
    test_box.Transform(Transform.Translation(0, 0, tol));
    for (int i = index_out.Count - 1; i >= 0; i--)
    {
      if (boxinside(test_box, brep.DuplicateSubBrep(new[] { index_out[i] }).GetBoundingBox(true)))
      {
        index_in.Add(index_out[i]);
        index_out.RemoveAt(i);
      }
    }

    if (should_orient) brep.Transform(reorient);

    brep_in = brep.DuplicateSubBrep(index_in);
    brep_out = brep.DuplicateSubBrep(index_out);
  }
  public static void clean_lines(ref Curve[] curves, double tol = 0.01)
  {
    int count = curves.Length;

    // Use a HashSet to track indices to remove for faster lookups
    HashSet<int> removeSet = new HashSet<int>();

    for (int i = 0; i < count; i++)
    {
      int next = (i + 1) % count;
      if (curves[i].IsLinear(0.01) && curves[next].IsLinear(0.01))
      {
        if (curves[i].TangentAtEnd.EpsilonEquals(curves[next].TangentAtStart, 0.01))
        {
          curves[i] = new LineCurve(curves[i].PointAtStart, curves[next].PointAtEnd);
          removeSet.Add(next);
        }
      }
    }

    // Filter out curves that need to be removed using LINQ
    curves = curves
        .Where((curve, index) => !removeSet.Contains(index))
        .ToArray();
  }
  private void match_crv_ends(Curve[] curves)
  {
    int count = curves.Length;
    List<Point3d> straight_pts = new List<Point3d>();
    List<Curve> curved = new List<Curve>();
    for (int i = 0; i < count; i++)
    {
      if (curves[i].IsLinear(0.01))
      {
        straight_pts.Add(curves[i].PointAtStart);
        straight_pts.Add(curves[i].PointAtEnd);
      }
      else
      {
        curved.Add(curves[i]);
      }
    }

    for (int i = 0; i < curved.Count; i++)
    {
      Point3d start_pt = curved[i].PointAtStart;
      Point3d end_pt = curved[i].PointAtEnd;
      for (int j = 0; j < straight_pts.Count; j++)
      {
        Point3d test_pt = straight_pts[j];
        if (start_pt.EpsilonEquals(test_pt, 0.01)) curved[i].SetStartPoint(test_pt);
        if (end_pt.EpsilonEquals(test_pt, 0.01)) curved[i].SetEndPoint(test_pt);
      }
    }
  }
  public static NurbsSurface planar_srf(double x = 1, double y = 1)
  {
    x *= 0.5;
    y *= 0.5;

    return NurbsSurface.CreateFromCorners(
      new Point3d(-x, -y, 0),
      new Point3d(-x, y, 0),
      new Point3d(x, y, 0),
      new Point3d(x, -y, 0));
  }
  public static BoundingBox bb_union<T>(IList<T> geos, double inflate = 0) where T : GeometryBase
  {
    BoundingBox bb = BoundingBox.Empty;
    for (int i = 0; i < geos.Count; i++) bb.Union(geos[i].GetBoundingBox(true));
    if (inflate != 0) bb.Inflate(inflate);
    return bb;
  }
  public static void sort_crvs(Curve[] curvesA, Curve[] curvesB, double tol = 0.001)
  {
    sort_crv(curvesA, tol);

    // Initialize first curve for crvsB
    //InitializeFirstCurveB(curvesA[0], curvesB.ToList(), curvesB, tol);
    set_first_curve(curvesA[0], ref curvesB);

    sort_crv(curvesB, tol);
  }
  public static void sort_crvs(Plane plane, Curve[] curvesA, Curve[] curvesB, double tol = 0.001)
  {
    int count = curvesA.Length;
    Transform flatten = Transform.Scale(plane, 1, 1, 0);
    Curve[] cA = curvesA.Select(c => c.DuplicateCurve()).ToArray();
    Curve[] cB = curvesB.Select(c => c.DuplicateCurve()).ToArray();

    TransformGeos(cA, flatten);
    TransformGeos(cB, flatten);

    int[] sortA = sort_index(cA, out bool[] flipA);

    bool flip = set_first_curve(cA[0], ref cB);

    int[] sortB = sort_index(cB, out bool[] flipB);
    flipB[0] = flip;

    Array.Sort(sortA, curvesA);
    Array.Sort(sortB, curvesB);
    Array.Sort(sortA, flipA);
    Array.Sort(sortB, flipB);

    for (int i = 0; i < count; i++)
    {
      if (flipA[i]) curvesA[i].Reverse();
      if (flipB[i]) curvesB[i].Reverse();
    }
  }
  public static bool set_first_curve(Curve crv, ref Curve[] curve_list, double tol = 0.001)
  {
    bool flip = false;

    int count = curve_list.Length;
    Interval interval = new Interval(0, 1);
    double inset = 0.3;

    crv.Domain = interval;
    Point3d ptA = crv.PointAt(inset);
    Point3d ptB = crv.PointAt(1 - inset);

    double minDistance = double.MaxValue;
    int start = 0;

    for (int i = 0; i < count; i++)
    {
      curve_list[i].Domain = interval;
      Point3d pt0 = curve_list[i].PointAt(inset);
      Point3d pt1 = curve_list[i].PointAt(1 - inset);

      double distance = Math.Min(ptA.DistanceToSquared(pt0), ptA.DistanceToSquared(pt1)) + Math.Min(ptB.DistanceToSquared(pt0), ptB.DistanceToSquared(pt1));

      if (distance < minDistance)
      {
        minDistance = distance;
        start = i;
      }
    }

    if (start > 0)
    {
      Curve[] sorted = new Curve[count];
      Array.Copy(curve_list, start, sorted, 0, count - start);
      Array.Copy(curve_list, 0, sorted, count - start, start);
      curve_list = sorted;
    }

    if (ptA.DistanceToSquared(curve_list[0].PointAt(inset)) > ptA.DistanceToSquared(curve_list[0].PointAt(1 - inset)))
    {
      curve_list[0].Reverse();
      flip = true;
    }
    return flip;
  }
  public static void sort_crv(Curve[] curves, double tol = 0.01)
  {
    int count = curves.Length;
    List<Curve> crvs = curves.Skip(1).ToList();

    for (int i = 0; i < count - 1; i++)
    {
      Point3d end = curves[i].PointAtEnd;
      for (int j = 0; j < crvs.Count; j++)
      {
        if (end.EpsilonEquals(crvs[j].PointAtStart, tol))
        {
          curves[i + 1] = crvs[j];
          crvs.RemoveAt(j);
          break;
        }
        else if (end.EpsilonEquals(crvs[j].PointAtEnd, tol))
        {
          crvs[j].Reverse();
          curves[i + 1] = crvs[j];
          crvs.RemoveAt(j);
          break;
        }
      }
    }
  }
  public static int[] sort_index(Curve[] curves, out bool[] flip, double tol = 0.01)
  {
    int count = curves.Length;

    int[] idx = new int[count];
    bool[] flip_bool = new bool[count]; // defaults to 'false' so no need to add assign anything other than 'true'

    List<Curve> crvs = new ArraySegment<Curve>(curves, 1, count - 1).ToList();
    List<int> idx_list = Enumerable.Range(1, count - 1).ToList();

    for (int i = 0; i < count - 1; i++)
    {
      Point3d end = curves[i].PointAtEnd;
      for (int j = 0; j < crvs.Count; j++)
      {
        if (end.EpsilonEquals(crvs[j].PointAtStart, tol))
        {
          curves[i + 1] = crvs[j];
          crvs.RemoveAt(j);
          idx[i + 1] = idx_list[j];
          idx_list.RemoveAt(j);
          break;
        }
        else if (end.EpsilonEquals(crvs[j].PointAtEnd, tol))
        {
          flip_bool[i + 1] = true;
          crvs[j].Reverse();
          curves[i + 1] = crvs[j];
          crvs.RemoveAt(j);
          idx[i + 1] = idx_list[j];
          idx_list.RemoveAt(j);
          break;
        }
      }
    }
    flip = flip_bool;
    return idx;
  }
  public static Point3d project_point(Point3d pt, Brep brep, Vector3d direction) // Optimised
  {
    pt = new Point3d(pt - direction);
    Point3d[] pts = Intersection.RayShoot(new Ray3d(pt, direction), new[] { brep }, 2);
    if (pts.Length == 1) return pts[0];
    if (pts.Length == 2)
    {
      double dist1 = pt.DistanceToSquared(pts[0]);
      double dist2 = pt.DistanceToSquared(pts[1]);
      return dist1 < dist2 ? pts[0] : pts[1];
    }
    if (pts.Length > 2)
    {
      double[] distances = pts.Select(p => pt.DistanceToSquared(p)).ToArray();
      return pts[Array.IndexOf(distances, distances.Min())];
    }
    return Point3d.Unset;
  }
  public static Curve project_closest(Curve crv, Brep brep, Vector3d dir, double tol)  // Optimised
  {
    Interval interval = new Interval(0, 1);

    crv.Transform(Transform.Translation(-dir));
    Curve[] projected_curves = Curve.ProjectToBrep(crv, brep, dir, tol);
    Curve[] projected_joined = Curve.JoinCurves(projected_curves, tol, false);

    Point3d centre = crv.GetBoundingBox(true).Center;
    int closestIndex = 0;
    double minDistance = double.MaxValue;

    for (int i = 0; i < projected_joined.Length; i++)
    {
      projected_joined[i].Domain = interval;
      double distance = centre.DistanceToSquared(projected_joined[i].GetBoundingBox(true).Center);
      if (distance < minDistance)
      {
        minDistance = distance;
        closestIndex = i;
      }

    }
    return projected_joined[closestIndex];
  }
  public static Plane curves_plane(Curve[] curves, double tol = 0.01)  // Optimized
  {
    int count = curves.Length;
    BoundingBox bb = bb_union(curves);

    if (bb.Max.Z - bb.Min.Z < 0.01) return new Plane(bb.Center, Vector3d.XAxis, Vector3d.YAxis); // XY Plane
    if (bb.Max.X - bb.Min.X < 0.01) return new Plane(bb.Center, Vector3d.YAxis, Vector3d.ZAxis); // ZY Plane
    if (bb.Max.Y - bb.Min.Y < 0.01) return new Plane(bb.Center, Vector3d.XAxis, Vector3d.ZAxis); // ZX Plane

    HashSet<Plane> uniquePlanes = new HashSet<Plane>();
    for (int i = 0; i < count; i++)
    {
      if (curves[i].TryGetPlane(out Plane pl, tol))
      {
        pl.Origin = bb.Center;
        uniquePlanes.Add(pl);
      }
    }
    return uniquePlanes.First();
  }
  public Plane plane_on_box(Plane plane, BoundingBox bb, double distance)
  {
    double tol = 0.01;
    if (plane.OriginX < bb.Max.X - tol && plane.OriginX > bb.Min.X + tol
    && (plane.Normal.EpsilonEquals(Vector3d.XAxis, 0.1) || plane.Normal.EpsilonEquals(-Vector3d.XAxis, 0.1)))
    {
      if (plane.OriginX - bb.Min.X > bb.Max.X - plane.OriginX) plane.OriginX = bb.Max.X + distance;
      else plane.OriginX = bb.Min.X - distance;
    }
    else if (plane.OriginY < bb.Max.Y - tol && plane.OriginY > bb.Min.Y + tol
    && (plane.Normal.EpsilonEquals(Vector3d.YAxis, 0.1) || plane.Normal.EpsilonEquals(-Vector3d.YAxis, 0.1)))
    {
      if (plane.OriginY - bb.Min.Y > bb.Max.Y - plane.OriginY) plane.OriginY = bb.Max.Y + distance;
      else plane.OriginY = bb.Min.Y - distance;
    }
    else if (plane.OriginZ < bb.Max.Z - tol && plane.OriginZ > bb.Min.Z + tol
    && (plane.Normal.EpsilonEquals(Vector3d.ZAxis, 0.1) || plane.Normal.EpsilonEquals(-Vector3d.ZAxis, 0.1)))
    {
      if (plane.OriginZ - bb.Min.Z > bb.Max.Z - plane.OriginZ) plane.OriginZ = bb.Max.Z + distance;
      else plane.OriginZ = bb.Min.Z - distance;
    }

    return plane;
  }
  public Curve[] offset(Curve[] curves, double fillet, out Plane pln, double tol = 0.001)
  {
    int count = curves.Length;
    Plane plane = curves_plane(curves);
    pln = plane;
    if (fillet == 0)
    {
      Curve[] dups = new Curve[count];
      for (int i = 0; i < count; i++) dups[i] = curves[i].DuplicateCurve();
      return dups;
    }

    Curve[] off1 = new Curve[count];
    Curve[] off2 = new Curve[count];
    Point3d pt = plane.Origin;
    Vector3d normal = plane.Normal;
    CurveOffsetCornerStyle cs = CurveOffsetCornerStyle.Smooth;
    CurveOffsetEndStyle es = CurveOffsetEndStyle.None;

    for (int i = 0; i < count; i++)
    {
      bool offset_type = !curves[i].IsArc(0.1);
      off1[i] = Curve.JoinCurves(curves[i].Offset(pt, normal, fillet, tol, tol, offset_type, cs, es), tol, false)[0];
      off2[i] = Curve.JoinCurves(curves[i].Offset(pt, normal, -fillet, tol, tol, offset_type, cs, es), tol, false)[0];
    }

    double len1 = bb_union(off1).Diagonal.Length;
    double len2 = bb_union(off2).Diagonal.Length;

    if ((fillet > 0) == (len1 < len2)) return neaten_crvs(loop_crv(off2, fillet), curves);
    return square_crvs(loop_crv(off1, fillet));

    //return neaten_crvs(loop_crv(off2, fillet), curves);
    //return neaten_crvs(loop_crv(off1, fillet), curves);
  }
  public Curve[] neaten_crvs(Curve[] crvs, Curve[] match_crvs, double tol = 0.1)
  {
    /// Designed for offset curves, where initial curves (match_crvs) are in a sorted loop, and the crvs also is a corresponding sorted loop
    /// Will also work for a single loop of curves that is not necessarily offset.  Just set match_crvs to 'null'.

    int count = crvs.Length;
    Interval interval = new Interval(0, 1);

    bool[] end_curvature_matches = new bool[count];
    bool[] is_linear = new bool[count];
    Vector3d[] end_tan = new Vector3d[count];
    Vector3d[] vecs = { Vector3d.XAxis, -Vector3d.XAxis, Vector3d.YAxis, -Vector3d.YAxis, Vector3d.ZAxis, -Vector3d.ZAxis };

    if (match_crvs.Length == count)
    {
      for (int i = 0; i < count; i++)
      {
        crvs[i].Domain = interval;
        match_crvs[i].Domain = interval;
        is_linear[i] = match_crvs[i].IsLinear(tol);
        end_tan[i] = match_crvs[i].TangentAtEnd;
        for (int j = 0; j < 6; j++) if (end_tan[i].EpsilonEquals(vecs[j], tol)) end_tan[i] = vecs[j];
      }

      for (int i = 0; i < count; i++)
      {
        int last = (i - 1 + count) % count;
        end_curvature_matches[i] = match_crvs[i].CurvatureAt(0).EpsilonEquals(match_crvs[last].CurvatureAt(1), 0.1) && match_crvs[i].TangentAtStart.EpsilonEquals(end_tan[last], 0.1);
      }
    }
    else
    {
      for (int i = 0; i < count; i++)
      {
        crvs[i].Domain = interval;
        is_linear[i] = crvs[i].IsLinear(tol);
        end_tan[i] = crvs[i].TangentAtEnd;
        for (int j = 0; j < 6; j++) if (end_tan[i].EpsilonEquals(vecs[j], tol)) end_tan[i] = vecs[j];
      }

      for (int i = 0; i < count; i++)
      {
        int last = (i - 1 + count) % count;
        end_curvature_matches[i] = crvs[i].CurvatureAt(0).EpsilonEquals(crvs[last].CurvatureAt(1), 0.1) && crvs[i].TangentAtStart.EpsilonEquals(end_tan[last], 0.1);
      }
    }


    // string test_vecs = "";
    // for (int i = 0; i < count; i++) test_vecs += is_linear[i].ToString() + ", " + crvs[i].ToNurbsCurve().Points.Count.ToString() +"|  " ;
    // Print(test_vecs);

    for (int i = 0; i < count; i++)
    {
      if (is_linear[i] || !end_curvature_matches[i] || crvs[i].IsArc(0.1)) continue;


      NurbsCurve curve = crvs[i].ToNurbsCurve();
      int ptnum = curve.Points.Count;
      //Print(ptnum.ToString());

      Point3d[] pts = curve.Points.Select(p => p.Location).ToArray();
      int degree = curve.Degree;
      if (ptnum < 6) continue;

      // ------- Square ends if not square

      Vector3d tan = end_tan[(i - 1 + count) % count];
      tan.Unitize();
      pts[1] = new Point3d(pts[0] + (tan * pts[0].DistanceTo(pts[1])));
      pts[2] = new Point3d(pts[0] + (tan * pts[0].DistanceTo(pts[2])));

      if (is_linear[(i + 1) % count])
      {
        tan = -end_tan[i];
        tan.Unitize();
        pts[ptnum - 2] = new Point3d(pts[ptnum - 1] + (tan * pts[ptnum - 1].DistanceTo(pts[ptnum - 2])));
        pts[ptnum - 3] = new Point3d(pts[ptnum - 1] + (tan * pts[ptnum - 1].DistanceTo(pts[ptnum - 3])));
      }

      crvs[i] = NurbsCurve.Create(false, degree, pts);
    }
    return crvs;
  }
  public Curve[] square_crvs(Curve[] crvs, double tol = 0.1)
  {
    int count = crvs.Length;
    for (int i = 0; i < count; i++) crvs[i] = square_crv(crvs[i]);
    return crvs;
  }
  public Curve square_crv(Curve crv, double tol = 0.1)
  {
    if (crv.IsLinear(0.01) || crv.IsArc(0.1)) return crv;

    NurbsCurve curve = crv.ToNurbsCurve();
    Point3d[] pts = curve.Points.Select(p => p.Location).ToArray();
    int count = pts.Length;
    if (curve.Points.Count < 6) return crv;

    Vector3d[] vecs = { Vector3d.XAxis, -Vector3d.XAxis, Vector3d.YAxis, -Vector3d.YAxis, Vector3d.ZAxis, -Vector3d.ZAxis };
    Vector3d start_vec = curve.TangentAtStart;
    Vector3d end_vec = curve.TangentAtEnd;

    bool start_found = false;
    bool end_found = false;

    for (int j = 0; j < 6; j++)
    {
      if (!start_found && start_vec.EpsilonEquals(vecs[j], tol))
      {
        if (vecs[j].X == 0) pts[1].X = pts[2].X = pts[0].X;
        if (vecs[j].Y == 0) pts[1].Y = pts[2].Y = pts[0].Y;
        if (vecs[j].Z == 0) pts[1].Z = pts[2].Z = pts[0].Z;
        start_found = true;
      }

      if (!end_found && end_vec.EpsilonEquals(vecs[j], tol))
      {
        if (vecs[j].X == 0) pts[count - 2].X = pts[count - 3].X = pts[count - 1].X;
        if (vecs[j].Y == 0) pts[count - 2].Y = pts[count - 3].Y = pts[count - 1].Y;
        if (vecs[j].Z == 0) pts[count - 2].Z = pts[count - 3].Z = pts[count - 1].Z;
        end_found = true;
      }
      if (start_found && end_found) break;
    }
    return Curve.CreateControlPointCurve(pts, curve.Degree);
  }
  public static Curve[] loop_crv(Curve[] curves, double radius, double tol = 0.001)
  {
    if (Curve.JoinCurves(curves, tol, false)[0].IsClosed) return curves;

    int count = curves.Length;
    radius = Math.Abs(radius) * 2;

    //bool[] is_arc = new bool[count];
    Point3d[] startPoints = new Point3d[count];
    Point3d[] endPoints = new Point3d[count];
    double[] extendMin = new double[count];
    double[] extendMax = new double[count];

    for (int i = 0; i < count; i++)
    {
      //is_arc[i] = curves[i].IsArc(0.1);
      startPoints[i] = curves[i].PointAtStart;
      endPoints[i] = curves[i].PointAtEnd;
      extendMin[i] = curves[i].Domain.Min - radius;
      extendMax[i] = curves[i].Domain.Max + radius;
    }

    for (int i = 0; i < count; i++)
    {
      //if(is_arc[i]) continue;
      int last = (i + count - 1) % count;
      int next = (i + 1) % count;

      if (!startPoints[i].EpsilonEquals(endPoints[last], tol))
        curves[i] = curves[i].Extend(extendMin[i], curves[i].Domain.Max);
      if (!endPoints[i].EpsilonEquals(startPoints[next], tol))
        curves[i] = curves[i].Extend(curves[i].Domain.Min, extendMax[i]);
    }

    for (int i = 0; i < count; i++)
    {
      //if(is_arc[i]) continue;
      int last = (i + count - 1) % count;
      int next = (i + 1) % count;

      if (!startPoints[i].EpsilonEquals(endPoints[last], tol))
      {
        CurveIntersections cx = Intersection.CurveCurve(curves[i], curves[last], tol, tol);
        curves[i] = curves[i].Split(cx[0].ParameterA)[1];
        curves[last] = curves[last].Split(cx[0].ParameterB)[0];
      }
    }

    Interval interval = new Interval(0, 1);
    for (int i = 0; i < count; i++)
    {
      //if(is_arc[i]) continue;
      int degree = curves[i].Degree;
      Vector3d start = curves[i].TangentAtStart;
      Vector3d end = curves[i].TangentAtEnd;
      curves[i].Domain = interval;
      if (curves[i].CurvatureAt(0.5).SquareLength > 200 || curves[i].DuplicateSegments().Length > 1)
      {
        BoundingBox bb = curves[i].GetBoundingBox(true);

        int ptnum = (int)Math.Max(9, Math.Floor(curves[i].ToNurbsCurve().Points.Count * 1.0));
        Curve crv = curves[i].Rebuild(ptnum, degree, true);
        Point3d[] pts = crv.ToNurbsCurve().Points.Select(p => p.Location).ToArray();
        for (int j = 0; j < pts.Length; j++)
        {
          pts[j].X = Math.Max(bb.Min.X, Math.Min(bb.Max.X, pts[j].X));
          pts[j].Y = Math.Max(bb.Min.Y, Math.Min(bb.Max.Y, pts[j].Y));
          pts[j].Z = Math.Max(bb.Min.Z, Math.Min(bb.Max.Z, pts[j].Z));
        }
        curves[i] = Curve.CreateControlPointCurve(pts, degree); //NurbsCurve.Create(false, degree, pts);
      }
    }
    return curves;
  }
  public static bool boxboxinside2D(BoundingBox a, BoundingBox b)
  {
    if (a.Max.X < b.Max.X) return false;
    if (a.Min.X > b.Min.X) return false;
    if (a.Max.Y < b.Max.Y) return false;
    if (a.Min.Y > b.Min.Y) return false;

    return true;
  }
  public static bool boxoverlap(BoundingBox a, BoundingBox b)
  {
    if (a.Max.X < b.Min.X) return false;
    if (a.Min.X > b.Max.X) return false;
    if (a.Max.Y < b.Min.Y) return false;
    if (a.Min.Y > b.Max.Y) return false;
    if (a.Max.Z < b.Min.Z) return false;
    if (a.Min.Z > b.Max.Z) return false;

    return true;
  }
  public static bool boxoverlap2D(BoundingBox a, BoundingBox b)
  {
    if (a.Max.X < b.Min.X) return false;
    if (a.Min.X > b.Max.X) return false;
    if (a.Max.Y < b.Min.Y) return false;
    if (a.Min.Y > b.Max.Y) return false;

    return true;
  }
  public static bool boxinside(BoundingBox outer, BoundingBox inner)
  {
    if (outer.Min.X > inner.Min.X) return false;
    if (outer.Max.X < inner.Max.X) return false;
    if (outer.Min.Y > inner.Min.Y) return false;
    if (outer.Max.Y < inner.Max.Y) return false;
    if (outer.Min.Z > inner.Min.Z) return false;
    if (outer.Max.Z < inner.Max.Z) return false;
    return true;
  }
  public static void TransformGeos<T>(IList<T> geos, Transform transform) where T : GeometryBase
  {
    for (int i = 0; i < geos.Count; i++) geos[i].Transform(transform);
  }
  public bool no_input(string name) => Component.Params.Input[Component.Params.IndexOfInputParam(name)].SourceCount == 0;
# ---------- end extrude_punch ----------
scripts_2 = ScriptsFolderPath("D:\Core_Files\Scripts\")
bra_3 = Branch_select(tree=trim, i=Slider(2, range=0..10))  # -> remains, branch; inputs tree: tree, i: Int32; same code as bra
extrude_punch_2 = ExtrudeAndPunch(curves=move_3.Geometry, radii=Slider(0.5, range=0..1), extrude=subtraction)  # -> surfaces, pl, crv, notes; inputs curves: list, brep: Brep, radii: list of Double, bulges: list of Double, extrude: Double, inset: Double, flip: Boolean; same code as extrude_punch
donut_ext = CSharpScript(rad0=number_slider_10, rad1=number_slider_11, fillet=Slider(0.3, range=0..1), extrude=Slider(1, range=0..1))  # -> surfaces, circleA, circleB; inputs rad0: Double, rad1: Double, fillet: Double, bulge: Double, extrude: Double
# ---------- donut_ext: C# usings ----------
using Rhino.Geometry.Intersect;
# ---------- donut_ext: C# ----------
    if (rad0.GetHashCode() == 0) rad0 = 5.0;
    if (rad1.GetHashCode() == 0) rad1 = 3.0;
    if (fillet.GetHashCode() == 0) fillet = 0.5;
    if (bulge.GetHashCode() == 0) bulge = 0.65;
    if (extrude.GetHashCode() == 0) extrude = 10;

    const double tol = 0.01;
    bool center = true;
    bool flip = false;
    if (extrude < 0) flip = true;
    extrude = Math.Abs(extrude);

    Circle circle0 = new Circle(rad0);
    Circle circle1 = new Circle(rad1);
    Vector3d direction = Vector3d.ZAxis;
    Plane plane = Plane.WorldXY;
    Point3d centre = Point3d.Origin;
    double extrude_fil = (extrude * 0.5) - fillet;
    double rad_fil0 = rad0 - fillet;
    double rad_fil1 = rad1 + fillet;


    // ---- Set Orientation ---- //

    Brep[] final_breps = new Brep[8];
    final_breps[2] = Brep.CreateFromCylinder(new Cylinder(circle0, extrude_fil * 2), false, false);
    final_breps[6] = Brep.CreateFromCylinder(new Cylinder(circle1, extrude_fil * 2), false, false);
    final_breps[2].Transform(Transform.Translation(direction * -extrude_fil));
    final_breps[6].Transform(Transform.Translation(direction * -extrude_fil));

    final_breps[0] = Brep.CreatePlanarBreps(new[] { new Circle(rad_fil0).ToNurbsCurve(), new Circle(rad_fil1).ToNurbsCurve() }, tol)[0];
    final_breps[0].Transform(Transform.Translation(direction * extrude * 0.5));
    final_breps[4] = final_breps[0].DuplicateBrep();
    final_breps[4].Transform(Transform.Mirror(plane));


    Line axis = new Line(centre, new Point3d(0, 0, -1));
    NurbsCurve side_ln0 = new Line(new Point3d(rad0, 0, extrude_fil - 1), new Point3d(rad0, 0, extrude_fil)).ToNurbsCurve();
    NurbsCurve top_ln0 = new Line(new Point3d(rad_fil0, 0, extrude * 0.5), new Point3d(rad_fil0 - 1, 0, extrude * 0.5)).ToNurbsCurve();
    NurbsCurve side_ln1 = new Line(new Point3d(rad1, 0, extrude_fil - 1), new Point3d(rad1, 0, extrude_fil)).ToNurbsCurve();
    NurbsCurve top_ln1 = new Line(new Point3d(rad_fil1, 0, extrude * 0.5), new Point3d(rad_fil1 + 1, 0, extrude * 0.5)).ToNurbsCurve();

    Curve fillet_crv0 = Curve.CreateBlendCurve(side_ln0, top_ln0, BlendContinuity.Curvature, bulge, bulge);
    Curve fillet_crv1 = Curve.CreateBlendCurve(side_ln1, top_ln1, BlendContinuity.Curvature, bulge, bulge);

    final_breps[1] = RevSurface.Create(fillet_crv0, axis).ToBrep();
    final_breps[3] = final_breps[1].DuplicateBrep();
    final_breps[3].Transform(Transform.Mirror(plane));

    final_breps[5] = RevSurface.Create(fillet_crv1, axis).ToBrep();
    final_breps[7] = final_breps[5].DuplicateBrep();
    final_breps[7].Transform(Transform.Mirror(plane));


    Brep final_brep = Brep.JoinBreps(final_breps, tol)[0];

    if (!center) final_brep.Transform(Transform.Translation(0, 0, extrude * 0.5));
    if (!center && flip) final_brep.Transform(Transform.Mirror(plane));

    surfaces = new GH_Brep(final_brep);
    circleA = new GH_Circle(circle0);
    circleB = new GH_Circle(circle1);
# ---------- donut_ext: C# additional code ----------
  public static bool boxbox(BoundingBox a, BoundingBox b)
  {
    if(a.Max.X < b.Min.X) return false;
    if(a.Min.X > b.Max.X) return false;
    if(a.Max.Y < b.Min.Y) return false;
    if(a.Min.Y > b.Max.Y) return false;
    if(a.Max.Z < b.Min.Z) return false;
    if(a.Min.Z > b.Max.Z) return false;
    return true;
  }
# ---------- end donut_ext ----------
text_3 = CSharpScript(text="Mac Studio")  # -> curves; inputs text: String, height: Double, font: String; same code as text
divide = DivideCurve(Curve=tweencrv, Count=Slider(504, range=0..1000), Kinks=False)  # -> simplify(Points), Tangents, Parameters
scripts_3 = ScriptsFolderPath("D:\Core_Files\Scripts\")

extc = Extrude_capped(crvs=text_2)  # -> E; inputs crvs: list, len: Double
# ---------- extc: C# usings ----------
using System.Linq;
using System.Buffers;
# ---------- extc: C# ----------
    // Update 2025-08-06

    Component.Message = "Capped";

    if (no_input("crvs")) return;
    if (no_input("len")) len = 5.0;
    bool capped = true;
    bool centre = true;
    const double tol = 0.01;
    Plane plane = Plane.WorldXY;

    // ------- Set up Curves ------- //

    Curve[] curve_list = object_curve_convert(crvs);
    Plane pl = curves_plane(curve_list);

    Vector3d extrude = Vector3d.ZAxis * len;

    Transform orient = Transform.PlaneToPlane(pl, Plane.WorldXY);
    Transform reorient = Transform.PlaneToPlane(Plane.WorldXY, pl);

    if (centre) orient = Transform.Translation(-extrude * 0.5) * orient;
    TransformGeos(curve_list, orient);


    // ------- Process Curves ------- //

    Curve[] curveloops = donut_sort(curve_list, tol, out int[] keys, out bool[] orientation);
    int[] groups = new HashSet<int>(keys).ToArray();
    int count = groups.Length;


    // ------- Create Breps ------- //

    List<GH_Brep> all_breps = new List<GH_Brep>();
    for (int i = 0; i < count; i++)
    {

      Curve[] curves = key_select(curve_list, keys, groups[i]);
      int curve_count = curves.Length;

      int side_count = capped ? curve_count + 2 : curve_count;
      Brep[] sides = new Brep[side_count];
      for (int j = 0; j < curve_count; j++) sides[j] = Surface.CreateExtrusion(curves[j], extrude).ToBrep();

      if (capped && curveloops[i].IsClosed)
      {
        sides[curve_count] = Brep.CreatePlanarBreps(curves, tol)[0];
        sides[curve_count + 1] = sides[curve_count].DuplicateBrep();
        sides[curve_count + 1].Transform(Transform.Translation(extrude));
      }
      Brep[] body = Brep.JoinBreps(sides, tol, 0.1);

      if (body.Length == 1 && curveloops[i].IsClosed && body[0].SolidOrientation == BrepSolidOrientation.Inward) body[0].Flip();
      TransformGeos(body, reorient);
      all_breps.AddRange(Array.ConvertAll(body, b => new GH_Brep(b)));
    }

    E = all_breps;
# ---------- extc: C# additional code ----------
  private Curve[] donut_sort(Curve[] curve_list, double tol, out int[] key_values, out bool[] orientation)
  {
    // Join curves and calculate bounding boxes
    Curve[] curveloops = Curve.JoinCurves(curve_list, tol, true, false, out int[] keys);
    BoundingBox[] bbs = bb_each(curveloops);
    int count = curve_list.Length;
    int group_count = curveloops.Length;

    // Precompute boxboxinside2D results and store them in a 1D byte array
    byte[] precomputedInside = new byte[group_count * group_count];
    for (int i = 0; i < group_count; i++)
    {
      for (int j = i + 1; j < group_count; j++) // j starts from i + 1 to avoid duplicate checks
      {
        bool inside_i_to_j = boxboxinside2D(bbs[i], bbs[j]); // Check (i -> j)
        precomputedInside[i * group_count + j] = (byte)(inside_i_to_j ? 1 : 0);

        bool inside_j_to_i = boxboxinside2D(bbs[j], bbs[i]); // Check (j -> i)
        precomputedInside[j * group_count + i] = (byte)(inside_j_to_i ? 1 : 0);
      }
    }

    bool[] inner = new bool[count]; // Store orientation for curves

    // Loop through the bounding boxes, optimized to avoid unnecessary checks
    for (int i = 0; i < group_count; i++)
    {
      for (int j = i + 1; j < group_count; j++) // Avoid duplicate checks: j > i ensures no repeat
      {
        if (precomputedInside[i * group_count + j] == 1)
        {
          for (int k = 0; k < count; k++) // Update keys for matching bounding box pairs
          {
            if (keys[k] == j)
            {
              keys[k] = i;
              inner[k] = true;  // Mark as inside
            }
          }
        }

        if (precomputedInside[j * group_count + i] == 1) // Also check the opposite direction
        {
          for (int k = 0; k < count; k++)
          {
            if (keys[k] == i)
            {
              keys[k] = j;
              inner[k] = true;
            }
          }
        }
      }
    }

    key_values = keys;
    orientation = inner;
    return curveloops;
  }


  public static Plane curves_plane(Curve[] curves, double tol = 0.01)  // Optimized
  {

    BoundingBox bb = bb_union(curves);

    if (bb.Max.Z - bb.Min.Z < 0.01) return new Plane(bb.Center, Vector3d.XAxis, Vector3d.YAxis); // XY Plane
    if (bb.Max.X - bb.Min.X < 0.01) return new Plane(bb.Center, Vector3d.YAxis, Vector3d.ZAxis); // ZY Plane
    if (bb.Max.Y - bb.Min.Y < 0.01) return new Plane(bb.Center, Vector3d.XAxis, Vector3d.ZAxis); // ZX Plane

    int count = curves.Length;
    HashSet<Plane> uniquePlanes = new HashSet<Plane>();
    for (int i = 0; i < count; i++)
    {
      if (curves[i].TryGetPlane(out Plane pl, tol))
      {
        pl.Origin = bb.Center;
        uniquePlanes.Add(pl);
      }
    }
    return uniquePlanes.First();
  }



  public static Curve[] object_curve_convert(IReadOnlyList<object> objects)
  {

    ArrayPool<Curve> pool = ArrayPool<Curve>.Shared;
    int count = objects.Count;
    // A rough upper bound – the worst case is a Curve that duplicates into many segments.
    // 2× is generous but still keeps the pool buffer small.

    // Pre‑allocate a buffer large enough to hold most of the results.
    Curve[] buffer = pool.Rent(count * 2);
    int index = 0;

    // Helper to grow the buffer when we run out of space.
    void Expand()
    {
      // Double the current size (or at least the remaining required slots)
      int newSize = Math.Max(buffer.Length * 2, index + count);
      Curve[] newBuf = pool.Rent(newSize);
      Array.Copy(buffer, newBuf, index);
      pool.Return(buffer);
      buffer = newBuf;
    }

    for (int i = 0; i < count; i++)
    {
      var obj = objects[i];

      switch (obj)
      {
        case Curve c:
          // DuplicateSegments() returns a List<Curve>, we copy it in a tight loop.
          foreach (var seg in c.DuplicateSegments())
          {
            if (index == buffer.Length) Expand();
            buffer[index++] = seg;
          }
          break;

        case Line l:
          if (index == buffer.Length) Expand();
          buffer[index++] = new LineCurve(l);
          break;

        case Circle cir:
          if (index == buffer.Length) Expand();
          buffer[index++] = new ArcCurve(cir);
          break;

        case Arc a:
          if (index == buffer.Length) Expand();
          buffer[index++] = new ArcCurve(a);
          break;
      }
    }

    // Slice the used portion into a new array of the exact size the caller expects.
    Curve[] result = new Curve[index];
    Array.Copy(buffer, result, index);

    // Return the temporary buffer to the pool.
    pool.Return(buffer);

    return result;
  }

  private Curve[] key_select(Curve[] curve_list, int[] keys, int value)
  {
    // Cache frequently used values locally to avoid repeated field accesses
    int len = curve_list.Length;
    int val = value;

    int count = 0;
    for (int i = 0; i < len; ++i) if (keys[i] == val) count++;

    Curve[] result = new Curve[count];

    int idx = 0;
    for (int i = 0; i < len; ++i) if (keys[i] == val) result[idx++] = curve_list[i];

    return result;
  }

  
  public static void TransformGeos(GeometryBase[] geos, Transform transform)
  {
    int count = geos.Length;
    for (int i = 0; i < count; i++) geos[i].Transform(transform);
  }


  public static BoundingBox[] bb_each(GeometryBase[] geos, double inflate = 0)
  {
    // Allocate the backing array once – this is the only allocation.
    int len = geos.Length;
    BoundingBox[] bb = new BoundingBox[len];

    // Create a Span over the array to eliminate bounds checks inside the loops.
    Span<BoundingBox> bbSpan = bb;

    // Fill the array with bounding boxes.
    for (int i = 0; i < len; i++) bbSpan[i] = geos[i].GetBoundingBox(true);

    // Inflate in place if required.
    if (inflate != 0) for (int i = 0; i < len; i++) bbSpan[i].Inflate(inflate);

    // Return the array – Span cannot be returned.
    return bb;
  }

  public static BoundingBox bb_union(GeometryBase[] geos, double inflate = 0)
  {
    double box_x_min = double.MaxValue;
    double box_x_max = double.MinValue;
    double box_y_max = double.MinValue;
    double box_y_min = double.MaxValue;
    double box_z_min = double.MaxValue;
    double box_z_max = double.MinValue;

    for (int i = 0; i < geos.Length; i++)
    {
      BoundingBox bb = geos[i].GetBoundingBox(true);
      Point3d min = bb.Min;
      Point3d max = bb.Max;

      if (min.X < box_x_min) box_x_min = min.X;
      if (max.X > box_x_max) box_x_max = max.X;
      if (min.Y < box_y_min) box_y_min = min.Y;
      if (max.Y > box_y_max) box_y_max = max.Y;
      if (min.Z < box_z_min) box_z_min = min.Z;
      if (max.Z > box_z_max) box_z_max = max.Z;
    }

    box_x_min -= inflate;
    box_x_max += inflate;
    box_y_max -= inflate;
    box_y_min += inflate;
    box_z_min -= inflate;
    box_z_max += inflate;

    return new BoundingBox(box_x_min, box_x_max, box_y_max, box_y_min, box_z_min, box_z_max);
  }

  public static bool boxboxinside2D(BoundingBox a, BoundingBox b)
  {
    if (a.Max.X < b.Max.X) return false;
    if (a.Min.X > b.Min.X) return false;
    if (a.Max.Y < b.Max.Y) return false;
    if (a.Min.Y > b.Min.Y) return false;

    return true;
  }



  public bool no_input(string name) => Component.Params.Input[Component.Params.IndexOfInputParam(name)].SourceCount == 0;
# ---------- end extc ----------
para = ScriptParasite(Enable=Toggle(True), Folder=scripts)
volcano_straight = CSharpScript(
    curves=cir_3,
    brep=extrude_punch_2.surfaces,
    filletA=Slider(0.6, range=0..1),
    filletB=Slider(0.5, range=0..1),
    blendA=number_slider_19,
    blendB=number_slider_19,
    extrude=number_slider_15,
    inset=subtraction_2)  # -> brp, pl, crv, sides, notes; inputs curves: list of Curve, brep: Brep, filletA: Double, filletB: Double, blendA: Double, blendB: Double, extrude: Double, inset: Double, cap: Boolean
# ---------- volcano_straight: C# ----------
    // Updated 2025-07-09

    notes = "Needs Cleaning and Notes adding";
    // Needs to be optimised for straight sections
    // Needs to work when offset == 0
    // Needs to be able to loop over curves (see ~Line 117)

    if (no_input("brep")) { Component.Message = "input brep"; return; }
    if (no_input("curves")) { brp = new GH_Brep(brep); Component.Message = "input curves"; return; }
    if (no_input("extrude") || Math.Abs(extrude) < 0.01) { brp = new GH_Brep(brep); crv = curves; return; }
    extrude = -extrude;

    if (no_input("inset")) inset = 0;
    string message = "Straight Extrude";
    int volcano_type = 0;
    if (inset > 0) {
      message = "Inset from Curves";
      volcano_type = 1;
    }
    else if (inset < 0) {
      message = "Inset from Brep";
      volcano_type = 2;
    }
    inset = Math.Abs(inset);

    Component.Message = message;

    if (no_input("filletA")) filletA = 0;
    if (no_input("filletB")) filletB = 0;
    if (no_input("blendA")) blendA = 0.5;
    if (no_input("blendB")) blendB = 0.5;

    if (no_input("cap")) cap = true;


    // ------ Set Up Default Values ------ //

    double[] radii = { filletA, filletB };
    double[] bulges = { blendA, blendB };


    double tol = 0.0001;
    int sectors = 12;
    Interval interval = new Interval(0, 1);
    Plane pln = Plane.WorldXY;

    Curve[] curve_list = curves.ToArray();

    Curve[] curveloops = Curve.JoinCurves(curve_list, tol, true, false, out int[] keys);
    int idx = keys.Max() + 1;
    Plane[] planes = new Plane[idx];

    BoundingBox brep_bb = new BoundingBox();
    if (!no_input("brep")) brep_bb = brep.GetBoundingBox(true);

    List<Curve> temp_crvs = new List<Curve>();
    List<int> temp_ints = new List<int>();
    for (int i = 0; i < idx; i++)
    {
      if (!curveloops[i].IsClosed) continue;
      Curve[] crvs = curve_list.Where((c, j) => keys[j] == i).ToArray();
      // if (!no_input("inset") && inset != 0) crvs = offset(crvs, -inset, out planes[i], tol);
      // else planes[i] = curves_plane(crvs);

      planes[i] = curves_plane(crvs);
      TransformGeos(crvs, Transform.Scale(planes[i], 1, 1, 0));

      int count = crvs.Length;
      if (count > 1)
      {
        sort_crv(crvs);
        clean_lines(ref crvs);
        match_crv_ends(crvs);
      }
      temp_crvs.AddRange(crvs);
      temp_ints.AddRange(Enumerable.Repeat(i, crvs.Length));
    }

    keys = temp_ints.ToArray();
    curve_list = temp_crvs.ToArray();



    // ------- Main Loop ------- //

    List<Curve> all_crvs = new List<Curve>();
    List<Brep> all_breps = new List<Brep>();
    List<Plane> plane_list = new List<Plane>();


    for (int i = 0; i < idx; i++)
    {
      Curve[] crvs = curve_list.Where((c, j) => keys[j] == i).ToArray();
      int count = crvs.Length;

      Plane plane = planes[i];
      Transform orient = Transform.PlaneToPlane(plane, pln);
      Transform reorient = Transform.PlaneToPlane(pln, plane);


      brep.Transform(orient);
      TransformGeos(crvs, orient);

      // Check that the curve is inside the Brep's bounds
      double edge_inset_caution = 0.2; // 0.2 + Math.Max(radii[0], radii[1])

      if (!boxboxinside2D(brep.GetBoundingBox(true), bb_union(crvs, edge_inset_caution)))
      {
        brep.Transform(reorient);
        continue;
      }

      // ------- Construct Breps and Parts ------- //

      //Brep test_piece = new Brep();
      Plane base_plane = Plane.Unset;
      Curve[] hole_crvs = new Curve[count];
      Brep part;

      if (volcano_type == 1) part = volcano_from_curves(crvs, brep, extrude, inset, radii, bulges, sectors, tol, out base_plane, out hole_crvs);
      else if (volcano_type == 2) part = volcano_from_brep(crvs, brep, extrude, inset, radii, bulges, sectors, tol, out base_plane, out hole_crvs);
      else part = square_volcano(crvs, brep, extrude, radii, bulges, sectors, tol, out base_plane, out hole_crvs);

      Curve[] hole_curves = hole_crvs.Where(c => c != null).ToArray();

      brep = part;
      brep.Transform(reorient);

      if (base_plane.IsValid) { base_plane.Transform(reorient); plane_list.Add(base_plane); }
      if (hole_curves.Length > 0) { TransformGeos(hole_curves, reorient); all_crvs.AddRange(hole_curves); }
    }

    if (all_breps.Count == 0) all_breps.Add(brep);
    crv = all_crvs.Select(c => new GH_Curve(c));
    pl = plane_list;
    brp = all_breps.Select(b => new GH_Brep(b));



    string identifier = "";

    string[] note_strings = {
        identifier,
        "Posistive 'inset' uses the edge of the extrude as the reference point for insetting",
        "Negative 'inset' uses the base of the extrude as the reference point for insetting"
      };

    notes = note_strings;
# ---------- volcano_straight: C# additional code ----------
public static void sort_crv(Curve[] curves, double tol = 0.01)
  {
    int count = curves.Length;
    List<Curve> crvs = curves.Skip(1).ToList();

    for (int i = 0; i < count - 1; i++)
    {
      Point3d end = curves[i].PointAtEnd;
      for (int j = 0; j < crvs.Count; j++)
      {
        if (end.EpsilonEquals(crvs[j].PointAtStart, tol))
        {
          curves[i + 1] = crvs[j];
          crvs.RemoveAt(j);
          break;
        }
        else if (end.EpsilonEquals(crvs[j].PointAtEnd, tol))
        {
          crvs[j].Reverse();
          curves[i + 1] = crvs[j];
          crvs.RemoveAt(j);
          break;
        }
      }
    }
  }
public static void clean_lines(ref Curve[] curves, double tol = 0.01)
  {
    int count = curves.Length;

    // Use a HashSet to track indices to remove for faster lookups
    HashSet<int> removeSet = new HashSet<int>();

    for (int i = 0; i < count; i++)
    {
      int next = (i + 1) % count;
      if (curves[i].IsLinear(0.01) && curves[next].IsLinear(0.01))
      {
        if (curves[i].TangentAtEnd.EpsilonEquals(curves[next].TangentAtStart, 0.01))
        {
          curves[i] = new LineCurve(curves[i].PointAtStart, curves[next].PointAtEnd);
          removeSet.Add(next);
        }
      }
    }

    // Filter out curves that need to be removed using LINQ
    curves = curves
        .Where((curve, index) => !removeSet.Contains(index))
        .ToArray();
  }
private void match_crv_ends(Curve[] curves)
  {
    int count = curves.Length;
    List<Point3d> straight_pts = new List<Point3d>();
    List<Curve> curved = new List<Curve>();
    for (int i = 0; i < count; i++)
    {
      if (curves[i].IsLinear(0.01))
      {
        straight_pts.Add(curves[i].PointAtStart);
        straight_pts.Add(curves[i].PointAtEnd);
      }
      else
      {
        curved.Add(curves[i]);
      }
    }

    for (int i = 0; i < curved.Count; i++)
    {
      Point3d start_pt = curved[i].PointAtStart;
      Point3d end_pt = curved[i].PointAtEnd;
      for (int j = 0; j < straight_pts.Count; j++)
      {
        Point3d test_pt = straight_pts[j];
        if (start_pt.EpsilonEquals(test_pt, 0.01)) curved[i].SetStartPoint(test_pt);
        if (end_pt.EpsilonEquals(test_pt, 0.01)) curved[i].SetEndPoint(test_pt);
      }
    }
  }


  // -------------------------------------------------------------------------------

  private Brep volcano_from_curves(Curve[] curves, Brep brep, double extrude, double inset, double[] radii, double[] bulges, int sectors, double tol, out Plane pl, out Curve[] crvs)
  {
    Point3d pu = Point3d.Unset;
    double gap = 1.0 / (sectors - 1.0);
    Plane pln = Plane.WorldXY;
    Vector3d Z_up = Vector3d.ZAxis;
    int count = curves.Length;

    bool A_sharp = radii[0] == 0;
    bool B_sharp = radii[1] == 0;

    double radA = radii[0]; // Fillet Radius at Brep
    double radB = radii[1]; // Fillet Radius at Curve

    bool A_chamfer = bulges[0] == 0;
    bool B_chamfer = bulges[1] == 0;

    int cross_numA = A_chamfer ? 2 : 4;
    int cross_numB = B_chamfer ? 2 : 4;

    bool remirror = brep.GetBoundingBox(true).Center.Z < 0;  // Put Brep above Plane.XY
    Transform mirror = Transform.Mirror(pln);
    if (remirror) brep.Transform(mirror);


    // ------- Setup Curves ------- //

    double hyp = Math.Sqrt((inset * inset) + (extrude * extrude));
    double ratioA = A_sharp ? 0 : (hyp - radA) / hyp;
    double ratioB = B_sharp ? 1 : radB / hyp;

    double ratioC = A_sharp ? 0 : radA / hyp;
    double ratioD = B_sharp ? 1 : (hyp - radB) / hyp;

    double[] insets = { inset + radA, (ratioA * inset), (ratioB * inset), -radB };  // on the XY plane
    double[] offsets = { 0, (ratioC * extrude), (ratioD * extrude), (extrude) };  // in the Z-Axis


    Curve[] crvA = offset(curves, insets[0], out _, tol);

    // ------- Separate BrepFaces ------- //

    Brep[] final_breps = new Brep[count * 3 + 3];
    separate_brepfaces(brep, crvA, Z_up, out Brep brep_half, out Brep brep_out);
    final_breps[count * 3 + 1] = brep_out;

    double len = 0.2;
    Surface cutter = planar_srf(len, len);
    cutter.Transform(Transform.Translation(0, len * 0.5, 0));

    double[] ts = Enumerable.Range(0, sectors).Select(x => x * gap).ToArray();


    // ------- Setup Curves ------- //

    crvA = crvA.Select(c => project_closest(c, brep_half, Z_up, tol)).ToArray();


    Curve[] crvB = offset(curves, insets[1], out _, tol);
    Curve[] crvC = offset(curves, insets[2], out _, tol);
    Curve[] crvD = offset(curves, insets[3], out _, tol);

    Curve[] final_crvs = curves;  //offset(curves, -inset, out _, tol);


    Point3d central_pt = project_point(Point3d.Origin, brep, Z_up);
    Plane A_plane = pln;
    A_plane.Origin = central_pt;

    Plane B_plane = A_plane;
    Plane C_plane = A_plane;
    Plane D_plane = A_plane;
    Plane final_plane = A_plane;


    A_plane.Transform(Transform.Translation(0, 0, offsets[0]));
    B_plane.Transform(Transform.Translation(0, 0, offsets[1]));
    C_plane.Transform(Transform.Translation(0, 0, offsets[2]));
    D_plane.Transform(Transform.Translation(0, 0, offsets[3]));

    TransformGeos(crvB, Transform.Scale(B_plane, 1, 1, 0));
    TransformGeos(crvC, Transform.Scale(C_plane, 1, 1, 0));
    TransformGeos(crvD, Transform.Scale(D_plane, 1, 1, 0));
    TransformGeos(final_crvs, Transform.Scale(D_plane, 1, 1, 0)); 



    // ------- Create test to see if surface is flat.  If so, a more simple construction can be used ------- //

    Curve[] test_flat_crvs = crvA; // new Curve[count * 2];
    // Array.Copy(offset(curves, radA - 0.1, out _, tol), test_flat_crvs, count);
    // Array.Copy(crvA, 0, test_flat_crvs, count, count);

    bool flat_srf = test_flat(test_flat_crvs, brep_half, Z_up, tol, out _);


    // ------- main loop ------- //

    //List<Curve> test_crvs = crvD.Concat(crvC).Concat(crvB).Concat(crvA).ToList();

    BlendContinuity curvature = BlendContinuity.Curvature;
    LoftType straight_loft = LoftType.Straight;

    for (int i = 0; i < count; i++)
    {
      bool straight = crvA[i].IsLinear(0.01);

      Curve[] edges_A = new Curve[sectors];
      Curve[] edges_B = new Curve[sectors];

      for (int j = 0; j < sectors; j++)
      {
        Point3d pB = crvB[i].PointAtNormalizedLength(ts[j]);
        Point3d pC = crvC[i].PointAtNormalizedLength(ts[j]); // new Point3d(pB.X, pB.Y, inside_z);
        Curve lnA = new LineCurve(pB, pC);
        bool straight_check = !straight || (straight && (j == 0 || j == sectors - 1));

        if (!A_sharp && straight_check && !A_chamfer)
        {
          Point3d pA = crvA[i].PointAtNormalizedLength(ts[j]);
          Vector3d vec = new Vector3d(pA - pB) { Z = 0 };

          if (flat_srf)
          {
            Curve top_ln = new LineCurve(pA + vec, pA);
            edges_A[j] = Curve.CreateBlendCurve(top_ln, lnA, curvature, bulges[0], bulges[0]);
          }
          else
          {
            Plane frame = new Plane(pA, Z_up, vec);
            Transform frame_trans = Transform.PlaneToPlane(pln, frame);

            cutter.Transform(Transform.PlaneToPlane(pln, frame));
            Intersection.BrepSurface(brep_half, cutter, tol, out Curve[] int_crvs, out _);
            cutter.Transform(Transform.PlaneToPlane(frame, pln));

            Curve cx_crv = (int_crvs.Length > 1) ? Curve.JoinCurves(int_crvs, tol, false)[0] : int_crvs[0];
            if (pA.DistanceToSquared(cx_crv.PointAtStart) < 0.001) cx_crv.Reverse();
            edges_A[j] = Curve.CreateBlendCurve(cx_crv, lnA, curvature, bulges[0], bulges[0]);
          }
        }

        if (!B_sharp && straight_check && !B_chamfer)
        {
          Point3d pD = crvD[i].PointAtNormalizedLength(ts[j]);
          Vector3d vec = new Vector3d(pD - pB) { Z = 0 };
          Curve lnB = new LineCurve(new Line(pD, vec, 1));
          edges_B[j] = Curve.CreateBlendCurve(lnA, lnB, curvature, bulges[1], bulges[1]);
        }
      }


      if (!A_sharp)
      {
        if (straight) final_breps[i] = (A_chamfer)
            ? Brep.CreateFromLoft(new[] { crvA[i], crvB[i] }, pu, pu, straight_loft, false)[0]
            : Brep.CreateFromLoft(new[] { edges_A[0], edges_A[sectors - 1] }, pu, pu, straight_loft, false)[0];
        else final_breps[i] = (A_chamfer)
          ? Brep.CreateFromLoft(new[] { crvA[i], crvB[i] }, pu, pu, straight_loft, false)[0]
          : edge_srf(crvA[i], crvB[i], edges_A, cross_numA);
      }

      if (!B_sharp)
      {
        if (straight) final_breps[(count * 2) + i] = (B_chamfer)
            ? Brep.CreateFromLoft(new[] { crvC[i], crvD[i] }, pu, pu, straight_loft, false)[0]
            : Brep.CreateFromLoft(new[] { edges_B[0], edges_B[sectors - 1] }, pu, pu, straight_loft, false)[0];
        else final_breps[(count * 2) + i] = (B_chamfer)
          ? Brep.CreateFromLoft(new[] { crvC[i], crvD[i] }, pu, pu, straight_loft, false)[0]
          : edge_srf(crvC[i], crvD[i], edges_B, cross_numB);
      }

      final_breps[count + i] = Brep.CreateFromLoft(new[] { crvB[i], crvC[i] }, pu, pu, straight_loft, false)[0];
    }

    // ------- Re-Assemble parts ------- //

    final_breps[count * 3] = Brep.CreatePlanarBreps(crvD, 0.001)[0];

    BoundingBox target_bb = bb_union(crvA);
    target_bb.Inflate(0.1);

    List<Brep> pieces = brep_half.Split(crvA, tol).Where(b => !boxboxinside2D(target_bb, b.GetBoundingBox(true))).ToList();
    pieces.AddRange(final_breps);

    Brep final_brep = Brep.JoinBreps(pieces, 0.001, 0.1)[0]; // new Brep(); //  brep; //

    final_plane = new Plane(final_plane.Origin, -final_plane.XAxis, -final_plane.YAxis);

    if (remirror)
    {
      final_brep.Transform(mirror);
      brep.Transform(mirror);
      final_plane.Transform(mirror);
      TransformGeos(final_crvs, mirror);
    }

    if (final_brep.SolidOrientation == BrepSolidOrientation.Inward) final_brep.Flip();

    pl = final_plane; // Plane.WorldXY; //
    crvs = final_crvs; // new[] { new LineCurve(Point3d.Origin, new Point3d(0, 0, 1)) }; // crvA.Concat(crvB).Concat(crvC).Concat(crvD).ToArray(); //  crvD; //

    return final_brep; // new Brep(); //
    
    
  }
  
  private Brep volcano_from_brep(Curve[] curves, Brep brep, double extrude, double inset, double[] radii, double[] bulges, int sectors, double tol, out Plane pl, out Curve[] crvs)
  {
    Point3d pu = Point3d.Unset;
    double gap = 1.0 / (sectors - 1.0);
    Plane pln = Plane.WorldXY;
    Vector3d Z_up = Vector3d.ZAxis;
    int count = curves.Length;

    bool A_sharp = radii[0] == 0;
    bool B_sharp = radii[1] == 0;

    double radA = radii[0]; // Fillet Radius at Brep
    double radB = radii[1]; // Fillet Radius at Curve

    bool A_chamfer = bulges[0] == 0;
    bool B_chamfer = bulges[1] == 0;

    int cross_numA = A_chamfer ? 2 : 4;
    int cross_numB = B_chamfer ? 2 : 4;

    bool remirror = brep.GetBoundingBox(true).Center.Z < 0;  // Put Brep above Plane.XY
    Transform mirror = Transform.Mirror(pln);
    if (remirror) brep.Transform(mirror);

    if (extrude == 0) { pl = pln; crvs = curves; return brep; }



    // ------- Setup Curves ------- //

    double hyp = Math.Sqrt((inset * inset) + (extrude * extrude));
    double ratioA = A_sharp ? 0 : radA / hyp;
    double ratioB = B_sharp ? 1 : (hyp - radB) / hyp;

    double[] insets = { radA, -(ratioA * inset), -(ratioB * inset), -inset - radB };  // on the XY plane
    double[] offsets = { 0, (ratioA * extrude), (ratioB * extrude), (extrude) };  // in the Z-Axis


    Curve[] crvA = offset(curves, insets[0], out _, tol);

    // ------- Separate BrepFaces ------- //

    Brep[] final_breps = new Brep[count * 3 + 3];
    separate_brepfaces(brep, crvA, Z_up, out Brep brep_half, out Brep brep_out);
    final_breps[count * 3 + 1] = brep_out;

    double len = 0.2;
    Surface cutter = planar_srf(len, len);
    cutter.Transform(Transform.Translation(0, len * 0.5, 0));

    double[] ts = Enumerable.Range(0, sectors).Select(x => x * gap).ToArray();


    // ------- Setup Curves ------- //

    crvA = crvA.Select(c => project_closest(c, brep_half, Z_up, tol)).ToArray();


    Curve[] crvB = offset(curves, insets[1], out _, tol);
    Curve[] crvC = offset(curves, insets[2], out _, tol);
    Curve[] crvD = offset(curves, insets[3], out _, tol);

    Curve[] final_crvs = offset(curves, -inset, out _, tol);


    Point3d central_pt = project_point(Point3d.Origin, brep, Z_up);
    Plane A_plane = pln;
    A_plane.Origin = central_pt;

    Plane B_plane = A_plane;
    Plane C_plane = A_plane;
    Plane D_plane = A_plane;
    Plane final_plane = A_plane;


    A_plane.Transform(Transform.Translation(0, 0, offsets[0]));
    B_plane.Transform(Transform.Translation(0, 0, offsets[1]));
    C_plane.Transform(Transform.Translation(0, 0, offsets[2]));
    D_plane.Transform(Transform.Translation(0, 0, offsets[3]));

    TransformGeos(crvB, Transform.Scale(B_plane, 1, 1, 0));
    TransformGeos(crvC, Transform.Scale(C_plane, 1, 1, 0));
    TransformGeos(crvD, Transform.Scale(D_plane, 1, 1, 0));
    TransformGeos(final_crvs, Transform.Scale(D_plane, 1, 1, 0)); 



    // ------- Create test to see if surface is flat.  If so, a more simple construction can be used ------- //

    Curve[] test_flat_crvs = crvA; // new Curve[count * 2];
    // Array.Copy(offset(curves, radA - 0.1, out _, tol), test_flat_crvs, count);
    // Array.Copy(crvA, 0, test_flat_crvs, count, count);

    bool flat_srf = test_flat(test_flat_crvs, brep_half, Z_up, tol, out _);


    // ------- main loop ------- //

    //List<Curve> test_crvs = crvD.Concat(crvC).Concat(crvB).Concat(crvA).ToList();

    BlendContinuity curvature = BlendContinuity.Curvature;
    LoftType straight_loft = LoftType.Straight;

    for (int i = 0; i < count; i++)
    {
      bool straight = crvA[i].IsLinear(0.01);

      Curve[] edges_A = new Curve[sectors];
      Curve[] edges_B = new Curve[sectors];

      for (int j = 0; j < sectors; j++)
      {
        Point3d pB = crvB[i].PointAtNormalizedLength(ts[j]);
        Point3d pC = crvC[i].PointAtNormalizedLength(ts[j]); // new Point3d(pB.X, pB.Y, inside_z);
        Curve lnA = new LineCurve(pB, pC);
        bool straight_check = !straight || (straight && (j == 0 || j == sectors - 1));

        if (!A_sharp && straight_check && !A_chamfer)
        {
          Point3d pA = crvA[i].PointAtNormalizedLength(ts[j]);
          Vector3d vec = new Vector3d(pA - pB) { Z = 0 };

          if (flat_srf)
          {
            Curve top_ln = new LineCurve(pA + vec, pA);
            edges_A[j] = Curve.CreateBlendCurve(top_ln, lnA, curvature, bulges[0], bulges[0]);
          }
          else
          {
            Plane frame = new Plane(pA, Z_up, vec);
            Transform frame_trans = Transform.PlaneToPlane(pln, frame);

            cutter.Transform(Transform.PlaneToPlane(pln, frame));
            Intersection.BrepSurface(brep_half, cutter, tol, out Curve[] int_crvs, out _);
            cutter.Transform(Transform.PlaneToPlane(frame, pln));

            Curve cx_crv = (int_crvs.Length > 1) ? Curve.JoinCurves(int_crvs, tol, false)[0] : int_crvs[0];
            if (pA.DistanceToSquared(cx_crv.PointAtStart) < 0.001) cx_crv.Reverse();
            edges_A[j] = Curve.CreateBlendCurve(cx_crv, lnA, curvature, bulges[0], bulges[0]);
          }
        }

        if (!B_sharp && straight_check && !B_chamfer)
        {
          Point3d pD = crvD[i].PointAtNormalizedLength(ts[j]);
          Vector3d vec = new Vector3d(pD - pB) { Z = 0 };
          Curve lnB = new LineCurve(new Line(pD, vec, 1));
          edges_B[j] = Curve.CreateBlendCurve(lnA, lnB, curvature, bulges[1], bulges[1]);
        }
      }


      if (!A_sharp)
      {
        if (straight) final_breps[i] = (A_chamfer)
            ? Brep.CreateFromLoft(new[] { crvA[i], crvB[i] }, pu, pu, straight_loft, false)[0]
            : Brep.CreateFromLoft(new[] { edges_A[0], edges_A[sectors - 1] }, pu, pu, straight_loft, false)[0];
        else final_breps[i] = (A_chamfer)
          ? Brep.CreateFromLoft(new[] { crvA[i], crvB[i] }, pu, pu, straight_loft, false)[0]
          : edge_srf(crvA[i], crvB[i], edges_A, cross_numA);
      }

      if (!B_sharp)
      {
        if (straight) final_breps[(count * 2) + i] = (B_chamfer)
            ? Brep.CreateFromLoft(new[] { crvC[i], crvD[i] }, pu, pu, straight_loft, false)[0]
            : Brep.CreateFromLoft(new[] { edges_B[0], edges_B[sectors - 1] }, pu, pu, straight_loft, false)[0];
        else final_breps[(count * 2) + i] = (B_chamfer)
          ? Brep.CreateFromLoft(new[] { crvC[i], crvD[i] }, pu, pu, straight_loft, false)[0]
          : edge_srf(crvC[i], crvD[i], edges_B, cross_numB);
      }

      final_breps[count + i] = Brep.CreateFromLoft(new[] { crvB[i], crvC[i] }, pu, pu, straight_loft, false)[0];
    }

    // ------- Re-Assemble parts ------- //

    final_breps[count * 3] = Brep.CreatePlanarBreps(crvD, 0.001)[0];

    BoundingBox target_bb = bb_union(crvA);
    target_bb.Inflate(0.1);

    List<Brep> pieces = brep_half.Split(crvA, tol).Where(b => !boxboxinside2D(target_bb, b.GetBoundingBox(true))).ToList();
    pieces.AddRange(final_breps);

    Brep final_brep = Brep.JoinBreps(pieces, 0.001, 0.1)[0]; // new Brep(); //  brep; //

    final_plane = new Plane(final_plane.Origin, -final_plane.XAxis, -final_plane.YAxis);

    if (remirror)
    {
      final_brep.Transform(mirror);
      brep.Transform(mirror);
      final_plane.Transform(mirror);
      TransformGeos(final_crvs, mirror);
    }

    if (final_brep.SolidOrientation == BrepSolidOrientation.Inward) final_brep.Flip();

    pl = final_plane; // Plane.WorldXY; //
    crvs = final_crvs; // new[] { new LineCurve(Point3d.Origin, new Point3d(0, 0, 1)) }; // crvA.Concat(crvB).Concat(crvC).Concat(crvD).ToArray(); //  crvD; //

    return final_brep; // new Brep(); //
    
    
  }
  
  private Brep square_volcano(Curve[] curves, Brep brep, double extrude, double[] radii, double[] bulges, int sectors, double tol, out Plane pl, out Curve[] crvs)
        {
          Point3d pu = Point3d.Unset;
          double gap = 1.0 / (sectors - 1.0);
          Plane pln = Plane.WorldXY;
          Vector3d Z_up = Vector3d.ZAxis;
          int count = curves.Length;

          bool top_sharp = radii[0] == 0;
          bool bot_sharp = radii[1] == 0;

          bool top_chamfer = bulges[0] == 0;
          bool bot_chamfer = bulges[1] == 0;

          int cross_numA = top_chamfer ? 2 : 4;
          int cross_numB = bot_chamfer ? 2 : 4;

          bool remirror = brep.GetBoundingBox(true).Center.Z < 0;  // Put Brep above Plane.XY
          Transform mirror = Transform.Mirror(pln);
          if (remirror) brep.Transform(mirror);

          if (extrude == 0) { pl = pln; crvs = curves; return brep; }
          double flip = (extrude < 0) ? -1 : 1;


          // ------- Setup Curves ------- //

          double radA = radii[0];
          double radB = -radii[1];

          Curve[] crvA = (top_sharp)
          ? curves.Select(c => c.DuplicateCurve()).ToArray()
          : offset(curves, radA, out _, tol);


          // ------- Separate BrepFaces ------- //

          Brep[] final_breps = new Brep[count * 3 + 3];
          separate_brepfaces(brep, crvA, Z_up, out Brep brep_half, out Brep brep_out);
          final_breps[count * 3 + 1] = brep_out;

          double len = 0.2;
          Surface cutter = planar_srf(len, len);
          cutter.Transform(Transform.Translation(0, len * 0.5, 0));

          double[] ts = Enumerable.Range(0, sectors).Select(x => x * gap).ToArray();


          // ------- Setup Curves ------- //

          Curve[] crvB = curves.Select(c => c.DuplicateCurve()).ToArray();

          Curve[] crvD = (bot_sharp)
            ? curves.Select(c => c.DuplicateCurve()).ToArray()
            : offset(curves, radB, out _, tol);

          crvA = crvA.Select(c => project_closest(c, brep_half, Z_up, tol)).ToArray();
          crvB = (top_sharp)
            ? crvA.Select(c => c.DuplicateCurve()).ToArray()
            : crvB.Select(c => project_closest(c, brep_half, Z_up, tol)).ToArray();

          sort_crvs(pln, crvA, crvB);
          sort_crvs(pln, crvA, crvD);
          Curve[] crvC = crvB.Select(c => c.DuplicateCurve()).ToArray();
          Curve[] final_crvs = crvB.Select(c => c.DuplicateCurve()).ToArray();

          Plane base_plane = pln;
          Plane inside_plane = pln;
          Point3d central_pt = project_point(Point3d.Origin, brep, Z_up);
          base_plane.Origin = central_pt;
          base_plane.Transform(Transform.Translation(0, 0, extrude));
          double z_move = base_plane.OriginZ;

          double inside_z = base_plane.OriginZ - (radii[1] * flip);
          inside_plane.OriginZ = inside_z;
          TransformGeos(crvB, Transform.Translation(0, 0, radii[0] * flip));
          TransformGeos(crvC, Transform.Scale(inside_plane, 1, 1, 0));
          TransformGeos(crvD, Transform.Scale(base_plane, 1, 1, 0));


          // ------- Create test to see if surface is flat.  If so, a more simple construction can be used ------- //

          Curve[] test_flat_crvs = new Curve[count * 2];
          Array.Copy(offset(curves, radA - 0.1, out _, tol), test_flat_crvs, count);
          Array.Copy(crvA, 0, test_flat_crvs, count, count);

          bool flat_srf = test_flat(test_flat_crvs, brep_half, Z_up, tol, out _);


          // ------- main loop ------- //

          //List<Curve> test_crvs = new List<Curve>();

          BlendContinuity curvature = BlendContinuity.Curvature;
          LoftType straight_loft = LoftType.Straight;

          for (int i = 0; i < count; i++)
          {
            bool straight = crvA[i].IsLinear(0.01);

            Curve[] edges_A = new Curve[sectors];
            Curve[] edges_B = new Curve[sectors];

            for (int j = 0; j < sectors; j++)
            {
              Point3d pB = crvB[i].PointAtNormalizedLength(ts[j]);
              Point3d pC = new Point3d(pB.X, pB.Y, inside_z);
              Curve lnA = new LineCurve(pB, pC);
              bool straight_check = !straight || (straight && (j == 0 || j == sectors - 1));

              if (!top_sharp && straight_check && !top_chamfer)
              {
                Point3d pA = crvA[i].PointAtNormalizedLength(ts[j]);
                Vector3d vec = new Vector3d(pA - pB) { Z = 0 };

                if (flat_srf)
                {
                  Curve top_ln = new LineCurve(pA + vec, pA);
                  edges_A[j] = Curve.CreateBlendCurve(top_ln, lnA, curvature, bulges[0], bulges[0]);
                }
                else
                {
                  Plane frame = new Plane(pA, Z_up, vec);
                  Transform frame_trans = Transform.PlaneToPlane(pln, frame);

                  cutter.Transform(Transform.PlaneToPlane(pln, frame));
                  Intersection.BrepSurface(brep_half, cutter, tol, out Curve[] int_crvs, out _);
                  cutter.Transform(Transform.PlaneToPlane(frame, pln));

                  Curve cx_crv = (int_crvs.Length > 1) ? Curve.JoinCurves(int_crvs, tol, false)[0] : int_crvs[0];
                  if (pA.DistanceToSquared(cx_crv.PointAtStart) < 0.001) cx_crv.Reverse();
                  edges_A[j] = Curve.CreateBlendCurve(cx_crv, lnA, curvature, bulges[0], bulges[0]);
                }
              }

              if (!bot_sharp && straight_check && !bot_chamfer)
              {
                Point3d pD = crvD[i].PointAtNormalizedLength(ts[j]);
                Vector3d vec = new Vector3d(pD - pB) { Z = 0 };
                Curve lnB = new LineCurve(new Line(pD, vec, 1));
                edges_B[j] = Curve.CreateBlendCurve(lnA, lnB, curvature, bulges[1], bulges[1]);
              }
            }

            if (!top_sharp)
            {
              if (straight) final_breps[i] = (top_chamfer)
                  ? Brep.CreateFromLoft(new[] { crvA[i], crvB[i] }, pu, pu, straight_loft, false)[0]
                  : Brep.CreateFromLoft(new[] { edges_A[0], edges_A[sectors - 1] }, pu, pu, straight_loft, false)[0];
              else final_breps[i] = (top_chamfer)
                ? Brep.CreateFromLoft(new[] { crvA[i], crvB[i] }, pu, pu, straight_loft, false)[0]
                : edge_srf(crvA[i], crvB[i], edges_A, cross_numA);
            }

            if (!bot_sharp)
            {
              if (straight) final_breps[(count * 2) + i] = (bot_chamfer)
                  ? Brep.CreateFromLoft(new[] { crvC[i], crvD[i] }, pu, pu, straight_loft, false)[0]
                  : Brep.CreateFromLoft(new[] { edges_B[0], edges_B[sectors - 1] }, pu, pu, straight_loft, false)[0];
              else final_breps[(count * 2) + i] = (bot_chamfer)
                ? Brep.CreateFromLoft(new[] { crvC[i], crvD[i] }, pu, pu, straight_loft, false)[0]
                : edge_srf(crvC[i], crvD[i], edges_B, cross_numB);
            }

            final_breps[count + i] = Brep.CreateFromLoft(new[] { crvB[i], crvC[i] }, pu, pu, straight_loft, false)[0];
          }

          // ------- Re-Assemble parts ------- //

          final_breps[count * 3] = Brep.CreatePlanarBreps(crvD, 0.001)[0];

          BoundingBox target_bb = bb_union(crvA);
          target_bb.Inflate(0.1);

          List<Brep> pieces = brep_half.Split(crvA, tol).Where(b => !boxboxinside2D(target_bb, b.GetBoundingBox(true))).ToList();

          pieces.AddRange(final_breps);

          Brep final_brep = Brep.JoinBreps(pieces, 0.001, 0.1)[0]; // new Brep(); //  brep; //

          base_plane = new Plane(base_plane.Origin, -base_plane.XAxis, -base_plane.YAxis);

          if (remirror)
          {
            final_brep.Transform(mirror);
            brep.Transform(mirror);
            base_plane.Transform(mirror);
            TransformGeos(final_crvs, mirror);
          }

          if (final_brep.SolidOrientation == BrepSolidOrientation.Inward) final_brep.Flip();

          pl = base_plane; // Plane.WorldXY; //
          crvs = final_crvs; // new[] { new LineCurve(Point3d.Origin, new Point3d(0, 0, 1)) }; // crvA.Concat(crvB).Concat(crvC).Concat(crvD).ToArray(); //  crvD; //

          return final_brep; // new Brep(); //
        }

  public void separate_brepfaces(Brep brep, Curve[] crvs, Vector3d direction, out Brep brep_in, out Brep brep_out) // !!! FIX !!!
  {
    double tol = 0.001;
    int count = crvs.Length;
    int face_count = brep.Faces.Count;

    bool should_orient = direction.EpsilonEquals(Vector3d.ZAxis, tol);
    Transform reorient = Transform.Unset;
    if (should_orient)
    {
      Plane pl = curves_plane(crvs);
      Transform orient = Transform.PlaneToPlane(pl, Plane.WorldXY);
      reorient = Transform.PlaneToPlane(Plane.WorldXY, pl);
      TransformGeos(crvs, orient);
      brep.Transform(orient);
    }

    int ptnum = 14;
    double pt_gap = 1.0 / ptnum;
    Point3d[] pts = new Point3d[count * ptnum];
    int counter = 0;
    for (int i = 0; i < count; i++)
    {
      crvs[i].Reparameterize();
      for (int j = 0; j < ptnum; j++)
      {
        // pts[counter++] = Intersection.RayShoot(new Ray3d(crvs[i].PointAt(pt_gap * (j + 0.5)), direction), new[] { brep }, 1)[0];
        pts[counter++] = project_point(crvs[i].PointAt(pt_gap * (j + 0.5)), brep, direction);
      }
    }

    HashSet<int> index_in = new HashSet<int>();
    for (int i = 0; i < pts.Length; i++)
    {
      brep.ClosestPoint(pts[i], out _, out ComponentIndex ci, out _, out _, tol, out _);
      if (ci.Index != -1) index_in.Add(ci.Index);
    }

    List<int> index_out = new List<int>();
    for (int i = 0; i < face_count; i++)
    {
      if (!index_in.Contains(i)) index_out.Add(i);  //index_outx[counter++] = i;
    }

    BoundingBox test_box = new BoundingBox(pts);
    test_box.Union(new Point3d(0, 0, -brep.GetBoundingBox(false).Min.Z - 10));
    test_box.Transform(Transform.Translation(0, 0, tol));
    for (int i = index_out.Count - 1; i >= 0; i--)
    {
      if (boxinside(test_box, brep.DuplicateSubBrep(new[] { index_out[i] }).GetBoundingBox(true)))
      {
        index_in.Add(index_out[i]);
        index_out.RemoveAt(i);
      }
    }

    if (should_orient) brep.Transform(reorient);

    brep_in = brep.DuplicateSubBrep(index_in);
    brep_out = brep.DuplicateSubBrep(index_out);
  }
  public static bool boxinside(BoundingBox outer, BoundingBox inner)
  {
    if (outer.Min.X > inner.Min.X) return false;
    if (outer.Max.X < inner.Max.X) return false;
    if (outer.Min.Y > inner.Min.Y) return false;
    if (outer.Max.Y < inner.Max.Y) return false;
    if (outer.Min.Z > inner.Min.Z) return false;
    if (outer.Max.Z < inner.Max.Z) return false;
    return true;
  }
public static NurbsSurface planar_srf(double x = 1, double y = 1)
  {
    x *= 0.5;
    y *= 0.5;

    return NurbsSurface.CreateFromCorners(
      new Point3d(-x, -y, 0),
      new Point3d(-x, y, 0),
      new Point3d(x, y, 0),
      new Point3d(x, -y, 0));
  }
public static Curve project_closest(Curve crv, Brep brep, Vector3d dir, double tol)  // Optimised
  {
    Interval interval = new Interval(0, 1);

    crv.Transform(Transform.Translation(-dir));
    Curve[] projected_curves = Curve.ProjectToBrep(crv, brep, dir, tol);
    Curve[] projected_joined = Curve.JoinCurves(projected_curves, tol, false);

    Point3d centre = crv.GetBoundingBox(true).Center;
    int closestIndex = 0;
    double minDistance = double.MaxValue;

    for (int i = 0; i < projected_joined.Length; i++)
    {
      projected_joined[i].Domain = interval;
      double distance = centre.DistanceToSquared(projected_joined[i].GetBoundingBox(true).Center);
      if (distance < minDistance)
      {
        minDistance = distance;
        closestIndex = i;
      }

    }
    return projected_joined[closestIndex];
  }
public Curve[] offset(Curve[] curves, double fillet, out Plane pln, double tol = 0.001)
  {
    int count = curves.Length;
    Plane plane = curves_plane(curves);
    pln = plane;
    if (fillet == 0)
    {
      Curve[] dups = new Curve[count];
      for (int i = 0; i < count; i++) dups[i] = curves[i].DuplicateCurve();
      return dups;
    }

    Curve[] off1 = new Curve[count];
    Curve[] off2 = new Curve[count];
    Point3d pt = plane.Origin;
    Vector3d normal = plane.Normal;
    CurveOffsetCornerStyle cs = CurveOffsetCornerStyle.Smooth;
    CurveOffsetEndStyle es = CurveOffsetEndStyle.None;

    for (int i = 0; i < count; i++)
    {
      bool offset_type = !curves[i].IsArc(0.1);
      off1[i] = Curve.JoinCurves(curves[i].Offset(pt, normal, fillet, tol, tol, offset_type, cs, es), tol, false)[0];
      off2[i] = Curve.JoinCurves(curves[i].Offset(pt, normal, -fillet, tol, tol, offset_type, cs, es), tol, false)[0];
    }

    double len1 = bb_union(off1).Diagonal.Length;
    double len2 = bb_union(off2).Diagonal.Length;

    if ((fillet > 0) == (len1 < len2)) return neaten_crvs(loop_crv(off2, fillet), curves);
    return square_crvs(loop_crv(off1, fillet));

    //return neaten_crvs(loop_crv(off2, fillet), curves);
    //return neaten_crvs(loop_crv(off1, fillet), curves);
  }
public Curve[] square_crvs(Curve[] crvs, double tol = 0.1)
  {
    int count = crvs.Length;
    for (int i = 0; i < count; i++) crvs[i] = square_crv(crvs[i]);
    return crvs;
  }
public static Plane curves_plane(Curve[] curves, double tol = 0.01)  // Optimized
  {
    int count = curves.Length;
    BoundingBox bb = bb_union(curves);

    if (bb.Max.Z - bb.Min.Z < 0.01) return new Plane(bb.Center, Vector3d.XAxis, Vector3d.YAxis); // XY Plane
    if (bb.Max.X - bb.Min.X < 0.01) return new Plane(bb.Center, Vector3d.YAxis, Vector3d.ZAxis); // ZY Plane
    if (bb.Max.Y - bb.Min.Y < 0.01) return new Plane(bb.Center, Vector3d.XAxis, Vector3d.ZAxis); // ZX Plane

    HashSet<Plane> uniquePlanes = new HashSet<Plane>();
    for (int i = 0; i < count; i++)
    {
      if (curves[i].TryGetPlane(out Plane pl, tol))
      {
        pl.Origin = bb.Center;
        uniquePlanes.Add(pl);
      }
    }
    return uniquePlanes.First();
  }
public static Curve[] loop_crv(Curve[] curves, double radius, double tol = 0.001)
  {
    if (Curve.JoinCurves(curves, tol, false)[0].IsClosed) return curves;

    int count = curves.Length;
    radius = Math.Abs(radius) * 2;

    //bool[] is_arc = new bool[count];
    Point3d[] startPoints = new Point3d[count];
    Point3d[] endPoints = new Point3d[count];
    double[] extendMin = new double[count];
    double[] extendMax = new double[count];

    for (int i = 0; i < count; i++)
    {
      //is_arc[i] = curves[i].IsArc(0.1);
      startPoints[i] = curves[i].PointAtStart;
      endPoints[i] = curves[i].PointAtEnd;
      extendMin[i] = curves[i].Domain.Min - radius;
      extendMax[i] = curves[i].Domain.Max + radius;
    }

    for (int i = 0; i < count; i++)
    {
      //if(is_arc[i]) continue;
      int last = (i + count - 1) % count;
      int next = (i + 1) % count;

      if (!startPoints[i].EpsilonEquals(endPoints[last], tol))
        curves[i] = curves[i].Extend(extendMin[i], curves[i].Domain.Max);
      if (!endPoints[i].EpsilonEquals(startPoints[next], tol))
        curves[i] = curves[i].Extend(curves[i].Domain.Min, extendMax[i]);
    }

    for (int i = 0; i < count; i++)
    {
      //if(is_arc[i]) continue;
      int last = (i + count - 1) % count;
      int next = (i + 1) % count;

      if (!startPoints[i].EpsilonEquals(endPoints[last], tol))
      {
        CurveIntersections cx = Intersection.CurveCurve(curves[i], curves[last], tol, tol);
        curves[i] = curves[i].Split(cx[0].ParameterA)[1];
        curves[last] = curves[last].Split(cx[0].ParameterB)[0];
      }
    }

    Interval interval = new Interval(0, 1);
    for (int i = 0; i < count; i++)
    {
      //if(is_arc[i]) continue;
      int degree = curves[i].Degree;
      Vector3d start = curves[i].TangentAtStart;
      Vector3d end = curves[i].TangentAtEnd;
      curves[i].Domain = interval;
      if (curves[i].CurvatureAt(0.5).SquareLength > 200 || curves[i].DuplicateSegments().Length > 1)
      {
        BoundingBox bb = curves[i].GetBoundingBox(true);

        int ptnum = (int)Math.Max(9, Math.Floor(curves[i].ToNurbsCurve().Points.Count * 1.0));
        Curve crv = curves[i].Rebuild(ptnum, degree, true);
        Point3d[] pts = crv.ToNurbsCurve().Points.Select(p => p.Location).ToArray();
        for (int j = 0; j < pts.Length; j++)
        {
          pts[j].X = Math.Max(bb.Min.X, Math.Min(bb.Max.X, pts[j].X));
          pts[j].Y = Math.Max(bb.Min.Y, Math.Min(bb.Max.Y, pts[j].Y));
          pts[j].Z = Math.Max(bb.Min.Z, Math.Min(bb.Max.Z, pts[j].Z));
        }
        curves[i] = Curve.CreateControlPointCurve(pts, degree); //NurbsCurve.Create(false, degree, pts);
      }
    }
    return curves;
  }
public Curve[] neaten_crvs(Curve[] crvs, Curve[] match_crvs, double tol = 0.1)
  {
    /// Designed for offset curves, where initial curves (match_crvs) are in a sorted loop, and the crvs also is a corresponding sorted loop
    /// Will also work for a single loop of curves that is not necessarily offset.  Just set match_crvs to 'null'.

    int count = crvs.Length;
    Interval interval = new Interval(0, 1);

    bool[] end_curvature_matches = new bool[count];
    bool[] is_linear = new bool[count];
    Vector3d[] end_tan = new Vector3d[count];
    Vector3d[] vecs = { Vector3d.XAxis, -Vector3d.XAxis, Vector3d.YAxis, -Vector3d.YAxis, Vector3d.ZAxis, -Vector3d.ZAxis };

    if (match_crvs.Length == count)
    {
      for (int i = 0; i < count; i++)
      {
        crvs[i].Domain = interval;
        match_crvs[i].Domain = interval;
        is_linear[i] = match_crvs[i].IsLinear(tol);
        end_tan[i] = match_crvs[i].TangentAtEnd;
        for (int j = 0; j < 6; j++) if (end_tan[i].EpsilonEquals(vecs[j], tol)) end_tan[i] = vecs[j];
      }

      for (int i = 0; i < count; i++)
      {
        int last = (i - 1 + count) % count;
        end_curvature_matches[i] = match_crvs[i].CurvatureAt(0).EpsilonEquals(match_crvs[last].CurvatureAt(1), 0.1) && match_crvs[i].TangentAtStart.EpsilonEquals(end_tan[last], 0.1);
      }
    }
    else
    {
      for (int i = 0; i < count; i++)
      {
        crvs[i].Domain = interval;
        is_linear[i] = crvs[i].IsLinear(tol);
        end_tan[i] = crvs[i].TangentAtEnd;
        for (int j = 0; j < 6; j++) if (end_tan[i].EpsilonEquals(vecs[j], tol)) end_tan[i] = vecs[j];
      }

      for (int i = 0; i < count; i++)
      {
        int last = (i - 1 + count) % count;
        end_curvature_matches[i] = crvs[i].CurvatureAt(0).EpsilonEquals(crvs[last].CurvatureAt(1), 0.1) && crvs[i].TangentAtStart.EpsilonEquals(end_tan[last], 0.1);
      }
    }


    // string test_vecs = "";
    // for (int i = 0; i < count; i++) test_vecs += is_linear[i].ToString() + ", " + crvs[i].ToNurbsCurve().Points.Count.ToString() +"|  " ;
    // Print(test_vecs);

    for (int i = 0; i < count; i++)
    {
      if (is_linear[i] || !end_curvature_matches[i] || crvs[i].IsArc(0.1)) continue;


      NurbsCurve curve = crvs[i].ToNurbsCurve();
      int ptnum = curve.Points.Count;
      //Print(ptnum.ToString());

      Point3d[] pts = curve.Points.Select(p => p.Location).ToArray();
      int degree = curve.Degree;
      if (ptnum < 6) continue;

      // ------- Square ends if not square

      Vector3d tan = end_tan[(i - 1 + count) % count];
      tan.Unitize();
      pts[1] = new Point3d(pts[0] + (tan * pts[0].DistanceTo(pts[1])));
      pts[2] = new Point3d(pts[0] + (tan * pts[0].DistanceTo(pts[2])));

      if (is_linear[(i + 1) % count])
      {
        tan = -end_tan[i];
        tan.Unitize();
        pts[ptnum - 2] = new Point3d(pts[ptnum - 1] + (tan * pts[ptnum - 1].DistanceTo(pts[ptnum - 2])));
        pts[ptnum - 3] = new Point3d(pts[ptnum - 1] + (tan * pts[ptnum - 1].DistanceTo(pts[ptnum - 3])));
      }

      crvs[i] = NurbsCurve.Create(false, degree, pts);
    }
    return crvs;
  }
public static void sort_crvs(Plane plane, Curve[] curvesA, Curve[] curvesB, double tol = 0.001)
  {
    int count = curvesA.Length;
    Transform flatten = Transform.Scale(plane, 1, 1, 0);
    Curve[] cA = curvesA.Select(c => c.DuplicateCurve()).ToArray();
    Curve[] cB = curvesB.Select(c => c.DuplicateCurve()).ToArray();

    TransformGeos(cA, flatten);
    TransformGeos(cB, flatten);

    int[] sortA = sort_index(cA, out bool[] flipA);

    bool flip = set_first_curve(cA[0], ref cB);

    int[] sortB = sort_index(cB, out bool[] flipB);
    flipB[0] = flip;

    Array.Sort(sortA, curvesA);
    Array.Sort(sortB, curvesB);
    Array.Sort(sortA, flipA);
    Array.Sort(sortB, flipB);

    for (int i = 0; i < count; i++)
    {
      if (flipA[i]) curvesA[i].Reverse();
      if (flipB[i]) curvesB[i].Reverse();
    }
  }
public static int[] sort_index(Curve[] curves, out bool[] flip, double tol = 0.01)
  {
    int count = curves.Length;

    int[] idx = new int[count];
    bool[] flip_bool = new bool[count]; // defaults to 'false' so no need to add assign anything other than 'true'

    List<Curve> crvs = new ArraySegment<Curve>(curves, 1, count - 1).ToList();
    List<int> idx_list = Enumerable.Range(1, count - 1).ToList();

    for (int i = 0; i < count - 1; i++)
    {
      Point3d end = curves[i].PointAtEnd;
      for (int j = 0; j < crvs.Count; j++)
      {
        if (end.EpsilonEquals(crvs[j].PointAtStart, tol))
        {
          curves[i + 1] = crvs[j];
          crvs.RemoveAt(j);
          idx[i + 1] = idx_list[j];
          idx_list.RemoveAt(j);
          break;
        }
        else if (end.EpsilonEquals(crvs[j].PointAtEnd, tol))
        {
          flip_bool[i + 1] = true;
          crvs[j].Reverse();
          curves[i + 1] = crvs[j];
          crvs.RemoveAt(j);
          idx[i + 1] = idx_list[j];
          idx_list.RemoveAt(j);
          break;
        }
      }
    }
    flip = flip_bool;
    return idx;
  }
public static bool set_first_curve(Curve crv, ref Curve[] curve_list, double tol = 0.001)
  {
    bool flip = false;

    int count = curve_list.Length;
    Interval interval = new Interval(0, 1);
    double inset = 0.3;

    crv.Domain = interval;
    Point3d ptA = crv.PointAt(inset);
    Point3d ptB = crv.PointAt(1 - inset);

    double minDistance = double.MaxValue;
    int start = 0;

    for (int i = 0; i < count; i++)
    {
      curve_list[i].Domain = interval;
      Point3d pt0 = curve_list[i].PointAt(inset);
      Point3d pt1 = curve_list[i].PointAt(1 - inset);

      double distance = Math.Min(ptA.DistanceToSquared(pt0), ptA.DistanceToSquared(pt1)) + Math.Min(ptB.DistanceToSquared(pt0), ptB.DistanceToSquared(pt1));

      if (distance < minDistance)
      {
        minDistance = distance;
        start = i;
      }
    }

    if (start > 0)
    {
      Curve[] sorted = new Curve[count];
      Array.Copy(curve_list, start, sorted, 0, count - start);
      Array.Copy(curve_list, 0, sorted, count - start, start);
      curve_list = sorted;
    }

    if (ptA.DistanceToSquared(curve_list[0].PointAt(inset)) > ptA.DistanceToSquared(curve_list[0].PointAt(1 - inset)))
    {
      curve_list[0].Reverse();
      flip = true;
    }
    return flip;
  }
public static Point3d project_point(Point3d pt, Brep brep, Vector3d direction) // Optimised
  {
    pt = new Point3d(pt - direction);
    Point3d[] pts = Intersection.RayShoot(new Ray3d(pt, direction), new[] { brep }, 2);
    if (pts.Length == 1) return pts[0];
    if (pts.Length == 2)
    {
      double dist1 = pt.DistanceToSquared(pts[0]);
      double dist2 = pt.DistanceToSquared(pts[1]);
      return dist1 < dist2 ? pts[0] : pts[1];
    }
    if (pts.Length > 2)
    {
      double[] distances = pts.Select(p => pt.DistanceToSquared(p)).ToArray();
      return pts[Array.IndexOf(distances, distances.Min())];
    }
    return Point3d.Unset;
  }
public static bool test_flat(Curve[] crvs, Brep brep, Vector3d direction, double tol, out Point3d[] test_pts)
  {
    int count = crvs.Length;
    Interval interval = new Interval(0, 1);

    Point3d[] pts = new Point3d[count * 3];
    for (int i = 0; i < count; i++)
    {
      crvs[i].Domain = interval;
      pts[i] = project_point(crvs[i].PointAt(0.15), brep, direction);
      pts[count + i] = project_point(crvs[i].PointAt(0.5), brep, direction);
      pts[(count * 2) + i] = project_point(crvs[i].PointAt(0.85), brep, direction);
    }

    test_pts = pts;
    Plane.FitPlaneToPoints(pts, out _, out double amount);
    return amount < tol;
  }
public Brep edge_srf(Curve top, Curve bottom, Curve[] edge_curves, int num, bool loop = false, double tol = 0.001)
  {
    if (num < 3 || edge_curves == null)
    {
      return Brep.CreateFromLoft(new[] { top, bottom }, Point3d.Unset, Point3d.Unset, LoftType.Straight, false)[0];
    }
    double ang_tol = 0.1;
    double cos_tol = Math.Cos(ang_tol);

    Vector3d[] axes = new Vector3d[] { Vector3d.XAxis, -Vector3d.XAxis, Vector3d.YAxis, -Vector3d.YAxis, Vector3d.ZAxis, -Vector3d.ZAxis };

    Vector3d start = top.TangentAtStart; // Already Unitized Vector
    Vector3d end = top.TangentAtEnd;
    for (int i = 0; i < 6; i++)
    {
      if (start * axes[i] > cos_tol) { start = axes[i]; break; }
    }
    for (int i = 0; i < 6; i++)
    {
      if (end * axes[i] > cos_tol) { end = axes[i]; break; }
    }

    int count = edge_curves.Length;
    double gap = 1 / (num - 1.0);

    Curve[] curves = new Curve[num];

    if (edge_curves[0].PointAtStart.EpsilonEquals(top.PointAtStart, 0.01) ||
      edge_curves[0].PointAtStart.EpsilonEquals(top.PointAtEnd, 0.01))
    {
      curves[0] = top;
      curves[num - 1] = bottom;
    }
    else { curves[0] = bottom; curves[num - 1] = top; }

    int pt_num = loop ? count + 1 : count;
    Point3d[] edge_mid_pts = new Point3d[pt_num];

    for (int i = 1; i < num - 1; i++)
    {
      double gap_size = gap * i;
      for (int j = 0; j < count; j++) edge_mid_pts[j] = edge_curves[j].PointAtNormalizedLength(gap_size);
      if (loop) edge_mid_pts[count] = edge_mid_pts[0];

      Curve edge_mid = Curve.CreateInterpolatedCurve(edge_mid_pts, 3, CurveKnotStyle.Uniform, start, end);
      if (edge_mid.IsCircle(0.01)) edge_mid = new ArcCurve(new Circle(edge_mid_pts[0], edge_mid_pts[1], edge_mid_pts[2])); //circle_check(edge_mid, edge_mid_pts);
      else edge_mid = square_crv(edge_mid);
      curves[i] = edge_mid;
    }

    if (top.IsClosed) Array.Resize(ref edge_curves, edge_curves.Length - 1);

    NurbsSurface surface = NurbsSurface.CreateNetworkSurface(curves, 3, 3, edge_curves, 3, 3, tol, tol, tol, out _);
    if (surface == null) surface = NurbsSurface.CreateNetworkSurface(new[] { top, bottom }, 3, 3, edge_curves, 3, 3, tol, tol, tol, out _);

    return surface.ToBrep(); // new Brep(); //

  }  // optimized
public Curve square_crv(Curve crv, double tol = 0.1)
  {
    if (crv.IsLinear(0.01) || crv.IsArc(0.1)) return crv;

    NurbsCurve curve = crv.ToNurbsCurve();
    Point3d[] pts = curve.Points.Select(p => p.Location).ToArray();
    int count = pts.Length;
    if (curve.Points.Count < 6) return crv;

    Vector3d[] vecs = { Vector3d.XAxis, -Vector3d.XAxis, Vector3d.YAxis, -Vector3d.YAxis, Vector3d.ZAxis, -Vector3d.ZAxis };
    Vector3d start_vec = curve.TangentAtStart;
    Vector3d end_vec = curve.TangentAtEnd;

    bool start_found = false;
    bool end_found = false;

    for (int j = 0; j < 6; j++)
    {
      if (!start_found && start_vec.EpsilonEquals(vecs[j], tol))
      {
        if (vecs[j].X == 0) pts[1].X = pts[2].X = pts[0].X;
        if (vecs[j].Y == 0) pts[1].Y = pts[2].Y = pts[0].Y;
        if (vecs[j].Z == 0) pts[1].Z = pts[2].Z = pts[0].Z;
        start_found = true;
      }

      if (!end_found && end_vec.EpsilonEquals(vecs[j], tol))
      {
        if (vecs[j].X == 0) pts[count - 2].X = pts[count - 3].X = pts[count - 1].X;
        if (vecs[j].Y == 0) pts[count - 2].Y = pts[count - 3].Y = pts[count - 1].Y;
        if (vecs[j].Z == 0) pts[count - 2].Z = pts[count - 3].Z = pts[count - 1].Z;
        end_found = true;
      }
      if (start_found && end_found) break;
    }
    return Curve.CreateControlPointCurve(pts, curve.Degree);
  }
public static bool boxboxinside2D(BoundingBox a, BoundingBox b)
  {
    if (a.Max.X < b.Max.X) return false;
    if (a.Min.X > b.Min.X) return false;
    if (a.Max.Y < b.Max.Y) return false;
    if (a.Min.Y > b.Min.Y) return false;

    return true;
  }
public static BoundingBox bb_union(GeometryBase[] geos, double inflate = 0)
  {
    BoundingBox bb = BoundingBox.Empty;
    for (int i = 0; i < geos.Length; i++) bb.Union(geos[i].GetBoundingBox(true));
    if (inflate != 0) bb.Inflate(inflate);
    return bb;
  }
public static void TransformGeos<T>(IList<T> geos, Transform transform) where T : GeometryBase
  {
    for (int i = 0; i < geos.Count; i++) geos[i].Transform(transform);
  }
public bool no_input(string name) => Component.Params.Input[Component.Params.IndexOfInputParam(name)].SourceCount == 0;

  // public void separate_brepfaces(Brep brep, Curve[] crvs, Vector3d direction, out Brep brep_in, out Brep brep_out)
  // {
  //   double tol = 0.001;
  //   int count = crvs.Length;
  //   Interval interval = new Interval(0, 1);
  //   Point3d[] pts = new Point3d[count * 3];
  //   for (int i = 0; i < count; i++)
  //   {
  //     crvs[i].Domain = interval;
  //     pts[i] = project_point(crvs[i].PointAt(0.15), brep, direction);
  //     pts[count + i] = project_point(crvs[i].PointAt(0.5), brep, direction);
  //     pts[(count * 2) + i] = project_point(crvs[i].PointAt(0.85), brep, direction);
  //   }

  //   HashSet<int> index_in = new HashSet<int>();
  //   for (int i = 0; i < count * 3; i++)
  //   {
  //     brep.ClosestPoint(pts[i], out _, out ComponentIndex ci, out _, out _, tol, out _);
  //     index_in.Add(ci.Index);
  //   }
  //   int[] index_out = new int[brep.Faces.Count - index_in.Count];
  //   int counter = 0;
  //   for (int i = 0; i < brep.Faces.Count; i++)
  //   {
  //     if (!index_in.Contains(i))
  //     {
  //       index_out[counter] = i;
  //       counter++;
  //     }
  //   }

  //   brep_in = brep.DuplicateSubBrep(index_in);
  //   brep_out = brep.DuplicateSubBrep(index_out);
  // }
  // public Brep edge_srf(Curve bottom, Curve[] edge_curves, int num, out Curve top, bool loop = false, double tol = 0.001)
  // {
  //   if (num < 3)
  //   {
  //     top =null;
  //     return null;
  //   }
  //   Vector3d start = bottom.TangentAtStart;
  //   Vector3d end = bottom.TangentAtEnd;

  //   int count = edge_curves.Length;
  //   double gap = 1 / (num - 1.0);
  //   Curve[] u_crvs = new Curve[num];

  //   int start_idx = 0;
  //   int end_idx = num;
  //   bool match = (edge_curves[0].PointAtEnd.EpsilonEquals(bottom.PointAtStart, 0.01) || edge_curves[0].PointAtEnd.EpsilonEquals(bottom.PointAtEnd, 0.01));
  //   if (match) u_crvs[--end_idx] = bottom;
  //   else u_crvs[start_idx++] = bottom;

  //   int pt_num = (loop) ? count + 1 : count;
  //   Point3d[] edge_mid_pts = new Point3d[pt_num];

  //   for (int i = start_idx; i < end_idx; i++)
  //   {
  //     double gap_size = gap * i;
  //     for (int j = 0; j < count; j++) edge_mid_pts[j] = edge_curves[j].PointAtNormalizedLength(gap_size);
  //     if (loop) edge_mid_pts[count] = edge_mid_pts[0];

  //     Curve edge_mid = Curve.CreateInterpolatedCurve(edge_mid_pts, 3, CurveKnotStyle.Uniform, start, end);
  //     if (edge_mid.IsCircle(0.01)) edge_mid = new ArcCurve(new Circle(edge_mid_pts[0], edge_mid_pts[1], edge_mid_pts[2])); //circle_check(edge_mid, edge_mid_pts);
  //     else edge_mid = square_crv(edge_mid);
  //     u_crvs[i] = edge_mid;
  //   }

  //   int crv_num = bottom.IsClosed ? count - 1 : count;
  //   Curve[] v = new Curve[crv_num];
  //   Array.Copy(edge_curves, v, crv_num);
  //   top = match ? u_crvs[0] : u_crvs[u_crvs.Length - 1];
  //   return NurbsSurface.CreateNetworkSurface(u_crvs, 3, 3, v, 3, 3, tol, tol, tol, out _).ToBrep();
  // }  // optimized

  // public Brep edge_srf(Curve top, Curve bottom, Curve[] edge_curves, int num, bool loop = false, double tol = 0.001)
  // {
  //   if (num < 3) return Brep.CreateFromLoft(new[] { top, bottom }, Point3d.Unset, Point3d.Unset, LoftType.Straight, false).FirstOrDefault();

  //   Vector3d start = top.TangentAtStart;
  //   Vector3d end = top.TangentAtEnd;

  //   int count = edge_curves.Length;
  //   double gap = 1 / (num - 1.0);
  //   Curve[] curves = new Curve[num];


  //   if (edge_curves[0].PointAtStart.EpsilonEquals(top.PointAtStart, 0.01) ||
  //     edge_curves[0].PointAtStart.EpsilonEquals(top.PointAtEnd, 0.01))
  //   {
  //     curves[0] = top;
  //     curves[num - 1] = bottom;
  //   }
  //   else { curves[0] = bottom; curves[num - 1] = top; }

  //   int pt_num = (loop) ? count + 1 : count;
  //   Point3d[] edge_mid_pts = new Point3d[pt_num];

  //   for (int i = 1; i < num - 1; i++)
  //   {
  //     double gap_size = gap * i;
  //     for (int j = 0; j < count; j++) edge_mid_pts[j] = edge_curves[j].PointAtNormalizedLength(gap_size);
  //     if (loop) edge_mid_pts[count] = edge_mid_pts[0];

  //     Curve edge_mid = Curve.CreateInterpolatedCurve(edge_mid_pts, 3, CurveKnotStyle.Uniform, start, end);
  //     if (edge_mid.IsCircle(0.01)) edge_mid = new ArcCurve(new Circle(edge_mid_pts[0], edge_mid_pts[1], edge_mid_pts[2])); //circle_check(edge_mid, edge_mid_pts);
  //     else edge_mid = square_crv(edge_mid);
  //     curves[i] = edge_mid;
  //   }

  //   int crv_num = top.IsClosed ? count - 1 : count;
  //   Curve[] v = new Curve[crv_num];
  //   Array.Copy(edge_curves, v, crv_num);
  //   return NurbsSurface.CreateNetworkSurface(curves, 3, 3, v, 3, 3, tol, tol, tol, out _).ToBrep();
  // }  // optimized

  // public bool test_flat(Curve[] crvs, Brep brep, Vector3d direction, double tol, out Point3d[] test_pts)
  // {
  //   int count = crvs.Length;
  //   Interval interval = new Interval(0, 1);
  //   Point3d[] pts = new Point3d[count * 3];
  //   for (int i = 0; i < count; i++)
  //   {
  //     crvs[i].Domain = interval;
  //     pts[i] = project_point(crvs[i].PointAt(0.15), brep, direction);
  //     pts[count + i] = project_point(crvs[i].PointAt(0.5), brep, direction);
  //     pts[(count * 2) + i] = project_point(crvs[i].PointAt(0.85), brep, direction);
  //   }

  //   test_pts = pts;
  //   Plane.FitPlaneToPoints(pts, out _, out double amount);
  //   return amount < tol;
  // }

  // public static NurbsSurface planar_srf(double x = 1, double y = 1)
  // {

  //   x *= 0.5;
  //   y *= 0.5;

  //   return NurbsSurface.CreateFromCorners(
  //     new Point3d(-x, -y, 0),
  //     new Point3d(-x, y, 0),
  //     new Point3d(x, y, 0),
  //     new Point3d(x, -y, 0));
  // }

  // public Curve[] offset(Curve[] curves, double fillet, double tol)
  // {
  //   if (fillet == 0)
  //   {
  //     Curve[] dups = new Curve[curves.Length];
  //     for (int i = 0; i < curves.Length; i++) dups[i] = curves[i].DuplicateCurve();
  //     return dups;
  //   }

  //   Plane plane = curve_planes(curves);
  //   Curve[] off1 = curves.Select(c => Curve.JoinCurves(c.Offset(plane.Origin, plane.Normal, fillet, tol, tol, true, CurveOffsetCornerStyle.Smooth, CurveOffsetEndStyle.None), tol, false)[0]).ToArray();
  //   Curve[] off2 = curves.Select(c => Curve.JoinCurves(c.Offset(plane.Origin, plane.Normal, -fillet, tol, tol, true, CurveOffsetCornerStyle.Smooth, CurveOffsetEndStyle.None), tol, false)[0]).ToArray();

  //   double len1 = bb_union(off1).Diagonal.Length;
  //   double len2 = bb_union(off2).Diagonal.Length;

  //   if ((fillet > 0) == (len1 < len2)) return square_crvs(loop_crv(off2, fillet));
  //   else return square_crvs(loop_crv(off2, fillet));
  // }

  // private double offset_max(BoundingBox big_bb, BoundingBox small_bb)
  // {
  //   double[] diffs =
  //   {
  //     big_bb.Max.X - small_bb.Max.X,
  //     big_bb.Max.Y - small_bb.Max.Y,
  //     //big_bb.Max.Z - small_bb.Max.Z,
  //     small_bb.Min.X - big_bb.Min.X,
  //     small_bb.Min.Y - big_bb.Min.Y
  //     //,small_bb.Min.Z - big_bb.Min.Z
  //   };
  //   return diffs.Min();
  // }

  // public static bool boxboxinside2D(BoundingBox a, BoundingBox b)
  // {
  //   if (a.Max.X < b.Max.X) return false;
  //   if (a.Min.X > b.Min.X) return false;
  //   if (a.Max.Y < b.Max.Y) return false;
  //   if (a.Min.Y > b.Min.Y) return false;

  //   return true;
  // }

  // private BoundingBox bb_intersector(Curve[] curves, Brep brep, Vector3d dir, int ptnum = 100, bool inc_origin = true)
  // {
  //   Interval interval = new Interval(0,1);
  //   int total_pts = curves.Length * ptnum;
  //   if (inc_origin) total_pts++;

  //   Point3d[] pts = new Point3d[total_pts];
  //   double gap = 1.0 / ptnum;
  //   double[] gaps = Enumerable.Range(0, ptnum).Select(n => n * gap).ToArray();

  //   for (int i = 0; i < curves.Length; i++)
  //   {
  //     curves[i].Domain = interval;
  //     for (int j = 0; j < ptnum; j++)
  //     {
  //       pts[(ptnum*i) + j] = project_point(curves[i].PointAt(gaps[j]), brep, dir);
  //     }
  //   }
  //   if (inc_origin) pts[total_pts - 1] = Point3d.Origin;

  //   return new BoundingBox(pts);
  // }

  // private Curve[] cross_crvs(Curve[] edge_curves, int num, Curve crvA, Curve crvB, bool loop)
  // {
  //   Vector3d start = crvA.TangentAtStart;
  //   Vector3d end = crvA.TangentAtEnd;
  //   Interval interval = new Interval(0, 1);
  //   for (int i = 0; i < edge_curves.Length; i++) edge_curves[i].Domain = interval;
  //   double gaps = Convert.ToDouble(num - 1);

  //   Curve[] curves = new Curve[num];
  //   curves[0] = crvA;
  //   curves[num-1] = crvB;
  //   for (int i = 1; i < num-1; i++)
  //   {
  //     double div = (num - 1 - i) / gaps;
  //     Point3d[] edge_mid_pts = edge_curves.Select(c => c.PointAtNormalizedLength(div)).ToArray();
  //     if (loop)
  //     {
  //       Array.Resize(ref edge_mid_pts, edge_mid_pts.Length + 1);
  //       edge_mid_pts[edge_mid_pts.Length - 1] = edge_mid_pts[0];
  //     }
  //     Curve edge_mid = Curve.CreateInterpolatedCurve(edge_mid_pts, 3, CurveKnotStyle.Uniform, start, end);
  //     edge_mid = circle_check(edge_mid, edge_mid_pts);
  //     edge_mid = square_crv(edge_mid);
  //     curves[i] = edge_mid;
  //   }
  //   return curves;
  // }

  // private Curve[] cross_crvs(Curve[] edge_curves, int num, Vector3d start, Vector3d end, bool loop)
  // {
  //   Interval interval = new Interval(0, 1);
  //   for (int i = 0; i < edge_curves.Length; i++) edge_curves[i].Domain = interval;
  //   double gaps = Convert.ToDouble(num - 1);

  //   Curve[] curves = new Curve[num];
  //   for (int i = 0; i < num; i++)
  //   {
  //     double div = (num - 1 - i) / gaps;
  //     Point3d[] edge_mid_pts = edge_curves.Select(c => c.PointAtNormalizedLength(div)).ToArray();
  //     if (loop)
  //     {
  //       Array.Resize(ref edge_mid_pts, edge_mid_pts.Length + 1);
  //       edge_mid_pts[edge_mid_pts.Length - 1] = edge_mid_pts[0];
  //     }
  //     Curve edge_mid = Curve.CreateInterpolatedCurve(edge_mid_pts, 3, CurveKnotStyle.Uniform, start, end);
  //     edge_mid = circle_check(edge_mid, edge_mid_pts);
  //     edge_mid = square_crv(edge_mid);
  //     curves[i] = edge_mid;
  //   }
  //   return curves;
  // }

  // private Curve circle_check(Curve curve, Point3d[] pts)
  // {
  //   return (curve.IsCircle(0.01)) ? new ArcCurve(new Circle(pts[0], pts[1], pts[2])) : curve;
  // }

  // public Curve[] square_crvs(Curve[] curves, double tol = 0.01)
  // {

  //   Vector3d[] vecs = { Vector3d.XAxis, -Vector3d.XAxis, Vector3d.YAxis, -Vector3d.YAxis, Vector3d.ZAxis, -Vector3d.ZAxis };
  //   for (int i = 0; i < curves.Length; i++)
  //   {
  //     NurbsCurve curve = curves[i].ToNurbsCurve();
  //     int last_pt = curve.Points.Count - 1;
  //     Vector3d start = curve.TangentAtStart;
  //     Vector3d end = curve.TangentAtEnd;

  //     for (int j = 0; j < 6; j++)
  //     {
  //       if (Vector3d.VectorAngle(start, vecs[j]) < tol)
  //       {
  //         curve.SetEndCondition(false, NurbsCurve.NurbsCurveEndConditionType.Curvature, curve.PointAtStart, vecs[j]);
  //         break;
  //       }
  //     }
  //     for (int j = 0; j < 6; j++)
  //     {
  //       if (Vector3d.VectorAngle(end, vecs[j]) < tol)
  //       {
  //         curve.SetEndCondition(true, NurbsCurve.NurbsCurveEndConditionType.Curvature, curve.PointAtEnd, vecs[j]);
  //         break;
  //       }
  //     }
  //     curves[i] = curve;
  //   }
  //   return curves;
  // }

  // public Curve square_crv(Curve crv, double tol = 0.01)
  // {

  //   Vector3d[] vecs = { Vector3d.XAxis, -Vector3d.XAxis, Vector3d.YAxis, -Vector3d.YAxis, Vector3d.ZAxis, -Vector3d.ZAxis };

  //     NurbsCurve curve = crv.ToNurbsCurve();
  //     int last_pt = curve.Points.Count - 1;
  //     Vector3d start = curve.TangentAtStart;
  //     Vector3d end = curve.TangentAtEnd;

  //     for (int j = 0; j < 6; j++)
  //     {
  //       if (Vector3d.VectorAngle(start, vecs[j]) < tol)
  //       {
  //         curve.SetEndCondition(false, NurbsCurve.NurbsCurveEndConditionType.Curvature, curve.PointAtStart, vecs[j]);
  //         break;
  //       }
  //     }
  //     for (int j = 0; j < 6; j++)
  //     {
  //       if (Vector3d.VectorAngle(end, vecs[j]) < tol)
  //       {
  //         curve.SetEndCondition(true, NurbsCurve.NurbsCurveEndConditionType.Curvature, curve.PointAtEnd, vecs[j]);
  //         break;
  //       }
  //     }
  //   return crv;
  // }

  // public static void TransformGeos(GeometryBase[] geos, Transform transform)
  // {
  //   for (int i = 0; i < geos.Length; i++) geos[i].Transform(transform);
  // }

  // public static Curve[] object_curve_convert(List<object> objects)
  // {
  //   int count = objects.Count;
  //   Curve[] curves = new Curve[count];
  //   for (int i = 0; i < count; i++) curves[i] = (objects[i] is Curve) ? objects[i] as Curve : new ArcCurve((Arc)objects[i]);
  //   return curves;
  // }

  // public static Plane curve_planes(Curve[] curves)
  // {
  //   int count = curves.Length;

  //   BoundingBox bb = BoundingBox.Empty;
  //   for (int i = 0; i < count; i++) bb.Union(curves[i].GetBoundingBox(true));

  //   if (bb.Max.Z - bb.Min.Z < 0.01) return new Plane(bb.Center, Vector3d.XAxis, Vector3d.YAxis);
  //   if (bb.Max.X - bb.Min.X < 0.01) return new Plane(bb.Center, Vector3d.YAxis, Vector3d.ZAxis);
  //   if (bb.Max.Y - bb.Min.Y < 0.01) return new Plane(bb.Center, Vector3d.XAxis, Vector3d.ZAxis);

  //   Plane[] pl = new Plane[count];
  //   for (int i = 0; i < count; i++) curves[i].TryGetPlane(out pl[i]);
  //   for (int i = 0; i < count; i++) pl[i].Origin = bb.Center;

  //   return new HashSet<Plane>(pl).First();
  // }

  // private bool no_input(string name) => Component.Params.Input[Component.Params.IndexOfInputParam(name)].SourceCount == 0;

  // public static void sort_crvs(Plane plane, Curve[] curvesA, Curve[] curvesB, double tol = 0.001)
  // {
  //   int count = curvesA.Length;
  //   Transform flatten = Transform.Scale(plane, 1, 1, 0);
  //   Curve[] cA = curvesA.Select(c => c.DuplicateCurve()).ToArray();
  //   Curve[] cB = curvesB.Select(c => c.DuplicateCurve()).ToArray();

  //   TransformGeos(cA, flatten);
  //   TransformGeos(cB, flatten);

  //   int[] sortA = sort_index(cA, out bool[] flipA);

  //   bool flip = set_first_curve(cA[0], ref cB);

  //   int[] sortB = sort_index(cB, out bool[] flipB);
  //   flipB[0] = flip;

  //   Array.Sort(sortA, curvesA);
  //   Array.Sort(sortB, curvesB);
  //   Array.Sort(sortA, flipA);
  //   Array.Sort(sortB, flipB);

  //   for (int i = 0; i < count; i++)
  //   {
  //     if (flipA[i]) curvesA[i].Reverse();
  //     if (flipB[i]) curvesB[i].Reverse();
  //   }
  // }

  // public static bool set_first_curve(Curve crv, ref Curve[] curve_list, double tol = 0.001)
  // {
  //   bool flip = false;

  //   int count = curve_list.Length;
  //   Interval interval = new Interval(0, 1);
  //   crv.Domain = interval;
  //   double inset = 0.3;

  //   Point3d ptA = crv.PointAt(inset);
  //   Point3d ptB = crv.PointAt(1 - inset);

  //   double minDistance = double.MaxValue;
  //   int start = 0;

  //   for (int i = 0; i < count; i++)
  //   {
  //     curve_list[i].Domain = interval;
  //     Point3d pt0 = curve_list[i].PointAt(inset);
  //     Point3d pt1 = curve_list[i].PointAt(1 - inset);

  //     double distance = Math.Min(ptA.DistanceToSquared(pt0), ptA.DistanceToSquared(pt1)) + Math.Min(ptB.DistanceToSquared(pt0), ptB.DistanceToSquared(pt1));

  //     if (distance < minDistance)
  //     {
  //       minDistance = distance;
  //       start = i;
  //     }
  //   }

  //   if (start > 0)
  //   {
  //     Curve[] sorted = new Curve[count];
  //     Array.Copy(curve_list, start, sorted, 0, count - start);
  //     Array.Copy(curve_list, 0, sorted, count - start, start);
  //     curve_list = sorted;
  //   }

  //   if (ptA.DistanceToSquared(curve_list[0].PointAt(inset)) > ptA.DistanceToSquared(curve_list[0].PointAt(1 - inset)))
  //   {
  //     curve_list[0].Reverse();
  //     flip = true;
  //   }
  //   return flip;
  // }

  // public static int[] sort_index(Curve[] curves, out bool[] flip, double tol = 0.01)
  // {
  //   int count = curves.Length;

  //   int[] idx = new int[count];
  //   bool[] flip_bool = new bool[count]; // defaults to 'false' so no need to add assign anything other than 'true'

  //   List<Curve> crvs = new ArraySegment<Curve>(curves, 1, count - 1).ToList();
  //   List<int> idx_list = Enumerable.Range(1, count - 1).ToList();

  //   for (int i = 0; i < count - 1; i++)
  //   {
  //     Point3d end = curves[i].PointAtEnd;
  //     for (int j = 0; j < crvs.Count; j++)
  //     {
  //       if (end.EpsilonEquals(crvs[j].PointAtStart, tol))
  //       {
  //         curves[i + 1] = crvs[j];
  //         crvs.RemoveAt(j);
  //         idx[i + 1] = idx_list[j];
  //         idx_list.RemoveAt(j);
  //         break;
  //       }
  //       else if (end.EpsilonEquals(crvs[j].PointAtEnd, tol))
  //       {
  //         flip_bool[i + 1] = true;
  //         crvs[j].Reverse();
  //         curves[i + 1] = crvs[j];
  //         crvs.RemoveAt(j);
  //         idx[i + 1] = idx_list[j];
  //         idx_list.RemoveAt(j);
  //         break;
  //       }
  //     }
  //   }
  //   flip = flip_bool;
  //   return idx;
  // }

  // public static NurbsSurface plane_srf(Plane pl, double size = 0.5)
  // {
  //   size *= 0.5;

  //   NurbsSurface surface = NurbsSurface.CreateFromCorners(
  //     new Point3d(-size, -size, 0),
  //     new Point3d(-size, size, 0),
  //     new Point3d(size, size, 0),
  //     new Point3d(size, -size, 0));

  //   surface.Transform(Transform.PlaneToPlane(Plane.WorldXY, pl));

  //   return surface;
  // }

  // public Point3d project_point(Point3d pt, Brep brep, Vector3d direction) // Optimised
  // {
  //   pt = new Point3d(pt - direction);
  //   Point3d[] pts = Intersection.RayShoot(new Ray3d(pt, direction), new[] { brep }, 2);
  //   if (pts.Length == 1) return pts[0];
  //   if (pts.Length == 2) return pt.DistanceToSquared(pts[0]) < pt.DistanceToSquared(pts[1]) ? pts[0] : pts[1];
  //   if (pts.Length > 2)
  //   {
  //     double[] distances = pts.Select(p => pt.DistanceToSquared(p)).ToArray();
  //     return pts[Array.IndexOf(distances, distances.Min())];
  //   }
  //   return pt;
  // }

  // private Curve project_closest(Curve crv, Brep brep, Vector3d direction, double tolerance)
  // {
  //   //Interval interval = new Interval(0, 1);

  //   Curve[] projected_curves = Curve.ProjectToBrep(crv, brep, direction, tolerance);
  //   Curve[] projected_joined = Curve.JoinCurves(projected_curves, tolerance, false);

  //   Point3d centre = crv.GetBoundingBox(true).Center;

  //   double[] distances = new double[projected_joined.Length];
  //   for (int i = 0; i < projected_joined.Length; i++)
  //   {
  //     //projected_joined[i].Domain = interval;
  //     distances[i] = centre.DistanceToSquared(projected_joined[i].GetBoundingBox(true).Center);
  //   }

  //   return projected_joined[Array.IndexOf(distances, distances.Min())];

  // }

  // private Curve[] offset_crvs(Plane plane, Curve[] curves, double fillet, out bool flip, double tol = 0.01)
  // {
  //   if (fillet == 0)
  //   {
  //     flip = false;
  //     Curve[] dups = new Curve[curves.Length];
  //     for (int i = 0; i < curves.Length; i++) dups[i] = curves[i].DuplicateCurve();
  //     return dups;
  //   }
  //   Curve[] off1 = curves.Select(c => Curve.JoinCurves(c.Offset(plane, fillet, tol, CurveOffsetCornerStyle.Sharp), tol)[0]).ToArray();
  //   Curve[] off2 = curves.Select(c => Curve.JoinCurves(c.Offset(plane, -fillet, tol, CurveOffsetCornerStyle.Sharp), tol)[0]).ToArray();
  //   double len1 = bb_union(off1).Diagonal.Length;
  //   double len2 = bb_union(off2).Diagonal.Length;

  //   if (fillet > 0)
  //   {
  //     if (len1 > len2)
  //     {
  //       flip = false;
  //       return loop_crv(off1, fillet);
  //     }
  //     else
  //     {
  //       flip = true;
  //       return loop_crv(off2, fillet);
  //     }
  //   }
  //   else
  //   {
  //     if (len1 < len2)
  //     {
  //       flip = false;
  //       return loop_crv(off1, fillet);
  //     }
  //     else
  //     {
  //       flip = true;
  //       return loop_crv(off2, fillet);
  //     }
  //   }
  // }

  // public static Curve[] offset_crvs(Plane plane, Curve[] curves, double fillet, double tol = 0.01)
  // {
  //   if (fillet == 0)
  //   {
  //     Curve[] dups = new Curve[curves.Length];
  //     for (int i = 0; i < curves.Length; i++) dups[i] = curves[i].DuplicateCurve();
  //     return dups;
  //   }
  //   Curve[] off1 = curves.Select(c => Curve.JoinCurves(c.Offset(plane, fillet, tol, CurveOffsetCornerStyle.Sharp), tol)[0]).ToArray();
  //   Curve[] off2 = curves.Select(c => Curve.JoinCurves(c.Offset(plane, -fillet, tol, CurveOffsetCornerStyle.Sharp), tol)[0]).ToArray();
  //   double len1 = bb_union(off1).Diagonal.Length;
  //   double len2 = bb_union(off2).Diagonal.Length;

  //   if (fillet > 0)
  //   {
  //     if (len1 > len2) return loop_crv(off1, fillet);
  //     else return loop_crv(off2, fillet);
  //   }
  //   else
  //   {
  //     if (len1 < len2) return loop_crv(off1, fillet);
  //     else return loop_crv(off2, fillet);
  //   }
  // }

  // public static Curve[] loop_crv(Curve[] curves, double fillet)
  // {
  //   double tol = 0.0001;
  //   int count = curves.Length;
  //   fillet = Math.Abs(fillet);

  //   for (int i = 0; i < count; i++)
  //   {
  //     int last = (i + count - 1) % count;
  //     int next = (i + 1) % count;

  //     if (curves[i].PointAtStart.DistanceToSquared(curves[last].PointAtEnd) > tol) curves[i] = curves[i].Extend(curves[i].Domain.Min - (fillet * 2), curves[i].Domain.Max);
  //     if (curves[i].PointAtEnd.DistanceToSquared(curves[next].PointAtStart) > tol) curves[i] = curves[i].Extend(curves[i].Domain.Min, curves[i].Domain.Max + (fillet * 2));

  //   }

  //   for (int i = 0; i < count; i++)
  //   {
  //     int last = (i + count - 1) % count;
  //     int next = (i + 1) % count;

  //     if (curves[i].PointAtStart.DistanceToSquared(curves[last].PointAtEnd) > tol)
  //     {
  //       CurveIntersections cx = Intersection.CurveCurve(curves[i], curves[last], tol, tol);
  //       double tA = cx[0].ParameterA;
  //       double tB = cx[0].ParameterB;
  //       curves[i] = curves[i].Split(tA)[1];
  //       curves[last] = curves[last].Split(tB)[0];
  //     }

  //     if (curves[i].PointAtEnd.DistanceToSquared(curves[next].PointAtStart) > tol)
  //     {
  //       CurveIntersections cx = Intersection.CurveCurve(curves[i], curves[next], tol, tol);
  //       double tA = cx[0].ParameterA;
  //       double tB = cx[0].ParameterB;
  //       curves[i] = curves[i].Split(tA)[0];
  //       curves[next] = curves[next].Split(tB)[1];
  //     }
  //   }

  //   return curves;
  // }

  // public static BoundingBox bb_union(GeometryBase[] geos, double inflate = 0)
  // {
  //   BoundingBox bb = BoundingBox.Empty;
  //   for (int i = 0; i < geos.Length; i++) bb.Union(geos[i].GetBoundingBox(true));
  //   if (inflate == 0) return bb;
  //   bb.Inflate(inflate);
  //   return bb;
  // }


  // public BoundingBox[] facebox(Brep brep, double inflate = 0)
  // {
  //   BoundingBox[] bb = new BoundingBox[brep.Faces.Count];
  //   for (int i = 0; i < brep.Faces.Count; i++)
  //   {
  //     int[] edgelist = brep.Faces[i].AdjacentEdges();
  //     bb[i] = bb_union(edgelist.Select(e => brep.Edges[e]).ToArray());
  //     if (inflate != 0) bb[i].Inflate(inflate);
  //   }
  //   return bb;
  // }

  // public static bool boxbox(BoundingBox a, BoundingBox b)
  // {
  //   if (a.Max.X < b.Min.X) return false;
  //   if (a.Min.X > b.Max.X) return false;
  //   if (a.Max.Y < b.Min.Y) return false;
  //   if (a.Min.Y > b.Max.Y) return false;
  //   if (a.Max.Z < b.Min.Z) return false;
  //   if (a.Min.Z > b.Max.Z) return false;
  //   return true;
  // }
  // public static bool boxboxinside(BoundingBox a, BoundingBox b) // check if b is inside a
  // {
  //   if (a.Max.X < b.Max.X) return false;
  //   if (a.Min.X > b.Min.X) return false;
  //   if (a.Max.Y < b.Max.Y) return false;
  //   if (a.Min.Y > b.Min.Y) return false;
  //   //if (a.Max.Z < b.Max.Z) return false;
  //   //if (a.Min.Z > b.Min.Z) return false;
  //   return true;
  // }
# ---------- end volcano_straight ----------
para_2 = ScriptParasite(Enable=Toggle(False), Folder=scripts_3)

geo_5 = Geometry(volcano_straight.brp)
emboss = Extrude_capped(brep=geo_5, crvs=move_2.Geometry, extrude=number_slider_18)  # -> out, E, A, B, C, D, F; inputs brep: Brep, crvs: list, extrude: Double
# ---------- emboss: C# usings ----------
using Rhino.Geometry.Intersect;
using System.Linq;
using System.Buffers;
using System.Runtime.CompilerServices;
# ---------- emboss: C# ----------
    // Update 2025-08-20

    Component.Message = "Capped";

    if (no_input("crvs")) return;
    if (no_input("extrude")) extrude = 5.0;
    bool capped = true;
    bool centre = true;
    const double tol = 0.01;
    Plane plane = Plane.WorldXY;


    // ------- Set up Curves ------- //

    Curve[] curve_list = object_curve_convert(crvs);
    clean_lines(ref curve_list);

    int count = curve_list.Length;
    Print(count.ToString());
    Plane pl = curves_plane(curve_list);
    Vector3d dir = new Vector3d(0, 0, extrude);

    Transform orient = Transform.PlaneToPlane(pl, Plane.WorldXY);
    Transform reorient = Transform.PlaneToPlane(Plane.WorldXY, pl);

    if (centre) orient = Transform.Translation(-dir * 0.5) * orient;
    TransformGeos(curve_list, orient);

    Brep[] srfs = Brep.CreatePlanarBreps(curve_list, tol);
    BoundingBox[] bb_srfs = bb_each(srfs, 0.01);
    int bb_count = bb_srfs.Length;
    BoundingBox[] bbs_crvs = bb_each(curve_list);

    int[] process_order = RankBoundingBoxesByArea(bb_srfs);

    int[] group_idx = new int[count];
    bool[] inside = new bool[count];
    bool[] done_crvs = new bool[count];
    for (int i = 0; i < count; i++) done_crvs[i] = false;

    for (int i = 0; i < bb_count; i++)
    {
      int idx = process_order[i];
      for (int j = 0; j < count; j++)
      {
        if (!done_crvs[j])
        {
          if (boxboxinside2D(bb_srfs[idx], bbs_crvs[j]))
          {
            group_idx[j] = idx;
            done_crvs[j] = true;
          }
        }
      }
    }


    for (int i = 0; i < bb_count; i++)
    {

      Curve[] temp_crvs = key_select(curve_list, group_idx, i);
      if (temp_crvs.Length == 0) continue;

      Curve[] joined_curves = Curve.JoinCurves(temp_crvs, tol, false, true, out int[] temp_keys);

      if (joined_curves.Length < 2) continue;

      int[] ranking = RankBoundingBoxesByArea(Array.ConvertAll(joined_curves, c => c.GetBoundingBox(true)));
      int target = ranking[ranking.Length - 1];
      int counter = 0;
      for (int j = 0; j < count; j++)
      {
        if (group_idx[j] == i) inside[j] = temp_keys[counter++] != target;
      }
    }



    if (no_input("brep"))
    {
      // ------- Create Breps ------- //

      List<GH_Brep> all_breps = new List<GH_Brep>();
      for (int i = 0; i < bb_count; i++)
      {
        Curve[] curves = key_select(curve_list, group_idx, i);
        int curve_count = curves.Length;

        int side_count = capped ? curve_count + 2 : curve_count;
        Brep[] sides = new Brep[side_count];
        for (int j = 0; j < curve_count; j++) sides[j] = Surface.CreateExtrusion(curves[j], dir).ToBrep();

        if (capped)
        {
          sides[curve_count] = Brep.CreatePlanarBreps(curves, tol)[0];
          sides[curve_count + 1] = sides[curve_count].DuplicateBrep();
          sides[curve_count + 1].Transform(Transform.Translation(dir));
        }
        Brep[] body = Brep.JoinBreps(sides, tol, 0.1);

        if (body.Length == 1 && body[0].SolidOrientation == BrepSolidOrientation.Inward) body[0].Flip();
        TransformGeos(body, reorient);
        all_breps.AddRange(Array.ConvertAll(body, b => new GH_Brep(b)));
      }

      E = all_breps;
    }


    else
    {
      List<Brep> all_breps = new List<Brep>();
      for (int i = 0; i < count; i++)
      {
        Curve[] curves = key_select(curve_list, inside, group_idx, i, out bool[] orients);
        int crv_count = curves.Length;

        int co = 0;
        int ci = 0;

        for (int j = 0; j < crv_count; j++)
        {
          if (orients[j]) co++;
          else ci++;
        }

        // Initialize arrays with exact required sizes
        Curve[] curves_outer = new Curve[co];
        Curve[] curves_inner = new Curve[ci];

        co = 0;
        ci = 0;

        for (int j = 0; j < crv_count; j++)
        {
          if (orients[j]) curves_outer[co++] = curves[j];
          else curves_inner[ci++] = curves[j];
        }

        // brep = hole_extrude(curves_outer, curves_inner, brep, extrude, tol, out Plane out_pl, out Curve[] out_crvs);

        // ---------------------------- FIX THIS / FIX THIS / FIX THIS / FIX THIS / FIX THIS / FIX THIS ---------------------------- //

        all_breps.Add(hole_extrude(curves_outer, curves_inner, brep, extrude, tol, out Plane out_pl, out Curve[] out_crvs));



      }
      E = all_breps;
      //E = brep;
    }
# ---------- emboss: C# additional code ----------
  private Brep hole_extrude(Curve[] curves_outer, Curve[] curves_inner, Brep brep, double extrude, double tol, out Plane pl, out Curve[] crvs)
  {
    Plane pln = Plane.WorldXY;
    Vector3d Z_up = Vector3d.ZAxis;

    int count = curves_inner.Length + curves_outer.Length;


    bool remirror = brep.GetBoundingBox(true).Center.Z < 0;  // Put Brep above Plane.XY
    Transform mirror = Transform.Mirror(pln);
    if (remirror) brep.Transform(mirror);

    if (extrude == 0) { pl = pln; crvs = curves_outer.Concat(curves_inner).ToArray(); return brep; }
    double flip = (extrude < 0) ? -1 : 1;


    // ------- Separate BrepFaces ------- //

    Brep[] final_breps = new Brep[count * 3 + 3];
    separate_brepfaces(brep, curves_outer, Z_up, out Brep brep_half, out Brep brep_out);
    // final_breps[count * 3 + 1] = brep_out;

    Print(curves_inner.Length.ToString());
    Print(curves_outer.Length.ToString());


    // ------- Setup Curves ------- //

    // curves_outer = Array.ConvertAll(curves_outer, c => project_closest(c, brep_half, Z_up, tol));
    // curves_inner = Array.ConvertAll(curves_inner, c => project_closest(c, brep_half, Z_up, tol));
    // Curve[] crvA = new Curve[count];

    // Array.Copy(curves_outer, crvA, curves_outer.Length);
    // Array.Copy(curves_inner, 0, crvA, curves_outer.Length, curves_inner.Length);

    // Curve[] crvB = Array.ConvertAll(crvA, c => c.DuplicateCurve());
    // Curve[] final_crvs = Array.ConvertAll(crvA, c => c.DuplicateCurve());

    // Plane base_plane = pln;
    // Plane inside_plane = pln;
    // Point3d central_pt = project_point(Point3d.Origin, brep, Z_up);
    // base_plane.Origin = central_pt;
    // base_plane.Transform(Transform.Translation(0, 0, extrude));

    // TransformGeos(crvB, Transform.Scale(inside_plane, 1, 1, 0));


    // // ------- main loop ------- //

    // //List<Curve> test_crvs = new List<Curve>();

    // LoftType straight_loft = LoftType.Straight;

    // for (int i = 0; i < count; i++)
    // {
    //   final_breps[i] = Brep.CreateFromLoft(new[] { crvA[i], crvB[i] }, pu, pu, straight_loft, false)[0];
    // }



    // // ------- Re-Assemble parts ------- //

    // Brep[] caps = Brep.CreatePlanarBreps(crvB, 0.001);

    // BoundingBox target_bb = bb_union(crvA);
    // target_bb.Inflate(0.1);

    // List<Brep> pieces = brep_half.Split(crvA, tol).Where(b => !boxboxinside2D(target_bb, b.GetBoundingBox(true))).ToList();

    // pieces.AddRange(final_breps);

    // Brep final_brep = Brep.JoinBreps(pieces, 0.001, 0.1)[0]; // new Brep(); //  brep; //

    // base_plane = new Plane(base_plane.Origin, -base_plane.XAxis, -base_plane.YAxis);

    // if (remirror)
    // {
    //   final_brep.Transform(mirror);
    //   brep.Transform(mirror);
    //   base_plane.Transform(mirror);
    //   TransformGeos(final_crvs, mirror);
    // }

    // if (final_brep.SolidOrientation == BrepSolidOrientation.Inward) final_brep.Flip();

    pl = Plane.WorldXY; //base_plane; // 
    crvs = new[] { new LineCurve(Point3d.Origin, new Point3d(0, 0, 1)) }; // crvA.Concat(crvB).Concat(crvC).Concat(crvD).ToArray(); //  crvD; // final_crvs; // 

    return brep_half; // new Brep(); //final_brep; // 
  }




  public static void clean_lines(ref Curve[] curves, double tol = 0.01)
  {
    const double DOT_THRESHOLD = 0.99619; // ~5 degrees

    bool[] islinear = Array.ConvertAll(curves, c => c.IsLinear(tol));
    Point3d[] startpt = Array.ConvertAll(curves, c => c.PointAtStart);
    Point3d[] endpt = Array.ConvertAll(curves, c => c.PointAtEnd);
    Vector3d[] startvec = Array.ConvertAll(curves, c => c.TangentAtStart);
    Vector3d[] endvec = Array.ConvertAll(curves, c => c.TangentAtEnd);

    int count = curves.Length;
    Curve[] result = new Curve[count];
    int w = 0;


    for (int i = 0; i < count; i++)
    {
      if (i + 1 < count)
      {

        if (islinear[i] && islinear[i + 1] && endvec[i] * startvec[i + 1] > DOT_THRESHOLD)
        {
          result[w++] = new LineCurve(startpt[i], endpt[i + 1]);
          i++; // skip the next curve (merged)
          continue;
        }
      }

      result[w++] = curves[i];
    }

    if (w != count)
    {
      Curve[] trimmed = new Curve[w];
      Array.Copy(result, trimmed, w); // Faster than manual loop
      curves = trimmed;
    }
    else
    {
      curves = result;
    }
  }



  public void separate_brepfaces(Brep brep, Curve[] crvs, Vector3d direction, out Brep brep_in, out Brep brep_out) // !!! FIX !!!
  {
    double tol = 0.001;
    int count = crvs.Length;
    int face_count = brep.Faces.Count;

    bool should_orient = direction.EpsilonEquals(Vector3d.ZAxis, tol);
    Transform reorient = Transform.Unset;
    if (should_orient)
    {
      Plane pl = curves_plane(crvs);
      Transform orient = Transform.PlaneToPlane(pl, Plane.WorldXY);
      reorient = Transform.PlaneToPlane(Plane.WorldXY, pl);
      TransformGeos(crvs, orient);
      brep.Transform(orient);
    }

    int ptnum = 14;
    double pt_gap = 1.0 / ptnum;
    Point3d[] pts = new Point3d[count * ptnum];
    int counter = 0;
    for (int i = 0; i < count; i++)
    {
      crvs[i].Reparameterize();
      for (int j = 0; j < ptnum; j++)
      {
        // pts[counter++] = Intersection.RayShoot(new Ray3d(crvs[i].PointAt(pt_gap * (j + 0.5)), direction), new[] { brep }, 1)[0];
        pts[counter++] = project_point(crvs[i].PointAt(pt_gap * (j + 0.5)), brep, direction);
      }
    }

    HashSet<int> index_in = new HashSet<int>();
    for (int i = 0; i < pts.Length; i++)
    {
      brep.ClosestPoint(pts[i], out _, out ComponentIndex ci, out _, out _, tol, out _);
      if (ci.Index != -1) index_in.Add(ci.Index);
    }

    List<int> index_out = new List<int>();
    for (int i = 0; i < face_count; i++)
    {
      if (!index_in.Contains(i)) index_out.Add(i);  //index_outx[counter++] = i;
    }

    BoundingBox test_box = new BoundingBox(pts);
    test_box.Union(new Point3d(0, 0, -brep.GetBoundingBox(false).Min.Z - 10));
    test_box.Transform(Transform.Translation(0, 0, tol));
    for (int i = index_out.Count - 1; i >= 0; i--)
    {
      if (boxinside(test_box, brep.DuplicateSubBrep(new[] { index_out[i] }).GetBoundingBox(true)))
      {
        index_in.Add(index_out[i]);
        index_out.RemoveAt(i);
      }
    }

    if (should_orient) brep.Transform(reorient);

    brep_in = brep.DuplicateSubBrep(index_in);
    brep_out = brep.DuplicateSubBrep(index_out);
  }

  public static Point3d project_point(Point3d pt, Brep brep, Vector3d direction) // Optimised
  {
    pt = new Point3d(pt - direction);
    Point3d[] pts = Intersection.RayShoot(new Ray3d(pt, direction), new[] { brep }, 2);
    int len = pts.Length;
    if (len == 1) return pts[0];
    if (len == 2)
    {
      double dist1 = pt.DistanceToSquared(pts[0]);
      double dist2 = pt.DistanceToSquared(pts[1]);
      return dist1 < dist2 ? pts[0] : pts[1];
    }
if (len > 2)
    {
        int closest_idx = 0;
        double min_dist = pt.DistanceToSquared(pts[0]);

        for (int i = 1; i < len; i++)
        {
            double dist = pt.DistanceToSquared(pts[i]);
            if (dist < min_dist)
            {
                min_dist = dist;
                closest_idx = i;
            }
        }
        return pts[closest_idx];
    }

    return Point3d.Unset;
  }

  public static NurbsSurface planar_srf(double x = 1, double y = 1)
  {
    x *= 0.5;
    y *= 0.5;

    return NurbsSurface.CreateFromCorners(
      new Point3d(-x, -y, 0),
      new Point3d(-x, y, 0),
      new Point3d(x, y, 0),
      new Point3d(x, -y, 0));
  }

  public static Curve project_closest(Curve crv, Brep brep, Vector3d dir, double tol)  // Optimised
  {
    Interval interval = new Interval(0, 1);

    crv.Transform(Transform.Translation(-dir));
    Curve[] projected_curves = Curve.ProjectToBrep(crv, brep, dir, tol);
    Curve[] projected_joined = Curve.JoinCurves(projected_curves, tol, false);

    Point3d centre = crv.GetBoundingBox(true).Center;
    int closestIndex = 0;
    double minDistance = double.MaxValue;

    for (int i = 0; i < projected_joined.Length; i++)
    {
      projected_joined[i].Domain = interval;
      double distance = centre.DistanceToSquared(projected_joined[i].GetBoundingBox(true).Center);
      if (distance < minDistance)
      {
        minDistance = distance;
        closestIndex = i;
      }

    }
    return projected_joined[closestIndex];
  }

  public static bool test_flat(Curve[] crvs, Brep brep, Vector3d direction, double tol, out Point3d[] test_pts)
  {
    int count = crvs.Length;
    Interval interval = new Interval(0, 1);

    Point3d[] pts = new Point3d[count * 3];
    for (int i = 0; i < count; i++)
    {
      crvs[i].Domain = interval;
      pts[i] = project_point(crvs[i].PointAt(0.15), brep, direction);
      pts[count + i] = project_point(crvs[i].PointAt(0.5), brep, direction);
      pts[(count * 2) + i] = project_point(crvs[i].PointAt(0.85), brep, direction);
    }

    test_pts = pts;
    Plane.FitPlaneToPoints(pts, out _, out double amount);
    return amount < tol;
  }

  private Brep quick_extrude(Curve[] crvs, double extrude, double radius, double bulge, int sectors, bool centre, double tol, out Curve[] out_crvs)
  {
    // -------  Set Up Conditions  ------- //

    bool loop = crvs.Length == 1 && crvs[0].IsClosed;
    bool mirror = extrude != Math.Abs(extrude) && !centre;
    extrude = Math.Abs(extrude);
    int cross_num = (bulge == 0) ? 2 : 4;

    bool has_sides = radius < extrude * 0.5;
    if (!has_sides) radius = extrude * 0.5;

    bool C2arc = bulge <= -1 && (radius * 3) + tol < extrude; // bulge is less than one and does not make the radius bigger than half the extrude
    if (C2arc)
    {
      radius *= 1.5;
      bulge = 0.72;
    }

    // -------  Set Up Standard Variables  ------- //

    int count = crvs.Length;
    Point3d pu = Point3d.Unset;

    Curve[] crvA = offset(crvs, -radius, out _, tol);
    Curve[] crvC = crvs.Select(c => c.DuplicateCurve()).ToArray();

    if (Math.Abs(crvA[0].PointAtStart.DistanceTo(crvs[0].PointAtStart) - radius) > tol) sort_crvs(crvA, crvs);

    Transform moveB = Transform.Translation(0, 0, radius);
    Transform moveC = Transform.Translation(0, 0, extrude - radius);
    Transform moveD = Transform.Translation(0, 0, extrude);
    Transform moveC2 = Transform.Translation(0, 0, radius);
    Transform mirror_trans = Transform.Mirror(Plane.WorldXY);
    Transform centre_trans = Transform.Translation(0, 0, -(extrude * 0.5));

    // -------  Main Loop - Build Surfaces  ------- //

    Brep[] srfs = new Brep[(count * 3) + 2];

    for (int i = 0; i < count; i++)
    {
      bool straight = crvs[i].IsLinear(0.01);
      crvs[i].Transform(moveB);  // ---- Arrange Curves---- //
      crvC[i].Transform(moveC);

      if (has_sides) srfs[i] = Brep.CreateFromLoft(new[] { crvs[i], crvC[i] }, pu, pu, LoftType.Straight, false)[0];
      srfs[i].Flip();
      int edge_num = straight ? 2 : sectors;

      Curve[] edges = simple_edges(crvA[i], crvs[i], bulge, edge_num);
      srfs[count + i] = edge_srf(crvs[i], crvA[i], edges, cross_num); //

      srfs[(count * 2) + i] = srfs[count + i].DuplicateBrep();
      srfs[(count * 2) + i].Transform(mirror_trans);
      srfs[(count * 2) + i].Transform(moveD);
      crvC[i].Transform(moveC2);
    }

    srfs[count * 3] = Brep.CreatePlanarBreps(crvA, 0.001)[0];
    srfs[(count * 3) + 1] = srfs[count * 3].DuplicateBrep();
    srfs[(count * 3) + 1].Transform(moveD);

    Brep brep = Brep.JoinBreps(srfs.Where(s => s != null), 0.001, 0.1)[0];

    if (mirror) { brep.Transform(mirror_trans); TransformGeos(crvC, mirror_trans); }
    if (centre) { brep.Transform(centre_trans); TransformGeos(crvC, centre_trans); }

    out_crvs = crvC;

    return brep;
  }

  public static Curve[] simple_edges(Curve crvA, Curve crvB, double bulge, int sectors)
  {
    double gap = 1 / (sectors - 1.0);
    Interval interval = new Interval(0, 1);
    crvA.Domain = interval;
    crvB.Domain = interval;
    Point3d[] ptsA = new Point3d[sectors];
    Point3d[] ptsB = new Point3d[sectors];
    for (int i = 0; i < sectors; i++)
    {
      ptsA[i] = crvA.PointAt(gap * i);
      ptsB[i] = crvB.PointAt(gap * i);
    }
    // Output Chamfers
    if (bulge == 0) return ptsA.Select((p, i) => new LineCurve(p, ptsB[i])).ToArray();
    // Output Arcs
    if (bulge < 0) return ptsA.Select((p, i) => new ArcCurve(new Arc(ptsB[i], -Vector3d.ZAxis, p))).ToArray();

    // Output Blends
    Curve[] edge_curves = new Curve[sectors];
    Curve side_ln = new LineCurve(new Point3d(0, 0, 1), Point3d.Origin);
    for (int i = 0; i < sectors; i++)
    {
      Vector3d move = new Vector3d(ptsB[i]);
      Vector3d vec = new Vector3d(ptsA[i] - ptsB[i]) { Z = 0 };
      Curve crv0 = new LineCurve(ptsA[i], ptsA[i] + vec);
      side_ln.Transform(Transform.Translation(move));
      edge_curves[i] = Curve.CreateBlendCurve(side_ln, crv0, BlendContinuity.Curvature, bulge, bulge);
      side_ln.Transform(Transform.Translation(-move));
    }
    return edge_curves;
  }

  public Brep edge_srf(Curve top, Curve bottom, Curve[] edge_curves, int num, bool loop = false, double tol = 0.001)
  {
    if (num < 3 || edge_curves == null)
    {
      return Brep.CreateFromLoft(new[] { top, bottom }, Point3d.Unset, Point3d.Unset, LoftType.Straight, false)[0];
    }
    double ang_tol = 0.1;
    double cos_tol = Math.Cos(ang_tol);

    Vector3d[] axes = new Vector3d[] { Vector3d.XAxis, -Vector3d.XAxis, Vector3d.YAxis, -Vector3d.YAxis, Vector3d.ZAxis, -Vector3d.ZAxis };

    Vector3d start = top.TangentAtStart; // Already Unitized Vector
    Vector3d end = top.TangentAtEnd;
    for (int i = 0; i < 6; i++)
    {
      if (start * axes[i] > cos_tol) { start = axes[i]; break; }
    }
    for (int i = 0; i < 6; i++)
    {
      if (end * axes[i] > cos_tol) { end = axes[i]; break; }
    }

    int count = edge_curves.Length;
    double gap = 1 / (num - 1.0);

    Curve[] curves = new Curve[num];

    if (edge_curves[0].PointAtStart.EpsilonEquals(top.PointAtStart, 0.01) ||
      edge_curves[0].PointAtStart.EpsilonEquals(top.PointAtEnd, 0.01))
    {
      curves[0] = top;
      curves[num - 1] = bottom;
    }
    else { curves[0] = bottom; curves[num - 1] = top; }

    int pt_num = loop ? count + 1 : count;
    Point3d[] edge_mid_pts = new Point3d[pt_num];

    for (int i = 1; i < num - 1; i++)
    {
      double gap_size = gap * i;
      for (int j = 0; j < count; j++) edge_mid_pts[j] = edge_curves[j].PointAtNormalizedLength(gap_size);
      if (loop) edge_mid_pts[count] = edge_mid_pts[0];

      Curve edge_mid = Curve.CreateInterpolatedCurve(edge_mid_pts, 3, CurveKnotStyle.Uniform, start, end);
      if (edge_mid.IsCircle(0.01)) edge_mid = new ArcCurve(new Circle(edge_mid_pts[0], edge_mid_pts[1], edge_mid_pts[2])); //circle_check(edge_mid, edge_mid_pts);
      else edge_mid = square_crv(edge_mid);
      curves[i] = edge_mid;
    }

    if (top.IsClosed) Array.Resize(ref edge_curves, edge_curves.Length - 1);

    NurbsSurface surface = NurbsSurface.CreateNetworkSurface(curves, 3, 3, edge_curves, 3, 3, tol, tol, tol, out _);
    if (surface == null) surface = NurbsSurface.CreateNetworkSurface(new[] { top, bottom }, 3, 3, edge_curves, 3, 3, tol, tol, tol, out _);

    return surface.ToBrep(); // new Brep(); //

  }  // optimized

  public Curve[] offset(Curve[] curves, double fillet, out Plane pln, double tol = 0.001)
  {
    int count = curves.Length;

    // CHANGE: cache plane once
    Plane plane = curves_plane(curves);
    pln = plane;

    if (fillet == 0)
    {
      // CHANGE: direct copy; no DuplicateCurve (faster if curves are never modified downstream)
      Curve[] copy = new Curve[count];
      for (int i = 0; i < count; i++) copy[i] = curves[i];
      return copy;
    }

    Point3d pt = plane.Origin;
    Vector3d normal = plane.Normal;

    // CHANGE: reuse temp arrays to avoid alloc cycles
    Curve[] off1 = new Curve[count];
    Curve[] off2 = new Curve[count];

    CurveOffsetCornerStyle cs = CurveOffsetCornerStyle.Smooth;
    CurveOffsetEndStyle es = CurveOffsetEndStyle.None;

    for (int i = 0; i < count; i++)
    {
      Curve c = curves[i];

      // CHANGE: store once; no IsArc tolerance allocation
      bool offset_type = !c.IsArc(0.1);

      // CHANGE: join curves more defensively — avoid allocation explosion
      Curve[] pos = c.Offset(pt, normal, fillet, tol, tol, offset_type, cs, es);
      Curve[] neg = c.Offset(pt, normal, -fillet, tol, tol, offset_type, cs, es);

      off1[i] = pos.Length > 0 ? Curve.JoinCurves(pos, tol, false)[0] : c;
      off2[i] = neg.Length > 0 ? Curve.JoinCurves(neg, tol, false)[0] : c;
    }

    // CHANGE: compute bounding boxes once; reuse reference
    BoundingBox bb1 = bb_union(off1);
    BoundingBox bb2 = bb_union(off2);

    double len1 = bb1.Diagonal.Length;
    double len2 = bb2.Diagonal.Length;

    // CHANGE: cache loop_crv once
    Curve[] loop = (fillet > 0) == (len1 < len2)
      ? loop_crv(off2, fillet)
      : loop_crv(off1, fillet);

    // CHANGE: direct return without intermediate arrays
    return (fillet > 0) == (len1 < len2)
      ? neaten_crvs(loop, curves)
      : square_crvs(loop);
  }

  private Curve[] key_select(Curve[] curve_list, int[] keys, int value)
  {
    // Cache frequently used values locally to avoid repeated field accesses
    int len = curve_list.Length;
    int val = value;

    int count = 0;
    for (int i = 0; i < len; ++i) if (keys[i] == val) count++;

    Curve[] result = new Curve[count];

    int idx = 0;
    for (int i = 0; i < len; ++i) if (keys[i] == val) result[idx++] = curve_list[i];

    return result;
  }

  private Curve[] key_select(Curve[] curve_list, bool[] orient_list, int[] keys, int value, out bool[] orients)
  {
    // Cache frequently used values locally to avoid repeated field accesses
    int len = curve_list.Length;
    int val = value;

    int count = 0;
    for (int i = 0; i < len; ++i) if (keys[i] == val) count++;

    Curve[] result = new Curve[count];
    bool[] orient = new bool[count];

    int idx = 0;
    for (int i = 0; i < len; ++i) if (keys[i] == val)
      {
        orient[idx] = orient_list[i];
        result[idx++] = curve_list[i];
      }

    orients = orient;
    return result;
  }

  public Curve square_crv(Curve crv, double tol = 0.1)
  {
    if (crv.IsLinear(0.01) || crv.IsArc(0.1)) return crv;

    NurbsCurve curve = crv.ToNurbsCurve();
    Point3d[] pts = curve.Points.Select(p => p.Location).ToArray();
    int count = pts.Length;
    if (curve.Points.Count < 6) return crv;

    Vector3d[] vecs = { Vector3d.XAxis, -Vector3d.XAxis, Vector3d.YAxis, -Vector3d.YAxis, Vector3d.ZAxis, -Vector3d.ZAxis };
    Vector3d start_vec = curve.TangentAtStart;
    Vector3d end_vec = curve.TangentAtEnd;

    bool start_found = false;
    bool end_found = false;

    for (int j = 0; j < 6; j++)
    {
      if (!start_found && start_vec.EpsilonEquals(vecs[j], tol))
      {
        if (vecs[j].X == 0) pts[1].X = pts[2].X = pts[0].X;
        if (vecs[j].Y == 0) pts[1].Y = pts[2].Y = pts[0].Y;
        if (vecs[j].Z == 0) pts[1].Z = pts[2].Z = pts[0].Z;
        start_found = true;
      }

      if (!end_found && end_vec.EpsilonEquals(vecs[j], tol))
      {
        if (vecs[j].X == 0) pts[count - 2].X = pts[count - 3].X = pts[count - 1].X;
        if (vecs[j].Y == 0) pts[count - 2].Y = pts[count - 3].Y = pts[count - 1].Y;
        if (vecs[j].Z == 0) pts[count - 2].Z = pts[count - 3].Z = pts[count - 1].Z;
        end_found = true;
      }
      if (start_found && end_found) break;
    }
    return Curve.CreateControlPointCurve(pts, curve.Degree);
  }

  public Curve[] square_crvs(Curve[] crvs, double tol = 0.1)
  {
    int count = crvs.Length;
    for (int i = 0; i < count; i++) crvs[i] = square_crv(crvs[i]);
    return crvs;
  }

  public Curve[] neaten_crvs(Curve[] crvs, Curve[] match_crvs, double tol = 0.1)
  {
    /// Designed for offset curves, where initial curves (match_crvs) are in a sorted loop, and the crvs also is a corresponding sorted loop
    /// Will also work for a single loop of curves that is not necessarily offset.  Just set match_crvs to 'null'.

    int count = crvs.Length;
    Interval interval = new Interval(0, 1);

    bool[] end_curvature_matches = new bool[count];
    bool[] is_linear = new bool[count];
    Vector3d[] end_tan = new Vector3d[count];
    Vector3d[] vecs = { Vector3d.XAxis, -Vector3d.XAxis, Vector3d.YAxis, -Vector3d.YAxis, Vector3d.ZAxis, -Vector3d.ZAxis };

    if (match_crvs.Length == count)
    {
      for (int i = 0; i < count; i++)
      {
        crvs[i].Domain = interval;
        match_crvs[i].Domain = interval;
        is_linear[i] = match_crvs[i].IsLinear(tol);
        end_tan[i] = match_crvs[i].TangentAtEnd;
        for (int j = 0; j < 6; j++) if (end_tan[i].EpsilonEquals(vecs[j], tol)) end_tan[i] = vecs[j];
      }

      for (int i = 0; i < count; i++)
      {
        int last = (i - 1 + count) % count;
        end_curvature_matches[i] = match_crvs[i].CurvatureAt(0).EpsilonEquals(match_crvs[last].CurvatureAt(1), 0.1) && match_crvs[i].TangentAtStart.EpsilonEquals(end_tan[last], 0.1);
      }
    }
    else
    {
      for (int i = 0; i < count; i++)
      {
        crvs[i].Domain = interval;
        is_linear[i] = crvs[i].IsLinear(tol);
        end_tan[i] = crvs[i].TangentAtEnd;
        for (int j = 0; j < 6; j++) if (end_tan[i].EpsilonEquals(vecs[j], tol)) end_tan[i] = vecs[j];
      }

      for (int i = 0; i < count; i++)
      {
        int last = (i - 1 + count) % count;
        end_curvature_matches[i] = crvs[i].CurvatureAt(0).EpsilonEquals(crvs[last].CurvatureAt(1), 0.1) && crvs[i].TangentAtStart.EpsilonEquals(end_tan[last], 0.1);
      }
    }


    // string test_vecs = "";
    // for (int i = 0; i < count; i++) test_vecs += is_linear[i].ToString() + ", " + crvs[i].ToNurbsCurve().Points.Count.ToString() +"|  " ;
    // Print(test_vecs);

    for (int i = 0; i < count; i++)
    {
      if (is_linear[i] || !end_curvature_matches[i] || crvs[i].IsArc(0.1)) continue;


      NurbsCurve curve = crvs[i].ToNurbsCurve();
      int ptnum = curve.Points.Count;
      //Print(ptnum.ToString());

      Point3d[] pts = curve.Points.Select(p => p.Location).ToArray();
      int degree = curve.Degree;
      if (ptnum < 6) continue;

      // ------- Square ends if not square

      Vector3d tan = end_tan[(i - 1 + count) % count];
      tan.Unitize();
      pts[1] = new Point3d(pts[0] + (tan * pts[0].DistanceTo(pts[1])));
      pts[2] = new Point3d(pts[0] + (tan * pts[0].DistanceTo(pts[2])));

      if (is_linear[(i + 1) % count])
      {
        tan = -end_tan[i];
        tan.Unitize();
        pts[ptnum - 2] = new Point3d(pts[ptnum - 1] + (tan * pts[ptnum - 1].DistanceTo(pts[ptnum - 2])));
        pts[ptnum - 3] = new Point3d(pts[ptnum - 1] + (tan * pts[ptnum - 1].DistanceTo(pts[ptnum - 3])));
      }

      crvs[i] = NurbsCurve.Create(false, degree, pts);
    }
    return crvs;
  }

  public static Curve[] loop_crv(Curve[] curves, double radius, double tol = 0.001)
  {
    if (Curve.JoinCurves(curves, tol, false)[0].IsClosed) return curves;

    int count = curves.Length;
    radius = Math.Abs(radius) * 2;

    //bool[] is_arc = new bool[count];
    Point3d[] startPoints = new Point3d[count];
    Point3d[] endPoints = new Point3d[count];
    double[] extendMin = new double[count];
    double[] extendMax = new double[count];

    for (int i = 0; i < count; i++)
    {
      //is_arc[i] = curves[i].IsArc(0.1);
      startPoints[i] = curves[i].PointAtStart;
      endPoints[i] = curves[i].PointAtEnd;
      extendMin[i] = curves[i].Domain.Min - radius;
      extendMax[i] = curves[i].Domain.Max + radius;
    }

    for (int i = 0; i < count; i++)
    {
      //if(is_arc[i]) continue;
      int last = (i + count - 1) % count;
      int next = (i + 1) % count;

      if (!startPoints[i].EpsilonEquals(endPoints[last], tol))
        curves[i] = curves[i].Extend(extendMin[i], curves[i].Domain.Max);
      if (!endPoints[i].EpsilonEquals(startPoints[next], tol))
        curves[i] = curves[i].Extend(curves[i].Domain.Min, extendMax[i]);
    }

    for (int i = 0; i < count; i++)
    {
      //if(is_arc[i]) continue;
      int last = (i + count - 1) % count;
      int next = (i + 1) % count;

      if (!startPoints[i].EpsilonEquals(endPoints[last], tol))
      {
        CurveIntersections cx = Intersection.CurveCurve(curves[i], curves[last], tol, tol);
        curves[i] = curves[i].Split(cx[0].ParameterA)[1];
        curves[last] = curves[last].Split(cx[0].ParameterB)[0];
      }
    }

    Interval interval = new Interval(0, 1);
    for (int i = 0; i < count; i++)
    {
      //if(is_arc[i]) continue;
      int degree = curves[i].Degree;
      Vector3d start = curves[i].TangentAtStart;
      Vector3d end = curves[i].TangentAtEnd;
      curves[i].Domain = interval;
      if (curves[i].CurvatureAt(0.5).SquareLength > 200 || curves[i].DuplicateSegments().Length > 1)
      {
        BoundingBox bb = curves[i].GetBoundingBox(true);

        int ptnum = (int)Math.Max(9, Math.Floor(curves[i].ToNurbsCurve().Points.Count * 1.0));
        Curve crv = curves[i].Rebuild(ptnum, degree, true);
        Point3d[] pts = crv.ToNurbsCurve().Points.Select(p => p.Location).ToArray();
        for (int j = 0; j < pts.Length; j++)
        {
          pts[j].X = Math.Max(bb.Min.X, Math.Min(bb.Max.X, pts[j].X));
          pts[j].Y = Math.Max(bb.Min.Y, Math.Min(bb.Max.Y, pts[j].Y));
          pts[j].Z = Math.Max(bb.Min.Z, Math.Min(bb.Max.Z, pts[j].Z));
        }
        curves[i] = Curve.CreateControlPointCurve(pts, degree); //NurbsCurve.Create(false, degree, pts);
      }
    }
    return curves;
  }


  /* 
    private Curve[] donut_sort(Curve[] curve_list, double tol, out int[] key_values, out bool[] orientation)
    {
      // Join curves and calculate bounding boxes
      Curve[] curveloops = Curve.JoinCurves(curve_list, tol, true, false, out int[] keys);
      BoundingBox[] bbs = bb_each(curveloops);
      int count = curve_list.Length;
      int group_count = curveloops.Length;

      // Precompute boxboxinside2D results and store them in a 1D byte array
      byte[] precomputedInside = new byte[group_count * group_count];
      for (int i = 0; i < group_count; i++)
      {
        for (int j = i + 1; j < group_count; j++) // j starts from i + 1 to avoid duplicate checks
        {
          bool inside_i_to_j = boxboxinside2D(bbs[i], bbs[j]); // Check (i -> j)
          precomputedInside[i * group_count + j] = (byte)(inside_i_to_j ? 1 : 0);

          bool inside_j_to_i = boxboxinside2D(bbs[j], bbs[i]); // Check (j -> i)
          precomputedInside[j * group_count + i] = (byte)(inside_j_to_i ? 1 : 0);
        }
      }

      bool[] inner = new bool[count]; // Store orientation for curves

      // Loop through the bounding boxes, optimized to avoid unnecessary checks
      for (int i = 0; i < group_count; i++)
      {
        for (int j = i + 1; j < group_count; j++) // Avoid duplicate checks: j > i ensures no repeat
        {
          if (precomputedInside[i * group_count + j] == 1)
          {
            for (int k = 0; k < count; k++) // Update keys for matching bounding box pairs
            {
              if (keys[k] == j)
              {
                keys[k] = i;
                inner[k] = true;  // Mark as inside
              }
            }
          }

          if (precomputedInside[j * group_count + i] == 1) // Also check the opposite direction
          {
            for (int k = 0; k < count; k++)
            {
              if (keys[k] == i)
              {
                keys[k] = j;
                inner[k] = true;
              }
            }
          }
        }
      }

      key_values = keys;
      orientation = inner;
      return curveloops;
    }
 */


  // private Curve[] donut_sort(Curve[] curve_list, double tol, out int[] key_values, out bool[] orientation, out Brep[] surfaces)
  // {
  //   Brep[] srfs = Brep.CreatePlanarBreps(curve_list, tol);
  //   BoundingBox[] bbs = bb_each(srfs);
  //   int[] process_order = RankBy2dArea(bbs);






  //   /*


  //       // Join curves and calculate bounding boxes
  //       Curve[] curveloops = Curve.JoinCurves(curve_list, tol, true, false, out int[] keys);
  //       BoundingBox[] bbs = bb_each(curveloops);
  //       int count = curve_list.Length;
  //       int group_count = curveloops.Length;

  //       // Precompute boxboxinside2D results and store them in a 1D byte array
  //       byte[] precomputedInside = new byte[group_count * group_count];
  //       for (int i = 0; i < group_count; i++)
  //       {
  //         for (int j = i + 1; j < group_count; j++) // j starts from i + 1 to avoid duplicate checks
  //         {
  //           bool inside_i_to_j = boxboxinside2D(bbs[i], bbs[j]); // Check (i -> j)
  //           precomputedInside[i * group_count + j] = (byte)(inside_i_to_j ? 1 : 0);

  //           bool inside_j_to_i = boxboxinside2D(bbs[j], bbs[i]); // Check (j -> i)
  //           precomputedInside[j * group_count + i] = (byte)(inside_j_to_i ? 1 : 0);
  //         }
  //       }

  //       bool[] inner = new bool[count]; // Store orientation for curves

  //       // Loop through the bounding boxes, optimized to avoid unnecessary checks
  //       for (int i = 0; i < group_count; i++)
  //       {
  //         for (int j = i + 1; j < group_count; j++) // Avoid duplicate checks: j > i ensures no repeat
  //         {
  //           if (precomputedInside[i * group_count + j] == 1)
  //           {
  //             for (int k = 0; k < count; k++) // Update keys for matching bounding box pairs
  //             {
  //               if (keys[k] == j)
  //               {
  //                 keys[k] = i;
  //                 inner[k] = true;  // Mark as inside
  //               }
  //             }
  //           }

  //           if (precomputedInside[j * group_count + i] == 1) // Also check the opposite direction
  //           {
  //             for (int k = 0; k < count; k++)
  //             {
  //               if (keys[k] == i)
  //               {
  //                 keys[k] = j;
  //                 inner[k] = true;
  //               }
  //             }
  //           }
  //         }
  //       }

  //       key_values = keys;
  //       orientation = inner;
  //       return curveloops;

  //       */

  // }


public static int[] RankBoundingBoxesByArea(BoundingBox[] bbs, bool smallest = true)
{
    int n = bbs.Length;

    // 1. Compute 2‑D areas (ignore Z)
    double[] areas = new double[n];
    for (int i = 0; i < n; i++)
    {
        BoundingBox bb = bbs[i];
        double width  = bb.Max.X - bb.Min.X;
        double height = bb.Max.Y - bb.Min.Y;
        areas[i] = width * height;
    }

    // 2. Create index array
    int[] indices = new int[n];
    for (int i = 0; i < n; i++) indices[i] = i;

    // 3. Sort indices by descending area using Array.Sort with custom comparison
    if (smallest) Array.Sort(indices, new Comparison<int>((i1, i2) => areas[i1].CompareTo(areas[i2]))); 
    else Array.Sort(indices, new Comparison<int>((i1, i2) => areas[i2].CompareTo(areas[i1])));  // flip i1 and i2 to flip sort order

    // 4. Build the rank array
    int[] rank = new int[n];
    for (int r = 0; r < n; r++)
    {
        int originalIdx = indices[r];
        rank[originalIdx] = r; // r = 0 for smallest, r = n-1 for largest
    }

    return rank;
}



  [MethodImpl(MethodImplOptions.AggressiveInlining | MethodImplOptions.AggressiveOptimization)]
  public static void sort_crvs(Curve[] curves, double tol = 0.001)
  {
    int n = curves.Length;
    if (n < 2) return;

    // Precompute start/end points
    Point3d[] starts = Array.ConvertAll(curves, c => c.PointAtStart);
    Point3d[] ends = Array.ConvertAll(curves, c => c.PointAtEnd);

    // Remaining indices buffer
    int[] remaining = new int[n - 1];
    for (int i = 1; i < n; i++)
      remaining[i - 1] = i;
    int remCount = n - 1;

    // Chain-link the curves
    for (int i = 0; i < n - 1; i++)
    {
      Point3d currEnd = ends[i];
      int j = 0;

      while (j < remCount)
      {
        int idx = remaining[j];

        // match start‐to‐end
        if (currEnd.DistanceToSquared(starts[idx]) <= tol)
        {
          curves[i + 1] = curves[idx];
        }
        // match end‐to‐end (with reverse)
        else if (currEnd.DistanceToSquared(ends[idx]) <= tol)
        {
          curves[idx].Reverse();
          curves[i + 1] = curves[idx];
        }
        else
        {
          j++;
          continue;
        }

        // swap-tail removal
        remaining[j] = remaining[--remCount];
        break;
      }

    }
  }

  public static void sort_crvs(Curve[] curvesA, Curve[] curvesB, double tol = 0.001)
  {
    sort_crvs(curvesA, tol);
    set_first_curve(curvesA[0], ref curvesB);
    sort_crvs(curvesB, tol);
  }


  [MethodImpl(MethodImplOptions.AggressiveInlining | MethodImplOptions.AggressiveOptimization)]
  public static bool set_first_curve(Curve crv, ref Curve[] curve_list, double tol = 0.001)
  {
    int count = curve_list.Length;
    bool flip = false;

    Interval crv_int = crv.Domain;
    double crv_dom = crv_int.T1 - crv_int.T0;
    double tA = crv_int.T0 + 0.3 * crv_dom;
    double tB = crv_int.T0 + 0.7 * crv_dom;

    Point3d ptA = crv.PointAt(tA);
    Point3d ptB = crv.PointAt(tB);

    double ax = ptA.X, ay = ptA.Y, az = ptA.Z;
    double bx = ptB.X, by = ptB.Y, bz = ptB.Z;

    double minDistance = double.MaxValue;
    int start = 0;

    for (int i = 0; i < count; i++)
    {
      Curve c = curve_list[i];

      Interval interval = c.Domain;
      double domain = interval.T1 - interval.T0;
      double t0 = interval.T0 + 0.3 * domain;
      double t1 = interval.T0 + 0.7 * domain;

      Point3d pt0 = c.PointAt(t0);
      Point3d pt1 = c.PointAt(t1);

      // inline squared distances: (A to 0/1)
      double dx = ax - pt0.X; double dy = ay - pt0.Y; double dz = az - pt0.Z;
      double dA0 = dx * dx + dy * dy + dz * dz;

      dx = ax - pt1.X; dy = ay - pt1.Y; dz = az - pt1.Z;
      double dA1 = dx * dx + dy * dy + dz * dz;

      double dAmin = dA0 < dA1 ? dA0 : dA1;

      // inline squared distances: (B to 0/1)
      dx = bx - pt0.X; dy = by - pt0.Y; dz = bz - pt0.Z;
      double dB0 = dx * dx + dy * dy + dz * dz;

      dx = bx - pt1.X; dy = by - pt1.Y; dz = bz - pt1.Z;
      double dB1 = dx * dx + dy * dy + dz * dz;

      double dBmin = dB0 < dB1 ? dB0 : dB1;

      double distance = dAmin + dBmin;

      if (distance < minDistance)
      {
        minDistance = distance;
        start = i;
      }
    }

    if (start > 0)
    {
      // in-place rotate left by 'start' positions with triple reverse (no allocation)
      Array.Reverse(curve_list, 0, start);
      Array.Reverse(curve_list, start, count - start);
      Array.Reverse(curve_list, 0, count);
    }

    // recompute only the needed points for the first curve; compare squared distances to decide flip
    Curve first = curve_list[0];
    crv_int = first.Domain;
    crv_dom = crv_int.T1 - crv_int.T0;
    tA = crv_int.T0 + 0.3 * crv_dom;
    tB = crv_int.T0 + 0.7 * crv_dom;

    // Interval d0 = first.Domain;
    // double dt0 = d0.T1 - d0.T0;
    // double tf0 = d0.T0 + 0.3 * dt0;
    // double tf1 = d0.T0 + 0.7 * dt0;

    Point3d q0 = first.PointAt(tA);
    Point3d q1 = first.PointAt(tB);

    double ddx = ax - q0.X; double ddy = ay - q0.Y; double ddz = az - q0.Z;
    double d0sq = ddx * ddx + ddy * ddy + ddz * ddz;

    ddx = ax - q1.X; ddy = ay - q1.Y; ddz = az - q1.Z;
    double d1sq = ddx * ddx + ddy * ddy + ddz * ddz;

    if (d0sq > d1sq)
    {
      first.Reverse();
      flip = true;
    }

    return flip;
  }


  public static Plane curves_plane(Curve[] curves, double tol = 0.01)  // Optimized
  {
    int count = curves.Length;
    BoundingBox bb = bb_union(curves);

    if (bb.Max.Z - bb.Min.Z < 0.01) return new Plane(bb.Center, Vector3d.XAxis, Vector3d.YAxis); // XY Plane
    if (bb.Max.X - bb.Min.X < 0.01) return new Plane(bb.Center, Vector3d.YAxis, Vector3d.ZAxis); // ZY Plane
    if (bb.Max.Y - bb.Min.Y < 0.01) return new Plane(bb.Center, Vector3d.XAxis, Vector3d.ZAxis); // ZX Plane

    HashSet<Plane> uniquePlanes = new HashSet<Plane>();
    for (int i = 0; i < count; i++)
    {
      if (curves[i].TryGetPlane(out Plane pl, tol))
      {
        pl.Origin = bb.Center;
        uniquePlanes.Add(pl);
      }
    }
    return uniquePlanes.First();
  }
  static int max_int(ReadOnlySpan<int> keys)
  {
    int max = keys[0];
    for (int i = 1; i < keys.Length; i++)
      if (keys[i] > max) max = keys[i];
    return max;
  }

  public static Curve[] object_curve_convert(IReadOnlyList<object> objects)
  {

    ArrayPool<Curve> pool = ArrayPool<Curve>.Shared;
    int count = objects.Count;
    // A rough upper bound – the worst case is a Curve that duplicates into many segments.
    // 2× is generous but still keeps the pool buffer small.



    // Pre‑allocate a buffer large enough to hold most of the results.
    Curve[] buffer = pool.Rent(count * 2);
    int index = 0;

    // Helper to grow the buffer when we run out of space.
    void Expand()
    {
      // Double the current size (or at least the remaining required slots)
      int newSize = Math.Max(buffer.Length * 2, index + count);
      Curve[] newBuf = pool.Rent(newSize);
      Array.Copy(buffer, newBuf, index);
      pool.Return(buffer);
      buffer = newBuf;
    }

    for (int i = 0; i < count; i++)
    {
      object obj = objects[i];

      switch (obj)
      {
        case Curve c:
          // DuplicateSegments() returns a List<Curve>, we copy it in a tight loop.
          foreach (var seg in c.DuplicateSegments())
          {
            if (index == buffer.Length) Expand();
            buffer[index++] = seg;
          }
          break;

        case Line l:
          if (index == buffer.Length) Expand();
          buffer[index++] = new LineCurve(l);
          break;

        case Circle cir:
          if (index == buffer.Length) Expand();
          buffer[index++] = new ArcCurve(cir);
          break;

        case Arc a:
          if (index == buffer.Length) Expand();
          buffer[index++] = new ArcCurve(a);
          break;
      }
    }

    // Slice the used portion into a new array of the exact size the caller expects.
    Curve[] result = new Curve[index];
    Array.Copy(buffer, result, index);

    // Return the temporary buffer to the pool.
    pool.Return(buffer);

    return result;
  }


  public static void TransformGeos(GeometryBase[] geos, Transform transform)
  {
    int count = geos.Length;
    for (int i = 0; i < count; i++) geos[i].Transform(transform);
  }

  public static BoundingBox[] bb_each(GeometryBase[] geos, double inflate = 0)
  {
    // Allocate the backing array once – this is the only allocation.
    int len = geos.Length;
    BoundingBox[] bb = new BoundingBox[len];

    // Create a Span over the array to eliminate bounds checks inside the loops.
    Span<BoundingBox> bbSpan = bb;

    // Fill the array with bounding boxes.
    for (int i = 0; i < len; i++) bbSpan[i] = geos[i].GetBoundingBox(true);

    // Inflate in place if required.
    if (inflate != 0) for (int i = 0; i < len; i++) bbSpan[i].Inflate(inflate);

    // Return the array – Span cannot be returned.
    return bb;
  }
  public static BoundingBox bb_union(GeometryBase[] geos, double inflate = 0)
  {
    double box_x_min = double.MaxValue;
    double box_x_max = double.MinValue;
    double box_y_max = double.MinValue;
    double box_y_min = double.MaxValue;
    double box_z_min = double.MaxValue;
    double box_z_max = double.MinValue;

    for (int i = 0; i < geos.Length; i++)
    {
      BoundingBox bb = geos[i].GetBoundingBox(true);
      Point3d min = bb.Min;
      Point3d max = bb.Max;

      if (min.X < box_x_min) box_x_min = min.X;
      if (max.X > box_x_max) box_x_max = max.X;
      if (min.Y < box_y_min) box_y_min = min.Y;
      if (max.Y > box_y_max) box_y_max = max.Y;
      if (min.Z < box_z_min) box_z_min = min.Z;
      if (max.Z > box_z_max) box_z_max = max.Z;
    }

    box_x_min -= inflate;
    box_x_max += inflate;
    box_y_max -= inflate;
    box_y_min += inflate;
    box_z_min -= inflate;
    box_z_max += inflate;

    return new BoundingBox(box_x_min, box_y_min, box_z_min, box_x_max, box_y_max, box_z_max);
  }
  public static bool boxinside(BoundingBox outer, BoundingBox inner)
  {
    if (outer.Min.X > inner.Min.X) return false;
    if (outer.Max.X < inner.Max.X) return false;
    if (outer.Min.Y > inner.Min.Y) return false;
    if (outer.Max.Y < inner.Max.Y) return false;
    if (outer.Min.Z > inner.Min.Z) return false;
    if (outer.Max.Z < inner.Max.Z) return false;
    return true;
  }
  public static bool boxboxinside2D(BoundingBox outer, BoundingBox inner)
  {
    if (outer.Min.X > inner.Min.X) return false;
    if (outer.Max.X < inner.Max.X) return false;
    if (outer.Min.Y > inner.Min.Y) return false;
    if (outer.Max.Y < inner.Max.Y) return false;

    return true;
  }
  public bool no_input(string name) => Component.Params.Input[Component.Params.IndexOfInputParam(name)].SourceCount == 0;
# ---------- end emboss ----------
emboss_2 = Extrude_capped(brep=geo_5, crvs=move_2.Geometry, extrude=number_slider_18)  # -> out, E, A, B, C, D, F; inputs brep: Brep, crvs: list, extrude: Double, radii: list of Double, bulges: list of Double
# ---------- emboss_2: C# ----------
    // Update 2025-08-29

    Component.Message = "";

    bool has_brep = !no_input("brep");
    bool has_radii = !no_input("radii");
    if (radii.Count == 1) radii.Add(radii[0]);
    if (has_radii) if (radii[0] == 0 && radii[1] == 0) has_radii = false;

    if (no_input("crvs")) return;
    if (no_input("extrude")) extrude = 5.0;
    if (no_input("bulges")) bulges = new List<double> { 0.65, 0.65 };
    else if (bulges.Count == 1) bulges.Add(bulges[0]);

    bool capped = true;
    bool centre = true;
    const double tol = 0.01;
    Plane plane = Plane.WorldXY;




    // Curve[] curve_loops = Curve.JoinCurves(curve_list, tol, false, true, out int[] test_keys);
    // BoundingBox[] bb_containers = containers(curve_loops, tol);
    // int group_count = bb_containers.Length;

    // BoundingBox[] bbs_crvs = bb_each(curve_list);
    // Curve[][] crv_groups = containers_grouped(bb_containers, bbs_crvs, curve_list); // last array contains curves that are not planar and to be treated separately??


    // for (int i = 0; i < group_count; i++)
    // {
    //   for (int j = 0; j < crv_groups[i].Length; j++)
    //   {
    //     Curve[] loops = donut_sort(crv_groups[i], tol, out int[] key_values, out bool[] orientation);
    //   }
    // }


    // if (centre) orient = Transform.Translation(-dir * 0.5) * orient;
    // TransformGeos(curve_list, orient);


    // ------- Set up Curves ------- //

    Curve[] curve_list = object_curve_convert(crvs);
    clean_lines(ref curve_list);

    int crv_count = curve_list.Length;

    Brep[] srfs = Brep.CreatePlanarBreps(curve_list, tol);
    int count = srfs.Length;


    // ------- Get the Orients without moving anything, then use the original BB and Curve locations to group the curves

    Transform[] orients = new Transform[count];
    Transform[] reorients = new Transform[count];
    BoundingBox[] bb_srfs = new BoundingBox[count];
    Plane[] test_plns = new Plane[count];
    for (int i = 0; i < count; i++)
    {
      Plane temp_pl = srf_plane(srfs[i], out bb_srfs[i]);
      orients[i] = Transform.PlaneToPlane(temp_pl, plane);
      reorients[i] = Transform.PlaneToPlane(plane, temp_pl);
      test_plns[i] = temp_pl;
    }


    // ------- Finds out which curves are in which BB then give them a corresponding group_idx

    //int[] process_order = RankBoundingBoxesByVolume(bb_srfs);

    int[] group_idx = new int[crv_count];
    bool[] done_crvs = new bool[crv_count]; //     Array.Fill(done_crvs, false); Already populated with 'false'

    BoundingBox[] bbs_crvs = bb_each(curve_list);

    for (int i = 0; i < count; i++)
    {
      //int idx = process_order[i];
      for (int j = 0; j < crv_count; j++)
      {
        if (!done_crvs[j])
        {
          if (bb_srfs[i].Contains(bbs_crvs[j]))
          {
            group_idx[j] = i;
            done_crvs[j] = true;
          }
        }
      }
    }


    // ------- Start by selecting curves by group, and then split the curves into inside (-ve space) curves and outside curves
    Print(count.ToString());
    for (int i = 0; i < count; i++)
    {
      Curve[] temp_crvs = key_select(curve_list, group_idx, i);
      int temp_count = temp_crvs.Length;
      if (temp_count == 0) continue;
      for (int j = 0; j < temp_count; j++) temp_crvs[j].Transform(orients[i]);

      Curve[] joined_curves = Curve.JoinCurves(temp_crvs, tol, false, true, out int[] temp_keys);
      Curve[] outer = new Curve[temp_count];
      Curve[] inner = new Curve[temp_count];


      if (joined_curves.Length > 1)
      {
        int[] ranking = RankBoundingBoxesByArea(Array.ConvertAll(joined_curves, c => c.GetBoundingBox(true)), false);
        int target = ranking[0];

        int inner_count = 0;
        int outer_count = 0;
        for (int j = 0; j < temp_count; j++)
        {
          if (temp_keys[j] == target) outer[outer_count++] = temp_crvs[j];
          else inner[inner_count++] = temp_crvs[j];
        }

        Array.Resize(ref outer, outer_count);
        Array.Resize(ref inner, inner_count);
      }
      else Array.Copy(temp_crvs, outer, temp_count);

      brep.Transform(orients[i]);

      if (has_radii) brep = hole_extrude(brep, outer, inner, extrude, tol, out Plane out_pl, out Curve[] out_crvs);
      else brep = simple_hole(brep, outer, inner, extrude, tol, out Plane out_pl, out Curve[] out_crvs);

      brep.Transform(reorients[i]);


    }

    /*

          if (no_input("brep"))
          {
            // ------- Create Breps ------- //

            List<GH_Brep> all_breps = new List<GH_Brep>();
            for (int i = 0; i < bb_count; i++)
            {
              Curve[] curves = key_select(curve_list, group_idx, i);
              int curve_count = curves.Length;

              int side_count = capped ? curve_count + 2 : curve_count;
              Brep[] sides = new Brep[side_count];
              for (int j = 0; j < curve_count; j++) sides[j] = Surface.CreateExtrusion(curves[j], dir).ToBrep();

              if (capped)
              {
                sides[curve_count] = Brep.CreatePlanarBreps(curves, tol)[0];
                sides[curve_count + 1] = sides[curve_count].DuplicateBrep();
                sides[curve_count + 1].Transform(Transform.Translation(dir));
              }
              Brep[] body = Brep.JoinBreps(sides, tol, 0.1);

              if (body.Length == 1 && body[0].SolidOrientation == BrepSolidOrientation.Inward) body[0].Flip();
              TransformGeos(body, reorient);
              all_breps.AddRange(Array.ConvertAll(body, b => new GH_Brep(b)));
            }

            E = all_breps;
          }


          else
          {
            List<Brep> all_breps = new List<Brep>();
            for (int i = 0; i < count; i++)
            {
              Curve[] curves = key_select(curve_list, inside, group_idx, i, out bool[] orients);
              int crv_count = curves.Length;

              int co = 0;
              int ci = 0;

              for (int j = 0; j < crv_count; j++)
              {
                if (orients[j]) co++;
                else ci++;
              }

              // Initialize arrays with exact required sizes
              Curve[] curves_outer = new Curve[co];
              Curve[] curves_inner = new Curve[ci];

              co = 0;
              ci = 0;

              for (int j = 0; j < crv_count; j++)
              {
                if (orients[j]) curves_outer[co++] = curves[j];
                else curves_inner[ci++] = curves[j];
              }

              // brep = hole_extrude(curves_outer, curves_inner, brep, extrude, tol, out Plane out_pl, out Curve[] out_crvs);

              // ---------------------------- FIX THIS / FIX THIS / FIX THIS / FIX THIS / FIX THIS / FIX THIS ---------------------------- //

              all_breps.Add(hole_extrude(curves_outer, curves_inner, brep, extrude, tol, out Plane out_pl, out Curve[] out_crvs));



            }
            E = all_breps;
            //E = brep;
          }
    */
# ---------- emboss_2: C# additional code ----------
  private Brep simple_hole(Brep brep, Curve[] curves_outer, Curve[] curves_inner, double extrude, double tol, out Plane pl, out Curve[] crvs)
  {
    Plane pln = Plane.WorldXY;
    Vector3d Z_up = Vector3d.ZAxis;

    int count = curves_inner.Length + curves_outer.Length;


    bool remirror = brep.GetBoundingBox(true).Center.Z < 0;  // Put Brep above Plane.XY
    Transform mirror = Transform.Mirror(pln);
    if (remirror) brep.Transform(mirror);

    if (extrude == 0) { pl = pln; crvs = curves_outer.Concat(curves_inner).ToArray(); return brep; }
    double flip = (extrude < 0) ? -1 : 1;


    // ------- Separate BrepFaces ------- //

    Brep[] final_breps = new Brep[count * 3 + 3];
    separate_brepfaces(brep, curves_outer, Z_up, out Brep brep_half, out Brep brep_out);
    // final_breps[count * 3 + 1] = brep_out;

    Print(curves_inner.Length.ToString());
    Print(curves_outer.Length.ToString());


    // ------- Setup Curves ------- //



    // curves_outer = Array.ConvertAll(curves_outer, c => project_closest(c, brep_half, Z_up, tol));
    // curves_inner = Array.ConvertAll(curves_inner, c => project_closest(c, brep_half, Z_up, tol));
    // Curve[] crvA = new Curve[count];

    // Array.Copy(curves_outer, crvA, curves_outer.Length);
    // Array.Copy(curves_inner, 0, crvA, curves_outer.Length, curves_inner.Length);

    // Curve[] crvB = Array.ConvertAll(crvA, c => c.DuplicateCurve());
    // Curve[] final_crvs = Array.ConvertAll(crvA, c => c.DuplicateCurve());

    // Plane base_plane = Plane.WorldXY;
    // Plane inside_plane = Plane.WorldXY;
    // Point3d central_pt = project_point(Point3d.Origin, brep, Z_up);
    // base_plane.Origin = central_pt;
    // base_plane.Transform(Transform.Translation(0, 0, extrude));

    // TransformGeos(crvB, Transform.Scale(inside_plane, 1, 1, 0));





    // // ------- main loop ------- //

    // //List<Curve> test_crvs = new List<Curve>();

    // LoftType straight_loft = LoftType.Straight;

    // for (int i = 0; i < count; i++)
    // {
    //   final_breps[i] = Brep.CreateFromLoft(new[] { crvA[i], crvB[i] }, pu, pu, straight_loft, false)[0];
    // }



    // // ------- Re-Assemble parts ------- //

    // Brep[] caps = Brep.CreatePlanarBreps(crvB, 0.001);

    // BoundingBox target_bb = bb_union(crvA);
    // target_bb.Inflate(0.1);

    // List<Brep> pieces = brep_half.Split(crvA, tol).Where(b => !boxboxinside2D(target_bb, b.GetBoundingBox(true))).ToList();

    // pieces.AddRange(final_breps);

    // Brep final_brep = Brep.JoinBreps(pieces, 0.001, 0.1)[0]; // new Brep(); //  brep; //

    // base_plane = new Plane(base_plane.Origin, -base_plane.XAxis, -base_plane.YAxis);

    // if (remirror)
    // {
    //   final_brep.Transform(mirror);
    //   brep.Transform(mirror);
    //   base_plane.Transform(mirror);
    //   TransformGeos(final_crvs, mirror);
    // }

    // if (final_brep.SolidOrientation == BrepSolidOrientation.Inward) final_brep.Flip();

    pl = Plane.WorldXY; //base_plane; // 
    crvs = new[] { new LineCurve(Point3d.Origin, new Point3d(0, 0, 1)) }; // crvA.Concat(crvB).Concat(crvC).Concat(crvD).ToArray(); //  crvD; // final_crvs; // 

    return brep_half; // new Brep(); //final_brep; // 
  }


  private Brep hole_extrude(Brep brep, Curve[] curves_outer, Curve[] curves_inner, double extrude, double tol, out Plane pl, out Curve[] crvs)
  {
    Plane pln = Plane.WorldXY;
    Vector3d Z_up = Vector3d.ZAxis;

    int count = curves_inner.Length + curves_outer.Length;


    bool remirror = brep.GetBoundingBox(true).Center.Z < 0;  // Put Brep above Plane.XY
    Transform mirror = Transform.Mirror(pln);
    if (remirror) brep.Transform(mirror);

    if (extrude == 0) { pl = pln; crvs = curves_outer.Concat(curves_inner).ToArray(); return brep; }
    double flip = (extrude < 0) ? -1 : 1;


    // ------- Separate BrepFaces ------- //

    Brep[] final_breps = new Brep[count * 3 + 3];
    separate_brepfaces(brep, curves_outer, Z_up, out Brep brep_half, out Brep brep_out);
    // final_breps[count * 3 + 1] = brep_out;

    Print(curves_inner.Length.ToString());
    Print(curves_outer.Length.ToString());


    // ------- Setup Curves ------- //



    // curves_outer = Array.ConvertAll(curves_outer, c => project_closest(c, brep_half, Z_up, tol));
    // curves_inner = Array.ConvertAll(curves_inner, c => project_closest(c, brep_half, Z_up, tol));
    // Curve[] crvA = new Curve[count];

    // Array.Copy(curves_outer, crvA, curves_outer.Length);
    // Array.Copy(curves_inner, 0, crvA, curves_outer.Length, curves_inner.Length);

    // Curve[] crvB = Array.ConvertAll(crvA, c => c.DuplicateCurve());
    // Curve[] final_crvs = Array.ConvertAll(crvA, c => c.DuplicateCurve());

    // Plane base_plane = Plane.WorldXY;
    // Plane inside_plane = Plane.WorldXY;
    // Point3d central_pt = project_point(Point3d.Origin, brep, Z_up);
    // base_plane.Origin = central_pt;
    // base_plane.Transform(Transform.Translation(0, 0, extrude));

    // TransformGeos(crvB, Transform.Scale(inside_plane, 1, 1, 0));





    // // ------- main loop ------- //

    // //List<Curve> test_crvs = new List<Curve>();

    // LoftType straight_loft = LoftType.Straight;

    // for (int i = 0; i < count; i++)
    // {
    //   final_breps[i] = Brep.CreateFromLoft(new[] { crvA[i], crvB[i] }, pu, pu, straight_loft, false)[0];
    // }



    // // ------- Re-Assemble parts ------- //

    // Brep[] caps = Brep.CreatePlanarBreps(crvB, 0.001);

    // BoundingBox target_bb = bb_union(crvA);
    // target_bb.Inflate(0.1);

    // List<Brep> pieces = brep_half.Split(crvA, tol).Where(b => !boxboxinside2D(target_bb, b.GetBoundingBox(true))).ToList();

    // pieces.AddRange(final_breps);

    // Brep final_brep = Brep.JoinBreps(pieces, 0.001, 0.1)[0]; // new Brep(); //  brep; //

    // base_plane = new Plane(base_plane.Origin, -base_plane.XAxis, -base_plane.YAxis);

    // if (remirror)
    // {
    //   final_brep.Transform(mirror);
    //   brep.Transform(mirror);
    //   base_plane.Transform(mirror);
    //   TransformGeos(final_crvs, mirror);
    // }

    // if (final_brep.SolidOrientation == BrepSolidOrientation.Inward) final_brep.Flip();

    pl = Plane.WorldXY; //base_plane; // 
    crvs = new[] { new LineCurve(Point3d.Origin, new Point3d(0, 0, 1)) }; // crvA.Concat(crvB).Concat(crvC).Concat(crvD).ToArray(); //  crvD; // final_crvs; // 

    return brep_half; // new Brep(); //final_brep; // 
  }




  public static void clean_lines(ref Curve[] curves, double tol = 0.01)
  {
    const double DOT_THRESHOLD = 0.99619; // ~5 degrees

    bool[] islinear = Array.ConvertAll(curves, c => c.IsLinear(tol));
    Point3d[] startpt = Array.ConvertAll(curves, c => c.PointAtStart);
    Point3d[] endpt = Array.ConvertAll(curves, c => c.PointAtEnd);
    Vector3d[] startvec = Array.ConvertAll(curves, c => c.TangentAtStart);
    Vector3d[] endvec = Array.ConvertAll(curves, c => c.TangentAtEnd);

    int count = curves.Length;
    Curve[] result = new Curve[count];
    int w = 0;


    for (int i = 0; i < count; i++)
    {
      if (i + 1 < count)
      {

        if (islinear[i] && islinear[i + 1] && endvec[i] * startvec[i + 1] > DOT_THRESHOLD)
        {
          result[w++] = new LineCurve(startpt[i], endpt[i + 1]);
          i++; // skip the next curve (merged)
          continue;
        }
      }

      result[w++] = curves[i];
    }

    if (w != count)
    {
      Curve[] trimmed = new Curve[w];
      Array.Copy(result, trimmed, w); // Faster than manual loop
      curves = trimmed;
    }
    else
    {
      curves = result;
    }
  }



  public void separate_brepfaces(Brep brep, Curve[] crvs, Vector3d direction, out Brep brep_in, out Brep brep_out) // !!! FIX !!!
  {
    double tol = 0.001;
    int count = crvs.Length;
    int face_count = brep.Faces.Count;

    bool should_orient = direction.EpsilonEquals(Vector3d.ZAxis, tol);
    Transform reorient = Transform.Unset;
    if (should_orient)
    {
      Plane pl = curves_plane(crvs);
      Transform orient = Transform.PlaneToPlane(pl, Plane.WorldXY);
      reorient = Transform.PlaneToPlane(Plane.WorldXY, pl);
      TransformGeos(crvs, orient);
      brep.Transform(orient);
    }

    int ptnum = 14;
    double pt_gap = 1.0 / ptnum;
    Point3d[] pts = new Point3d[count * ptnum];
    int counter = 0;
    for (int i = 0; i < count; i++)
    {
      crvs[i].Reparameterize();
      for (int j = 0; j < ptnum; j++)
      {
        // pts[counter++] = Intersection.RayShoot(new Ray3d(crvs[i].PointAt(pt_gap * (j + 0.5)), direction), new[] { brep }, 1)[0];
        pts[counter++] = project_point(crvs[i].PointAt(pt_gap * (j + 0.5)), brep, direction);
      }
    }

    HashSet<int> index_in = new HashSet<int>();
    for (int i = 0; i < pts.Length; i++)
    {
      brep.ClosestPoint(pts[i], out _, out ComponentIndex ci, out _, out _, tol, out _);
      if (ci.Index != -1) index_in.Add(ci.Index);
    }

    List<int> index_out = new List<int>();
    for (int i = 0; i < face_count; i++)
    {
      if (!index_in.Contains(i)) index_out.Add(i);  //index_outx[counter++] = i;
    }

    BoundingBox test_box = new BoundingBox(pts);
    test_box.Union(new Point3d(0, 0, -brep.GetBoundingBox(false).Min.Z - 10));
    test_box.Transform(Transform.Translation(0, 0, tol));
    for (int i = index_out.Count - 1; i >= 0; i--)
    {
      if (boxinside(test_box, brep.DuplicateSubBrep(new[] { index_out[i] }).GetBoundingBox(true)))
      {
        index_in.Add(index_out[i]);
        index_out.RemoveAt(i);
      }
    }

    if (should_orient) brep.Transform(reorient);

    brep_in = brep.DuplicateSubBrep(index_in);
    brep_out = brep.DuplicateSubBrep(index_out);
  }

  public static Point3d project_point(Point3d pt, Brep brep, Vector3d direction) // Optimised
  {
    pt = new Point3d(pt - direction);
    Point3d[] pts = Intersection.RayShoot(new Ray3d(pt, direction), new[] { brep }, 2);
    int len = pts.Length;
    if (len == 1) return pts[0];
    if (len == 2)
    {
      double dist1 = pt.DistanceToSquared(pts[0]);
      double dist2 = pt.DistanceToSquared(pts[1]);
      return dist1 < dist2 ? pts[0] : pts[1];
    }
    if (len > 2)
    {
      int closest_idx = 0;
      double min_dist = pt.DistanceToSquared(pts[0]);

      for (int i = 1; i < len; i++)
      {
        double dist = pt.DistanceToSquared(pts[i]);
        if (dist < min_dist)
        {
          min_dist = dist;
          closest_idx = i;
        }
      }
      return pts[closest_idx];
    }

    return Point3d.Unset;
  }

  public static NurbsSurface planar_srf(double x = 1, double y = 1)
  {
    x *= 0.5;
    y *= 0.5;

    return NurbsSurface.CreateFromCorners(
      new Point3d(-x, -y, 0),
      new Point3d(-x, y, 0),
      new Point3d(x, y, 0),
      new Point3d(x, -y, 0));
  }

  public static Curve project_closest(Curve crv, Brep brep, Vector3d dir, double tol)  // Optimised
  {
    Interval interval = new Interval(0, 1);

    crv.Transform(Transform.Translation(-dir));
    Curve[] projected_curves = Curve.ProjectToBrep(crv, brep, dir, tol);
    Curve[] projected_joined = Curve.JoinCurves(projected_curves, tol, false);

    Point3d centre = crv.GetBoundingBox(true).Center;
    int closestIndex = 0;
    double minDistance = double.MaxValue;

    for (int i = 0; i < projected_joined.Length; i++)
    {
      projected_joined[i].Domain = interval;
      double distance = centre.DistanceToSquared(projected_joined[i].GetBoundingBox(true).Center);
      if (distance < minDistance)
      {
        minDistance = distance;
        closestIndex = i;
      }

    }
    return projected_joined[closestIndex];
  }

  public static bool test_flat(Curve[] crvs, Brep brep, Vector3d direction, double tol, out Point3d[] test_pts)
  {
    int count = crvs.Length;
    Interval interval = new Interval(0, 1);

    Point3d[] pts = new Point3d[count * 3];
    for (int i = 0; i < count; i++)
    {
      crvs[i].Domain = interval;
      pts[i] = project_point(crvs[i].PointAt(0.15), brep, direction);
      pts[count + i] = project_point(crvs[i].PointAt(0.5), brep, direction);
      pts[(count * 2) + i] = project_point(crvs[i].PointAt(0.85), brep, direction);
    }

    test_pts = pts;
    Plane.FitPlaneToPoints(pts, out _, out double amount);
    return amount < tol;
  }

  private Brep quick_extrude(Curve[] crvs, double extrude, double radius, double bulge, int sectors, bool centre, double tol, out Curve[] out_crvs)
  {
    // -------  Set Up Conditions  ------- //

    bool loop = crvs.Length == 1 && crvs[0].IsClosed;
    bool mirror = extrude != Math.Abs(extrude) && !centre;
    extrude = Math.Abs(extrude);
    int cross_num = (bulge == 0) ? 2 : 4;

    bool has_sides = radius < extrude * 0.5;
    if (!has_sides) radius = extrude * 0.5;

    bool C2arc = bulge <= -1 && (radius * 3) + tol < extrude; // bulge is less than one and does not make the radius bigger than half the extrude
    if (C2arc)
    {
      radius *= 1.5;
      bulge = 0.72;
    }

    // -------  Set Up Standard Variables  ------- //

    int count = crvs.Length;
    Point3d pu = Point3d.Unset;

    Curve[] crvA = offset(crvs, -radius, out _, tol);
    Curve[] crvC = crvs.Select(c => c.DuplicateCurve()).ToArray();

    if (Math.Abs(crvA[0].PointAtStart.DistanceTo(crvs[0].PointAtStart) - radius) > tol) sort_crvs(crvA, crvs);

    Transform moveB = Transform.Translation(0, 0, radius);
    Transform moveC = Transform.Translation(0, 0, extrude - radius);
    Transform moveD = Transform.Translation(0, 0, extrude);
    Transform moveC2 = Transform.Translation(0, 0, radius);
    Transform mirror_trans = Transform.Mirror(Plane.WorldXY);
    Transform centre_trans = Transform.Translation(0, 0, -(extrude * 0.5));

    // -------  Main Loop - Build Surfaces  ------- //

    Brep[] srfs = new Brep[(count * 3) + 2];

    for (int i = 0; i < count; i++)
    {
      bool straight = crvs[i].IsLinear(0.01);
      crvs[i].Transform(moveB);  // ---- Arrange Curves---- //
      crvC[i].Transform(moveC);

      if (has_sides) srfs[i] = Brep.CreateFromLoft(new[] { crvs[i], crvC[i] }, pu, pu, LoftType.Straight, false)[0];
      srfs[i].Flip();
      int edge_num = straight ? 2 : sectors;

      Curve[] edges = simple_edges(crvA[i], crvs[i], bulge, edge_num);
      srfs[count + i] = edge_srf(crvs[i], crvA[i], edges, cross_num); //

      srfs[(count * 2) + i] = srfs[count + i].DuplicateBrep();
      srfs[(count * 2) + i].Transform(mirror_trans);
      srfs[(count * 2) + i].Transform(moveD);
      crvC[i].Transform(moveC2);
    }

    srfs[count * 3] = Brep.CreatePlanarBreps(crvA, 0.001)[0];
    srfs[(count * 3) + 1] = srfs[count * 3].DuplicateBrep();
    srfs[(count * 3) + 1].Transform(moveD);

    Brep brep = Brep.JoinBreps(srfs.Where(s => s != null), 0.001, 0.1)[0];

    if (mirror) { brep.Transform(mirror_trans); TransformGeos(crvC, mirror_trans); }
    if (centre) { brep.Transform(centre_trans); TransformGeos(crvC, centre_trans); }

    out_crvs = crvC;

    return brep;
  }

  public static Curve[] simple_edges(Curve crvA, Curve crvB, double bulge, int sectors)
  {
    double gap = 1 / (sectors - 1.0);
    Interval interval = new Interval(0, 1);
    crvA.Domain = interval;
    crvB.Domain = interval;
    Point3d[] ptsA = new Point3d[sectors];
    Point3d[] ptsB = new Point3d[sectors];
    for (int i = 0; i < sectors; i++)
    {
      ptsA[i] = crvA.PointAt(gap * i);
      ptsB[i] = crvB.PointAt(gap * i);
    }
    // Output Chamfers
    if (bulge == 0) return ptsA.Select((p, i) => new LineCurve(p, ptsB[i])).ToArray();
    // Output Arcs
    if (bulge < 0) return ptsA.Select((p, i) => new ArcCurve(new Arc(ptsB[i], -Vector3d.ZAxis, p))).ToArray();

    // Output Blends
    Curve[] edge_curves = new Curve[sectors];
    Curve side_ln = new LineCurve(new Point3d(0, 0, 1), Point3d.Origin);
    for (int i = 0; i < sectors; i++)
    {
      Vector3d move = new Vector3d(ptsB[i]);
      Vector3d vec = new Vector3d(ptsA[i] - ptsB[i]) { Z = 0 };
      Curve crv0 = new LineCurve(ptsA[i], ptsA[i] + vec);
      side_ln.Transform(Transform.Translation(move));
      edge_curves[i] = Curve.CreateBlendCurve(side_ln, crv0, BlendContinuity.Curvature, bulge, bulge);
      side_ln.Transform(Transform.Translation(-move));
    }
    return edge_curves;
  }

  public Brep edge_srf(Curve top, Curve bottom, Curve[] edge_curves, int num, bool loop = false, double tol = 0.001)
  {
    if (num < 3 || edge_curves == null)
    {
      return Brep.CreateFromLoft(new[] { top, bottom }, Point3d.Unset, Point3d.Unset, LoftType.Straight, false)[0];
    }
    double ang_tol = 0.1;
    double cos_tol = Math.Cos(ang_tol);

    Vector3d[] axes = new Vector3d[] { Vector3d.XAxis, -Vector3d.XAxis, Vector3d.YAxis, -Vector3d.YAxis, Vector3d.ZAxis, -Vector3d.ZAxis };

    Vector3d start = top.TangentAtStart; // Already Unitized Vector
    Vector3d end = top.TangentAtEnd;
    for (int i = 0; i < 6; i++)
    {
      if (start * axes[i] > cos_tol) { start = axes[i]; break; }
    }
    for (int i = 0; i < 6; i++)
    {
      if (end * axes[i] > cos_tol) { end = axes[i]; break; }
    }

    int count = edge_curves.Length;
    double gap = 1 / (num - 1.0);

    Curve[] curves = new Curve[num];

    if (edge_curves[0].PointAtStart.EpsilonEquals(top.PointAtStart, 0.01) ||
      edge_curves[0].PointAtStart.EpsilonEquals(top.PointAtEnd, 0.01))
    {
      curves[0] = top;
      curves[num - 1] = bottom;
    }
    else { curves[0] = bottom; curves[num - 1] = top; }

    int pt_num = loop ? count + 1 : count;
    Point3d[] edge_mid_pts = new Point3d[pt_num];

    for (int i = 1; i < num - 1; i++)
    {
      double gap_size = gap * i;
      for (int j = 0; j < count; j++) edge_mid_pts[j] = edge_curves[j].PointAtNormalizedLength(gap_size);
      if (loop) edge_mid_pts[count] = edge_mid_pts[0];

      Curve edge_mid = Curve.CreateInterpolatedCurve(edge_mid_pts, 3, CurveKnotStyle.Uniform, start, end);
      if (edge_mid.IsCircle(0.01)) edge_mid = new ArcCurve(new Circle(edge_mid_pts[0], edge_mid_pts[1], edge_mid_pts[2])); //circle_check(edge_mid, edge_mid_pts);
      else edge_mid = square_crv(edge_mid);
      curves[i] = edge_mid;
    }

    if (top.IsClosed) Array.Resize(ref edge_curves, edge_curves.Length - 1);

    NurbsSurface surface = NurbsSurface.CreateNetworkSurface(curves, 3, 3, edge_curves, 3, 3, tol, tol, tol, out _);
    if (surface == null) surface = NurbsSurface.CreateNetworkSurface(new[] { top, bottom }, 3, 3, edge_curves, 3, 3, tol, tol, tol, out _);

    return surface.ToBrep(); // new Brep(); //

  }  // optimized

  public Curve[] offset(Curve[] curves, double fillet, out Plane pln, double tol = 0.001)
  {
    int count = curves.Length;

    // CHANGE: cache plane once
    Plane plane = curves_plane(curves);
    pln = plane;

    if (fillet == 0)
    {
      // CHANGE: direct copy; no DuplicateCurve (faster if curves are never modified downstream)
      Curve[] copy = new Curve[count];
      for (int i = 0; i < count; i++) copy[i] = curves[i];
      return copy;
    }

    Point3d pt = plane.Origin;
    Vector3d normal = plane.Normal;

    // CHANGE: reuse temp arrays to avoid alloc cycles
    Curve[] off1 = new Curve[count];
    Curve[] off2 = new Curve[count];

    CurveOffsetCornerStyle cs = CurveOffsetCornerStyle.Smooth;
    CurveOffsetEndStyle es = CurveOffsetEndStyle.None;

    for (int i = 0; i < count; i++)
    {
      Curve c = curves[i];

      // CHANGE: store once; no IsArc tolerance allocation
      bool offset_type = !c.IsArc(0.1);

      // CHANGE: join curves more defensively — avoid allocation explosion
      Curve[] pos = c.Offset(pt, normal, fillet, tol, tol, offset_type, cs, es);
      Curve[] neg = c.Offset(pt, normal, -fillet, tol, tol, offset_type, cs, es);

      off1[i] = pos.Length > 0 ? Curve.JoinCurves(pos, tol, false)[0] : c;
      off2[i] = neg.Length > 0 ? Curve.JoinCurves(neg, tol, false)[0] : c;
    }

    // CHANGE: compute bounding boxes once; reuse reference
    BoundingBox bb1 = bb_union(off1);
    BoundingBox bb2 = bb_union(off2);

    double len1 = bb1.Diagonal.Length;
    double len2 = bb2.Diagonal.Length;

    // CHANGE: cache loop_crv once
    Curve[] loop = (fillet > 0) == (len1 < len2)
      ? loop_crv(off2, fillet)
      : loop_crv(off1, fillet);

    // CHANGE: direct return without intermediate arrays
    return (fillet > 0) == (len1 < len2)
      ? neaten_crvs(loop, curves)
      : square_crvs(loop);
  }

  private Curve[] key_select(Curve[] curve_list, int[] keys, int value)
  {
    // Cache frequently used values locally to avoid repeated field accesses
    int len = curve_list.Length;
    int val = value;

    int count = 0;
    for (int i = 0; i < len; ++i) if (keys[i] == val) count++;

    Curve[] result = new Curve[count];

    int idx = 0;
    for (int i = 0; i < len; ++i) if (keys[i] == val) result[idx++] = curve_list[i];

    return result;
  }

  private Curve[] key_select(Curve[] curve_list, bool[] orient_list, int[] keys, int value, out bool[] orients)
  {
    // Cache frequently used values locally to avoid repeated field accesses
    int len = curve_list.Length;
    int val = value;

    int count = 0;
    for (int i = 0; i < len; ++i) if (keys[i] == val) count++;

    Curve[] result = new Curve[count];
    bool[] orient = new bool[count];

    int idx = 0;
    for (int i = 0; i < len; ++i) if (keys[i] == val)
      {
        orient[idx] = orient_list[i];
        result[idx++] = curve_list[i];
      }

    orients = orient;
    return result;
  }

  public Curve square_crv(Curve crv, double tol = 0.1)
  {
    if (crv.IsLinear(0.01) || crv.IsArc(0.1)) return crv;

    NurbsCurve curve = crv.ToNurbsCurve();
    Point3d[] pts = curve.Points.Select(p => p.Location).ToArray();
    int count = pts.Length;
    if (curve.Points.Count < 6) return crv;

    Vector3d[] vecs = { Vector3d.XAxis, -Vector3d.XAxis, Vector3d.YAxis, -Vector3d.YAxis, Vector3d.ZAxis, -Vector3d.ZAxis };
    Vector3d start_vec = curve.TangentAtStart;
    Vector3d end_vec = curve.TangentAtEnd;

    bool start_found = false;
    bool end_found = false;

    for (int j = 0; j < 6; j++)
    {
      if (!start_found && start_vec.EpsilonEquals(vecs[j], tol))
      {
        if (vecs[j].X == 0) pts[1].X = pts[2].X = pts[0].X;
        if (vecs[j].Y == 0) pts[1].Y = pts[2].Y = pts[0].Y;
        if (vecs[j].Z == 0) pts[1].Z = pts[2].Z = pts[0].Z;
        start_found = true;
      }

      if (!end_found && end_vec.EpsilonEquals(vecs[j], tol))
      {
        if (vecs[j].X == 0) pts[count - 2].X = pts[count - 3].X = pts[count - 1].X;
        if (vecs[j].Y == 0) pts[count - 2].Y = pts[count - 3].Y = pts[count - 1].Y;
        if (vecs[j].Z == 0) pts[count - 2].Z = pts[count - 3].Z = pts[count - 1].Z;
        end_found = true;
      }
      if (start_found && end_found) break;
    }
    return Curve.CreateControlPointCurve(pts, curve.Degree);
  }

  public Curve[] square_crvs(Curve[] crvs, double tol = 0.1)
  {
    int count = crvs.Length;
    for (int i = 0; i < count; i++) crvs[i] = square_crv(crvs[i]);
    return crvs;
  }

  public Curve[] neaten_crvs(Curve[] crvs, Curve[] match_crvs, double tol = 0.1)
  {
    /// Designed for offset curves, where initial curves (match_crvs) are in a sorted loop, and the crvs also is a corresponding sorted loop
    /// Will also work for a single loop of curves that is not necessarily offset.  Just set match_crvs to 'null'.

    int count = crvs.Length;
    Interval interval = new Interval(0, 1);

    bool[] end_curvature_matches = new bool[count];
    bool[] is_linear = new bool[count];
    Vector3d[] end_tan = new Vector3d[count];
    Vector3d[] vecs = { Vector3d.XAxis, -Vector3d.XAxis, Vector3d.YAxis, -Vector3d.YAxis, Vector3d.ZAxis, -Vector3d.ZAxis };

    if (match_crvs.Length == count)
    {
      for (int i = 0; i < count; i++)
      {
        crvs[i].Domain = interval;
        match_crvs[i].Domain = interval;
        is_linear[i] = match_crvs[i].IsLinear(tol);
        end_tan[i] = match_crvs[i].TangentAtEnd;
        for (int j = 0; j < 6; j++) if (end_tan[i].EpsilonEquals(vecs[j], tol)) end_tan[i] = vecs[j];
      }

      for (int i = 0; i < count; i++)
      {
        int last = (i - 1 + count) % count;
        end_curvature_matches[i] = match_crvs[i].CurvatureAt(0).EpsilonEquals(match_crvs[last].CurvatureAt(1), 0.1) && match_crvs[i].TangentAtStart.EpsilonEquals(end_tan[last], 0.1);
      }
    }
    else
    {
      for (int i = 0; i < count; i++)
      {
        crvs[i].Domain = interval;
        is_linear[i] = crvs[i].IsLinear(tol);
        end_tan[i] = crvs[i].TangentAtEnd;
        for (int j = 0; j < 6; j++) if (end_tan[i].EpsilonEquals(vecs[j], tol)) end_tan[i] = vecs[j];
      }

      for (int i = 0; i < count; i++)
      {
        int last = (i - 1 + count) % count;
        end_curvature_matches[i] = crvs[i].CurvatureAt(0).EpsilonEquals(crvs[last].CurvatureAt(1), 0.1) && crvs[i].TangentAtStart.EpsilonEquals(end_tan[last], 0.1);
      }
    }


    // string test_vecs = "";
    // for (int i = 0; i < count; i++) test_vecs += is_linear[i].ToString() + ", " + crvs[i].ToNurbsCurve().Points.Count.ToString() +"|  " ;
    // Print(test_vecs);

    for (int i = 0; i < count; i++)
    {
      if (is_linear[i] || !end_curvature_matches[i] || crvs[i].IsArc(0.1)) continue;


      NurbsCurve curve = crvs[i].ToNurbsCurve();
      int ptnum = curve.Points.Count;
      //Print(ptnum.ToString());

      Point3d[] pts = curve.Points.Select(p => p.Location).ToArray();
      int degree = curve.Degree;
      if (ptnum < 6) continue;

      // ------- Square ends if not square

      Vector3d tan = end_tan[(i - 1 + count) % count];
      tan.Unitize();
      pts[1] = new Point3d(pts[0] + (tan * pts[0].DistanceTo(pts[1])));
      pts[2] = new Point3d(pts[0] + (tan * pts[0].DistanceTo(pts[2])));

      if (is_linear[(i + 1) % count])
      {
        tan = -end_tan[i];
        tan.Unitize();
        pts[ptnum - 2] = new Point3d(pts[ptnum - 1] + (tan * pts[ptnum - 1].DistanceTo(pts[ptnum - 2])));
        pts[ptnum - 3] = new Point3d(pts[ptnum - 1] + (tan * pts[ptnum - 1].DistanceTo(pts[ptnum - 3])));
      }

      crvs[i] = NurbsCurve.Create(false, degree, pts);
    }
    return crvs;
  }

  public static Curve[] loop_crv(Curve[] curves, double radius, double tol = 0.001)
  {
    if (Curve.JoinCurves(curves, tol, false)[0].IsClosed) return curves;

    int count = curves.Length;
    radius = Math.Abs(radius) * 2;

    //bool[] is_arc = new bool[count];
    Point3d[] startPoints = new Point3d[count];
    Point3d[] endPoints = new Point3d[count];
    double[] extendMin = new double[count];
    double[] extendMax = new double[count];

    for (int i = 0; i < count; i++)
    {
      //is_arc[i] = curves[i].IsArc(0.1);
      startPoints[i] = curves[i].PointAtStart;
      endPoints[i] = curves[i].PointAtEnd;
      extendMin[i] = curves[i].Domain.Min - radius;
      extendMax[i] = curves[i].Domain.Max + radius;
    }

    for (int i = 0; i < count; i++)
    {
      //if(is_arc[i]) continue;
      int last = (i + count - 1) % count;
      int next = (i + 1) % count;

      if (!startPoints[i].EpsilonEquals(endPoints[last], tol))
        curves[i] = curves[i].Extend(extendMin[i], curves[i].Domain.Max);
      if (!endPoints[i].EpsilonEquals(startPoints[next], tol))
        curves[i] = curves[i].Extend(curves[i].Domain.Min, extendMax[i]);
    }

    for (int i = 0; i < count; i++)
    {
      //if(is_arc[i]) continue;
      int last = (i + count - 1) % count;
      int next = (i + 1) % count;

      if (!startPoints[i].EpsilonEquals(endPoints[last], tol))
      {
        CurveIntersections cx = Intersection.CurveCurve(curves[i], curves[last], tol, tol);
        curves[i] = curves[i].Split(cx[0].ParameterA)[1];
        curves[last] = curves[last].Split(cx[0].ParameterB)[0];
      }
    }

    Interval interval = new Interval(0, 1);
    for (int i = 0; i < count; i++)
    {
      //if(is_arc[i]) continue;
      int degree = curves[i].Degree;
      Vector3d start = curves[i].TangentAtStart;
      Vector3d end = curves[i].TangentAtEnd;
      curves[i].Domain = interval;
      if (curves[i].CurvatureAt(0.5).SquareLength > 200 || curves[i].DuplicateSegments().Length > 1)
      {
        BoundingBox bb = curves[i].GetBoundingBox(true);

        int ptnum = (int)Math.Max(9, Math.Floor(curves[i].ToNurbsCurve().Points.Count * 1.0));
        Curve crv = curves[i].Rebuild(ptnum, degree, true);
        Point3d[] pts = crv.ToNurbsCurve().Points.Select(p => p.Location).ToArray();
        for (int j = 0; j < pts.Length; j++)
        {
          pts[j].X = Math.Max(bb.Min.X, Math.Min(bb.Max.X, pts[j].X));
          pts[j].Y = Math.Max(bb.Min.Y, Math.Min(bb.Max.Y, pts[j].Y));
          pts[j].Z = Math.Max(bb.Min.Z, Math.Min(bb.Max.Z, pts[j].Z));
        }
        curves[i] = Curve.CreateControlPointCurve(pts, degree); //NurbsCurve.Create(false, degree, pts);
      }
    }
    return curves;
  }
  public static int[] RankBoundingBoxesByArea(BoundingBox[] bbs, bool smallest = true)
  {
    int n = bbs.Length;

    // 1. Compute 2‑D areas (ignore Z)
    double[] areas = new double[n];
    for (int i = 0; i < n; i++)
    {
      BoundingBox bb = bbs[i];
      double width = bb.Max.X - bb.Min.X;
      double height = bb.Max.Y - bb.Min.Y;
      areas[i] = width * height;
    }

    // 2. Create index array
    int[] indices = new int[n];
    for (int i = 0; i < n; i++) indices[i] = i;

    // 3. Sort indices by descending area using Array.Sort with custom comparison
    if (smallest) Array.Sort(indices, new Comparison<int>((i1, i2) => areas[i1].CompareTo(areas[i2])));
    else Array.Sort(indices, new Comparison<int>((i1, i2) => areas[i2].CompareTo(areas[i1])));  // flip i1 and i2 to flip sort order

    // 4. Build the rank array
    int[] rank = new int[n];
    for (int r = 0; r < n; r++)
    {
      int originalIdx = indices[r];
      rank[originalIdx] = r; // r = 0 for smallest, r = n-1 for largest
    }

    return rank;
  }
  public static int[] RankBoundingBoxesByVolume(BoundingBox[] bbs, bool smallest = true)
  {
    int count = bbs.Length;

    // 1. Compute 2‑D areas (ignore Z)
    double[] vols = new double[count];
    for (int i = 0; i < count; i++)
    {
      BoundingBox bb = bbs[i];
      bb.Inflate(0.01);
      double width = bb.Max.X - bb.Min.X;
      double height = bb.Max.Y - bb.Min.Y;
      double depth = bb.Max.Z - bb.Min.Z;
      vols[i] = width * height * depth;
    }

    // 2. Create index array
    int[] indices = new int[count];
    for (int i = 0; i < count; i++) indices[i] = i;

    // 3. Sort indices by descending area using Array.Sort with custom comparison
    if (smallest) Array.Sort(indices, new Comparison<int>((i1, i2) => vols[i1].CompareTo(vols[i2])));
    else Array.Sort(indices, new Comparison<int>((i1, i2) => vols[i2].CompareTo(vols[i1])));  // flip i1 and i2 to flip sort order

    // 4. Build the rank array
    int[] rank = new int[count];
    for (int r = 0; r < count; r++)
    {
      int originalIdx = indices[r];
      rank[originalIdx] = r; // r = 0 for smallest, r = n-1 for largest
    }

    return rank;
  }

  [MethodImpl(MethodImplOptions.AggressiveInlining | MethodImplOptions.AggressiveOptimization)]
  public static void sort_crvs(Curve[] curves, double tol = 0.001)
  {
    int n = curves.Length;
    if (n < 2) return;

    // Precompute start/end points
    Point3d[] starts = Array.ConvertAll(curves, c => c.PointAtStart);
    Point3d[] ends = Array.ConvertAll(curves, c => c.PointAtEnd);

    // Remaining indices buffer
    int[] remaining = new int[n - 1];
    for (int i = 1; i < n; i++)
      remaining[i - 1] = i;
    int remCount = n - 1;

    // Chain-link the curves
    for (int i = 0; i < n - 1; i++)
    {
      Point3d currEnd = ends[i];
      int j = 0;

      while (j < remCount)
      {
        int idx = remaining[j];

        // match start‐to‐end
        if (currEnd.DistanceToSquared(starts[idx]) <= tol)
        {
          curves[i + 1] = curves[idx];
        }
        // match end‐to‐end (with reverse)
        else if (currEnd.DistanceToSquared(ends[idx]) <= tol)
        {
          curves[idx].Reverse();
          curves[i + 1] = curves[idx];
        }
        else
        {
          j++;
          continue;
        }

        // swap-tail removal
        remaining[j] = remaining[--remCount];
        break;
      }

    }
  }

  public static void sort_crvs(Curve[] curvesA, Curve[] curvesB, double tol = 0.001)
  {
    sort_crvs(curvesA, tol);
    set_first_curve(curvesA[0], ref curvesB);
    sort_crvs(curvesB, tol);
  }

  [MethodImpl(MethodImplOptions.AggressiveInlining | MethodImplOptions.AggressiveOptimization)]
  public static bool set_first_curve(Curve crv, ref Curve[] curve_list, double tol = 0.001)
  {
    int count = curve_list.Length;
    bool flip = false;

    Interval crv_int = crv.Domain;
    double crv_dom = crv_int.T1 - crv_int.T0;
    double tA = crv_int.T0 + 0.3 * crv_dom;
    double tB = crv_int.T0 + 0.7 * crv_dom;

    Point3d ptA = crv.PointAt(tA);
    Point3d ptB = crv.PointAt(tB);

    double ax = ptA.X, ay = ptA.Y, az = ptA.Z;
    double bx = ptB.X, by = ptB.Y, bz = ptB.Z;

    double minDistance = double.MaxValue;
    int start = 0;

    for (int i = 0; i < count; i++)
    {
      Curve c = curve_list[i];

      Interval interval = c.Domain;
      double domain = interval.T1 - interval.T0;
      double t0 = interval.T0 + 0.3 * domain;
      double t1 = interval.T0 + 0.7 * domain;

      Point3d pt0 = c.PointAt(t0);
      Point3d pt1 = c.PointAt(t1);

      // inline squared distances: (A to 0/1)
      double dx = ax - pt0.X; double dy = ay - pt0.Y; double dz = az - pt0.Z;
      double dA0 = dx * dx + dy * dy + dz * dz;

      dx = ax - pt1.X; dy = ay - pt1.Y; dz = az - pt1.Z;
      double dA1 = dx * dx + dy * dy + dz * dz;

      double dAmin = dA0 < dA1 ? dA0 : dA1;

      // inline squared distances: (B to 0/1)
      dx = bx - pt0.X; dy = by - pt0.Y; dz = bz - pt0.Z;
      double dB0 = dx * dx + dy * dy + dz * dz;

      dx = bx - pt1.X; dy = by - pt1.Y; dz = bz - pt1.Z;
      double dB1 = dx * dx + dy * dy + dz * dz;

      double dBmin = dB0 < dB1 ? dB0 : dB1;

      double distance = dAmin + dBmin;

      if (distance < minDistance)
      {
        minDistance = distance;
        start = i;
      }
    }

    if (start > 0)
    {
      // in-place rotate left by 'start' positions with triple reverse (no allocation)
      Array.Reverse(curve_list, 0, start);
      Array.Reverse(curve_list, start, count - start);
      Array.Reverse(curve_list, 0, count);
    }

    // recompute only the needed points for the first curve; compare squared distances to decide flip
    Curve first = curve_list[0];
    crv_int = first.Domain;
    crv_dom = crv_int.T1 - crv_int.T0;
    tA = crv_int.T0 + 0.3 * crv_dom;
    tB = crv_int.T0 + 0.7 * crv_dom;

    // Interval d0 = first.Domain;
    // double dt0 = d0.T1 - d0.T0;
    // double tf0 = d0.T0 + 0.3 * dt0;
    // double tf1 = d0.T0 + 0.7 * dt0;

    Point3d q0 = first.PointAt(tA);
    Point3d q1 = first.PointAt(tB);

    double ddx = ax - q0.X; double ddy = ay - q0.Y; double ddz = az - q0.Z;
    double d0sq = ddx * ddx + ddy * ddy + ddz * ddz;

    ddx = ax - q1.X; ddy = ay - q1.Y; ddz = az - q1.Z;
    double d1sq = ddx * ddx + ddy * ddy + ddz * ddz;

    if (d0sq > d1sq)
    {
      first.Reverse();
      flip = true;
    }

    return flip;
  }

  public static Plane srf_plane(Brep brep, out BoundingBox bb, double tol = 0.01)  // Optimized
  {
    bb = brep.GetBoundingBox(true);
    if (bb.Max.Z - bb.Min.Z < 0.01) return new Plane(bb.Center, Vector3d.XAxis, Vector3d.YAxis); // XY Plane
    if (bb.Max.X - bb.Min.X < 0.01) return new Plane(bb.Center, Vector3d.YAxis, Vector3d.ZAxis); // ZY Plane
    if (bb.Max.Y - bb.Min.Y < 0.01) return new Plane(bb.Center, Vector3d.XAxis, Vector3d.ZAxis); // ZX Plane

    if (brep.Faces[0].TryGetPlane(out Plane pl, tol))
    {
      pl.Origin = bb.Center;
      return pl;
    }

    return Plane.Unset;
  }
  public static Plane curves_plane(Curve[] curves, double tol = 0.01)  // Optimized
  {
    int count = curves.Length;
    BoundingBox bb = bb_union(curves);

    if (bb.Max.Z - bb.Min.Z < 0.01) return new Plane(bb.Center, Vector3d.XAxis, Vector3d.YAxis); // XY Plane
    if (bb.Max.X - bb.Min.X < 0.01) return new Plane(bb.Center, Vector3d.YAxis, Vector3d.ZAxis); // ZY Plane
    if (bb.Max.Y - bb.Min.Y < 0.01) return new Plane(bb.Center, Vector3d.XAxis, Vector3d.ZAxis); // ZX Plane

    HashSet<Plane> uniquePlanes = new HashSet<Plane>();
    for (int i = 0; i < count; i++)
    {
      if (curves[i].TryGetPlane(out Plane pl, tol))
      {
        pl.Origin = bb.Center;
        uniquePlanes.Add(pl);
      }
    }
    return uniquePlanes.First();
  }
  static int max_int(ReadOnlySpan<int> keys)
  {
    int max = keys[0];
    for (int i = 1; i < keys.Length; i++)
      if (keys[i] > max) max = keys[i];
    return max;
  }

  public static Curve[] object_curve_convert(IReadOnlyList<object> objects)
  {

    ArrayPool<Curve> pool = ArrayPool<Curve>.Shared;
    int count = objects.Count;
    // A rough upper bound – the worst case is a Curve that duplicates into many segments.
    // 2× is generous but still keeps the pool buffer small.



    // Pre‑allocate a buffer large enough to hold most of the results.
    Curve[] buffer = pool.Rent(count * 2);
    int index = 0;

    // Helper to grow the buffer when we run out of space.
    void Expand()
    {
      // Double the current size (or at least the remaining required slots)
      int newSize = Math.Max(buffer.Length * 2, index + count);
      Curve[] newBuf = pool.Rent(newSize);
      Array.Copy(buffer, newBuf, index);
      pool.Return(buffer);
      buffer = newBuf;
    }

    for (int i = 0; i < count; i++)
    {
      object obj = objects[i];

      switch (obj)
      {
        case Curve c:
          // DuplicateSegments() returns a List<Curve>, we copy it in a tight loop.
          foreach (var seg in c.DuplicateSegments())
          {
            if (index == buffer.Length) Expand();
            buffer[index++] = seg;
          }
          break;

        case Line l:
          if (index == buffer.Length) Expand();
          buffer[index++] = new LineCurve(l);
          break;

        case Circle cir:
          if (index == buffer.Length) Expand();
          buffer[index++] = new ArcCurve(cir);
          break;

        case Arc a:
          if (index == buffer.Length) Expand();
          buffer[index++] = new ArcCurve(a);
          break;
      }
    }

    // Slice the used portion into a new array of the exact size the caller expects.
    Curve[] result = new Curve[index];
    Array.Copy(buffer, result, index);

    // Return the temporary buffer to the pool.
    pool.Return(buffer);

    return result;
  }
  public static void TransformGeos(GeometryBase[] geos, Transform transform)
  {
    int count = geos.Length;
    for (int i = 0; i < count; i++) geos[i].Transform(transform);
  }
  public static BoundingBox[] bb_each(GeometryBase[] geos, double inflate = 0)
  {
    // Allocate the backing array once – this is the only allocation.
    int len = geos.Length;
    BoundingBox[] bb = new BoundingBox[len];

    // Create a Span over the array to eliminate bounds checks inside the loops.
    Span<BoundingBox> bbSpan = bb;

    // Fill the array with bounding boxes.
    for (int i = 0; i < len; i++) bbSpan[i] = geos[i].GetBoundingBox(true);

    // Inflate in place if required.
    if (inflate != 0) for (int i = 0; i < len; i++) bbSpan[i].Inflate(inflate);

    // Return the array – Span cannot be returned.
    return bb;
  }
  public static BoundingBox bb_union(GeometryBase[] geos, double inflate = 0)
  {
    double box_x_min = double.MaxValue;
    double box_x_max = double.MinValue;
    double box_y_max = double.MinValue;
    double box_y_min = double.MaxValue;
    double box_z_min = double.MaxValue;
    double box_z_max = double.MinValue;

    for (int i = 0; i < geos.Length; i++)
    {
      BoundingBox bb = geos[i].GetBoundingBox(true);
      Point3d min = bb.Min;
      Point3d max = bb.Max;

      if (min.X < box_x_min) box_x_min = min.X;
      if (max.X > box_x_max) box_x_max = max.X;
      if (min.Y < box_y_min) box_y_min = min.Y;
      if (max.Y > box_y_max) box_y_max = max.Y;
      if (min.Z < box_z_min) box_z_min = min.Z;
      if (max.Z > box_z_max) box_z_max = max.Z;
    }

    box_x_min -= inflate;
    box_x_max += inflate;
    box_y_max -= inflate;
    box_y_min += inflate;
    box_z_min -= inflate;
    box_z_max += inflate;

    return new BoundingBox(box_x_min, box_y_min, box_z_min, box_x_max, box_y_max, box_z_max);
  }
  public static bool boxinside(BoundingBox outer, BoundingBox inner)
  {
    if (outer.Min.X > inner.Min.X) return false;
    if (outer.Max.X < inner.Max.X) return false;
    if (outer.Min.Y > inner.Min.Y) return false;
    if (outer.Max.Y < inner.Max.Y) return false;
    if (outer.Min.Z > inner.Min.Z) return false;
    if (outer.Max.Z < inner.Max.Z) return false;
    return true;
  }
  public static bool boxboxinside2D(BoundingBox outer, BoundingBox inner)
  {
    if (outer.Min.X > inner.Min.X) return false;
    if (outer.Max.X < inner.Max.X) return false;
    if (outer.Min.Y > inner.Min.Y) return false;
    if (outer.Max.Y < inner.Max.Y) return false;

    return true;
  }
  public bool no_input(string name) => Component.Params.Input[Component.Params.IndexOfInputParam(name)].SourceCount == 0;
  
// ------- Unused ------- //

/*

  [MethodImpl(MethodImplOptions.AggressiveInlining | MethodImplOptions.AggressiveOptimization)]
  private Curve[][] containers_grouped(BoundingBox[] bbs, BoundingBox[] crvs, Curve[] curve_list)
  {
    // hoist lengths to locals
    int contLen = bbs.Length;
    int crvLen = crvs.Length;

    // 1. Count curves per container (prevents List resize overhead)
    int[] counts = new int[contLen + 1];
    for (int i = 0; i < crvLen; i++)
    {
      BoundingBox cb = crvs[i];
      bool found = false;
      for (int j = 0; j < contLen; j++)
      {
        if (boxinside(bbs[j], cb))
        {
          counts[j]++; // increment fit count
          found = true;
        }
      }
      if (!found)
      {
        counts[contLen]++; // leftover bucket
      }

    }

    // 2. Allocate jagged arrays exactly once
    Curve[][] result = new Curve[contLen + 1][];
    int[] writeIdx = new int[contLen + 1];
    for (int j = 0; j < contLen + 1; j++)
    {
      result[j] = new Curve[counts[j]]; // exact capacity
    }

    // 3. Fill buckets in a second pass
    for (int i = 0; i < crvLen; i++)
    {
      BoundingBox cb = crvs[i];
      Curve curve = curve_list[i];
      bool found = false;

      for (int j = 0; j < contLen; j++)
      {
        if (boxinside(bbs[j], cb))
        {
          result[j][writeIdx[j]++] = curve;
          found = true;
        }
      }
      if (!found)
      {
        result[contLen][writeIdx[contLen]++] = curve; // leftover bucket
      }
    }

    return result;
  }

  private BoundingBox[] containers(Curve[] crvs, double tol = 0.01)
  {
    BoundingBox[] bb = bb_each(crvs);
    int len = bb.Length;
    bool[] isInside = new bool[len]; // default false

    BoundingBox bbi;

    // Use local variables for array access to reduce bounds checking
    // Avoid 'i != j' by running inner loop with two ranges: 0..i-1 and i+1..len-1 to minimize branching
    int count = len;
    for (int i = 0; i < len; i++)
    {
      bbi = bb[i];
      for (int j = 0; j < i; j++)
      {
        if (boxinside(bb[j], bbi))
        {
          isInside[i] = true;
          count--;
          break;
        }
      }
      if (isInside[i]) continue; // skip second inner loop if found inside

      for (int j = i + 1; j < len; j++)
      {
        if (boxinside(bb[j], bbi))
        {
          isInside[i] = true;
          count--;
          break;
        }
      }
    }

    BoundingBox[] result = new BoundingBox[count];
    int idx = 0;
    for (int i = 0; i < len; i++)
    {
      if (!isInside[i]) result[idx++] = bb[i];
    }

    for (int i = 0; i < count; i++) result[i].Inflate(tol);


    return result;
  }

  private Curve[] donut_sort(Curve[] curve_list, double tol, out int[] key_values, out bool[] orientation)
  {
    // Join curves and calculate bounding boxes
    Curve[] curveloops = Curve.JoinCurves(curve_list, tol, true, false, out int[] keys);
    BoundingBox[] bbs = bb_each(curveloops);
    int count = curve_list.Length;
    int group_count = curveloops.Length;

    // Precompute boxboxinside2D results and store them in a 1D byte array
    byte[] precomputedInside = new byte[group_count * group_count];
    for (int i = 0; i < group_count; i++)
    {
      for (int j = i + 1; j < group_count; j++) // j starts from i + 1 to avoid duplicate checks
      {
        bool inside_i_to_j = boxboxinside2D(bbs[i], bbs[j]); // Check (i -> j)
        precomputedInside[i * group_count + j] = (byte)(inside_i_to_j ? 1 : 0);

        bool inside_j_to_i = boxboxinside2D(bbs[j], bbs[i]); // Check (j -> i)
        precomputedInside[j * group_count + i] = (byte)(inside_j_to_i ? 1 : 0);
      }
    }

    bool[] inner = new bool[count]; // Store orientation for curves

    // Loop through the bounding boxes, optimized to avoid unnecessary checks
    for (int i = 0; i < group_count; i++)
    {
      for (int j = i + 1; j < group_count; j++) // Avoid duplicate checks: j > i ensures no repeat
      {
        if (precomputedInside[i * group_count + j] == 1)
        {
          for (int k = 0; k < count; k++) // Update keys for matching bounding box pairs
          {
            if (keys[k] == j)
            {
              keys[k] = i;
              inner[k] = true;  // Mark as inside
            }
          }
        }

        if (precomputedInside[j * group_count + i] == 1) // Also check the opposite direction
        {
          for (int k = 0; k < count; k++)
          {
            if (keys[k] == i)
            {
              keys[k] = j;
              inner[k] = true;
            }
          }
        }
      }
    }

    key_values = keys;
    orientation = inner;
    return curveloops;
  }


  
    private Curve[] donut_sort(Curve[] curve_list, double tol, out int[] key_values, out bool[] orientation)
    {
      // Join curves and calculate bounding boxes
      Curve[] curveloops = Curve.JoinCurves(curve_list, tol, true, false, out int[] keys);
      BoundingBox[] bbs = bb_each(curveloops);
      int count = curve_list.Length;
      int group_count = curveloops.Length;

      // Precompute boxboxinside2D results and store them in a 1D byte array
      byte[] precomputedInside = new byte[group_count * group_count];
      for (int i = 0; i < group_count; i++)
      {
        for (int j = i + 1; j < group_count; j++) // j starts from i + 1 to avoid duplicate checks
        {
          bool inside_i_to_j = boxboxinside2D(bbs[i], bbs[j]); // Check (i -> j)
          precomputedInside[i * group_count + j] = (byte)(inside_i_to_j ? 1 : 0);

          bool inside_j_to_i = boxboxinside2D(bbs[j], bbs[i]); // Check (j -> i)
          precomputedInside[j * group_count + i] = (byte)(inside_j_to_i ? 1 : 0);
        }
      }

      bool[] inner = new bool[count]; // Store orientation for curves

      // Loop through the bounding boxes, optimized to avoid unnecessary checks
      for (int i = 0; i < group_count; i++)
      {
        for (int j = i + 1; j < group_count; j++) // Avoid duplicate checks: j > i ensures no repeat
        {
          if (precomputedInside[i * group_count + j] == 1)
          {
            for (int k = 0; k < count; k++) // Update keys for matching bounding box pairs
            {
              if (keys[k] == j)
              {
                keys[k] = i;
                inner[k] = true;  // Mark as inside
              }
            }
          }

          if (precomputedInside[j * group_count + i] == 1) // Also check the opposite direction
          {
            for (int k = 0; k < count; k++)
            {
              if (keys[k] == i)
              {
                keys[k] = j;
                inner[k] = true;
              }
            }
          }
        }
      }

      key_values = keys;
      orientation = inner;
      return curveloops;
    }
 


  // private Curve[] donut_sort(Curve[] curve_list, double tol, out int[] key_values, out bool[] orientation, out Brep[] surfaces)
  // {
  //   Brep[] srfs = Brep.CreatePlanarBreps(curve_list, tol);
  //   BoundingBox[] bbs = bb_each(srfs);
  //   int[] process_order = RankBy2dArea(bbs);






  //   


  //       // Join curves and calculate bounding boxes
  //       Curve[] curveloops = Curve.JoinCurves(curve_list, tol, true, false, out int[] keys);
  //       BoundingBox[] bbs = bb_each(curveloops);
  //       int count = curve_list.Length;
  //       int group_count = curveloops.Length;

  //       // Precompute boxboxinside2D results and store them in a 1D byte array
  //       byte[] precomputedInside = new byte[group_count * group_count];
  //       for (int i = 0; i < group_count; i++)
  //       {
  //         for (int j = i + 1; j < group_count; j++) // j starts from i + 1 to avoid duplicate checks
  //         {
  //           bool inside_i_to_j = boxboxinside2D(bbs[i], bbs[j]); // Check (i -> j)
  //           precomputedInside[i * group_count + j] = (byte)(inside_i_to_j ? 1 : 0);

  //           bool inside_j_to_i = boxboxinside2D(bbs[j], bbs[i]); // Check (j -> i)
  //           precomputedInside[j * group_count + i] = (byte)(inside_j_to_i ? 1 : 0);
  //         }
  //       }

  //       bool[] inner = new bool[count]; // Store orientation for curves

  //       // Loop through the bounding boxes, optimized to avoid unnecessary checks
  //       for (int i = 0; i < group_count; i++)
  //       {
  //         for (int j = i + 1; j < group_count; j++) // Avoid duplicate checks: j > i ensures no repeat
  //         {
  //           if (precomputedInside[i * group_count + j] == 1)
  //           {
  //             for (int k = 0; k < count; k++) // Update keys for matching bounding box pairs
  //             {
  //               if (keys[k] == j)
  //               {
  //                 keys[k] = i;
  //                 inner[k] = true;  // Mark as inside
  //               }
  //             }
  //           }

  //           if (precomputedInside[j * group_count + i] == 1) // Also check the opposite direction
  //           {
  //             for (int k = 0; k < count; k++)
  //             {
  //               if (keys[k] == i)
  //               {
  //                 keys[k] = j;
  //                 inner[k] = true;
  //               }
  //             }
  //           }
  //         }
  //       }

  //       key_values = keys;
  //       orientation = inner;
  //       return curveloops;

  //       

  // }


*/
# ---------- end emboss_2 ----------
para_3 = ScriptParasite(Enable=Toggle(True), Folder=scripts_2)

item = ListItem(List=emboss_2.E, Index=number_slider_22, Wrap=True)
item_2 = ListItem(List=emboss_2.B, Index=Slider(0, range=0..10), Wrap=True)
pill_2 = Pill(rect=Slider(7, range=0..10), radii=Slider(1.7, range=0..10))  # -> curves, joined; inputs rect: Double, radii: Double
# ---------- pill_2: C# usings ----------
using System.Linq;
# ---------- pill_2: C# ----------
    // Update 2025-08-01

    if (no_input("radii")) radii = 1.25;
    if (no_input("rect")) rect = 7.5;
    rect -= radii * 2;

    Curve[] pill_crvs = rect > 0 ? pill(rect, radii) : circle(radii);

    curves = pill_crvs.Select(c => new GH_Curve(c));
    joined =  new GH_Curve(Curve.JoinCurves(pill_crvs, 0.01, false)[0]);
# ---------- pill_2: C# additional code ----------
  Curve[] pill(double rect, double radius)
  {
    Point3d[] pts = {
      new Point3d(-rect * 0.5, -radius, 0),
      new Point3d(-rect * 0.5, radius, 0),
      new Point3d(rect * 0.5, radius, 0),
      new Point3d(rect * 0.5, -radius, 0)
      };

    Curve [] crvs = {
      new ArcCurve(new Arc(pts[0], -Vector3d.XAxis, pts[1])),
      new LineCurve(pts[1], pts[2]),
      new ArcCurve(new Arc(pts[2], Vector3d.XAxis, pts[3])),
      new LineCurve(pts[3], pts[0])
    };

    return crvs;
  }


  Curve[] circle(double radius)
  {
    Point3d[] pts = {
      new Point3d(0, -radius, 0),
      new Point3d(0, radius, 0),
      };

    Curve[] crvs = {
      new ArcCurve(new Arc(pts[0], -Vector3d.XAxis, pts[1])),
      new ArcCurve(new Arc(pts[1], Vector3d.XAxis, pts[0]))
    };

    return crvs;
  }



  Curve[] pill(double rect, double radius, out Point3d[] pts)
  {
    pts = new[] {
      new Point3d(-rect * 0.5, -radius, 0),
      new Point3d(-rect * 0.5, radius, 0),
      new Point3d(rect * 0.5, radius, 0),
      new Point3d(rect * 0.5, -radius, 0)
      };

    Curve [] crvs = {
      new ArcCurve(new Arc(pts[0], -Vector3d.XAxis, pts[1])),
      new LineCurve(pts[1], pts[2]),
      new ArcCurve(new Arc(pts[2], Vector3d.XAxis, pts[3])),
      new LineCurve(pts[3], pts[0])
    };

    return crvs;
  }


  private bool no_input(string name) => Component.Params.Input[Component.Params.IndexOfInputParam(name)].SourceCount == 0;
# ---------- end pill_2 ----------
entwine = Entwine(Branch00=bra.branch, Branch01=flip_4.Curve, FlattenInputs=True)
X_2 = UnitX(Factor=Slider(105.5, range=0..150))
flip_5 = FlipMatrix(Data=entwine)
loft_2 = Align(curves=flip_5)  # -> flatten(srf); inputs curves: list of Curve; disabled
# ---------- loft_2: C# ----------
  srf = Brep.CreateFromLoft(curves, Point3d.Unset, Point3d.Unset, LoftType.Straight, false);
# ---------- end loft_2 ----------
edges_4 = Align(curves=flip_5)  # -> srf; inputs curves: list of Curve; disabled; same code as edges
geo_6 = Geometry(item)
disp = Branch_select(tree=divide.Points, flip=Toggle(True))  # -> odd, even; inputs tree: tree, flip: Boolean
# ---------- disp: C# ----------
tree.SimplifyPaths();

int count = tree.BranchCount;
DataTree<object> odd_tree = new DataTree<object>();
DataTree<object> even_tree = new DataTree<object>();

int match = flip ? 0 : 1;

for (int i = 0; i < count; i++)
{
    if (i%2 == match) odd_tree.AddRange(tree.Branch(i), new GH_Path(i)); 
    else even_tree.AddRange(tree.Branch(i), new GH_Path(i)); 
}

odd = odd_tree;
even = even_tree;
# ---------- end disp ----------
equals = Equality(FirstNumber=emboss_2.A, SecondNumber=number_slider_22)  # -> Equality, Inequality
extrude_punch_3 = ExtrudeAndPunch(curves=text_3, extrude=number_slider_23)  # -> surfaces, pl, crv, notes; inputs curves: list, brep: Brep, radii: list of Double, bulges: list of Double, extrude: Double, inset: Double, flip: Boolean; same code as extrude_punch
move_4 = Move(Geometry=pill_2.curves, Motion=X_2)  # -> Geometry, Transform
geo_7 = Geometry(emboss_2.B)
geo_8 = Geometry(emboss_2.A)
number_slider_27 = Slider(0, range=0..10)
cut_2 = SeparateItems(L=crv, i=number_slider_27)  # -> remains, items; inputs L: list, i: list of Int32; same code as cut
geo_9 = Geometry(cut_2.items)
geo_10 = Geometry(bra_3.branch)
sdiff = SolidDifference(BrepsA=volcano_straight.brp, BrepsB=donut_ext.surfaces)
Z_3 = UnitZ(Factor=Slider(5, range=0..10))
crv_2 = Curve(volcano_straight.crv)
nake = CSharpScript(brep=extrude_punch_2.surfaces)  # -> crvs, num; inputs brep: Brep
# ---------- nake: C# ----------
    Component.Message = "Naked Edges";

    List<int> indices = new List<int>();
    List<Curve> curves = new List<Curve>();

    for (int i = 0; i < brep.Edges.Count; i++)
    {
      if (brep.Edges[i].AdjacentFaces().Length == 1)
      {
        indices.Add(i);
        curves.Add(brep.Edges[i].DuplicateCurve());
      }
    }

    crvs = curves;
    num = indices;
# ---------- end nake ----------
box = Box(x=number_slider_24, y=number_slider_24, z=Slider(1, range=0..1))  # -> box; inputs x: Double, y: Double, z: Double
# ---------- box: C# ----------
    if (Component.Params.Input[0].SourceCount == 0)  x = 10;
    if (Component.Params.Input[1].SourceCount == 0)  y = 10;
    if (Component.Params.Input[2].SourceCount == 0)  z = 10;

    box = new GH_Box(new BoundingBox(new Point3d(x * -0.5, y * -0.5,  z * -0.5), new Point3d(x * 0.5, y * 0.5, z * 0.5)));
# ---------- end box ----------
nake_2 = CSharpScript(brep=volcano_straight.brp)  # -> crvs, num; inputs brep: Brep; same code as nake
cut_3 = SeparateItems(L=emboss_2.B, i=number_slider_27)  # -> remains, items; inputs L: list, i: list of Int32; same code as cut
bra_4 = Branch_select(tree=emboss_2.A, i=Slider(0, range=0..10))  # -> remains, branch; inputs tree: tree, i: Int32; same code as bra
Z_4 = UnitZ(Factor=Slider(3, range=0..10))
zebra = ZebraStripes(brep=extrude_punch_2.surfaces)  # inputs brep: Brep, scale: Double, rotate: Double
# ---------- zebra: C# usings ----------
using System.Drawing;
using Rhino.Display;
using Rhino.DocObjects;
using System.Linq;
using System.IO;
# ---------- zebra: C# ----------
    if (no_input("scale")) scale = 1.0;
    if (no_input("rotate")) rotate = 0.0;

    //string filepath = @"D:\\Core_Files\\zebra.bmp";

    string userObjectsPath = Path.Combine(
    System.Environment.GetFolderPath(System.Environment.SpecialFolder.ApplicationData), "Grasshopper", "UserObjects");

    Directory.CreateDirectory(userObjectsPath);
    string filepath = Path.Combine(userObjectsPath, "zebra.bmp");


    if (no_input("brep") || brep == null) return;
    if (!System.IO.File.Exists(filepath)) {
      byte[] bmp = new byte[]
      {
            0x42, 0x4D, 0x56, 0x00, 0x00, 0x00, 0x00, 0x00, 0x00, 0x00, 0x36, 0x00,
            0x00, 0x00, 0x28, 0x00, 0x00, 0x00, 0x0A, 0x00, 0x00, 0x00, 0x01, 0x00,
            0x00, 0x00, 0x01, 0x00, 0x18, 0x00, 0x00, 0x00, 0x00, 0x00, 0x20, 0x00,
            0x00, 0x00, 0x13, 0x0B, 0x00, 0x00, 0x13, 0x0B, 0x00, 0x00, 0x00, 0x00,
            0x00, 0x00, 0x00, 0x00, 0x00, 0x00, 0x00, 0x00, 0x00, 0x00, 0x00, 0x00,
            0x00, 0x00, 0x00, 0x00, 0x00, 0x00, 0x00, 0x00, 0x00, 0xFF, 0xFF, 0xFF,
            0xFF, 0xFF, 0xFF, 0xFF, 0xFF, 0xFF, 0xFF, 0xFF, 0xFF, 0xFF, 0xFF, 0xFF,
            0x00, 0x00
      };
      File.WriteAllBytes(filepath, bmp);
    }

    // Create a texture from the temporary file
    Texture texture = new Texture() { FileName = filepath };

    // Normalize scale within the specified range and invert
    scale = 25 / Math.Max(0.02, Math.Min(scale, 2.0));

    // Apply transformations to the texture
    texture.UvwTransform =  Transform.Rotation(rotate, Point3d.Origin) * Transform.Scale(Point3d.Origin, scale);

    DisplayMaterial mat = new DisplayMaterial(Color.White);
    mat.SetEnvironmentTexture(texture, true);  // add texture on front
    mat.SetEnvironmentTexture(texture, false); // add texture on back

    Mesh[] meshes = Mesh.CreateFromBrep(brep, MeshingParameters.QualityRenderMesh);
    Mesh M = new Mesh();
    foreach (Mesh partialMesh in meshes) M.Append(partialMesh);

    m_shapes.Add(M);
    m_materials.Add(mat);
# ---------- zebra: C# additional code ----------
  private bool no_input(string name)
  {
    string[] names = Component.Params.Input.Select(x => x.NickName.Trim()).ToArray();
    int input_idx = Array.IndexOf(names, name);
    return Component.Params.Input[input_idx].SourceCount == 0;
  }

  private BoundingBox m_box;
  private List<Mesh> m_shapes;
  private List<DisplayMaterial> m_materials;

  public override void BeforeRunScript()
  {
      BoundingBox m_box = BoundingBox.Empty;
      m_shapes = new List<Mesh>();
      m_materials = new List<DisplayMaterial>();
  }

  public override BoundingBox ClippingBox
  {
      get { return m_box; }
  }

  public override void DrawViewportMeshes(IGH_PreviewArgs args)
  {
      if (m_shapes == null) return;
      for (int i = 0; i < m_shapes.Count; i++)
      {
          args.Display.DrawMeshShaded(m_shapes[i], m_materials[i]);
      }
  }
# ---------- end zebra ----------
area = Area(Geometry=emboss_2.B)  # -> Area, Centroid
item_3 = ListItem(List=emboss_2.B, Index=0, Wrap=True)
m = MidPoint(crv=nake.crvs)  # -> mid; inputs crv: Curve
# ---------- m: C# ----------
    
    crv.Domain = new Interval(0, 1);
    mid = crv.PointAt(0.5);
# ---------- end m ----------
item_4 = ListItem(List=emboss_2.D, Index=number_slider_22, Wrap=True)
dispatch = Dispatch(List=emboss_2.E, DispatchPattern=equals.Equality)  # -> ListA, ListB
panel_2 = Panel(emboss_2.E)
rotate = Rotate(Geometry=move_4.Geometry, Angle=degrees(Slider(45, range=0..100)), Plane=PlaneXY(0, 0, 0))  # -> Geometry, Transform
disp_2 = Dispatch(List=disp.even, DispatchPattern=[True, False])  # -> ListA, ListB
disp_3 = Dispatch(List=disp.odd, DispatchPattern=[True, False])  # -> ListA, ListB
item_5 = ListItem(List=emboss_2.B, Index=number_slider_25, Wrap=True)
item_6 = ListItem(Index=number_slider_25, Wrap=True)
extr = Extrude(Base=text_2, Direction=Z_3)
move_5 = Move(Geometry=box, Motion=Z_4)  # -> Geometry, Transform
geo_11 = Geometry(cut_3.items)
panel_3 = Panel(item_4)
geo_12 = Geometry(dispatch.ListA)
cap = CapHoles(Brep=extr)
panel_4 = Panel(emboss_2.A)
panel_5 = Panel([extrude_punch_2.surfaces, nake.crvs])
_3d = CSharpScript(boxes=move_5.Geometry, breps=volcano_straight.brp)  # -> inside, outside; inputs boxes: list of GeometryBase, breps: list of Brep
# ---------- _3d: C# ----------
    Component.Message = "Overlap";
    if (Component.Params.Input[0].SourceCount == 0 || Component.Params.Input[1].SourceCount == 0)
    {
      inside = breps.Select(b => new GH_Brep(b));
      return;
    }

    List<Brep> in_list = new List<Brep>();
    List<Brep> out_list = new List<Brep>();

    for (int h = 0; h < breps.Count; h++)
    {
      BoundingBox[] big_bb = boxes.Select(g => g.GetBoundingBox(true)).ToArray();
      BoundingBox[] small_bb = breps[h].Faces.Select((g, idx) => breps[h].DuplicateSubBrep(new[] {idx}).GetBoundingBox(true)).ToArray();
      List<int> inside_int = new List<int>();
      List<int> outside_int = new List<int>();

      bool[] included = new bool[small_bb.Length];

      for (int i = 0; i < small_bb.Length; i++)
      {
        for (int j = 0; j < big_bb.Length; j++)
        {
          if (boxoverlap(big_bb[j], small_bb[i])) inside_int.Add(i);
          else outside_int.Add(i);
        }
      }
      in_list.Add(breps[h].DuplicateSubBrep(inside_int));
      out_list.Add(breps[h].DuplicateSubBrep(outside_int));
    }

    inside = in_list.Select(b => new GH_Brep(b));
    outside = out_list.Select(b => new GH_Brep(b));
# ---------- _3d: C# additional code ----------
  public static bool boxoverlap(BoundingBox a, BoundingBox b)
  {
    if (a.Max.X < b.Min.X) return false;
    if (a.Min.X > b.Max.X) return false;
    if (a.Max.Y < b.Min.Y) return false;
    if (a.Min.Y > b.Max.Y) return false;
    if (a.Max.Z < b.Min.Z) return false;
    if (a.Min.Z > b.Max.Z) return false;

    return true;
  }

  public static bool boxoverlap2D(BoundingBox a, BoundingBox b)
  {
    if (a.Max.X < b.Min.X) return false;
    if (a.Min.X > b.Max.X) return false;
    if (a.Max.Y < b.Min.Y) return false;
    if (a.Min.Y > b.Max.Y) return false;

    return true;
  }
# ---------- end _3d ----------
srf_cp = SurfaceClosestPoint(Point=[disp_3.ListA, disp_2.ListB], Surface=_3d.inside)  # -> Point, UVPoint, Distance
number_slider_28 = Slider(3, range=0..10)
number_slider_29 = Slider(20, range=0..100)
evalsrf = EvaluateSurface(Surface=_3d.inside, Point=srf_cp.UVPoint)  # -> Point, Normal, UDirection, VDirection, Frame
geo_13 = Geometry(emboss_2.E)
number_slider_30 = Slider(0.29, range=0..1)
number_slider_31 = Slider(0.4, range=0..1)
panel_6 = Panel(area.Area)
geo_14 = Geometry(_3d.inside)
end = EndPoints(Curve=geo_13)  # -> Start, End
rectangle_5 = Rectangle(radii=number_slider_28)  # -> rect, joined, points, notes; inputs x: Double, y: Double, radii: list of Double, bend: Double; same code as rectangle
cut_4 = SeparateItems(L=evalsrf.Frame, i=Slider(2, range=0..10))  # -> remains, items; inputs L: list, i: list of Int32; same code as cut
cir_6 = Circle(Plane=PlaneXY(0, 0, 0), Radius=Slider(0.7, range=0..1))
split = SplitList(List=text_3, Index=number_slider_28)  # -> ListA, ListB
orient = Orient(Geometry=_3d.inside, Source=cut_4.items, Target=PlaneXY(0, 0, 0))  # -> Geometry, Transform
extrude_punch_4 = ExtrudeAndPunch(curves=cir_6, brep=orient.Geometry, radii=Slider(0.05, range=0..0.1), extrude=Slider(2, range=0..10))  # -> surfaces, pl, crv, notes; inputs curves: list, brep: Brep, radii: list of Double, bulges: list of Double, extrude: Double, inset: Double, flip: Boolean; same code as extrude_punch
explode_3 = Explode(Curve=split.ListA, Recursive=True)  # -> Segments, Vertices
geo_15 = Geometry(flatten(explode_3.Segments))
scripts_4 = ScriptsFolderPath("D:\Core_Files\Scripts\")
panel_7 = Panel(emboss_2.out)
face = CSharpScript(brep=extrude_punch_4.surfaces, index=Slider(0, range=0..10))  # -> shell, surface; inputs brep: Brep, index: Int32
# ---------- face: C# usings ----------
using System.Threading.Tasks;
# ---------- face: C# ----------
    double tol = 0.1;
    Interval interval = new Interval(0, 1);
    int count = brep.Faces.Count;

    
    if (Component.Params.Input[1].SourceCount == 0) {

      double target = brep.GetBoundingBox(true).Max.Z;

      //Parallel.For(0, count, (i, state) => {
      for (int i = 0; i < count; i++){

        brep.Faces[i].ShrinkFace(BrepFace.ShrinkDisableSide.ShrinkAllSides);

        brep.Faces[i].SetDomain(0, interval);
        brep.Faces[i].SetDomain(1, interval);

        if (Math.Abs(brep.Faces[i].PointAt(0.5, 0.5).Z - target) < tol) {
          index = i;
          break;
          //state.Break();
        }
      }//);
    }

    int[] indexes = new int[count - 1];
    int counter = 0;
    for (int i = 0; i < count; i++){
      if (i != index){
        indexes[counter] = i;
        counter++;
      }
    }

    shell = brep.DuplicateSubBrep(indexes);
    surface = brep.Faces[index];
# ---------- end face ----------
orient_2 = Orient(Geometry=face.shell, Source=PlaneXY(0, 0, 0), Target=evalsrf.Frame)  # -> Geometry, Transform; disabled
number_slider_32 = Slider(10, range=0..10)
dup_4 = DuplicateData(Data=graft(rectangle_5.rect), Number=Slider(10, range=0..100), Order=True)
flip_6 = FlipMatrix(Data=dup_4)
extrude_punch_5 = ExtrudeAndPunch(curves=flip_6, radii=[number_slider_31, number_slider_30], extrude=number_slider_23)  # -> surfaces, pl, crv, notes; inputs curves: list, brep: Brep, radii: list of Double, bulges: list of Double, extrude: Double, inset: Double, flip: Boolean; same code as extrude_punch
extrude_punch_6 = ExtrudeAndPunch(curves=flip_6, radii=[number_slider_31, number_slider_30], extrude=number_slider_23)  # -> surfaces, pl, crv, notes; inputs curves: list, brep: Brep, radii: list of Double, bulges: list of Double, extrude: Double, inset: Double, flip: Boolean
# ---------- extrude_punch_6: C# ----------
    // Updated 2025-07-09

    if (no_input("curves")) { if (!no_input("brep")) surfaces = new GH_Brep(brep); Component.Message = ""; return; }
    if (no_input("radii")) radii.Add(0);
    if (no_input("bulges")) bulges.Add(0.68);
    if (no_input("flip")) flip = false;

    double tol = 0.0001;
    int sectors = 12;
    Interval interval = new Interval(0, 1);
    Plane pln = Plane.WorldXY;

    Curve[] curve_list = object_curve_convert(curves);

    Curve[] curveloops = Curve.JoinCurves(curve_list, tol, true, false, out int[] keys);
    int idx = keys.Max() + 1;
    Plane[] planes = new Plane[idx];

    BoundingBox brep_bb = new BoundingBox();
    if (!no_input("brep")) brep_bb = brep.GetBoundingBox(true);

    List<Curve> temp_crvs = new List<Curve>();
    List<int> temp_ints = new List<int>();
    for (int i = 0; i < idx; i++)
    {
      if (!curveloops[i].IsClosed) continue;
      Curve[] crvs = curve_list.Where((c, j) => keys[j] == i).ToArray();
      if (!no_input("inset") && inset != 0) crvs = offset(crvs, -inset, out planes[i], tol);
      else planes[i] = curves_plane(crvs);

      if (!no_input("brep"))
      {
        planes[i] = plane_on_box(planes[i], brep_bb, 1);
      }

      TransformGeos(crvs, Transform.Scale(planes[i], 1, 1, 0));

      int count = crvs.Length;
      if (count > 1)
      {
        sort_crv(crvs);
        clean_lines(ref crvs);
        match_crv_ends(crvs);
      }
      temp_crvs.AddRange(crvs);
      temp_ints.AddRange(Enumerable.Repeat(i, crvs.Length));
    }
    keys = temp_ints.ToArray();
    curve_list = temp_crvs.ToArray();

    if ((no_input("extrude") || extrude == 0) && (no_input("curves") || no_input("brep")))
    {
      crv = Array.ConvertAll(curve_list, c => new GH_Curve(c));
      Component.Message = "Surface";
      if (!no_input("brep")) surfaces = new GH_Brep(brep);
      else surfaces = Array.ConvertAll(Brep.CreatePlanarBreps(curve_list, 0.001), b => new GH_Brep(b));
      return;
    }

    if (no_input("extrude") && no_input("brep")) { Component.Message = ""; return; }


    // ------- Set Basic Conditions ------- //

    bool simple = no_input("radii");
    if (radii.Count == 1) radii.Add(radii[0]);
    if (radii[0] == 0 && radii[1] == 0) simple = true;
    bulges.Add(bulges[0]);

    bool has_extrude = (!no_input("extrude") && Math.Abs(extrude) > tol);
    bool has_brep = !no_input("brep");

    bool hole = has_brep && has_extrude;
    bool through_hole = has_brep && !has_extrude;
    bool extrusion = !hole && !through_hole;

    bool quick = false;
    bool mirror = false;
    bool centre = extrusion && flip;

    bool simple_extrude = extrusion && simple;
    bool normal_extrude = false;
    if (extrusion)
    {
      if (!simple) quick = radii[0] == radii[1];
      mirror = extrude != Math.Abs(extrude) && !centre;  // REVERSE direction of extrude (no point if the extrude is centred)
      normal_extrude = !mirror && !quick;
    }

    bool inner_hole = false;
    bool inner_though = false;
    if (flip)
    {
      inner_hole = hole;
      inner_though = through_hole;
      hole = false;
      through_hole = false;
    }
    if (hole && !inner_hole && flip) { hole = false; inner_hole = true; }

    // ------- Sort incoming curves ------- //

    List<Curve> all_crvs = new List<Curve>();
    List<Brep> all_breps = new List<Brep>();
    List<Plane> plane_list = new List<Plane>();


    // ------- Sort incoming curves ------- //


    for (int i = 0; i < idx; i++)
    {
      Curve[] crvs = curve_list.Where((c, j) => keys[j] == i).ToArray();
      int count = crvs.Length;

      Plane plane = planes[i];
      Transform orient = Transform.PlaneToPlane(plane, pln);
      Transform reorient = Transform.PlaneToPlane(pln, plane);


      if (has_brep) brep.Transform(orient);
      TransformGeos(crvs, orient);

      // Check that the curve is inside the Brep's bounds
      double edge_inset_caution = (through_hole || hole) && !simple ? 0.2 + Math.Max(radii[0], radii[1]) : 0.2;

      if (has_brep && !boxboxinside2D(brep.GetBoundingBox(true), bb_union(crvs, edge_inset_caution)))
      {
        brep.Transform(reorient);
        continue;
      }

      // ------- Construct Breps and Parts ------- //

      //Brep test_piece = new Brep();
      Plane base_plane = Plane.Unset;
      Curve[] hole_crvs = new Curve[count];
      Brep part = new Brep();
      if (simple_extrude) part = capped_extrude(crvs, out hole_crvs, extrude, centre, tol);
      else if (quick) part = quick_extrude(crvs, extrude, radii[0], bulges[0], sectors, centre, tol, out hole_crvs);
      else if (extrusion) part = full_extrude(crvs, extrude, radii, bulges, sectors, centre, tol, out hole_crvs);
      else if (hole) part = hole_extrude(crvs, brep, extrude, radii, bulges, sectors, tol, out base_plane, out hole_crvs);
      else if (inner_hole) part = hole_inner(crvs, brep, extrude, radii, bulges, sectors, tol, out base_plane, out hole_crvs);
      else if (through_hole) part = hole_through(crvs, brep, radii, bulges, sectors, tol, out hole_crvs);
      else if (inner_though) part = through_inner(crvs, brep, radii, bulges, sectors, tol, out hole_crvs);
      else continue;

      Curve[] hole_curves = hole_crvs.Where(c => c != null).ToArray();

      part.Transform(reorient);

      if (through_hole || hole) brep = part;
      else
      {
        all_breps.Add(part);
        if (has_brep) brep.Transform(reorient);
      }
      if (base_plane.IsValid) { base_plane.Transform(reorient); plane_list.Add(base_plane); }
      if (hole_curves.Length > 0) { TransformGeos(hole_curves, reorient); all_crvs.AddRange(hole_curves); }
    }

    if (all_breps.Count == 0) all_breps.Add(brep);
    crv = all_crvs.Select(c => new GH_Curve(c));
    pl = plane_list;
    surfaces = all_breps.Select(b => new GH_Brep(b));

    string identifier = "";
    if (simple_extrude) identifier = "Simple Extrude";
    else if (quick) identifier = "Quick Extrude";
    else if (extrusion) identifier = "Full Extrusion";
    else if (hole) identifier = "Indent Hole";
    else if (inner_hole) identifier = "Indent Hole Inner";
    else if (through_hole) identifier = "Through Hole";
    else if (inner_though) identifier = "Through Hole Inner";
    else identifier = "";

    Component.Message = identifier;


    string[] note_strings = {
      identifier
    };

    notes = note_strings;
# ---------- extrude_punch_6: C# additional code ----------
  private Brep hole_inner(Curve[] curves, Brep brep, double extrude, List<double> radii, List<double> bulges, int sectors, double tol, out Plane pl, out Curve[] crvs)
  {
    Point3d pu = Point3d.Unset;
    double gap = 1 / (sectors - 1.0);
    Plane pln = Plane.WorldXY;
    int count = curves.Length;
    int cross_numA = (bulges[0] == 0) ? 2 : 4; // (radii[0] < 0.25) ? 4 : 5;
    int cross_numB = (bulges[1] == 0) ? 2 : 4; // (radii[1] < 0.25) ? 4 : 5;

    bool remirror = brep.GetBoundingBox(true).Center.Z < 0;  // Put Brep above Plane.XY
    Transform mirror = Transform.Mirror(pln);
    if (remirror) brep.Transform(mirror);

    if (extrude == 0) { pl = pln; crvs = curves; return brep; } //brep
    bool flip = extrude < 0;

    // Transform move_curves = Transform.Translation(0,0,brep.GetBoundingBox(true).Min.Z - 1);
    // TransformGeos(curves, move_curves);

    // ------- Separate BrepFaces ------- //

    Brep[] final_breps = new Brep[count * 3 + 1];
    separate_brepfaces(brep, curves, Vector3d.ZAxis, out Brep brep_half, out Brep brep_out);


    // ------- Initial Geometry to be copied and transformed ------- //

    double radA = -radii[0]; //inset removed
    double radB = -radii[1]; //inset removed

    double len = 0.1;
    Surface cutter = planar_srf(len, len);
    cutter.Transform(Transform.Translation(0, len * 0.5, 0));

    double[] ts = new double[sectors];
    for (int i = 0; i < sectors; i++) ts[i] = i * gap;


    Plane base_plane = pln;
    Plane inside_plane = pln;
    Point3d central_pt = project_point(Point3d.Origin, brep, Vector3d.ZAxis);
    base_plane.Origin = new Point3d(central_pt.X, central_pt.Y, central_pt.Z + extrude);


    // ------- Create test to see if surface is flat.  If so, a more simple construction can be used ------- //

    Curve[] test_flat_crvs = new Curve[count * 2];
    Array.Copy(offset(curves, radA - 0.1, out _, tol), test_flat_crvs, count);
    Array.Copy(curves, 0, test_flat_crvs, count, count);

    bool flat_srf = test_flat(test_flat_crvs, brep_half, Vector3d.ZAxis, tol, out _);

    if (test_flat(test_flat_crvs, brep_half, Vector3d.ZAxis, tol, out _))
    {
      double extrude_val = remirror ? -extrude : extrude;
      Curve[] quick_crvs = new Curve[count];
      for (int i = 0; i < count; i++) quick_crvs[i] = project_closest(curves[i], brep_half, Vector3d.ZAxis, tol);

      Brep quick_brep = full_extrude(quick_crvs, extrude_val, radii, bulges, sectors, false, tol, out Curve[] out_crvs);

      pl = new Plane(new Point3d(0, 0, extrude), Vector3d.XAxis, Vector3d.YAxis); // base_plane; //
      crvs = out_crvs;

      return quick_brep;
    }

    // ------- Setup Curves ------- //

    Curve[] crvA = offset(curves, radA, out _, tol);
    Curve[] crvD = offset(curves, radB, out _, tol);

    //Curve[] final_crvs = crvA.Select(c => c.DuplicateCurve()).ToArray();

    crvA = crvA.Select(c => project_closest(c, brep_half, Vector3d.ZAxis, tol)).ToArray();
    Curve[] crvB = curves.Select(c => project_closest(c, brep_half, Vector3d.ZAxis, tol)).ToArray();

    sort_crvs(pln, crvA, crvB);
    sort_crvs(pln, crvA, crvD);

    match_crv_ends(crvA);
    match_crv_ends(crvB);
    match_crv_ends(crvD);

    Curve[] crvC = crvB.Select(c => c.DuplicateCurve()).ToArray();
    Curve[] final_crvs = crvA.Select(c => c.DuplicateCurve()).ToArray();

    double inside_z = base_plane.OriginZ - radii[1];  //double z_move = base_plane.OriginZ;

    inside_plane.OriginZ = inside_z;
    TransformGeos(crvB, Transform.Translation(0, 0, radii[0]));
    TransformGeos(crvC, Transform.Scale(inside_plane, 1, 1, 0));
    TransformGeos(crvD, Transform.Scale(base_plane, 1, 1, 0));

    List<Curve> test_crvs = new List<Curve>();

    // ------- main loop ------- //

    for (int i = 0; i < count; i++)
    {
      if (radii[0] == 0 && radii[1] == 0) { final_breps[count + i] = Brep.CreateFromLoft(new[] { crvB[i], crvC[i] }, pu, pu, LoftType.Straight, false)[0]; continue; } //circle_check(ref crvA[i]); //circle_check(ref crvB[i]); // can remove if simple circle hole built later //circle_check(ref crvC[i]); //circle_check(ref crvD[i]);

      bool straight = crvA[i].IsLinear(0.01) && crvB[i].IsLinear(0.01);

      Curve[] edges_A = new Curve[sectors];
      Curve[] edges_B = new Curve[sectors];

      for (int j = 0; j < sectors; j++)
      {
        Point3d pB = crvB[i].PointAtNormalizedLength(ts[j]);
        Point3d pC = new Point3d(pB.X, pB.Y, inside_z);
        Curve lnA = new LineCurve(pB, pC);
        bool straight_check = !straight || (straight && (j == 0 || j == sectors - 1));

        if (radii[0] != 0 && straight_check)
        {
          Point3d pA = crvA[i].PointAtNormalizedLength(ts[j]);
          //Vector3d vec = new Vector3d(pA - pB) { Z = 0 };
          Plane frame = new Plane(pA, Vector3d.ZAxis, new Vector3d(pA.X - pB.X, pA.Y - pB.Y, 0));

          cutter.Transform(Transform.PlaneToPlane(pln, frame));
          Intersection.BrepSurface(brep_half, cutter, tol, out Curve[] int_crvs, out _);
          cutter.Transform(Transform.PlaneToPlane(frame, pln));
          Curve cx_crv;
          if (pA.DistanceToSquared(int_crvs[0].PointAtEnd) < 0.0001) cx_crv = int_crvs[0];
          else
          {
            cx_crv = (int_crvs.Length > 1) ? Curve.JoinCurves(int_crvs, tol, false)[0] : int_crvs[0];
            if (pA.DistanceToSquared(cx_crv.PointAtStart) < 0.0001) cx_crv.Reverse();
          }
          edges_A[j] = Curve.CreateBlendCurve(cx_crv, lnA, BlendContinuity.Curvature, bulges[0], bulges[0]);
        }

        if (radii[1] != 0 && straight_check)
        {
          Point3d pD = crvD[i].PointAtNormalizedLength(ts[j]);  // PointAt(ts[j]);  NORMALIZED is more SOLID
          //Vector3d vec = new Vector3d(pD - pB) { Z = 0 };
          Curve lnB = new LineCurve(pD, new Point3d(pD.X + (pD.X - pB.X), pD.Y + (pD.Y - pB.Y), pD.Z)); //Curve lnB = new LineCurve(pD, pD + vec);
          edges_B[j] = Curve.CreateBlendCurve(lnA, lnB, BlendContinuity.Curvature, bulges[1], bulges[1]);
          // test_crvs.Add(lnA);
          // test_crvs.Add(lnB);
        }
      }
      test_crvs.Add(crvA[i]);
      test_crvs.Add(crvB[i]);
      // test_crvs.AddRange(crvC);
      // test_crvs.AddRange(crvD);
      test_crvs.AddRange(edges_A);
      //test_crvs.AddRange(edges_B);


      if (radii[0] != 0)
      {
        if (straight) final_breps[i] = (bulges[0] == 0)
            ? Brep.CreateFromLoft(new[] { crvA[i], crvB[i] }, pu, pu, LoftType.Straight, false)[0]
            : Brep.CreateFromLoft(new[] { edges_A[0], edges_A[sectors - 1] }, pu, pu, LoftType.Straight, false)[0];
        else final_breps[i] = (bulges[0] == 0)
          ? Brep.CreateFromLoft(new[] { crvA[i], crvB[i] }, pu, pu, LoftType.Straight, false)[0]
          : edge_srf(crvA[i], crvB[i], edges_A, cross_numA);
        // final_breps[i] = edge_srf(crvA[i], crvB[i], edges_A, cross_numA, out Curve[] cvx);
        // test_crvs.AddRange(cvx);
      }
      Print(cross_numB.ToString());
      if (radii[1] != 0)
      {
        if (straight) final_breps[(count * 2) + i] = (bulges[1] == 0)
            ? Brep.CreateFromLoft(new[] { crvC[i], crvD[i] }, pu, pu, LoftType.Straight, false)[0]
            : Brep.CreateFromLoft(new[] { edges_B[0], edges_B[sectors - 1] }, pu, pu, LoftType.Straight, false)[0];
        else final_breps[(count * 2) + i] = (bulges[1] == 0)
          ? Brep.CreateFromLoft(new[] { crvC[i], crvD[i] }, pu, pu, LoftType.Straight, false)[0]
          : edge_srf(crvC[i], crvD[i], edges_B, cross_numB);
        // final_breps[(count * 2) + i] = edge_srf(crvC[i], crvD[i], edges_B, cross_numB, out Curve[] cvx);
        // test_crvs.AddRange(cvx);
      }
      final_breps[count + i] = Brep.CreateFromLoft(new[] { crvB[i], crvC[i] }, pu, pu, LoftType.Straight, false)[0]; // edge_srf( crvB[i], crvC[i], null, cross_numB);//
    }


    // ------- Re-Assemble parts ------- //

    //Brep final_brep = new Brep();
    BoundingBox target_bb = bb_union(crvA, 0.1);
    Brep[] split_breps = brep_half.Split(crvA, tol);
    Brep[] pieces = new Brep[split_breps.Length + final_breps.Length + 1];
    int counter = 0;
    for (int i = 0; i < split_breps.Length; i++) if (boxboxinside2D(target_bb, split_breps[i].GetBoundingBox(true))) pieces[counter++] = split_breps[i];
    for (int i = 0; i < final_breps.Length; i++) if (final_breps[i] != null) pieces[counter++] = final_breps[i];
    pieces[counter++] = Brep.CreatePlanarBreps(crvD, 0.001)[0];
    Array.Resize(ref pieces, counter);

    //final_crvs = test_crvs.ToArray();
    Brep final_brep = Brep.JoinBreps(pieces, 0.001, 0.1)[0]; new Brep(); //
    // for (int i = 0; i < pieces.Length; i++) final_brep.Append(pieces[i]);

    base_plane = new Plane(base_plane.Origin, -base_plane.XAxis, -base_plane.YAxis);

    if (remirror)
    {
      final_brep.Transform(mirror);
      brep.Transform(mirror);
      base_plane.Transform(mirror);
      TransformGeos(final_crvs, mirror);
    }

    if (final_brep.SolidOrientation == BrepSolidOrientation.Inward) final_brep.Flip();

    pl = base_plane; //Plane.WorldXY; //
    crvs = final_crvs; // test_crvs.ToArray(); //new[] { new LineCurve(Point3d.Origin, new Point3d(0, 0, 1)) }; //   crvD; //

    return final_brep; // brep_half;  // brep_out;  // new Brep(); //
  }
  private Brep hole_extrude(Curve[] curves, Brep brep, double extrude, List<double> radii, List<double> bulges, int sectors, double tol, out Plane pl, out Curve[] crvs)
  {
    Point3d pu = Point3d.Unset;
    double gap = 1 / (sectors - 1.0);
    Plane pln = Plane.WorldXY;
    Vector3d Z_up = Vector3d.ZAxis;
    int count = curves.Length;

    bool top_sharp = radii[0] == 0;
    bool bot_sharp = radii[1] == 0;

    bool top_chamfer = bulges[0] == 0;
    bool bot_chamfer = bulges[1] == 0;

    int cross_numA = top_chamfer ? 2 : 4;
    int cross_numB = bot_chamfer ? 2 : 4;

    bool remirror = brep.GetBoundingBox(true).Center.Z < 0;  // Put Brep above Plane.XY
    Transform mirror = Transform.Mirror(pln);
    if (remirror) brep.Transform(mirror);

    if (extrude == 0) { pl = pln; crvs = curves; return brep; }
    double flip = (extrude < 0) ? -1 : 1;


    // ------- Setup Curves ------- //

    double radA = radii[0];
    double radB = -radii[1];

    Curve[] crvA = (top_sharp)
    ? curves.Select(c => c.DuplicateCurve()).ToArray()
    : offset(curves, radA, out _, tol);


    // ------- Separate BrepFaces ------- //

    Brep[] final_breps = new Brep[count * 3 + 3];
    separate_brepfaces(brep, crvA, Z_up, out Brep brep_half, out Brep brep_out);
    final_breps[count * 3 + 1] = brep_out;

    double len = 0.2;
    Surface cutter = planar_srf(len, len);
    cutter.Transform(Transform.Translation(0, len * 0.5, 0));

    double[] ts = Enumerable.Range(0, sectors).Select(x => x * gap).ToArray();


    // ------- Setup Curves ------- //

    Curve[] crvB = curves.Select(c => c.DuplicateCurve()).ToArray();

    Curve[] crvD = (bot_sharp)
      ? curves.Select(c => c.DuplicateCurve()).ToArray()
      : offset(curves, radB, out _, tol);

    crvA = crvA.Select(c => project_closest(c, brep_half, Z_up, tol)).ToArray();
    crvB = (top_sharp)
      ? crvA.Select(c => c.DuplicateCurve()).ToArray()
      : crvB.Select(c => project_closest(c, brep_half, Z_up, tol)).ToArray();

    sort_crvs(pln, crvA, crvB);
    sort_crvs(pln, crvA, crvD);
    Curve[] crvC = crvB.Select(c => c.DuplicateCurve()).ToArray();
    Curve[] final_crvs = crvB.Select(c => c.DuplicateCurve()).ToArray();

    Plane base_plane = pln;
    Plane inside_plane = pln;
    Point3d central_pt = project_point(Point3d.Origin, brep, Z_up);
    base_plane.Origin = central_pt;
    base_plane.Transform(Transform.Translation(0, 0, extrude));
    double z_move = base_plane.OriginZ;

    double inside_z = base_plane.OriginZ - (radii[1] * flip);
    inside_plane.OriginZ = inside_z;
    TransformGeos(crvB, Transform.Translation(0, 0, radii[0] * flip));
    TransformGeos(crvC, Transform.Scale(inside_plane, 1, 1, 0));
    TransformGeos(crvD, Transform.Scale(base_plane, 1, 1, 0));


    // ------- Create test to see if surface is flat.  If so, a more simple construction can be used ------- //

    Curve[] test_flat_crvs = new Curve[count * 2];
    Array.Copy(offset(curves, radA - 0.1, out _, tol), test_flat_crvs, count);
    Array.Copy(crvA, 0, test_flat_crvs, count, count);

    bool flat_srf = test_flat(test_flat_crvs, brep_half, Z_up, tol, out _);


    // ------- main loop ------- //

    //List<Curve> test_crvs = new List<Curve>();

    BlendContinuity curvature = BlendContinuity.Curvature;
    LoftType straight_loft = LoftType.Straight;

    for (int i = 0; i < count; i++)
    {
      bool straight = crvA[i].IsLinear(0.01);

      Curve[] edges_A = new Curve[sectors];
      Curve[] edges_B = new Curve[sectors];

      for (int j = 0; j < sectors; j++)
      {
        Point3d pB = crvB[i].PointAtNormalizedLength(ts[j]);
        Point3d pC = new Point3d(pB.X, pB.Y, inside_z);
        Curve lnA = new LineCurve(pB, pC);
        bool straight_check = !straight || (straight && (j == 0 || j == sectors - 1));

        if (!top_sharp && straight_check && !top_chamfer)
        {
          Point3d pA = crvA[i].PointAtNormalizedLength(ts[j]);
          Vector3d vec = new Vector3d(pA - pB) { Z = 0 };

          if (flat_srf)
          {
            Curve top_ln = new LineCurve(pA + vec, pA);
            edges_A[j] = Curve.CreateBlendCurve(top_ln, lnA, curvature, bulges[0], bulges[0]);
          }
          else
          {
            Plane frame = new Plane(pA, Z_up, vec);
            Transform frame_trans = Transform.PlaneToPlane(pln, frame);

            cutter.Transform(Transform.PlaneToPlane(pln, frame));
            Intersection.BrepSurface(brep_half, cutter, tol, out Curve[] int_crvs, out _);
            cutter.Transform(Transform.PlaneToPlane(frame, pln));

            Curve cx_crv = (int_crvs.Length > 1) ? Curve.JoinCurves(int_crvs, tol, false)[0] : int_crvs[0];
            if (pA.DistanceToSquared(cx_crv.PointAtStart) < 0.001) cx_crv.Reverse();
            edges_A[j] = Curve.CreateBlendCurve(cx_crv, lnA, curvature, bulges[0], bulges[0]);
          }
        }

        if (!bot_sharp && straight_check && !bot_chamfer)
        {
          Point3d pD = crvD[i].PointAtNormalizedLength(ts[j]);
          Vector3d vec = new Vector3d(pD - pB) { Z = 0 };
          Curve lnB = new LineCurve(new Line(pD, vec, 1));
          edges_B[j] = Curve.CreateBlendCurve(lnA, lnB, curvature, bulges[1], bulges[1]);
        }
      }

      if (!top_sharp)
      {
        if (straight) final_breps[i] = (top_chamfer)
            ? Brep.CreateFromLoft(new[] { crvA[i], crvB[i] }, pu, pu, straight_loft, false)[0]
            : Brep.CreateFromLoft(new[] { edges_A[0], edges_A[sectors - 1] }, pu, pu, straight_loft, false)[0];
        else final_breps[i] = (top_chamfer)
          ? Brep.CreateFromLoft(new[] { crvA[i], crvB[i] }, pu, pu, straight_loft, false)[0]
          : edge_srf(crvA[i], crvB[i], edges_A, cross_numA);
      }

      if (!bot_sharp)
      {
        if (straight) final_breps[(count * 2) + i] = (bot_chamfer)
            ? Brep.CreateFromLoft(new[] { crvC[i], crvD[i] }, pu, pu, straight_loft, false)[0]
            : Brep.CreateFromLoft(new[] { edges_B[0], edges_B[sectors - 1] }, pu, pu, straight_loft, false)[0];
        else final_breps[(count * 2) + i] = (bot_chamfer)
          ? Brep.CreateFromLoft(new[] { crvC[i], crvD[i] }, pu, pu, straight_loft, false)[0]
          : edge_srf(crvC[i], crvD[i], edges_B, cross_numB);
      }

      final_breps[count + i] = Brep.CreateFromLoft(new[] { crvB[i], crvC[i] }, pu, pu, straight_loft, false)[0];
    }

    // ------- Re-Assemble parts ------- //

    final_breps[count * 3] = Brep.CreatePlanarBreps(crvD, 0.001)[0];

    BoundingBox target_bb = bb_union(crvA);
    target_bb.Inflate(0.1);

    List<Brep> pieces = brep_half.Split(crvA, tol).Where(b => !boxboxinside2D(target_bb, b.GetBoundingBox(true))).ToList();

    pieces.AddRange(final_breps);

    Brep final_brep = Brep.JoinBreps(pieces, 0.001, 0.1)[0]; // new Brep(); //  brep; //

    base_plane = new Plane(base_plane.Origin, -base_plane.XAxis, -base_plane.YAxis);

    if (remirror)
    {
      final_brep.Transform(mirror);
      brep.Transform(mirror);
      base_plane.Transform(mirror);
      TransformGeos(final_crvs, mirror);
    }

    if (final_brep.SolidOrientation == BrepSolidOrientation.Inward) final_brep.Flip();

    pl = base_plane; // Plane.WorldXY; //
    crvs = final_crvs; // new[] { new LineCurve(Point3d.Origin, new Point3d(0, 0, 1)) }; // crvA.Concat(crvB).Concat(crvC).Concat(crvD).ToArray(); //  crvD; //

    return final_brep; // new Brep(); //
  }


  private Brep hole_through(Curve[] curves, Brep brep, List<double> radii, List<double> bulges, int sectors, double tol, out Curve[] crvs)
  {
    Point3d pu = Point3d.Unset;
    double gap = 1 / (sectors - 1.0);
    Plane pln = Plane.WorldXY;
    int count = curves.Length;
    Interval interval = new Interval(0, 1);

    //List<Curve> test_crvs = new List<Curve>();

    int cross_numA = (bulges[0] == 0) ? 2 : 4;
    int cross_numB = (bulges[1] == 0) ? 2 : 4;

    Transform mirror = Transform.Mirror(Plane.WorldXY);
    bool remirror = brep.GetBoundingBox(true).Center.Z < 0;
    if (remirror) brep.Transform(mirror);


    // ------- Setup Curves ------- //

    double radA = radii[0];
    double radB = radii[1];


    Curve[] crvB = curves.Select(c => c.DuplicateCurve()).ToArray();
    Curve[] crvC = crvB.Select(c => c.DuplicateCurve()).ToArray();

    Curve[] crvA = (radii[0] == 0)
      ? curves.Select(c => c.DuplicateCurve()).ToArray()
      : offset(curves, radA, out _, tol);

    Curve[] crvD = (radii[1] == 0)
      ? curves.Select(c => c.DuplicateCurve()).ToArray()
      : offset(curves, radB, out _, tol);

    Point3d pt_on_other_side = new Point3d(0, 0, brep.GetBoundingBox(true).Max.Z + 1);
    Transform move_to_other_sides = Transform.Translation(new Vector3d(pt_on_other_side));
    TransformGeos(crvC, move_to_other_sides);
    TransformGeos(crvD, move_to_other_sides);


    Curve[] test_flat_crvsA = new Curve[count * 2];
    Array.Copy(offset(crvA, 0.1, out _, tol), test_flat_crvsA, count);
    Array.Copy(crvA, 0, test_flat_crvsA, count, count);

    Curve[] test_flat_crvsD = new Curve[count * 2];
    Array.Copy(offset(crvD, 0.1, out _, tol), test_flat_crvsD, count);
    Array.Copy(crvD, 0, test_flat_crvsD, count, count);

    // ------- Separate BrepFaces ------- //

    Brep[] final_breps = new Brep[count * 3];
    separate_brepfaces(brep, crvA, Vector3d.ZAxis, out Brep brep_halfA, out Brep brep_out);
    separate_brepfaces(brep_out, crvD, -Vector3d.ZAxis, out Brep brep_halfB, out brep_out);

    double len = 0.2;
    Surface cutter = planar_srf(len, len);
    cutter.Transform(Transform.Translation(0, len * 0.5, 0));

    double[] ts = Enumerable.Range(0, sectors).Select(x => x * gap).ToArray();


    // ------- Project Curves ------- //

    crvA = crvA.Select(c => project_closest(c, brep_halfA, Vector3d.ZAxis, tol)).ToArray();
    crvB = (radii[0] == 0)
      ? crvA.Select(c => c.DuplicateCurve()).ToArray()
      : crvB.Select(c => project_closest(c, brep_halfA, Vector3d.ZAxis, tol)).ToArray();


    crvD = crvD.Select(c => project_closest(c, brep_halfB, -Vector3d.ZAxis, tol)).ToArray();
    crvC = (radii[1] == 0)
      ? crvD.Select(c => c.DuplicateCurve()).ToArray()
      : crvC.Select(c => project_closest(c, brep_halfB, -Vector3d.ZAxis, tol)).ToArray();

    sort_crvs(pln, curves, crvA);
    sort_crvs(pln, curves, crvB);
    sort_crvs(pln, curves, crvC);
    sort_crvs(pln, curves, crvD);

    Point3d central_ptA = project_point(Point3d.Origin, brep_halfA, Vector3d.ZAxis);
    Point3d central_ptB = project_point(pt_on_other_side, brep_halfB, -Vector3d.ZAxis);

    Curve[] final_crvs = crvB.Select(c => c.DuplicateCurve()).ToArray();

    TransformGeos(crvB, Transform.Translation(0, 0, radii[0]));
    TransformGeos(crvC, Transform.Translation(0, 0, -radii[1]));


    // ------- Create test to see if surface is flat.  If so, a more simple construction can be used ------- //

    bool flat_srfA = test_flat(test_flat_crvsA, brep_halfA, Vector3d.ZAxis, tol, out _);
    bool flat_srfB = test_flat(test_flat_crvsD, brep_halfB, -Vector3d.ZAxis, tol, out _);


    // ------- main loop ------- //

    for (int i = 0; i < count; i++)
    {
      crvA[i].Domain = interval;
      crvB[i].Domain = interval;
      crvC[i].Domain = interval;
      crvD[i].Domain = interval;

      bool straightA = crvA[i].IsLinear(0.01);  //crvA[i].IsLinear(0.01) && crvB[i].IsLinear(0.01);
      bool straightB = crvD[i].IsLinear(0.01);

      Curve[] edges_A = new Curve[sectors];
      Curve[] edges_B = new Curve[sectors];

      for (int j = 0; j < sectors; j++)
      {
        Point3d pB = crvB[i].PointAtNormalizedLength(ts[j]);
        Point3d pC = crvC[i].PointAtNormalizedLength(ts[j]);
        Curve ln = new LineCurve(pC, pB);

        bool straight_checkA = (!straightA || (straightA && (j == 0 || j == sectors - 1)));
        bool straight_checkB = (!straightB || (straightB && (j == 0 || j == sectors - 1)));

        if (radii[0] != 0 && straight_checkA && bulges[0] != 0)
        {
          Point3d pA = crvA[i].PointAtNormalizedLength(ts[j]);
          Vector3d vec = new Vector3d(pA - pB) { Z = 0 };

          if (flat_srfA)
          {
            Curve top_ln = new LineCurve(pA, pA + vec);
            edges_A[j] = Curve.CreateBlendCurve(ln, top_ln, BlendContinuity.Curvature, bulges[0], bulges[0]);
          }
          else
          {
            Plane frame = new Plane(pA, Vector3d.ZAxis, vec);
            Transform frame_trans = Transform.PlaneToPlane(Plane.WorldZX, frame);

            cutter.Transform(Transform.PlaneToPlane(pln, frame));
            Intersection.BrepSurface(brep_halfA, cutter, tol, out Curve[] int_crvs, out _);
            cutter.Transform(Transform.PlaneToPlane(frame, pln));

            Curve cx_crv = (int_crvs.Length > 1) ? Curve.JoinCurves(int_crvs, tol, false)[0] : int_crvs[0];
            if (central_ptA.DistanceToSquared(cx_crv.PointAtEnd) < central_ptA.DistanceToSquared(cx_crv.PointAtStart)) cx_crv.Reverse();
            edges_A[j] = Curve.CreateBlendCurve(ln, cx_crv, BlendContinuity.Curvature, bulges[0], bulges[0]);
            //int_crvs[0].Reverse();
            //edges_A[j] = Curve.CreateBlendCurve(ln, int_crvs[0], BlendContinuity.Curvature, bulges[0], bulges[0]);
          }
        }

        if (radii[1] != 0 && straight_checkB && bulges[1] != 0)
        {
          Point3d pD = crvD[i].PointAtNormalizedLength(ts[j]);
          Vector3d vec = new Vector3d(pD - pC) { Z = 0 };

          if (flat_srfB)
          {
            Curve top_ln = new LineCurve(pD + vec, pD);
            edges_B[j] = Curve.CreateBlendCurve(top_ln, ln, BlendContinuity.Curvature, bulges[1], bulges[1]);
          }
          else
          {
            Plane frame = new Plane(pD, -Vector3d.ZAxis, vec);
            Transform frame_trans = Transform.PlaneToPlane(Plane.WorldZX, frame);

            cutter.Transform(Transform.PlaneToPlane(pln, frame));
            Intersection.BrepSurface(brep_halfB, cutter, tol, out Curve[] int_crvs, out _);
            cutter.Transform(Transform.PlaneToPlane(frame, pln));

            Curve cx_crv = (int_crvs.Length > 1) ? Curve.JoinCurves(int_crvs, tol, false)[0] : int_crvs[0];
            if (central_ptB.DistanceToSquared(cx_crv.PointAtEnd) < central_ptB.DistanceToSquared(cx_crv.PointAtStart)) cx_crv.Reverse();
            edges_A[j] = Curve.CreateBlendCurve(cx_crv, ln, BlendContinuity.Curvature, bulges[1], bulges[1]);

            //edges_B[j] = Curve.CreateBlendCurve(int_crvs[0], ln, BlendContinuity.Curvature, bulges[1], bulges[1]);
          }
        }
      }

      if (radii[0] != 0)
      {
        if (straightA) final_breps[i] = (bulges[0] == 0)
            ? Brep.CreateFromLoft(new[] { crvA[i], crvB[i] }, pu, pu, LoftType.Straight, false)[0]
            : Brep.CreateFromLoft(new[] { edges_A[0], edges_A[sectors - 1] }, pu, pu, LoftType.Straight, false)[0];
        else final_breps[i] = (bulges[0] == 0)
          ? Brep.CreateFromLoft(new[] { crvB[i], crvA[i] }, pu, pu, LoftType.Straight, false)[0]
          : edge_srf(crvB[i], crvA[i], edges_A, cross_numA);
      }
      if (radii[1] != 0)
      {
        if (straightB) final_breps[(count * 2) + i] = (bulges[1] == 0)
            ? Brep.CreateFromLoft(new[] { crvC[i], crvD[i] }, pu, pu, LoftType.Straight, false)[0]
            : Brep.CreateFromLoft(new[] { edges_B[0], edges_B[sectors - 1] }, pu, pu, LoftType.Straight, false)[0];
        else final_breps[(count * 2) + i] = (bulges[1] == 0)
          ? Brep.CreateFromLoft(new[] { crvD[i], crvC[i] }, pu, pu, LoftType.Straight, false)[0]
          : edge_srf(crvD[i], crvC[i], edges_B, cross_numB);
      }
      final_breps[count + i] = Brep.CreateFromLoft(new[] { crvB[i], crvC[i] }, pu, pu, LoftType.Straight, false)[0];
    }


    if (remirror) brep.Transform(mirror);

    BoundingBox test_boxA = bb_union(crvA, 0.2);
    BoundingBox test_boxB = bb_union(crvD, 0.2);

    List<Brep> pieces = brep_halfA.Split(crvA, tol).Where(b => !boxboxinside2D(test_boxA, b.GetBoundingBox(true))).ToList();
    pieces.AddRange(brep_halfB.Split(crvD, tol).Where(b => !boxboxinside2D(test_boxB, b.GetBoundingBox(true))));
    pieces.AddRange(final_breps);
    pieces.Add(brep_out);

    Brep[] parts = Brep.JoinBreps(pieces.Where(p => p != null), 0.001, 0.1);
    Brep final_brep = new Brep();
    for (int i = 0; i < parts.Length; i++) if (parts[i] != null) final_brep.Append(parts[i]);

    if (remirror)
    {
      final_brep.Transform(mirror);
      brep.Transform(mirror);
      TransformGeos(final_crvs, mirror);
    }

    if (final_brep.SolidOrientation == BrepSolidOrientation.Inward) final_brep.Flip();

    crvs = final_crvs;

    return final_brep;
  }
  private Brep through_inner(Curve[] curves, Brep brep, List<double> radii, List<double> bulges, int sectors, double tol, out Curve[] crvs)
  {
    Point3d pu = Point3d.Unset;
    double gap = 1 / (sectors - 1.0);
    Plane pln = Plane.WorldXY;
    int count = curves.Length;
    Interval interval = new Interval(0, 1);

    int cross_numA = (bulges[0] == 0) ? 2 : 4;
    int cross_numB = (bulges[1] == 0) ? 2 : 4;

    Transform mirror = Transform.Mirror(Plane.WorldXY);
    bool remirror = brep.GetBoundingBox(true).Center.Z < 0;
    if (remirror) brep.Transform(mirror);


    // ------- Setup Curves & Adjust for Inset ------- //

    double radA = -(radii[0]); //inset removed
    double radB = -(radii[1]); //inset removed


    Curve[] crvB = curves.Select(c => c.DuplicateCurve()).ToArray(); // offset(curves, -inset, tol);
    Curve[] crvC = crvB.Select(c => c.DuplicateCurve()).ToArray();

    Curve[] crvA = (radii[0] == 0)
      ? curves.Select(c => c.DuplicateCurve()).ToArray() //offset(curves, -inset, tol)
      : offset(curves, radA, out _, tol);

    Curve[] crvD = (radii[1] == 0)
      ? curves.Select(c => c.DuplicateCurve()).ToArray() //offset(curves, -inset, tol)
      : offset(curves, radB, out _, tol);

    Point3d pt_on_other_side = new Point3d(0, 0, brep.GetBoundingBox(true).Max.Z + 1);
    Transform move_to_other_sides = Transform.Translation(new Vector3d(pt_on_other_side));
    TransformGeos(crvC, move_to_other_sides);
    TransformGeos(crvD, move_to_other_sides);


    Curve[] test_flat_crvsA = new Curve[count * 2];
    Array.Copy(offset(crvA, 0.1, out _, tol), test_flat_crvsA, count);
    Array.Copy(crvA, 0, test_flat_crvsA, count, count);

    Curve[] test_flat_crvsD = new Curve[count * 2];
    Array.Copy(offset(crvD, 0.1, out _, tol), test_flat_crvsD, count);
    Array.Copy(crvD, 0, test_flat_crvsD, count, count);


    // ------- Separate BrepFaces ------- //

    Brep[] final_breps = new Brep[count * 3];
    separate_brepfaces(brep, crvA, Vector3d.ZAxis, out Brep brep_halfA, out Brep brep_out);
    separate_brepfaces(brep_out, crvD, -Vector3d.ZAxis, out Brep brep_halfB, out brep_out);

    double len = 0.1;
    Surface cutter = planar_srf(len, len);
    cutter.Transform(Transform.Translation(0, len * 0.5, 0));

    double[] ts = Enumerable.Range(0, sectors).Select(x => x * gap).ToArray();


    // ------- Project Curves ------- //

    crvA = crvA.Select(c => project_closest(c, brep_halfA, Vector3d.ZAxis, tol)).ToArray();
    crvB = (radii[0] == 0)
      ? crvA.Select(c => c.DuplicateCurve()).ToArray()
      : crvB.Select(c => project_closest(c, brep_halfA, Vector3d.ZAxis, tol)).ToArray();


    crvD = crvD.Select(c => project_closest(c, brep_halfB, -Vector3d.ZAxis, tol)).ToArray();
    crvC = (radii[1] == 0)
      ? crvD.Select(c => c.DuplicateCurve()).ToArray()
      : crvC.Select(c => project_closest(c, brep_halfB, -Vector3d.ZAxis, tol)).ToArray();

    sort_crvs(pln, curves, crvA);
    sort_crvs(pln, curves, crvB);
    sort_crvs(pln, curves, crvC);
    sort_crvs(pln, curves, crvD);

    Point3d central_ptA = project_point(Point3d.Origin, brep_halfA, Vector3d.ZAxis);
    Point3d central_ptB = project_point(pt_on_other_side, brep_halfB, -Vector3d.ZAxis);

    Curve[] final_crvs = crvB.Select(c => c.DuplicateCurve()).ToArray();

    TransformGeos(crvB, Transform.Translation(0, 0, radii[0]));
    TransformGeos(crvC, Transform.Translation(0, 0, -radii[1]));


    // ------- Create test to see if surface is flat.  If so, a more simple construction can be used ------- //

    bool flat_srfA = test_flat(test_flat_crvsA, brep_halfA, Vector3d.ZAxis, tol, out _);
    bool flat_srfB = test_flat(test_flat_crvsD, brep_halfB, -Vector3d.ZAxis, tol, out _);
    //List<Curve> test_crvs = new List<Curve>();


    // ------- main loop ------- //

    for (int i = 0; i < count; i++)
    {
      crvA[i].Domain = interval;
      crvB[i].Domain = interval;
      crvC[i].Domain = interval;
      crvD[i].Domain = interval;

      bool straightA = crvA[i].IsLinear(0.01);  //crvA[i].IsLinear(0.01) && crvB[i].IsLinear(0.01);
      bool straightB = crvD[i].IsLinear(0.01);

      if (!straightA)
      {
        circle_check(ref crvA[i]);
        circle_check(ref crvD[i]);
      }

      Curve[] edges_A = new Curve[sectors];
      Curve[] edges_B = new Curve[sectors];

      for (int j = 0; j < sectors; j++)
      {
        Point3d pB = crvB[i].PointAtNormalizedLength(ts[j]);
        Point3d pC = crvC[i].PointAtNormalizedLength(ts[j]);
        Curve ln = new LineCurve(pC, pB);

        bool straight_checkA = (!straightA || (straightA && (j == 0 || j == sectors - 1)));
        bool straight_checkB = (!straightB || (straightB && (j == 0 || j == sectors - 1)));

        if (radii[0] != 0 && straight_checkA && bulges[0] != 0)
        {
          Point3d pA = crvA[i].PointAtNormalizedLength(ts[j]);
          Vector3d vec = new Vector3d(pA - pB) { Z = 0 };
          vec.Unitize();
          if (flat_srfA)
          {
            Curve top_ln = new LineCurve(pA, pA + vec);
            edges_A[j] = Curve.CreateBlendCurve(ln, top_ln, BlendContinuity.Curvature, bulges[0], bulges[0]);
          }
          else
          {
            Plane frame = new Plane(pA, Vector3d.ZAxis, vec);
            Transform frame_trans = Transform.PlaneToPlane(Plane.WorldZX, frame);


            cutter.Transform(Transform.PlaneToPlane(pln, frame));
            Intersection.BrepSurface(brep_halfA, cutter, tol, out Curve[] int_crvs, out _);
            cutter.Transform(Transform.PlaneToPlane(frame, pln));
            int_crvs[0].Reverse();

            //Curve cx_crv = (int_crvs.Length > 1) ? Curve.JoinCurves(int_crvs, tol, false)[0] : int_crvs[0];
            //if (central_ptA.DistanceToSquared(cx_crv.PointAtEnd) < central_ptA.DistanceToSquared(cx_crv.PointAtStart)) cx_crv.Reverse();
            //edges_A[j] = Curve.CreateBlendCurve(ln, cx_crv, BlendContinuity.Curvature, bulges[0], bulges[0]);

            edges_A[j] = Curve.CreateBlendCurve(ln, int_crvs[0], BlendContinuity.Curvature, bulges[0], bulges[0]);
          }
        }

        if (radii[1] != 0 && straight_checkB && bulges[1] != 0)
        {
          Point3d pD = crvD[i].PointAtNormalizedLength(ts[j]);
          Vector3d vec = new Vector3d(pD - pC) { Z = 0 };

          if (flat_srfB)
          {
            Curve top_ln = new LineCurve(pD + vec, pD);
            edges_B[j] = Curve.CreateBlendCurve(top_ln, ln, BlendContinuity.Curvature, bulges[1], bulges[1]);
          }
          else
          {
            Plane frame = new Plane(pD, -Vector3d.ZAxis, vec);
            Transform frame_trans = Transform.PlaneToPlane(Plane.WorldZX, frame);


            cutter.Transform(Transform.PlaneToPlane(pln, frame));
            Intersection.BrepSurface(brep_halfB, cutter, tol, out Curve[] int_crvs, out _);
            cutter.Transform(Transform.PlaneToPlane(frame, pln));

            //Curve cx_crv = (int_crvs.Length > 1) ? Curve.JoinCurves(int_crvs, tol, false)[0] : int_crvs[0];
            //if (central_ptB.DistanceToSquared(cx_crv.PointAtEnd) < central_ptB.DistanceToSquared(cx_crv.PointAtStart)) cx_crv.Reverse();
            //edges_A[j] = Curve.CreateBlendCurve(cx_crv, ln, BlendContinuity.Curvature, bulges[1], bulges[1]);

            edges_B[j] = Curve.CreateBlendCurve(int_crvs[0], ln, BlendContinuity.Curvature, bulges[1], bulges[1]);
          }
        }
      }


      if (radii[0] != 0)
      {
        if (straightA) final_breps[i] = (bulges[0] == 0)
            ? Brep.CreateFromLoft(new[] { crvA[i], crvB[i] }, pu, pu, LoftType.Straight, false)[0]
            : Brep.CreateFromLoft(new[] { edges_A[0], edges_A[sectors - 1] }, pu, pu, LoftType.Straight, false)[0];
        else final_breps[i] = (bulges[0] == 0)
          ? Brep.CreateFromLoft(new[] { crvB[i], crvA[i] }, pu, pu, LoftType.Straight, false)[0]
          : edge_srf(crvB[i], crvA[i], edges_A, cross_numA);
      }
      if (radii[1] != 0)
      {
        if (straightB) final_breps[(count * 2) + i] = (bulges[1] == 0)
            ? Brep.CreateFromLoft(new[] { crvC[i], crvD[i] }, pu, pu, LoftType.Straight, false)[0]
            : Brep.CreateFromLoft(new[] { edges_B[0], edges_B[sectors - 1] }, pu, pu, LoftType.Straight, false)[0];
        else final_breps[(count * 2) + i] = (bulges[1] == 0)
          ? Brep.CreateFromLoft(new[] { crvD[i], crvC[i] }, pu, pu, LoftType.Straight, false)[0]
          : edge_srf(crvD[i], crvC[i], edges_B, cross_numB);
      }
      final_breps[count + i] = Brep.CreateFromLoft(new[] { crvB[i], crvC[i] }, pu, pu, LoftType.Straight, false)[0];
    }

    //test_crvs.AddRange(crvC);
    //test_crvs.AddRange(crvD);

    //Brep test_brep = new Brep();
    //for (int i = 0; i < final_breps.Length; i++) if (final_breps[i] != null) test_brep.Append(final_breps[i]);

    //crvs = test_crvs.ToArray();
    //return test_brep;

    BoundingBox test_boxA = bb_union(crvA, 0.1);
    BoundingBox test_boxB = bb_union(crvD, 0.1);

    List<Brep> pieces = brep_halfA.Split(crvA, tol).Where(b => boxboxinside2D(test_boxA, b.GetBoundingBox(true))).ToList();
    pieces.AddRange(brep_halfB.Split(crvD, tol).Where(b => boxboxinside2D(test_boxB, b.GetBoundingBox(true))));
    pieces.AddRange(final_breps);


    Brep[] parts = Brep.JoinBreps(pieces.Where(p => p != null), 0.001, 0.1);
    Brep final_brep = new Brep();
    for (int i = 0; i < parts.Length; i++) if (parts[i] != null) final_brep.Append(parts[i]);

    if (remirror)
    {
      final_brep.Transform(mirror);
      brep.Transform(mirror);
      TransformGeos(final_crvs, mirror);
    }

    if (final_brep.SolidOrientation == BrepSolidOrientation.Inward) final_brep.Flip();

    crvs = final_crvs;

    return final_brep;
  }
  
private Brep full_extrude(Curve[] crvs, double extrude, List<double> radii, List<double> bulges, int sectors, bool centre, double tol, out Curve[] out_crvs)
  {
    Plane plane = curves_plane(crvs);
    Transform orient = Transform.PlaneToPlane(plane, Plane.WorldXY);
    Transform reorient = Transform.PlaneToPlane(Plane.WorldXY, plane);

    TransformGeos(crvs, orient);

    bool loop = crvs.Length == 1 && crvs[0].IsClosed;
    Point3d pu = Point3d.Unset;

    bool mirror = extrude != Math.Abs(extrude) && !centre;
    extrude = Math.Abs(extrude);

    // -------  Set Up Radii and Decide if should add Sides  ------- //

    radii = radii.Select(n => Math.Max(n, 0)).ToList();

    bool has_sides = radii[0] < extrude;
    if (!has_sides) { radii[0] = extrude; radii[1] = 0; }
    if (radii[1] > extrude - radii[0])
    {
      radii[1] = extrude - radii[0];
      has_sides = false;
    }

    bool C2arcA = bulges[0] <= -1 && (radii[0] * 1.5) <= extrude - radii[1];
    bool C2arcB = bulges[1] <= -1 && (radii[1] * 1.5) <= extrude - radii[0];
    if (C2arcA) { radii[0] *= 1.5; bulges[0] = 0.72; }
    if (C2arcB) { radii[1] *= 1.5; bulges[1] = 0.72; }

    bool has_radA = radii[0] != 0;
    bool has_radB = radii[1] != 0;


    // -------  Set Up Standard Variables  ------- //

    int count = crvs.Length;
    int v_num = (count == 1) ? v_num = sectors - 1 : sectors;

    crvs = square_crvs(crvs);
    match_crv_ends(crvs);
    Curve[] crvA = offset(crvs, -radii[0], out _, tol);
    Curve[] crvB = Array.ConvertAll(crvs, c => c.DuplicateCurve());
    Curve[] crvC = Array.ConvertAll(crvs, c => c.DuplicateCurve());
    Curve[] crvD = offset(crvs, -radii[1], out _, tol);


    if (Math.Abs(crvA[0].PointAtStart.DistanceTo(crvB[0].PointAtStart) - radii[0]) > tol) sort_crvs(crvA, crvB);
    if (Math.Abs(crvD[0].PointAtStart.DistanceTo(crvB[0].PointAtStart) - radii[1]) > tol) sort_crvs(crvD, crvB);

    Transform moveA = Transform.Translation(0, 0, radii[0]);
    Transform moveB = Transform.Translation(0, 0, radii[1]);
    Transform moveC = Transform.Translation(0, 0, extrude - (radii[1] * 2));
    Transform moveD = Transform.Translation(0, 0, extrude);
    Transform moveC2 = Transform.Translation(0, 0, radii[1]);

    Transform mirror_trans = Transform.Mirror(Plane.WorldXY);
    Transform centre_trans = Transform.Translation(0, 0, -(extrude * 0.5));

    // -------  Main Loop - Build Surfaces  ------- //

    Brep[] srfs = new Brep[(count * 3) + 2];

    for (int i = 0; i < count; i++)
    {
      crvB[i].Transform(moveA);  // ---- Arrange Curves---- //
      crvC[i].Transform(moveB);
      int edge_num = crvB[i].IsLinear(0.01) ? 2 : sectors;

      if (has_radA)
      {
        int cross_num = (bulges[0] == 0) ? 2 : 4;
        Curve[] edge_curves = simple_edges(crvA[i], crvB[i], bulges[0], edge_num);
        srfs[count + i] = edge_srf(crvA[i], crvB[i], edge_curves, cross_num);
      }

      if (has_radB)
      {
        int cross_num = (bulges[1] == 0) ? 2 : 4;
        Curve[] edge_curves = simple_edges(crvD[i], crvC[i], bulges[1], edge_num);
        srfs[(count * 2) + i] = edge_srf(crvD[i], crvC[i], edge_curves, cross_num);
        srfs[(count * 2) + i].Transform(mirror_trans);
        srfs[(count * 2) + i].Transform(moveD);
      }

      crvC[i].Transform(moveC);
      if (has_sides) srfs[i] = Brep.CreateFromLoft(new[] { crvB[i], crvC[i] }, pu, pu, LoftType.Straight, false)[0];
      crvC[i].Transform(moveC2);
    }

    srfs[count * 3] = Brep.CreatePlanarBreps(crvA, 0.001)[0];
    srfs[(count * 3) + 1] = Brep.CreatePlanarBreps(crvD, 0.001)[0];
    srfs[(count * 3) + 1].Transform(moveD);

    Brep brep = Brep.JoinBreps(srfs, 0.001, 0.1)[0];


    if (mirror) { brep.Transform(mirror_trans); TransformGeos(crvC, mirror_trans); }
    if (centre) { brep.Transform(centre_trans); TransformGeos(crvC, centre_trans); }

    brep.Transform(reorient);
    TransformGeos(crvs, reorient);

    out_crvs = crvs;

    return brep;
  }




  private Brep quick_extrude(Curve[] crvs, double extrude, double radius, double bulge, int sectors, bool centre, double tol, out Curve[] out_crvs)
  {
    // -------  Set Up Conditions  ------- //

    bool loop = crvs.Length == 1 && crvs[0].IsClosed;
    bool mirror = extrude != Math.Abs(extrude) && !centre;
    extrude = Math.Abs(extrude);
    int cross_num = (bulge == 0) ? 2 : 4;

    bool has_sides = radius < extrude * 0.5;
    if (!has_sides) radius = extrude * 0.5;

    bool C2arc = bulge <= -1 && (radius * 3) + tol < extrude; // bulge is less than one and does not make the radius bigger than half the extrude
    if (C2arc)
    {
      radius *= 1.5;
      bulge = 0.72;
    }

    // -------  Set Up Standard Variables  ------- //

    int count = crvs.Length;
    Point3d pu = Point3d.Unset;

    Curve[] crvA = offset(crvs, -radius, out _, tol);
    Curve[] crvC = Array.ConvertAll(crvs, c => c.DuplicateCurve());

    if (Math.Abs(crvA[0].PointAtStart.DistanceTo(crvs[0].PointAtStart) - radius) > tol) sort_crvs(crvA, crvs);

    Transform moveB = Transform.Translation(0, 0, radius);
    Transform moveC = Transform.Translation(0, 0, extrude - radius);
    Transform moveD = Transform.Translation(0, 0, extrude);
    Transform moveC2 = Transform.Translation(0, 0, radius);
    Transform mirror_trans = Transform.Mirror(Plane.WorldXY);
    Transform centre_trans = Transform.Translation(0, 0, -(extrude * 0.5));

    // -------  Main Loop - Build Surfaces  ------- //

    Brep[] srfs = new Brep[(count * 3) + 2];

    for (int i = 0; i < count; i++)
    {
      bool straight = crvs[i].IsLinear(0.01);
      crvs[i].Transform(moveB);  // ---- Arrange Curves---- //
      crvC[i].Transform(moveC);

      if (has_sides) srfs[i] = Brep.CreateFromLoft(new[] { crvs[i], crvC[i] }, pu, pu, LoftType.Straight, false)[0];
      srfs[i].Flip();
      int edge_num = straight ? 2 : sectors;

      Curve[] edges = simple_edges(crvA[i], crvs[i], bulge, edge_num);
      srfs[count + i] = edge_srf(crvs[i], crvA[i], edges, cross_num); //

      srfs[(count * 2) + i] = srfs[count + i].DuplicateBrep();
      srfs[(count * 2) + i].Transform(mirror_trans);
      srfs[(count * 2) + i].Transform(moveD);
      crvC[i].Transform(moveC2);
    }

    srfs[count * 3] = Brep.CreatePlanarBreps(crvA, 0.001)[0];
    srfs[(count * 3) + 1] = srfs[count * 3].DuplicateBrep();
    srfs[(count * 3) + 1].Transform(moveD);

    Brep brep = Brep.JoinBreps(srfs.Where(s => s != null), 0.001, 0.1)[0];

    if (mirror) { brep.Transform(mirror_trans); TransformGeos(crvC, mirror_trans); }
    if (centre) { brep.Transform(centre_trans); TransformGeos(crvC, centre_trans); }

    out_crvs = crvC;

    return brep;
  }
  public Brep edge_srf(Curve top, Curve bottom, Curve[] edge_curves, int num, bool loop = false, double tol = 0.001)
  {
    if (num < 3 || edge_curves == null)
    {
      return Brep.CreateFromLoft(new[] { top, bottom }, Point3d.Unset, Point3d.Unset, LoftType.Straight, false)[0];
    }
    double ang_tol = 0.1;
    double cos_tol = Math.Cos(ang_tol);

    Vector3d[] axes = new Vector3d[] { Vector3d.XAxis, -Vector3d.XAxis, Vector3d.YAxis, -Vector3d.YAxis, Vector3d.ZAxis, -Vector3d.ZAxis };

    Vector3d start = top.TangentAtStart; // Already Unitized Vector
    Vector3d end = top.TangentAtEnd;
    for (int i = 0; i < 6; i++)
    {
      if (start * axes[i] > cos_tol) { start = axes[i]; break; }
    }
    for (int i = 0; i < 6; i++)
    {
      if (end * axes[i] > cos_tol) { end = axes[i]; break; }
    }

    int count = edge_curves.Length;
    double gap = 1 / (num - 1.0);

    Curve[] curves = new Curve[num];

    if (edge_curves[0].PointAtStart.EpsilonEquals(top.PointAtStart, 0.01) ||
      edge_curves[0].PointAtStart.EpsilonEquals(top.PointAtEnd, 0.01))
    {
      curves[0] = top;
      curves[num - 1] = bottom;
    }
    else { curves[0] = bottom; curves[num - 1] = top; }

    int pt_num = loop ? count + 1 : count;
    Point3d[] edge_mid_pts = new Point3d[pt_num];

    for (int i = 1; i < num - 1; i++)
    {
      double gap_size = gap * i;
      for (int j = 0; j < count; j++) edge_mid_pts[j] = edge_curves[j].PointAtNormalizedLength(gap_size);
      if (loop) edge_mid_pts[count] = edge_mid_pts[0];

      Curve edge_mid = Curve.CreateInterpolatedCurve(edge_mid_pts, 3, CurveKnotStyle.Uniform, start, end);
      if (edge_mid.IsCircle(0.01)) edge_mid = new ArcCurve(new Circle(edge_mid_pts[0], edge_mid_pts[1], edge_mid_pts[2])); //circle_check(edge_mid, edge_mid_pts);
      else edge_mid = square_crv(edge_mid);
      curves[i] = edge_mid;
    }

    if (top.IsClosed) Array.Resize(ref edge_curves, edge_curves.Length - 1);

    NurbsSurface surface = NurbsSurface.CreateNetworkSurface(curves, 3, 3, edge_curves, 3, 3, tol, tol, tol, out _);
    if (surface == null) surface = NurbsSurface.CreateNetworkSurface(new[] { top, bottom }, 3, 3, edge_curves, 3, 3, tol, tol, tol, out _);

    return surface.ToBrep(); // new Brep(); //

  }  // optimized


  public Brep edge_srfx(Curve top, Curve bottom, Curve[] edge_curves, int num, out Curve[] crv_list, bool loop = false, double tol = 0.001)
  {
    if (num < 3 || edge_curves == null)
    {
      crv_list = null;
      return Brep.CreateFromLoft(new[] { top, bottom }, Point3d.Unset, Point3d.Unset, LoftType.Straight, false)[0];
    }
    double ang_tol = 0.01;

    Vector3d start = top.TangentAtStart;
    if (start.EpsilonEquals(Vector3d.XAxis, ang_tol)) start = Vector3d.XAxis;
    else if (start.EpsilonEquals(-Vector3d.XAxis, ang_tol)) start = -Vector3d.XAxis;
    else if (start.EpsilonEquals(Vector3d.YAxis, ang_tol)) start = Vector3d.YAxis;
    else if (start.EpsilonEquals(-Vector3d.YAxis, ang_tol)) start = -Vector3d.YAxis;
    else if (start.EpsilonEquals(Vector3d.ZAxis, ang_tol)) start = Vector3d.ZAxis;
    else if (start.EpsilonEquals(-Vector3d.ZAxis, ang_tol)) start = -Vector3d.ZAxis;

    Vector3d end = top.TangentAtEnd;
    if (end.EpsilonEquals(Vector3d.XAxis, ang_tol)) end = Vector3d.XAxis;
    else if (end.EpsilonEquals(-Vector3d.XAxis, ang_tol)) end = -Vector3d.XAxis;
    else if (end.EpsilonEquals(Vector3d.YAxis, ang_tol)) end = Vector3d.YAxis;
    else if (end.EpsilonEquals(-Vector3d.YAxis, ang_tol)) end = -Vector3d.YAxis;
    else if (end.EpsilonEquals(Vector3d.ZAxis, ang_tol)) end = Vector3d.ZAxis;
    else if (end.EpsilonEquals(-Vector3d.ZAxis, ang_tol)) end = -Vector3d.ZAxis;

    int count = edge_curves.Length;
    double gap = 1 / (num - 1.0);
    Curve[] curves = new Curve[num];
    Interval interval = new Interval(0, 1);
    for (int j = 0; j < count; j++) edge_curves[j].Domain = interval;

    if (edge_curves[0].PointAtStart.EpsilonEquals(top.PointAtStart, 0.01) ||
      edge_curves[0].PointAtStart.EpsilonEquals(top.PointAtEnd, 0.01))
    {
      curves[0] = top;
      curves[num - 1] = bottom;
    }
    else { curves[0] = bottom; curves[num - 1] = top; }

    int pt_num = loop ? count + 1 : count;
    Point3d[] edge_mid_pts = new Point3d[pt_num];

    for (int i = 1; i < num - 1; i++)
    {
      double gap_size = gap * i;
      for (int j = 0; j < count; j++) edge_mid_pts[j] = edge_curves[j].PointAtNormalizedLength(gap_size);
      if (loop) edge_mid_pts[count] = edge_mid_pts[0];

      Curve edge_mid = Curve.CreateInterpolatedCurve(edge_mid_pts, 3, CurveKnotStyle.Uniform, start, end);
      if (edge_mid.IsCircle(0.01)) edge_mid = new ArcCurve(new Circle(edge_mid_pts[0], edge_mid_pts[1], edge_mid_pts[2])); //circle_check(edge_mid, edge_mid_pts);
      else edge_mid = square_crv(edge_mid);
      curves[i] = edge_mid;
    }

    if (top.IsClosed) Array.Resize(ref edge_curves, edge_curves.Length - 1);
    crv_list = curves;

    NurbsSurface surface = NurbsSurface.CreateNetworkSurface(curves, 3, 3, edge_curves, 3, 3, tol, tol, tol, out _);
    if (surface == null) surface = NurbsSurface.CreateNetworkSurface(new[] { top, bottom }, 3, 3, edge_curves, 3, 3, tol, tol, tol, out _);

    return surface.ToBrep(); // new Brep(); //
  }  // optimized


  public static Curve[] simple_edges(Curve crvA, Curve crvB, double bulge, int sectors)
  {
    double gap = 1 / (sectors - 1.0);
    Interval interval = new Interval(0, 1);
    crvA.Domain = interval;
    crvB.Domain = interval;
    Point3d[] ptsA = new Point3d[sectors];
    Point3d[] ptsB = new Point3d[sectors];
    for (int i = 0; i < sectors; i++)
    {
      ptsA[i] = crvA.PointAtNormalizedLength(gap * i);
      ptsB[i] = crvB.PointAtNormalizedLength(gap * i);
    }
    // Output Chamfers
    if (bulge == 0) return ptsA.Select((p, i) => new LineCurve(p, ptsB[i])).ToArray();
    // Output Arcs
    if (bulge < 0) return ptsA.Select((p, i) => new ArcCurve(new Arc(ptsB[i], -Vector3d.ZAxis, p))).ToArray();

    // Output Blends
    Curve[] edge_curves = new Curve[sectors];
    Curve side_ln = new LineCurve(new Point3d(0, 0, 1), Point3d.Origin);
    for (int i = 0; i < sectors; i++)
    {
      Vector3d move = new Vector3d(ptsB[i]);
      Vector3d vec = new Vector3d(ptsA[i] - ptsB[i]) { Z = 0 };
      Curve crv0 = new LineCurve(ptsA[i], ptsA[i] + vec);
      side_ln.Transform(Transform.Translation(move));
      edge_curves[i] = Curve.CreateBlendCurve(side_ln, crv0, BlendContinuity.Curvature, bulge, bulge);
      side_ln.Transform(Transform.Translation(-move));
    }
    return edge_curves;
  }
  public static Brep capped_extrude(Curve[] crvs, out Curve[] out_crvs, double length = 5.0, bool centre = false, double tol = 0.01)
  {
    Point3d pu = Point3d.Unset;
    int count = crvs.Length;
    Vector3d dir = curves_plane(crvs).Normal * length;
    Transform moveC2 = Transform.Translation(dir);
    if (centre)
    {
      Transform transform = Transform.Translation(-dir * 0.5);
      for (int i = 0; i < count; i++) crvs[i].Transform(transform);
    }
    Curve[] crvC = new Curve[count];
    Brep[] sides = new Brep[count + 2];
    for (int i = 0; i < count; i++)
    {
      crvC[i] = crvs[i].DuplicateCurve();
      crvC[i].Transform(moveC2);
      sides[i + 1] = Brep.CreateFromLoft(new[] { crvs[i], crvC[i] }, pu, pu, LoftType.Straight, false)[0]; // Surface.CreateExtrusion(crvs[i], dir).ToBrep();
    }
    sides[0] = Brep.CreatePlanarBreps(crvs, 0.001)[0];
    sides[count + 1] = sides[0].DuplicateBrep();
    sides[count + 1].Transform(moveC2);

    Brep body = Brep.JoinBreps(sides, 0.001, 0.1)[0];
    if (body.SolidOrientation == BrepSolidOrientation.Inward) body.Flip();

    out_crvs = crvC;
    return body;
  }
  public static bool test_flat(Curve[] crvs, Brep brep, Vector3d direction, double tol, out Point3d[] test_pts)
  {
    int count = crvs.Length;
    Interval interval = new Interval(0, 1);

    Point3d[] pts = new Point3d[count * 3];
    for (int i = 0; i < count; i++)
    {
      crvs[i].Domain = interval;
      pts[i] = project_point(crvs[i].PointAt(0.15), brep, direction);
      pts[count + i] = project_point(crvs[i].PointAt(0.5), brep, direction);
      pts[(count * 2) + i] = project_point(crvs[i].PointAt(0.85), brep, direction);
    }

    test_pts = pts;
    Plane.FitPlaneToPoints(pts, out _, out double amount);
    return amount < tol;
  }
  public static bool circle_check(ref Curve curve, double tol = 0.01)  // ******** Needs Love
  {
    bool iscircle = curve.TryGetCircle(out Circle circle, tol);
    Point3d test_pt = curve.PointAtStart;
    if (iscircle) curve = new ArcCurve(circle);
    curve.ClosestPoint(test_pt, out double t);
    curve.ChangeClosedCurveSeam(t);
    //bool iscircle = curve.IsCircle(tol);
    //if (iscircle) curve = new ArcCurve(new Arc(curve.PointAtStart, curve.TangentAtStart, curve.PointAtEnd));
    return iscircle;
  }
  public static Curve[] object_curve_convert(List<object> objects)
  {
    int count = objects.Count;
    Curve[] curves = new Curve[count];
    for (int i = 0; i < count; i++)
    {
      if (objects[i] is Curve) curves[i] = objects[i] as Curve;
      else if (objects[i] is Line) curves[i] = new LineCurve((Line)objects[i]);
      else if (objects[i] is Circle) curves[i] = new ArcCurve((Circle)objects[i]);
      else curves[i] = new ArcCurve((Arc)objects[i]);
    }
    return curves;
  }

  public void separate_brepfaces(Brep brep, Curve[] crvs, Vector3d direction, out Brep brep_in, out Brep brep_out) // !!! FIX !!!
  {
    double tol = 0.001;
    int count = crvs.Length;
    int face_count = brep.Faces.Count;

    bool should_orient = direction.EpsilonEquals(Vector3d.ZAxis, tol);
    Transform reorient = Transform.Unset;
    if (should_orient)
    {
      Plane pl = curves_plane(crvs);
      Transform orient = Transform.PlaneToPlane(pl, Plane.WorldXY);
      reorient = Transform.PlaneToPlane(Plane.WorldXY, pl);
      TransformGeos(crvs, orient);
      brep.Transform(orient);
    }

    int ptnum = 14;
    double pt_gap = 1.0 / ptnum;
    Point3d[] pts = new Point3d[count * ptnum];
    int counter = 0;
    for (int i = 0; i < count; i++)
    {
      crvs[i].Reparameterize();
      for (int j = 0; j < ptnum; j++)
      {
        // pts[counter++] = Intersection.RayShoot(new Ray3d(crvs[i].PointAt(pt_gap * (j + 0.5)), direction), new[] { brep }, 1)[0];
        pts[counter++] = project_point(crvs[i].PointAt(pt_gap * (j + 0.5)), brep, direction);
      }
    }

    HashSet<int> index_in = new HashSet<int>();
    for (int i = 0; i < pts.Length; i++)
    {
      brep.ClosestPoint(pts[i], out _, out ComponentIndex ci, out _, out _, tol, out _);
      if (ci.Index != -1) index_in.Add(ci.Index);
    }

    List<int> index_out = new List<int>();
    for (int i = 0; i < face_count; i++)
    {
      if (!index_in.Contains(i)) index_out.Add(i);  //index_outx[counter++] = i;
    }

    BoundingBox test_box = new BoundingBox(pts);
    test_box.Union(new Point3d(0, 0, -brep.GetBoundingBox(false).Min.Z - 10));
    test_box.Transform(Transform.Translation(0, 0, tol));
    for (int i = index_out.Count - 1; i >= 0; i--)
    {
      if (boxinside(test_box, brep.DuplicateSubBrep(new[] { index_out[i] }).GetBoundingBox(true)))
      {
        index_in.Add(index_out[i]);
        index_out.RemoveAt(i);
      }
    }

    if (should_orient) brep.Transform(reorient);

    brep_in = brep.DuplicateSubBrep(index_in);
    brep_out = brep.DuplicateSubBrep(index_out);
  }




  public static void clean_lines(ref Curve[] curves, double tol = 0.01)
  {
    int count = curves.Length;

    // Use a HashSet to track indices to remove for faster lookups
    HashSet<int> removeSet = new HashSet<int>();

    for (int i = 0; i < count; i++)
    {
      int next = (i + 1) % count;
      if (curves[i].IsLinear(0.01) && curves[next].IsLinear(0.01))
      {
        if (curves[i].TangentAtEnd.EpsilonEquals(curves[next].TangentAtStart, 0.01))
        {
          curves[i] = new LineCurve(curves[i].PointAtStart, curves[next].PointAtEnd);
          removeSet.Add(next);
        }
      }
    }

    // Filter out curves that need to be removed using LINQ
    curves = curves
        .Where((curve, index) => !removeSet.Contains(index))
        .ToArray();
  }
  private void match_crv_ends(Curve[] curves)
  {
    int count = curves.Length;
    List<Point3d> straight_pts = new List<Point3d>();
    List<Curve> curved = new List<Curve>();
    for (int i = 0; i < count; i++)
    {
      if (curves[i].IsLinear(0.01))
      {
        straight_pts.Add(curves[i].PointAtStart);
        straight_pts.Add(curves[i].PointAtEnd);
      }
      else
      {
        curved.Add(curves[i]);
      }
    }

    for (int i = 0; i < curved.Count; i++)
    {
      Point3d start_pt = curved[i].PointAtStart;
      Point3d end_pt = curved[i].PointAtEnd;
      for (int j = 0; j < straight_pts.Count; j++)
      {
        Point3d test_pt = straight_pts[j];
        if (start_pt.EpsilonEquals(test_pt, 0.01)) curved[i].SetStartPoint(test_pt);
        if (end_pt.EpsilonEquals(test_pt, 0.01)) curved[i].SetEndPoint(test_pt);
      }
    }
  }
  public static NurbsSurface planar_srf(double x = 1, double y = 1)
  {
    x *= 0.5;
    y *= 0.5;

    return NurbsSurface.CreateFromCorners(
      new Point3d(-x, -y, 0),
      new Point3d(-x, y, 0),
      new Point3d(x, y, 0),
      new Point3d(x, -y, 0));
  }
  public static BoundingBox bb_union<T>(IList<T> geos, double inflate = 0) where T : GeometryBase
  {
    BoundingBox bb = BoundingBox.Empty;
    for (int i = 0; i < geos.Count; i++) bb.Union(geos[i].GetBoundingBox(true));
    if (inflate != 0) bb.Inflate(inflate);
    return bb;
  }
  public static void sort_crvs(Curve[] curvesA, Curve[] curvesB, double tol = 0.001)
  {
    sort_crv(curvesA, tol);

    // Initialize first curve for crvsB
    //InitializeFirstCurveB(curvesA[0], curvesB.ToList(), curvesB, tol);
    set_first_curve(curvesA[0], ref curvesB);

    sort_crv(curvesB, tol);
  }
  public static void sort_crvs(Plane plane, Curve[] curvesA, Curve[] curvesB, double tol = 0.001)
  {
    int count = curvesA.Length;
    Transform flatten = Transform.Scale(plane, 1, 1, 0);
    Curve[] cA = Array.ConvertAll(curvesA, c => c.DuplicateCurve());
    Curve[] cB = Array.ConvertAll(curvesB, c => c.DuplicateCurve());

    TransformGeos(cA, flatten);
    TransformGeos(cB, flatten);

    int[] sortA = sort_index(cA, out bool[] flipA);

    bool flip = set_first_curve(cA[0], ref cB);

    int[] sortB = sort_index(cB, out bool[] flipB);
    flipB[0] = flip;

    Array.Sort(sortA, curvesA);
    Array.Sort(sortB, curvesB);
    Array.Sort(sortA, flipA);
    Array.Sort(sortB, flipB);

    for (int i = 0; i < count; i++)
    {
      if (flipA[i]) curvesA[i].Reverse();
      if (flipB[i]) curvesB[i].Reverse();
    }
  }
  public static bool set_first_curve(Curve crv, ref Curve[] curve_list, double tol = 0.001)
  {
    bool flip = false;

    int count = curve_list.Length;
    Interval interval = new Interval(0, 1);
    double inset = 0.3;

    crv.Domain = interval;
    Point3d ptA = crv.PointAt(inset);
    Point3d ptB = crv.PointAt(1 - inset);

    double minDistance = double.MaxValue;
    int start = 0;

    for (int i = 0; i < count; i++)
    {
      curve_list[i].Domain = interval;
      Point3d pt0 = curve_list[i].PointAt(inset);
      Point3d pt1 = curve_list[i].PointAt(1 - inset);

      double distance = Math.Min(ptA.DistanceToSquared(pt0), ptA.DistanceToSquared(pt1)) + Math.Min(ptB.DistanceToSquared(pt0), ptB.DistanceToSquared(pt1));

      if (distance < minDistance)
      {
        minDistance = distance;
        start = i;
      }
    }

    if (start > 0)
    {
      Curve[] sorted = new Curve[count];
      Array.Copy(curve_list, start, sorted, 0, count - start);
      Array.Copy(curve_list, 0, sorted, count - start, start);
      curve_list = sorted;
    }

    if (ptA.DistanceToSquared(curve_list[0].PointAt(inset)) > ptA.DistanceToSquared(curve_list[0].PointAt(1 - inset)))
    {
      curve_list[0].Reverse();
      flip = true;
    }
    return flip;
  }
  public static void sort_crv(Curve[] curves, double tol = 0.01)
  {
    int count = curves.Length;
    List<Curve> crvs = curves.Skip(1).ToList();

    for (int i = 0; i < count - 1; i++)
    {
      Point3d end = curves[i].PointAtEnd;
      for (int j = 0; j < crvs.Count; j++)
      {
        if (end.EpsilonEquals(crvs[j].PointAtStart, tol))
        {
          curves[i + 1] = crvs[j];
          crvs.RemoveAt(j);
          break;
        }
        else if (end.EpsilonEquals(crvs[j].PointAtEnd, tol))
        {
          crvs[j].Reverse();
          curves[i + 1] = crvs[j];
          crvs.RemoveAt(j);
          break;
        }
      }
    }
  }
  public static int[] sort_index(Curve[] curves, out bool[] flip, double tol = 0.01)
  {
    int count = curves.Length;

    int[] idx = new int[count];
    bool[] flip_bool = new bool[count]; // defaults to 'false' so no need to add assign anything other than 'true'

    List<Curve> crvs = new ArraySegment<Curve>(curves, 1, count - 1).ToList();
    List<int> idx_list = Enumerable.Range(1, count - 1).ToList();

    for (int i = 0; i < count - 1; i++)
    {
      Point3d end = curves[i].PointAtEnd;
      for (int j = 0; j < crvs.Count; j++)
      {
        if (end.EpsilonEquals(crvs[j].PointAtStart, tol))
        {
          curves[i + 1] = crvs[j];
          crvs.RemoveAt(j);
          idx[i + 1] = idx_list[j];
          idx_list.RemoveAt(j);
          break;
        }
        else if (end.EpsilonEquals(crvs[j].PointAtEnd, tol))
        {
          flip_bool[i + 1] = true;
          crvs[j].Reverse();
          curves[i + 1] = crvs[j];
          crvs.RemoveAt(j);
          idx[i + 1] = idx_list[j];
          idx_list.RemoveAt(j);
          break;
        }
      }
    }
    flip = flip_bool;
    return idx;
  }
  public static Point3d project_point(Point3d pt, Brep brep, Vector3d direction) // Optimised
  {
    pt = new Point3d(pt - direction);
    Point3d[] pts = Intersection.RayShoot(new Ray3d(pt, direction), new[] { brep }, 2);
    if (pts.Length == 1) return pts[0];
    if (pts.Length == 2)
    {
      double dist1 = pt.DistanceToSquared(pts[0]);
      double dist2 = pt.DistanceToSquared(pts[1]);
      return dist1 < dist2 ? pts[0] : pts[1];
    }
    if (pts.Length > 2)
    {
      double[] distances = Array.ConvertAll(pts, p => pt.DistanceToSquared(p));
      return pts[Array.IndexOf(distances, distances.Min())];
    }
    return Point3d.Unset;
  }


  public static Curve project_closest(Curve crv, Brep brep, Vector3d dir, double tol)  // Optimised
  {
    Interval interval = new Interval(0, 1);

    crv.Transform(Transform.Translation(-dir));
    Curve[] projected_curves = Curve.ProjectToBrep(crv, brep, dir, tol);
    Curve[] projected_joined = Curve.JoinCurves(projected_curves, tol, false);

    Point3d centre = crv.GetBoundingBox(true).Center;
    int closestIndex = 0;
    double minDistance = double.MaxValue;

    for (int i = 0; i < projected_joined.Length; i++)
    {
      projected_joined[i].Domain = interval;
      double distance = centre.DistanceToSquared(projected_joined[i].GetBoundingBox(true).Center);
      if (distance < minDistance)
      {
        minDistance = distance;
        closestIndex = i;
      }

    }
    return projected_joined[closestIndex];
  }
  public static Plane curves_plane(Curve[] curves, double tol = 0.01)  // Optimized
  {
    int count = curves.Length;
    BoundingBox bb = bb_union(curves);

    if (bb.Max.Z - bb.Min.Z < 0.01) return new Plane(bb.Center, Vector3d.XAxis, Vector3d.YAxis); // XY Plane
    if (bb.Max.X - bb.Min.X < 0.01) return new Plane(bb.Center, Vector3d.YAxis, Vector3d.ZAxis); // ZY Plane
    if (bb.Max.Y - bb.Min.Y < 0.01) return new Plane(bb.Center, Vector3d.XAxis, Vector3d.ZAxis); // ZX Plane

    HashSet<Plane> uniquePlanes = new HashSet<Plane>();
    for (int i = 0; i < count; i++)
    {
      if (curves[i].TryGetPlane(out Plane pl, tol))
      {
        pl.Origin = bb.Center;
        uniquePlanes.Add(pl);
      }
    }
    return uniquePlanes.First();
  }
  public Plane plane_on_box(Plane plane, BoundingBox bb, double distance)
  {
    double tol = 0.01;
    if (plane.OriginX < bb.Max.X - tol && plane.OriginX > bb.Min.X + tol
    && (plane.Normal.EpsilonEquals(Vector3d.XAxis, 0.1) || plane.Normal.EpsilonEquals(-Vector3d.XAxis, 0.1)))
    {
      if (plane.OriginX - bb.Min.X > bb.Max.X - plane.OriginX) plane.OriginX = bb.Max.X + distance;
      else plane.OriginX = bb.Min.X - distance;
    }
    else if (plane.OriginY < bb.Max.Y - tol && plane.OriginY > bb.Min.Y + tol
    && (plane.Normal.EpsilonEquals(Vector3d.YAxis, 0.1) || plane.Normal.EpsilonEquals(-Vector3d.YAxis, 0.1)))
    {
      if (plane.OriginY - bb.Min.Y > bb.Max.Y - plane.OriginY) plane.OriginY = bb.Max.Y + distance;
      else plane.OriginY = bb.Min.Y - distance;
    }
    else if (plane.OriginZ < bb.Max.Z - tol && plane.OriginZ > bb.Min.Z + tol
    && (plane.Normal.EpsilonEquals(Vector3d.ZAxis, 0.1) || plane.Normal.EpsilonEquals(-Vector3d.ZAxis, 0.1)))
    {
      if (plane.OriginZ - bb.Min.Z > bb.Max.Z - plane.OriginZ) plane.OriginZ = bb.Max.Z + distance;
      else plane.OriginZ = bb.Min.Z - distance;
    }

    return plane;
  }
  public Curve[] offset(Curve[] curves, double fillet, out Plane pln, double tol = 0.001)
  {
    int count = curves.Length;
    Plane plane = curves_plane(curves);
    pln = plane;
    if (fillet == 0)
    {
      Curve[] dups = new Curve[count];
      for (int i = 0; i < count; i++) dups[i] = curves[i].DuplicateCurve();
      return dups;
    }

    Curve[] off1 = new Curve[count];
    Curve[] off2 = new Curve[count];
    Point3d pt = plane.Origin;
    Vector3d normal = plane.Normal;
    CurveOffsetCornerStyle cs = CurveOffsetCornerStyle.Smooth;
    CurveOffsetEndStyle es = CurveOffsetEndStyle.None;

    for (int i = 0; i < count; i++)
    {
      bool offset_type = !curves[i].IsArc(0.1);
      off1[i] = Curve.JoinCurves(curves[i].Offset(pt, normal, fillet, tol, tol, offset_type, cs, es), tol, false)[0];
      off2[i] = Curve.JoinCurves(curves[i].Offset(pt, normal, -fillet, tol, tol, offset_type, cs, es), tol, false)[0];
    }

    double len1 = bb_union(off1).Diagonal.Length;
    double len2 = bb_union(off2).Diagonal.Length;

    if ((fillet > 0) == (len1 < len2)) return neaten_crvs(loop_crv(off2, fillet), curves);
    return square_crvs(loop_crv(off1, fillet));

    //return neaten_crvs(loop_crv(off2, fillet), curves);
    //return neaten_crvs(loop_crv(off1, fillet), curves);
  }
  public Curve[] neaten_crvs(Curve[] crvs, Curve[] match_crvs, double tol = 0.1)
  {
    /// Designed for offset curves, where initial curves (match_crvs) are in a sorted loop, and the crvs also is a corresponding sorted loop
    /// Will also work for a single loop of curves that is not necessarily offset.  Just set match_crvs to 'null'.

    int count = crvs.Length;
    Interval interval = new Interval(0, 1);

    bool[] end_curvature_matches = new bool[count];
    bool[] is_linear = new bool[count];
    Vector3d[] end_tan = new Vector3d[count];
    Vector3d[] vecs = { Vector3d.XAxis, -Vector3d.XAxis, Vector3d.YAxis, -Vector3d.YAxis, Vector3d.ZAxis, -Vector3d.ZAxis };

    if (match_crvs.Length == count)
    {
      for (int i = 0; i < count; i++)
      {
        crvs[i].Domain = interval;
        match_crvs[i].Domain = interval;
        is_linear[i] = match_crvs[i].IsLinear(tol);
        end_tan[i] = match_crvs[i].TangentAtEnd;
        for (int j = 0; j < 6; j++) if (end_tan[i].EpsilonEquals(vecs[j], tol)) end_tan[i] = vecs[j];
      }

      for (int i = 0; i < count; i++)
      {
        int last = (i - 1 + count) % count;
        end_curvature_matches[i] = match_crvs[i].CurvatureAt(0).EpsilonEquals(match_crvs[last].CurvatureAt(1), 0.1) && match_crvs[i].TangentAtStart.EpsilonEquals(end_tan[last], 0.1);
      }
    }
    else
    {
      for (int i = 0; i < count; i++)
      {
        crvs[i].Domain = interval;
        is_linear[i] = crvs[i].IsLinear(tol);
        end_tan[i] = crvs[i].TangentAtEnd;
        for (int j = 0; j < 6; j++) if (end_tan[i].EpsilonEquals(vecs[j], tol)) end_tan[i] = vecs[j];
      }

      for (int i = 0; i < count; i++)
      {
        int last = (i - 1 + count) % count;
        end_curvature_matches[i] = crvs[i].CurvatureAt(0).EpsilonEquals(crvs[last].CurvatureAt(1), 0.1) && crvs[i].TangentAtStart.EpsilonEquals(end_tan[last], 0.1);
      }
    }


    // string test_vecs = "";
    // for (int i = 0; i < count; i++) test_vecs += is_linear[i].ToString() + ", " + crvs[i].ToNurbsCurve().Points.Count.ToString() +"|  " ;
    // Print(test_vecs);

    for (int i = 0; i < count; i++)
    {
      if (is_linear[i] || !end_curvature_matches[i] || crvs[i].IsArc(0.1)) continue;


      NurbsCurve curve = crvs[i].ToNurbsCurve();
      int ptnum = curve.Points.Count;
      //Print(ptnum.ToString());

      Point3d[] pts = curve.Points.Select(p => p.Location).ToArray();
      int degree = curve.Degree;
      if (ptnum < 6) continue;

      // ------- Square ends if not square

      Vector3d tan = end_tan[(i - 1 + count) % count];
      tan.Unitize();
      pts[1] = new Point3d(pts[0] + (tan * pts[0].DistanceTo(pts[1])));
      pts[2] = new Point3d(pts[0] + (tan * pts[0].DistanceTo(pts[2])));

      if (is_linear[(i + 1) % count])
      {
        tan = -end_tan[i];
        tan.Unitize();
        pts[ptnum - 2] = new Point3d(pts[ptnum - 1] + (tan * pts[ptnum - 1].DistanceTo(pts[ptnum - 2])));
        pts[ptnum - 3] = new Point3d(pts[ptnum - 1] + (tan * pts[ptnum - 1].DistanceTo(pts[ptnum - 3])));
      }

      crvs[i] = NurbsCurve.Create(false, degree, pts);
    }
    return crvs;
  }
  public Curve[] square_crvs(Curve[] crvs, double tol = 0.1)
  {
    int count = crvs.Length;
    for (int i = 0; i < count; i++) crvs[i] = square_crv(crvs[i]);
    return crvs;
  }
  public Curve square_crv(Curve crv, double tol = 0.1)
  {
    if (crv.IsLinear(0.01) || crv.IsArc(0.1)) return crv;

    NurbsCurve curve = crv.ToNurbsCurve();
    Point3d[] pts = curve.Points.Select(p => p.Location).ToArray();
    int count = pts.Length;
    if (curve.Points.Count < 6) return crv;

    Vector3d[] vecs = { Vector3d.XAxis, -Vector3d.XAxis, Vector3d.YAxis, -Vector3d.YAxis, Vector3d.ZAxis, -Vector3d.ZAxis };
    Vector3d start_vec = curve.TangentAtStart;
    Vector3d end_vec = curve.TangentAtEnd;

    bool start_found = false;
    bool end_found = false;

    for (int j = 0; j < 6; j++)
    {
      if (!start_found && start_vec.EpsilonEquals(vecs[j], tol))
      {
        if (vecs[j].X == 0) pts[1].X = pts[2].X = pts[0].X;
        if (vecs[j].Y == 0) pts[1].Y = pts[2].Y = pts[0].Y;
        if (vecs[j].Z == 0) pts[1].Z = pts[2].Z = pts[0].Z;
        start_found = true;
      }

      if (!end_found && end_vec.EpsilonEquals(vecs[j], tol))
      {
        if (vecs[j].X == 0) pts[count - 2].X = pts[count - 3].X = pts[count - 1].X;
        if (vecs[j].Y == 0) pts[count - 2].Y = pts[count - 3].Y = pts[count - 1].Y;
        if (vecs[j].Z == 0) pts[count - 2].Z = pts[count - 3].Z = pts[count - 1].Z;
        end_found = true;
      }
      if (start_found && end_found) break;
    }
    return Curve.CreateControlPointCurve(pts, curve.Degree);
  }
  public static Curve[] loop_crv(Curve[] curves, double radius, double tol = 0.001)
  {
    if (Curve.JoinCurves(curves, tol, false)[0].IsClosed) return curves;

    int count = curves.Length;
    radius = Math.Abs(radius) * 2;

    //bool[] is_arc = new bool[count];
    Point3d[] startPoints = new Point3d[count];
    Point3d[] endPoints = new Point3d[count];
    double[] extendMin = new double[count];
    double[] extendMax = new double[count];

    for (int i = 0; i < count; i++)
    {
      //is_arc[i] = curves[i].IsArc(0.1);
      startPoints[i] = curves[i].PointAtStart;
      endPoints[i] = curves[i].PointAtEnd;
      extendMin[i] = curves[i].Domain.Min - radius;
      extendMax[i] = curves[i].Domain.Max + radius;
    }

    for (int i = 0; i < count; i++)
    {
      //if(is_arc[i]) continue;
      int last = (i + count - 1) % count;
      int next = (i + 1) % count;

      if (!startPoints[i].EpsilonEquals(endPoints[last], tol))
        curves[i] = curves[i].Extend(extendMin[i], curves[i].Domain.Max);
      if (!endPoints[i].EpsilonEquals(startPoints[next], tol))
        curves[i] = curves[i].Extend(curves[i].Domain.Min, extendMax[i]);
    }

    for (int i = 0; i < count; i++)
    {
      //if(is_arc[i]) continue;
      int last = (i + count - 1) % count;
      int next = (i + 1) % count;

      if (!startPoints[i].EpsilonEquals(endPoints[last], tol))
      {
        CurveIntersections cx = Intersection.CurveCurve(curves[i], curves[last], tol, tol);
        curves[i] = curves[i].Split(cx[0].ParameterA)[1];
        curves[last] = curves[last].Split(cx[0].ParameterB)[0];
      }
    }

    Interval interval = new Interval(0, 1);
    for (int i = 0; i < count; i++)
    {
      //if(is_arc[i]) continue;
      int degree = curves[i].Degree;
      Vector3d start = curves[i].TangentAtStart;
      Vector3d end = curves[i].TangentAtEnd;
      curves[i].Domain = interval;
      if (curves[i].CurvatureAt(0.5).SquareLength > 200 || curves[i].DuplicateSegments().Length > 1)
      {
        BoundingBox bb = curves[i].GetBoundingBox(true);

        int ptnum = (int)Math.Max(9, Math.Floor(curves[i].ToNurbsCurve().Points.Count * 1.0));
        Curve crv = curves[i].Rebuild(ptnum, degree, true);
        Point3d[] pts = crv.ToNurbsCurve().Points.Select(p => p.Location).ToArray();
        for (int j = 0; j < pts.Length; j++)
        {
          pts[j].X = Math.Max(bb.Min.X, Math.Min(bb.Max.X, pts[j].X));
          pts[j].Y = Math.Max(bb.Min.Y, Math.Min(bb.Max.Y, pts[j].Y));
          pts[j].Z = Math.Max(bb.Min.Z, Math.Min(bb.Max.Z, pts[j].Z));
        }
        curves[i] = Curve.CreateControlPointCurve(pts, degree); //NurbsCurve.Create(false, degree, pts);
      }
    }
    return curves;
  }
  public static bool boxboxinside2D(BoundingBox a, BoundingBox b)
  {
    if (a.Max.X < b.Max.X) return false;
    if (a.Min.X > b.Min.X) return false;
    if (a.Max.Y < b.Max.Y) return false;
    if (a.Min.Y > b.Min.Y) return false;

    return true;
  }
  public static bool boxoverlap(BoundingBox a, BoundingBox b)
  {
    if (a.Max.X < b.Min.X) return false;
    if (a.Min.X > b.Max.X) return false;
    if (a.Max.Y < b.Min.Y) return false;
    if (a.Min.Y > b.Max.Y) return false;
    if (a.Max.Z < b.Min.Z) return false;
    if (a.Min.Z > b.Max.Z) return false;

    return true;
  }
  public static bool boxoverlap2D(BoundingBox a, BoundingBox b)
  {
    if (a.Max.X < b.Min.X) return false;
    if (a.Min.X > b.Max.X) return false;
    if (a.Max.Y < b.Min.Y) return false;
    if (a.Min.Y > b.Max.Y) return false;

    return true;
  }
  public static bool boxinside(BoundingBox outer, BoundingBox inner)
  {
    if (outer.Min.X > inner.Min.X) return false;
    if (outer.Max.X < inner.Max.X) return false;
    if (outer.Min.Y > inner.Min.Y) return false;
    if (outer.Max.Y < inner.Max.Y) return false;
    if (outer.Min.Z > inner.Min.Z) return false;
    if (outer.Max.Z < inner.Max.Z) return false;
    return true;
  }
  public static void TransformGeos<T>(IList<T> geos, Transform transform) where T : GeometryBase
  {
    for (int i = 0; i < geos.Count; i++) geos[i].Transform(transform);
  }
  public bool no_input(string name) => Component.Params.Input[Component.Params.IndexOfInputParam(name)].SourceCount == 0;
# ---------- end extrude_punch_6 ----------
para_4 = ScriptParasite(Enable=Toggle(True), Folder=scripts_4)

debrep = DeconstructBrep(Brep=extrude_punch_5.surfaces)  # -> Faces, Edges, Vertices
debrep_2 = DeconstructBrep(Brep=extrude_punch_6.surfaces)  # -> Faces, Edges, Vertices
nake_3 = CSharpScript(brep=face.shell)  # -> simplify(crvs), num; inputs brep: Brep; same code as nake
orient_3 = Orient(Geometry=nake_3.crvs, Source=PlaneXY(0, 0, 0), Target=evalsrf.Frame)  # -> Geometry, Transform
srfsplit = SurfaceSplit(Surface=_3d.inside, Curves=flatten(orient_3.Geometry))  # disabled
item_7 = ListItem(List=reverse(srfsplit), Index=0, Wrap=True)  # disabled
join_2 = BrepJoin(Breps=flatten([_3d.outside, item_7, orient_2.Geometry]))  # -> Breps, Closed; disabled
